# Grasshopper definition 20220618_Solid_Collide.gh (Grasshopper 1.0.7)
# plug-ins: Kangaroo2 Components, Weaverbird

gallery = ImageGallery(CycleDelay=30, Randomize=False, UseLocalImages=True, UseRemoteImages=True)

# ----
# End Wave Param
number_slider = Slider(0, range=0..100)

crv = Curve(<curve referenced from the Rhino model>)

brep = Brep(<brep referenced from the Rhino model>)
mesh = MeshBrep(
    Brep=brep,
    Settings={GridMaxCount=0, GridMinCount=16, JaggedSeams=False, MaxEdgeLength=0, MinEdgeLength=0.0001, MinTolerance=0, Refine=True, RefineAngle=0, RelativeTolerance=0.65, SimplePlanes=True, Tolerance=0})

boundary = BoundarySurfaces(Edges=crv)
mesh_2 = MeshBrep(
    Brep=boundary,
    Settings={GridMaxCount=0, GridMinCount=16, JaggedSeams=False, MaxEdgeLength=0, MinEdgeLength=0.0001, MinTolerance=0, Refine=True, RefineAngle=0, RelativeTolerance=0.65, SimplePlanes=True, Tolerance=0})

triremesh = TriRemesh(Geometry=mesh_2, Target=crv, Iterations=25)  # -> Triangulation, Dual, Creases

faceb = FaceBoundaries(Mesh=triremesh.Triangulation)
crv_2 = Curve(faceb)

mesh_3 = Mesh(triremesh.Triangulation)

# ----
# Color Format
# Input
data = Data(1)
# Method
data_2 = Data(1)
# Output
data_3 = Data(1)
# Display
data_4 = Data(1)
# Unuse
data_5 = Data(1)

preview = CustomPreview(Geometry=mesh_3, Material=ColourSwatch(SwatchColor=RGBA(163, 190, 199, 34)))

mesh_4 = Mesh(mesh_3)
wbvertices = WeaverbirdsVerticesComponent(MeshClosedPolylinesGroup=mesh_4, Weld=True)

crv_3 = Curve(crv_2)
preview_2 = CustomPreview(Geometry=crv_3, Material=ColourSwatch(SwatchColor=RGB(247, 119, 245)))

pt = Point(wbvertices)
preview_3 = CustomPreview(Geometry=pt, Material=ColourSwatch(SwatchColor=RGB(224, 247, 119)))

crv_4 = Curve(crv_2)
explode = Explode(Curve=crv_4, Recursive=True)  # -> Segments, Vertices

pt_2 = Point(flatten(wbvertices))
crv_5 = Curve(crv)
pull = PullPoint(Point=pt_2, Geometry=crv_5, ClosestOnly=True)  # -> ClosestPoint, Distance

smaller = SmallerThan(FirstNumber=pull.Distance, SecondNumber=Slider(0.1, range=0..0.1))  # -> SmallerThan, OrEqualTo
cull = CullPattern(List=pt_2, CullPattern=smaller.SmallerThan)
pt_3 = Point(cull)
alongcrv = SortAlongCurve(Points=pt_3, Curve=crv_5)  # -> Points, Indices

number_slider_2 = Slider(0.01, range=0..0.01)

pt_4 = Point(wbvertices)
spc = SolidPointCollide(Points=pt_4, Solid=mesh, Interior=False, Unidirectional=True, Strength=Slider(3, range=0..100))

Z = UnitZ(Factor=1)
neg = Negative(Value=Z)
load = Load(Point=wbvertices, ForceVector=neg, Weighting=Slider(0.01, range=0..0.01))

hingepoints = HingePoints(Mesh=mesh_4)  # -> _1, _2, _3, _4
hinge = Hinge(FoldStart=hingepoints._1, FoldEnd=hingepoints._2, Tip1=hingepoints._3, Tip2=hingepoints._4, Strength=1)

pt_5 = Point(flatten(alongcrv.Points))

pdecon = Deconstruct(Point=pt_5)  # -> XComponent, YComponent, ZComponent
lng = ListLength(List=pdecon.ZComponent)
range = Range(Domain=Domain(0, 1), Steps=lng)

pi = Pi(Factor=Slider(10, range=0..10))
dom = ConstructDomain(DomainStart=number_slider, DomainEnd=pi)
remap = RemapNumbers(Value=range, Source=Domain(0, 1), Target=dom)  # -> Mapped, Clipped

expression = Expression(x=remap.Mapped, y=Slider(0.303, range=0..1), z=Slider(0, range=0..4), Expression="y*Sin(x+z)")
multiplication = Multiplication(A=expression, B=Slider(0.8, range=0..1))
Z_2 = UnitZ(Factor=multiplication)
move = Move(Geometry=pt_5, Motion=Z_2)  # -> Geometry, Transform

anchor = Anchor(Point=pt_5, Target=move.Geometry, Strength=10000)
equallength = EqualLength(Line=explode.Segments, Strength=1)
length_line = LengthLine(Line=explode.Segments, Strength=Slider(0.4, range=0..1))
show = Show(G=mesh_4)

merge = Merge(
    Data1=flatten(show),
    Data2=flatten(anchor),
    Data3=flatten(length_line),
    Data4=flatten(hinge),
    Data5=flatten(equallength),
    Data6=flatten(spc),
    Data7=flatten(load))  # -> flatten(Result)
solver = Solver(GoalObjects=merge, Reset=Button(), Threshold=1e-15, Tolerance=0.0001, On=Toggle(True))  # -> I, V, O

item = ListItem(List=solver.O, Index=0, Wrap=True)
faceb_2 = FaceBoundaries(Mesh=item)

preview_4 = CustomPreview(Geometry=item, Material=ColourSwatch(SwatchColor=RGBA(119, 247, 207, 85)))

crv_6 = Curve(faceb_2)
preview_5 = CustomPreview(Geometry=crv_6, Material=ColourSwatch(SwatchColor=RGB(119, 247, 207)))
