# Grasshopper definition 20220618_Tensegrity.gh (Grasshopper 1.0.7)
# plug-ins: Bifocals, Kangaroo2 Components, Weaverbird

msphereex = MeshSphereEx(Base=PlaneXY(0, 0, 0), Radius=10, Count=5)
wbicosahedron = WeaverbirdsMeshMeshIcosahedron(Plane=PlaneXY(0, 0, 0), Radius=5)
faceb = FaceBoundaries(Mesh=wbicosahedron)
polygon = Polygon(Plane=PlaneXY(0, 0, 0), Radius=3, Segments=Slider(7, range=0..10), FilletRadius=0)  # -> Polygon, Length
unit_z = UnitZ(Factor=Slider(3, range=0..10))
faceb_2 = FaceBoundaries(Mesh=wbicosahedron)
explode = Explode(Curve=faceb_2, Recursive=True)  # -> Segments, Vertices
pt = Point(explode.Vertices)
move = Move(Geometry=polygon.Polygon, Motion=unit_z)  # -> Geometry, Transform
dupln = RemoveDuplicateLines(Lines=flatten(explode.Segments), Tolerance=0.01)
discontinuity = Discontinuity(Curve=polygon.Polygon, Level=1)  # -> Points, Parameters
number_slider = Slider(1, range=0..1)
pframe = PerpFrame(Curve=dupln, Parameter=Slider(0.5, range=0..1))
duppt = RemoveDuplicatePts(Points=flatten(pt), Tolerance=0.01)  # -> flatten(UniquePoints)
discontinuity_2 = Discontinuity(Curve=move.Geometry, Level=1)  # -> Points, Parameters
deplane = DeconstructPlane(Plane=pframe)  # -> Origin, XAxis, YAxis, ZAxis
end = EndPoints(Curve=dupln)  # -> Start, End
pl = ConstructPlane(Origin=deplane.Origin, XAxis=deplane.ZAxis, YAxis=deplane.XAxis)
merge = Merge(Data1=end.Start, Data2=end.End)
shift_list = ShiftList(List=discontinuity_2.Points, Shift=1, Wrap=True)
rotate = Rotate(Geometry=dupln, Angle=degrees(Slider(36, range=0..100)), Plane=pl)  # -> Geometry, Transform
cp = ClosestPoint(Point=graft(duppt), Cloud=merge)  # -> ClosestPoint, CPIndex, Distance
cps = ClosestPoints(Point=graft(duppt), Cloud=merge, Count=Slider(5, range=0..10))  # -> ClosestPoint, CPIndex, Distance
end_2 = EndPoints(Curve=rotate.Geometry)  # -> Start, End
explode_2 = Explode(Curve=[polygon.Polygon, move.Geometry], Recursive=True)  # -> Segments, Vertices
line = Line(StartPoint=discontinuity.Points, EndPoint=discontinuity_2.Points)
merge_2 = Merge(Data1=end_2.Start, Data2=end_2.End)
range = Range(Domain=Domain(0, 1), Steps=10)
item = ListItem(List=merge_2, Index=cps.CPIndex, Wrap=True)
line_2 = Line(flatten([explode_2.Segments, line]))
pline = PolyLine(Vertices=item, Closed=True)
item_2 = ListItem(List=item, Index=0, Wrap=True)  # -> Item, Item1
shatter = Shatter(Curve=reparameterize(line_2), Parameters=range)
ln = Line(StartPoint=item_2.Item, EndPoint=item_2.Item1)
panel = Panel(item)
line_3 = Line(StartPoint=discontinuity.Points, EndPoint=shift_list)
cables = Line(shatter)
rigids = Line(line_3)
length = Length(Curve=cables)
multiplication = Multiplication(A=length, B=Slider(0.5, range=0..1))
length_line = LengthLine(Line=rigids, Strength=Slider(50, range=0..100))
length_line_2 = LengthLine(Line=cables, Length=multiplication, Strength=10)
show = Show(G=rigids)
show_2 = Show(G=cables)
grab = Grab(On=True, Strength=1, Range=3)
boolean_toggle = BooleanToggle(True)
button = Button()
entwine = Entwine(Branch00=show, Branch01=show_2, Branch02=[length_line_2, length_line, grab], FlattenInputs=True)
bouncysolver = BouncySolver(GoalObjects=entwine, Reset=button, Threshold=1e-15, Tolerance=0.01, Damping=0.99, Iterations=10, On=boolean_toggle)  # -> I, V, O
solver = Solver(GoalObjects=entwine, Reset=button, Threshold=1e-15, Tolerance=0.01, On=boolean_toggle)  # -> I, V, O; disabled
unflatten_tree = UnflattenTree(Tree=bouncysolver.O, Guide=entwine)
explode_tree = ExplodeTree(Data=unflatten_tree)  # -> Branch0, Branch1, Branch2
pipe = Pipe(Curve=explode_tree.Branch0, Radius=Slider(0.1, range=0..1), Caps=0)
