# Grasshopper definition SmoothNumber.gh (Grasshopper 1.0.7)

gallery = ImageGallery(CycleDelay=30, Randomize=False, UseLocalImages=True, UseRemoteImages=True)
rectangle = Rectangle(Plane=PlaneXY(0, 0, 0), XSize=Domain(-1, 1), YSize=Domain(-2, 2), Radius=0)  # -> Rectangle, Length
boxrec = BoxRectangle(Rectangle=rectangle.Rectangle, Height=Slider(2, range=0..10))
smooth = SmoothNumbers(Numbers=Slider(0, range=0..100), SmoothDelay=1000)

# ----
# Color Format
# Input
data = Data(1)
# Method
data_2 = Data(1)
# Output
data_3 = Data(1)
# Display
data_4 = Data(1)
# Unuse
data_5 = Data(1)

rotate = Rotate(Geometry=boxrec, Angle=degrees(smooth), Plane=PlaneXY(0, 0, 0))  # -> Geometry, Transform
panel = Panel(smooth)
