# Grasshopper definition 20220625_3DTrussTriangle.gh (Grasshopper 1.0.7)
# plug-ins: Kangaroo2 Components, LunchBox

gallery = ImageGallery(CycleDelay=30, Randomize=False, UseLocalImages=True, UseRemoteImages=True)

# ----
# Roof_Top
number_slider = Slider(10000, range=0..10000)
number_slider_2 = Slider(9, range=9..100, expression="x*100")

md_slider = MDSlider(SliderMode=0, slider_value=Point(0.5, 0.5, 0.5), x_domain=Domain(0, 1), y_domain=Domain(0, 1), z_domain=Domain(0, 1))
rectangle = Rectangle(Plane=PlaneXY(0, 0, 0), XSize=number_slider, YSize=number_slider, Radius=0)  # -> Rectangle, Length
boundary = BoundarySurfaces(Edges=rectangle.Rectangle)
evalsrf = EvaluateSurface(Surface=reparameterize(boundary), Point=md_slider)  # -> Point, Normal, UDirection, VDirection, Frame
amp = Amplitude(Vector=evalsrf.Normal, Amplitude=Slider(22, range=5..30, expression="x*100"))
move = Move(Geometry=evalsrf.Point, Motion=amp)  # -> Geometry, Transform

# ----
# Color Format
# Input
data = Data(1)
# Method
data_2 = Data(1)
# Output
data_3 = Data(1)
# Display
data_4 = Data(1)
# Unuse
data_5 = Data(1)

patch = Patch(Curves=rectangle.Rectangle, Points=move.Geometry, Spans=20, Flexibility=1, Trim=True)
srf = Surface(patch)

preview = CustomPreview(Geometry=patch, Material=ColourSwatch(SwatchColor=RGB(171, 0, 0)))

preview_2 = CustomPreview(Geometry=srf, Material=ColourSwatch(SwatchColor=RGBA(98, 168, 189, 97)))

geo = Geometry(srf)
panel = Panel(number_slider_2)
mesh = MeshBrep(
    Brep=geo,
    Settings={GridMaxCount=0, GridMinCount=16, JaggedSeams=False, MaxEdgeLength=0, MinEdgeLength=0.0001, MinTolerance=0, Refine=True, RefineAngle=0, RelativeTolerance=0.65, SimplePlanes=True, Tolerance=0})
triremesh = TriRemesh(Geometry=mesh, Sharp=Toggle(False), Length=panel, Iterations=Slider(17, range=0..100))  # -> Triangulation, Dual, Creases

rebuildsrf = RebuildSurface(Surface=srf, UDegree=3, VDegree=3, UNumber=10, VNumber=10)
dim = Dimensions(Surface=rebuildsrf)  # -> UDimension, VDimension

division = Division(A=number_slider_2, B=2)
cos = Cosine(Value=degrees("60"))
division_2 = Division(A=division, B=cos)
division_3 = Division(A=dim.VDimension, B=division)

faceb = FaceBoundaries(Mesh=triremesh.Triangulation)

preview_3 = CustomPreview(Geometry=faceb, Material=ColourSwatch(SwatchColor=RGB(98, 168, 189)))

faceb_2 = FaceBoundaries(Mesh=triremesh.Triangulation)
boundary_2 = BoundarySurfaces(Edges=faceb_2)
preview_4 = CustomPreview(Geometry=boundary_2, Material=ColourSwatch(SwatchColor=RGBA(129, 203, 252, 75)))

division_4 = Division(A=dim.UDimension, B=division_2)
u = Integer(division_4)
v = Integer(division_3)

trib = TrianglePanelsB(Surface=rebuildsrf, UDivisions=u, VDivisions=v)
edges = BrepEdges(Brep=trib)  # -> Naked, Interior, NonManifold
len = Length(Curve=edges.Naked)

addition = Addition(A=v, B=1)
partition = PartitionList(List=trib, Size=addition)
split = SplitTree(Data=simplify(partition), Masks=flatten("{0,2,...}"))  # -> Positive, Negative

cull = CullPattern(List=split.Negative, CullPattern=invert([False, True]))
cull_2 = CullPattern(List=split.Positive, CullPattern=[False, True])
merge = Merge(Data1=cull_2, Data2=cull)
area = Area(Geometry=merge)  # -> Area, Centroid
srf_cp = SurfaceClosestPoint(Point=area.Centroid, Surface=merge)  # -> Point, UVPoint, Distance
evalsrf_2 = EvaluateSurface(Surface=merge, Point=srf_cp.UVPoint)  # -> Point, Normal, UDirection, VDirection, Frame
rev = Reverse(Vector=evalsrf_2.Normal)
amp_2 = Amplitude(Vector=evalsrf_2.Normal, Amplitude=Slider(450, range=0..1000))
move_2 = Move(Geometry=evalsrf_2.Point, Motion=amp_2)  # -> Geometry, Transform

debrep = DeconstructBrep(Brep=merge)  # -> Faces, Edges, Vertices
ln = Line(StartPoint=simplify(graft(move_2.Geometry)), EndPoint=simplify(debrep.Vertices))
pt = Point(move_2.Geometry)

split_2 = SplitTree(Data=pt, Masks=flatten("{0,2,...}"))  # -> Positive, Negative
pt_2 = Point(split_2.Negative)
pt_3 = Point(split_2.Positive)
shift = ShiftList(List=pt_2, Shift=1, Wrap=False)  # -> simplify(List)
split_3 = SplitTree(Data=pt_3, Masks=flatten("{0}"))  # -> Positive, Negative
ln_2 = Line(StartPoint=pt_3, EndPoint=shift)
ln_3 = Line(StartPoint=split_3.Negative, EndPoint=shift)

points = PointList(Points=pt, Size=Slider(100, range=0..100))

斜め線 = Curve(ln)
flip = FlipMatrix(Data=pt)

end = EndPoints(Curve=斜め線)  # -> Start, End
pline = PolyLine(Vertices=flip, Closed=False)
explode = Explode(Curve=pline, Recursive=True)  # -> Segments, Vertices

pline_2 = PolyLine(Vertices=pt, Closed=False)
explode_2 = Explode(Curve=pline_2, Recursive=True)  # -> Segments, Vertices

下の線_横 = Curve(explode_2.Segments)
下の線_斜め１ = Curve(explode.Segments)
下の線_斜め３ = Curve(ln_3)
下の線_斜め２ = Curve(ln_2)
上三角 = Curve(edges.Naked)
斜め線_2 = Curve(ln)
merge_2 = Merge(Data1=下の線_斜め１, Data2=下の線_斜め２, Data3=下の線_斜め３, Data4=下の線_横)

preview_5 = CustomPreview(Geometry=merge_2, Material=ColourSwatch(SwatchColor=RGB(28, 255, 232)))

preview_6 = CustomPreview(Geometry=斜め線_2, Material=ColourSwatch(SwatchColor=RGB(179, 28, 255)))

preview_7 = CustomPreview(Geometry=上三角, Material=ColourSwatch(SwatchColor=RGB(255, 28, 255)))
