# Grasshopper definition 20220625_PanelingRecursive.gh (Grasshopper 1.0.7)
# plug-ins: Kangaroo2 Components, Weaverbird

gallery = ImageGallery(CycleDelay=30, Randomize=False, UseLocalImages=True, UseRemoteImages=True)

# ----
# Roof_Top
number_slider = Slider(10000, range=0..10000)

md_slider = MDSlider(SliderMode=0, slider_value=Point(0.5, 0.5, 0.5), x_domain=Domain(0, 1), y_domain=Domain(0, 1), z_domain=Domain(0, 1))
rectangle = Rectangle(Plane=PlaneXY(0, 0, 0), XSize=number_slider, YSize=number_slider, Radius=0)  # -> Rectangle, Length
boundary = BoundarySurfaces(Edges=rectangle.Rectangle)
evalsrf = EvaluateSurface(Surface=reparameterize(boundary), Point=md_slider)  # -> Point, Normal, UDirection, VDirection, Frame
amp = Amplitude(Vector=evalsrf.Normal, Amplitude=Slider(22, range=5..30, expression="x*100"))
move = Move(Geometry=evalsrf.Point, Motion=amp)  # -> Geometry, Transform

# ----
# Color Format
# Input
data = Data(1)
# Method
data_2 = Data(1)
# Output
data_3 = Data(1)
# Display
data_4 = Data(1)
# Unuse
data_5 = Data(1)

patch = Patch(Curves=rectangle.Rectangle, Points=move.Geometry, Spans=20, Flexibility=1, Trim=True)
srf = Surface(patch)

preview = CustomPreview(Geometry=patch, Material=ColourSwatch(SwatchColor=RGB(171, 0, 0)))

preview_2 = CustomPreview(Geometry=srf, Material=ColourSwatch(SwatchColor=RGBA(98, 168, 189, 97)))

geo = Geometry(srf)
panel = Panel(Slider(9, range=9..100, expression="x*100"))
mesh = MeshBrep(
    Brep=geo,
    Settings={GridMaxCount=0, GridMinCount=16, JaggedSeams=False, MaxEdgeLength=0, MinEdgeLength=0.0001, MinTolerance=0, Refine=True, RefineAngle=0, RelativeTolerance=0.65, SimplePlanes=True, Tolerance=0})
triremesh = TriRemesh(Geometry=mesh, Sharp=Toggle(False), Length=panel, Iterations=Slider(100, range=0..100))  # -> Triangulation, Dual, Creases

faceb = FaceBoundaries(Mesh=triremesh.Triangulation)

preview_3 = CustomPreview(Geometry=faceb, Material=ColourSwatch(SwatchColor=RGB(1, 96, 125)))

wbtriangles = WeaverbirdsSplitTrianglesSubdivision(MeshCurves=triremesh.Triangulation, Level=Slider(5, range=2..5))

faceb_2 = FaceBoundaries(Mesh=wbtriangles)
boundary_2 = BoundarySurfaces(Edges=faceb_2)
preview_4 = CustomPreview(Geometry=boundary_2, Material=ColourSwatch(SwatchColor=RGBA(129, 203, 252, 75)))
