# Grasshopper definition 005_Origami.gh (Grasshopper 1.0.7)
# plug-ins: Kangaroo2 Components, Weaverbird

gallery = ImageGallery(CycleDelay=30, Randomize=False, UseLocalImages=True, UseRemoteImages=True)
panel = Panel("Origami_Sample")

# ---- group: Mountain fold lines
crv = Curve([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])

# ---- group: mesh of flat folding pattern
mesh = Mesh(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)

# ---- group: Valley fold lines
crv_2 = Curve([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])

# ----
reset = Button()

folding = Slider(0.491, range=0..0.99)
wbfacepolys = WeaverbirdsFacePolylines(Mesh=mesh)
pi = Pi(Factor=1)
neg = Negative(Value=pi)

hingepoints = HingePoints(Mesh=mesh)  # -> _1, _2, _3, _4
multiplication = Multiplication(A=neg, B=folding)
hinge = Hinge(
    FoldStart=hingepoints._1,
    FoldEnd=hingepoints._2,
    Tip1=hingepoints._3,
    Tip2=hingepoints._4,
    RestAngle=multiplication,
    Strength=0.1)

# ----
# Color Format
# Input
data = Data(1)
# Method
data_2 = Data(1)
# Output
data_3 = Data(1)
# Display
data_4 = Data(1)
# Unuse
data_5 = Data(1)

multiplication_2 = Multiplication(A=pi, B=folding)
hinge_2 = Hinge(
    FoldStart=hingepoints._1,
    FoldEnd=hingepoints._2,
    Tip1=hingepoints._3,
    Tip2=hingepoints._4,
    RestAngle=multiplication_2,
    Strength=0.1)

ln = Line(StartPoint=hingepoints._1, EndPoint=hingepoints._2)
eval = EvaluateCurve(Curve=reparameterize(crv_2), Parameter=0.5)  # -> Point, Tangent, Angle
eval_2 = EvaluateCurve(Curve=reparameterize(crv), Parameter=0.5)  # -> Point, Tangent, Angle
eval_3 = EvaluateCurve(Curve=ln, Parameter=0.5)  # -> graft(Point), Tangent, Angle
dist = Distance(PointA=eval.Point, PointB=eval_3.Point)
dist_2 = Distance(PointA=eval_2.Point, PointB=eval_3.Point)
sort = SortList(Keys=dist)  # -> Keys, ValuesA
sort_2 = SortList(Keys=dist_2)  # -> Keys, ValuesA
item = ListItem(List=sort.Keys, Index=0, Wrap=True)
item_2 = ListItem(List=sort_2.Keys, Index=0, Wrap=True)
smaller = SmallerThan(FirstNumber=item, SecondNumber=0.01)  # -> flatten(SmallerThan), OrEqualTo
smaller_2 = SmallerThan(FirstNumber=item_2, SecondNumber=0.01)  # -> flatten(SmallerThan), OrEqualTo
cull = CullPattern(List=hinge, CullPattern=smaller.SmallerThan)
cull_2 = CullPattern(List=hinge_2, CullPattern=smaller_2.SmallerThan)

medges = MeshEdges(Mesh=mesh)  # -> NakedEdges, InteriorEdges, NonManifoldEdges
length_line = LengthLine(Line=[medges.NakedEdges, medges.InteriorEdges], Strength=1)

# ---- group: a weak plastic anchor on all points prevents drift
demesh = DeconstructMesh(Mesh=mesh)  # -> Vertices, Faces, Colours, Normals
plasticanchor = PlasticAnchor(Point=demesh.Vertices, Limit=0.01, Strength=0.001)

# ----
show = Show(G=mesh)

solver = Solver(
    GoalObjects=[length_line, cull, cull_2, show, plasticanchor],
    Reset=reset,
    Threshold=1e-15,
    Tolerance=0.01,
    On=Toggle(True))  # -> I, V, O
bang = ExplodeTree(Data=solver.O)  # -> Branch0, Branch1
mesh_2 = Mesh(bang.Branch0)
wbjoin = WeaverbirdsJoinMeshesAndWeld(Mesh=mesh_2, Weld=False)

wbfacepolys_2 = WeaverbirdsFacePolylines(Mesh=wbjoin)
boundary = BoundarySurfaces(Edges=wbfacepolys_2)
preview = CustomPreview(Geometry=boundary, Material=ColourSwatch(SwatchColor=RGB(130, 104, 39)))
