# Grasshopper definition 006_MiuraOri.gh (Grasshopper 1.0.7)
# plug-ins: Kangaroo2 Components, Weaverbird

number_slider = Slider(10, range=0..10)
number_slider_2 = Slider(5, range=0..10)
gallery = ImageGallery(CycleDelay=30, Randomize=False, UseLocalImages=True, UseRemoteImages=True)
recgrid = Rectangular(
    Plane=PlaneXY(0, 0, 0),
    SizeX=number_slider,
    SizeY=Slider(10, range=0..10),
    ExtentX=number_slider_2,
    ExtentY=number_slider_2)  # -> Cells, Points

cos = Cosine(Value=degrees(Slider(70, range=0..100)))
multiplication = Multiplication(A=number_slider, B=cos)
X = UnitX(Factor=multiplication)

pt = Point(recgrid.Points)
P = DispatchPattern([True, False])
dispatch = Dispatch(List=pt, DispatchPattern=P)  # -> ListA, ListB
move = Move(Geometry=dispatch.ListA, Motion=X)  # -> Geometry, Transform
weave = Weave(Pattern=P, Stream0=dispatch.ListB, Stream1=move.Geometry, NullGaps=False)

# ----
# Color Format
# Input
data = Data(1)
# Method
data_2 = Data(1)
# Output
data_3 = Data(1)
# Display
data_4 = Data(1)
# Unuse
data_5 = Data(1)

flip = FlipMatrix(Data=weave)
pline = PolyLine(Vertices=weave, Closed=False)
pline_2 = PolyLine(Vertices=flip, Closed=False)
explode = Explode(Curve=[pline, pline_2], Recursive=True)  # -> flatten(Segments), Vertices

crv = Curve(flatten(pline_2))
lng = ListLength(List=crv)
subtraction = Subtraction(A=lng, B=1)
merge = Merge(Data1=Slider(0, range=0..100), Data2=subtraction)
cull_i = CullIndex(List=crv, Indices=merge, Wrap=True)

crv_2 = Curve(cull_i)

crv_3 = Curve(flatten(pline))
lng_2 = ListLength(List=crv_3)
subtraction_2 = Subtraction(A=lng_2, B=1)
merge_2 = Merge(Data1=Slider(0, range=0..100), Data2=subtraction_2)
cull_i_2 = CullIndex(List=crv_3, Indices=merge_2, Wrap=True)

dispatch_2 = Dispatch(List=crv_2, DispatchPattern=P)  # -> ListA, ListB
crv_4 = Curve(dispatch_2.ListB)
crv_5 = Curve(dispatch_2.ListA)
explode_2 = Explode(Curve=crv_4, Recursive=True)  # -> Segments, Vertices
explode_3 = Explode(Curve=crv_5, Recursive=True)  # -> Segments, Vertices
dispatch_3 = Dispatch(List=explode_2.Segments, DispatchPattern=P)  # -> ListA, ListB
dispatch_4 = Dispatch(List=explode_3.Segments, DispatchPattern=P)  # -> ListA, ListB
crv_6 = Curve([dispatch_3.ListB, dispatch_4.ListA])
crv_7 = Curve([dispatch_4.ListB, dispatch_3.ListA])
crv_8 = Curve(cull_i_2)
wbweave = WeaverbirdsMeshFromLinesWeaveBack(Lines=explode.Segments, MaximumValence=4)
dispatch_5 = Dispatch(List=crv_8, DispatchPattern=P)  # -> ListA, ListB
crv_9 = Curve(dispatch_5.ListB)
crv_10 = Curve(dispatch_5.ListA)
merge_3 = Merge(Data1=crv_10, Data2=crv_6)
merge_4 = Merge(Data1=crv_9, Data2=crv_7)
folding = Slider(0.182, range=0..0.99)

# ---- group: Mountain fold lines
crv_11 = Curve(merge_4)

# ----
angle = Panel("pi")
angle_2 = Panel("-pi")

# ---- group: mesh of flat folding pattern
mesh = Mesh(wbweave)

# ---- group: Valley fold lines
crv_12 = Curve(merge_3)

# ----
move_2 = Move(Motion=Vector(0, 0, 10))  # -> Geometry, Transform
tri = Triangulate(Mesh=mesh)  # -> Mesh, Count
faceb = FaceBoundaries(Mesh=mesh)

hingepoints = HingePoints(Mesh=tri.Mesh)  # -> _1, _2, _3, _4
multiplication_2 = Multiplication(A=angle_2, B=folding)
multiplication_3 = Multiplication(A=angle, B=folding)
ln = Line(StartPoint=hingepoints._1, EndPoint=hingepoints._2)
show = Show(G=tri.Mesh)
hinge = Hinge(
    FoldStart=hingepoints._1,
    FoldEnd=hingepoints._2,
    Tip1=hingepoints._3,
    Tip2=hingepoints._4,
    RestAngle=multiplication_3,
    Strength=0.01)
hinge_2 = Hinge(
    FoldStart=hingepoints._1,
    FoldEnd=hingepoints._2,
    Tip1=hingepoints._3,
    Tip2=hingepoints._4,
    RestAngle=multiplication_2,
    Strength=0.01)
eval = EvaluateCurve(Curve=reparameterize(crv_12), Parameter=0.5)  # -> Point, Tangent, Angle
eval_2 = EvaluateCurve(Curve=reparameterize(crv_11), Parameter=0.5)  # -> Point, Tangent, Angle
eval_3 = EvaluateCurve(Curve=ln, Parameter=0.5)  # -> graft(Point), Tangent, Angle
dist = Distance(PointA=eval.Point, PointB=eval_3.Point)
dist_2 = Distance(PointA=eval_2.Point, PointB=eval_3.Point)
sort = SortList(Keys=dist)  # -> Keys, ValuesA
sort_2 = SortList(Keys=dist_2)  # -> Keys, ValuesA
item = ListItem(List=sort.Keys, Index=0, Wrap=True)
item_2 = ListItem(List=sort_2.Keys, Index=0, Wrap=True)
smaller = SmallerThan(FirstNumber=item, SecondNumber=0.01)  # -> flatten(SmallerThan), OrEqualTo
smaller_2 = SmallerThan(FirstNumber=item_2, SecondNumber=0.01)  # -> flatten(SmallerThan), OrEqualTo
cull = CullPattern(List=hinge_2, CullPattern=smaller.SmallerThan)
cull_2 = CullPattern(List=hinge, CullPattern=smaller_2.SmallerThan)

# ---- group: maintain edge lengths
medges = MeshEdges(Mesh=tri.Mesh)  # -> NakedEdges, InteriorEdges, NonManifoldEdges
length_line = LengthLine(Line=[medges.NakedEdges, medges.InteriorEdges], Strength=10)

# ---- group: a weak plastic anchor on all points prevents drift
demesh = DeconstructMesh(Mesh=tri.Mesh)  # -> Vertices, Faces, Colours, Normals
plasticanchor = PlasticAnchor(Point=demesh.Vertices, Limit=0.01, Strength=0.01)

# ----
planarize = Planarize(M=mesh, Strength=Slider(1, range=0..1))
solver = Solver(
    GoalObjects=[length_line, cull, cull_2, show, plasticanchor, planarize],
    Reset=Button(),
    Threshold=1e-15,
    Tolerance=0.01,
    On=Toggle(True))  # -> I, V, O

item_3 = ListItem(List=solver.O, Index=0, Wrap=True)
faceb_2 = FaceBoundaries(Mesh=item_3)
boundary = BoundarySurfaces(Edges=faceb_2)
preview = CustomPreview(Geometry=boundary, Material=ColourSwatch(SwatchColor=RGB(111, 178, 174)))
