# Grasshopper definition 20220627_PakiPaki.gh (Grasshopper 1.0.7)
# plug-ins: LunchBox

list = ValueList({"One": 0, "Two": 1, "Three": 2, "Four": 3}, selected="One")
number_slider = Slider(29, range=0..100)
number_slider_2 = Slider(12, range=0..100)
gallery = ImageGallery(CycleDelay=30, Randomize=False, UseLocalImages=True, UseRemoteImages=True)
srf = Surface(<surface referenced from the Rhino model>)
quadstag = StaggeredQuadPanels(Surface=srf, UDivisions=number_slider_2, VDivisions=number_slider)
trib = TrianglePanelsB(Surface=srf, UDivisions=number_slider_2, VDivisions=number_slider)
quads = QuadPanels(Surface=srf, UDivisions=Slider(29, range=0..100), VDivisions=number_slider)
filter = StreamFilter(Gate=list, Stream0=quadstag, Stream1=trib, Stream2=quads)
edges = BrepEdges(Brep=filter)  # -> Naked, Interior, NonManifold
crv = Curve([edges.Naked, edges.Interior])
join = JoinCurves(Curves=crv, Preserve=False)  # -> flatten(Curves)

# ----
# Color Format
# Input
data = Data(1)
# Method
data_2 = Data(1)
# Output
data_3 = Data(1)
# Display
data_4 = Data(1)
# Unuse
data_5 = Data(1)

dom = ConstructDomain(DomainStart=Slider(0, range=0..1), DomainEnd=Slider(0.9, range=0..1))
lng = ListLength(List=join)
lng_2 = ListLength(List=join)
random = Random(Range=dom, Number=lng, Seed=Slider(1000, range=0..1000))
random_2 = Random(Range=dom, Number=lng_2, Seed=Slider(0, range=0..1000))
pt = ConstructPoint(XCoordinate=random, YCoordinate=random_2, ZCoordinate=0)
evalsrf = EvaluateSurface(Surface=reparameterize(join), Point=pt)  # -> Point, Normal, UDirection, VDirection, Frame
crv_2 = Curve(<curve referenced from the Rhino model>)
neg = Negative(Value=evalsrf.Normal)
pull = PullPoint(Point=evalsrf.Point, Geometry=crv_2, ClosestOnly=True)  # -> ClosestPoint, Distance
lng_3 = ListLength(List=join)
dom_2 = ConstructDomain(DomainStart=Slider(59, range=0..1000), DomainEnd=Slider(241, range=0..1000))
bnd = Bounds(Numbers=pull.Distance)
panel = Panel(bnd)
dom_3 = ConstructDomain(DomainStart=Slider(1, range=0..1), DomainEnd=Slider(0, range=0..100))
random_3 = Random(Range=dom_2, Number=lng_3, Seed=Slider(1000, range=0..1000))
dom_4 = ConstructDomain(DomainStart=Slider(0, range=0..1000), DomainEnd=Slider(1000, range=0..1000))
remap = RemapNumbers(Value=pull.Distance, Source=bnd, Target=dom_3)  # -> Mapped, Clipped
graph = GraphMapper(
    remap.Mapped,
    x0=0,
    x1=1,
    y0=0,
    y1=1,
    container_name="Bezier",
    cpx=[0, 0.7135540247, 0.9096325636, 1],
    cpy=[0, 0.2175337076, 0.382353425, 1])
remap_2 = RemapNumbers(Value=graph, Source=Domain(0, 1), Target=dom_4)  # -> Mapped, Clipped
addition = Addition(A=random_3, B=remap_2.Mapped)
amp = Amplitude(Vector=neg, Amplitude=addition)
move = Move(Geometry=evalsrf.Point, Motion=amp)  # -> Geometry, Transform
extr = ExtrudePoint(Base=graft(join), Point=graft(move.Geometry))
preview = CustomPreview(Geometry=extr, Material=ColourSwatch(SwatchColor=RGB(153, 109, 63)))
