# Grasshopper definition 008_GradientBrick.gh (Grasshopper 1.0.7)
# plug-ins: Pufferfish, Noise 4D, LunchBox

gallery = ImageGallery(CycleDelay=30, Randomize=False, UseLocalImages=True, UseRemoteImages=True)
srf = Surface(reparameterize(<surface referenced from the Rhino model>))
list = ValueList({"One": 0, "Two": 1}, selected="Two")
panel = Panel("PufferFish")

number_slider = Slider(30, range=0..30)
dom = ConstructDomain(DomainStart=0, DomainEnd=Slider(2071, range=0..10000))
sdivide = DivideSurface(Surface=srf, UCount=number_slider, VCount=10)  # -> Points, Normals, Parameters
simplex = SimplexNoise(Values=sdivide.Points, Time=Slider(0, range=0..100), Scale=Slider(9e-05, range=1e-05..0.0005))
bnd = Bounds(Numbers=flatten(simplex))
remap = RemapNumbers(Value=simplex, Source=bnd, Target=dom)  # -> Mapped, Clipped
amp = Amplitude(Vector=sdivide.Normals, Amplitude=remap.Mapped)
move = Move(Geometry=simplify(sdivide.Points), Motion=simplify(amp))  # -> Geometry, Transform
panel_2 = Panel(simplex)
srfgrid = SurfaceFromPoints(Points=flatten(move.Geometry), UCount=expr("x+1", number_slider), Interpolate=False)

number_slider_2 = Slider(70, range=0..100)

srf_2 = Surface(reparameterize(srfgrid))
srf_3 = Surface(reparameterize(srf))
filter = StreamFilter(Gate=list, Stream0=srf_3, Stream1=srf_2)

# ----
# Color Format
# Input
data = Data(1)
# Method
data_2 = Data(1)
# Output
data_3 = Data(1)
# Display
data_4 = Data(1)
# Unuse
data_5 = Data(1)

rebuildsrf = RebuildSurface(Surface=filter, UDegree=3, VDegree=3, UNumber=10, VNumber=10)
range = Range(Domain=Domain(0, 1), Steps=number_slider_2)
graph = GraphMapper(
    range,
    x0=0,
    x1=1,
    y0=0,
    y1=1,
    A=1,
    B=0,
    container_name="Linear",
    Graph_x0=0.25,
    Graph_x1=0.75,
    Graph_y0=0.25,
    Graph_y1=0.75)
paramsrfiso = ParameterSurfaceIsocurve(Surface=rebuildsrf, Parameter=graph, Direction=True)

divide = DivideCurve(Curve=paramsrfiso, Count=Slider(146, range=50..300), Kinks=False)  # -> simplify(Points), Tangents, Parameters

tstat = TreeStatistics(Tree=divide.Points)  # -> Paths, Length, Count
index = ItemIndex(List=tstat.Paths, Item=tstat.Paths)  # -> graft(Index)
P = DispatchPattern([True, False])
mod = Modulus(A=index, B=Slider(2, range=0..10))
item = ListItem(List=P, Index=mod, Wrap=True)  # -> Item, Item1
merge = Merge(Data1=item.Item, Data2=item.Item1)

dispatch = Dispatch(List=divide.Points, DispatchPattern=merge)  # -> ListA, ListB
pt = Point(dispatch.ListA)

relitem = RelativeItem(Tree=simplify(pt), Offset="{0}[1]", WrapPaths=False, WrapItems=False)  # -> ItemA, ItemB

ln = Line(StartPoint=relitem.ItemA, EndPoint=relitem.ItemB)
curvepoint = PointOnCurve(ln, parameter=0.5)

item_2 = ListItem(List=pt, Index=0, Wrap=True)  # -> flatten(Item)
pdecon = Deconstruct(Point=item_2)  # -> XComponent, YComponent, ZComponent
reldif = RelativeDifferences(Values=pdecon.ZComponent)
cull_i = CullIndex(List=reldif, Indices=Slider(0, range=0..100), Wrap=True)  # -> graft(List)
neg = Negative(Value=reldif)  # -> simplify(graft(Result))

srf_cp = SurfaceClosestPoint(Point=curvepoint, Surface=rebuildsrf)  # -> Point, UVPoint, Distance
evalsrf = EvaluateSurface(Surface=rebuildsrf, Point=srf_cp.UVPoint)  # -> Point, Normal, UDirection, VDirection, Frame
pt_2 = Point(evalsrf.Point)

deplane = DeconstructPlane(Plane=evalsrf.Frame)  # -> Origin, XAxis, YAxis, ZAxis

range_2 = Range(Domain=Domain(0, 1), Steps=number_slider_2)
graph_2 = GraphMapper(
    range_2,
    x0=0,
    x1=1,
    y0=0,
    y1=1,
    container_name="Bezier",
    cpx=[0, 0.449878633, 0.77569139, 1],
    cpy=[0, 0.05500507355, 0.1032343507, 0.3743878603])
dom_2 = ConstructDomain(DomainStart=Slider(4, range=0..10), DomainEnd=Slider(10, range=0..10))

Z = UnitZ(Factor=1)
pl = ConstructPlane(Origin=deplane.Origin, XAxis=deplane.XAxis, YAxis=Z)

dom_3 = ConstructDomain(DomainStart=Slider(0, range=0..100), DomainEnd=Slider(100, range=0..100))

division = Division(A=neg, B="2")
neg_2 = Negative(Value=division)
dom_4 = ConstructDomain(DomainStart=Slider(0, range=0..100), DomainEnd=division)

range_3 = Range(Domain=Domain(0, 1), Steps=number_slider_2)
graph_3 = GraphMapper(range_3, x0=0, x1=1, y0=0, y1=1, container_name="Sine", Equation_px=[0, 1], Equation_py=[0, 0.5139045119])
multiplication = Multiplication(A=graph_3, B=Slider(0.2, range=0..1))
addition = Addition(A=graph_2, B=multiplication)

remap_2 = RemapNumbers(Value=addition, Source=Domain(0, 1), Target=dom_2)  # -> graft(Mapped), graft(Clipped)

len = Length(Curve=ln)
division_2 = Division(A=len, B=remap_2.Clipped)
neg_3 = Negative(Value=division_2)
dom_5 = ConstructDomain(DomainStart=neg_3, DomainEnd=division_2)

box = CenterBox(Base=pl, X=dom_5, Y=dom_4, Z=dom_3)

mesh = Mesh(simplify(box))

lng = ListLength(List=mesh)
tstat_2 = TreeStatistics(Tree=lng)  # -> Paths, Length, Count
lng_2 = ListLength(List=tstat_2.Paths)
range_4 = Range(Domain=Domain(0, 1), Steps=lng_2)
random = Random(Range=Domain(0, 100000), Number=lng_2, Seed=2)
random_2 = Random(Range=Domain(0, 1), Number=simplify(lng), Seed=graft(random))  # -> simplify(Random)

graph_4 = GraphMapper(
    range_4,
    x0=0,
    x1=1,
    y0=0,
    y1=1,
    container_name="Bezier",
    cpx=[0, 0.5659444928, 0.5248811245, 1],
    cpy=[0, 0.02765601873, 0.8119559884, 1])

larger = LargerThan(FirstNumber=random_2, SecondNumber=graft(graph_4))  # -> simplify(LargerThan), OrEqualTo

dispatch_2 = Dispatch(List=mesh, DispatchPattern=larger.LargerThan)  # -> ListA, ListB

panel_3 = Panel(range_4)

preview = CustomPreview(Geometry=dispatch_2.ListA, Material=ColourSwatch(SwatchColor=RGBA(186, 244, 255, 150)))
preview_2 = CustomPreview(Geometry=dispatch_2.ListB, Material=ColourSwatch(SwatchColor=RGB(107, 55, 55)))
