# Grasshopper definition subD.gh (Grasshopper 1.0.7)
# plug-ins: Kangaroo2 Components

gallery = ImageGallery(CycleDelay=30, Randomize=False, UseLocalImages=True, UseRemoteImages=True)
subd = SubD(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)
meshsubd = MeshFromSubD(SubD=subd, Density=Slider(2, range=0..10))
bbox = BoundingBox(Content=meshsubd, Plane=PlaneXY(0, 0, 0))  # -> Box, Box_2
debrep = DeconstructBrep(Brep=bbox.Box)  # -> Faces, Edges, Vertices

# ----
# Color Format
# Input
data = Data(1)
# Method
data_2 = Data(1)
# Output
data_3 = Data(1)
# Display
data_4 = Data(1)
# Unuse
data_5 = Data(1)

evalsrf = EvaluateSurface(Surface=reparameterize(debrep.Faces), Point="0.5,0.5,0")  # -> Point, Normal, UDirection, VDirection, Frame
faceb = FaceBoundaries(Mesh=meshsubd)
Z = UnitZ(Factor=1)
boundary = BoundarySurfaces(Edges=faceb)
join = BrepJoin(Breps=boundary)  # -> Breps, Closed
debrep_2 = DeconstructBrep(Brep=join.Breps)  # -> Faces, Edges, Vertices
crv = Curve(debrep_2.Edges)
midpt = CurveMiddle(Curve=crv)
dprod = DotProduct(VectorA=evalsrf.Normal, VectorB=Z, Unitize=False)
vec = Vector(crv)
larger = LargerThan(FirstNumber=dprod, SecondNumber=Slider(0.2, range=0..1))  # -> LargerThan, OrEqualTo
dispatch = Dispatch(List=debrep.Faces, DispatchPattern=larger.LargerThan)  # -> ListA, ListB
srf = Surface(dispatch.ListA)
dim = Dimensions(Surface=srf)  # -> UDimension, VDimension
area = Area(Geometry=srf)  # -> Area, Centroid
division = Division(A=dim.UDimension, B=2)
cir = Circle(Plane=area.Centroid, Radius=division)
crv_2 = Curve(cir)
crv_cp = CurveClosestPoint(Point=midpt, Curve=crv_2)  # -> Point, Parameter, Distance
eval = EvaluateCurve(Curve=crv_2, Parameter=crv_cp.Parameter)  # -> Point, Tangent, Angle
dprod_2 = DotProduct(VectorA=eval.Tangent, VectorB=vec, Unitize=False)
abs = Absolute(Value=dprod_2)
larger_2 = LargerThan(FirstNumber=abs, SecondNumber=Slider(0.1, range=0..0.1))  # -> LargerThan, OrEqualTo
dispatch_2 = Dispatch(List=crv, DispatchPattern=larger_2.LargerThan)  # -> ListA, ListB
crv_3 = Curve(dispatch_2.ListA)
crv_4 = Curve(dispatch_2.ListB)
dupln = RemoveDuplicateLines(Lines=crv_3, Tolerance=0.01)
dupln_2 = RemoveDuplicateLines(Lines=crv_4, Tolerance=0.01)
join_2 = JoinCurves(Curves=dupln_2, Preserve=False)
join_3 = JoinCurves(Curves=dupln, Preserve=False)
item = ListItem(List=join_2, Index=0, Wrap=True)
ccx = CurveCurve(CurveA=join_3, CurveB=item)  # -> Points, flatten(ParamsA), flatten(ParamsB)
sort = SortList(Keys=ccx.ParamsB, ValuesA=join_3)  # -> Keys, ValuesA
P = DispatchPattern([True, False])
crv_5 = Curve(sort.ValuesA)
dispatch_3 = Dispatch(List=crv_5, DispatchPattern=P)  # -> ListA, ListB
disc = Discontinuity(Curve=dispatch_3.ListA, Level=1)  # -> Points, Parameters

# ---- group: OffsetFromSurface
number_slider = Slider(300, range=0..10000)

# ----
loft = Loft(Curves=crv_5, Options={Adjust=True, Closed=False, LoftEnds=0, LoftSimp=1, LoftType=1, Rebuild=10, Refit=0.01})
srf_cp = SurfaceClosestPoint(Point=disc.Points, Surface=loft)  # -> Point, UVPoint, Distance
crv_6 = Curve(dispatch_3.ListB)
evalsrf_2 = EvaluateSurface(Surface=loft, Point=srf_cp.UVPoint)  # -> Point, Normal, UDirection, VDirection, Frame
merge = Merge(Data1=simplify(graft(crv_6)))
amp = Amplitude(Vector=evalsrf_2.Normal, Amplitude=number_slider)
move = Move(Geometry=evalsrf_2.Point, Motion=amp)  # -> Geometry, Transform
pline = PolyLine(Vertices=move.Geometry, Closed=True)  # -> flatten(Polyline)
weave = Weave(Pattern=P, Stream0=dispatch_3.ListB, Stream1=pline, NullGaps=False)
loft_2 = Loft(Curves=weave, Options={Adjust=True, Closed=False, LoftEnds=0, LoftSimp=0, LoftType=3, Rebuild=10, Refit=0.01})
preview = CustomPreview(Geometry=loft_2, Material=ColourSwatch(SwatchColor=RGB(148, 136, 136)))
