# Grasshopper definition 20220610_BaseRoofStudy.gh (Grasshopper 1.0.7)
# plug-ins: Kangaroo2 Components, TT Toolbox, MeshEdit Components, Pufferfish

gallery = ImageGallery(CycleDelay=30, Randomize=False, UseLocalImages=True, UseRemoteImages=True)
number_slider = Slider(3, range=0..20, expression="x*1000")

# ----
# Sphere Cutting Height
number_slider_2 = Slider(5, range=0..14, expression="x*500")

# ----
# Offset Center
number_slider_3 = Slider(26, range=10..100, expression="x*50")

# ----
# Mesh Offset
number_slider_4 = Slider(3, range=0..30, expression="x*100")

number_slider_5 = Slider(30, range=0..100)

# ----
# Mesh Length
number_slider_6 = Slider(12, range=0..100, expression="x*100")

# ----
# Roof_Bottom
panel_2 = Panel("")

# ----
# Sphere Cutting Height
number_slider_7 = Slider(10, range=0..14, expression="x*500")

# ----
# Mesh Length
number_slider_8 = Slider(19, range=0..100, expression="x*100")

# ----
# Roof_Top
# OutLine
crv = Curve(<curve referenced from the Rhino model>)

# ----
# radius
number_slider_9 = Slider(15, range=0..20, expression="x*1000")

# ----
# height
number_slider_10 = Slider(14000, range=0..14000)

# ----
# Fillet
number_slider_11 = Slider(100, range=20..100, expression="x*100")

# ----
# Center Points
pt = Point(<point referenced from the Rhino model>)

centerpt = Point(pt)

# ----
# Center Points
pt_2 = Point(pt)

num = Number(number_slider_9)

subtraction = Subtraction(A=number_slider_10, B=number_slider_3)
subtraction_2 = Subtraction(A=subtraction, B=num)
Z = UnitZ(Factor=subtraction_2)
move = Move(Geometry=pt_2, Motion=Z)  # -> Geometry, Transform

subtraction_3 = Subtraction(A=number_slider_10, B=number_slider_9)
Z_2 = UnitZ(Factor=subtraction_3)
move_2 = Move(Geometry=pt, Motion=Z_2)  # -> Geometry, Transform

Z_3 = UnitZ(Factor=Slider(3, range=0..20, expression="x*1000"))
move_3 = Move(Geometry=centerpt, Motion=Z_3)  # -> Geometry, Transform
cir = Circle(Plane=move_3.Geometry, Radius=Slider(3, range=0..20, expression="x*1000"))

xy = XYPlane(Origin=Point(0, 0, 0))
disc = Discontinuity(Curve=crv, Level=1)  # -> Points, Parameters
cp = PlaneClosestPoint(Point=disc.Points, Plane=xy)  # -> Point, UVPoint, Distance

# ----
# Color Format
# Input
data = Data(1)
# Method
data_2 = Data(1)
# Output
data_3 = Data(1)
# Display
data_4 = Data(1)
# Unuse
data_5 = Data(1)

ln = Line(StartPoint=cp.Point, EndPoint=disc.Points)
linedim = LineDimension(Line=ln, Text="{0:0.0}", Size=Slider(324, range=0..1000))

pt_3 = Point(pt_2)
xz = XZPlane(Origin=pt_3)
yz = YZPlane(Origin=pt_3)

pt_4 = Point(pt)
xz_2 = XZPlane(Origin=pt_4)
yz_2 = YZPlane(Origin=pt_4)

fillet = Fillet(Curve=crv, Radius=number_slider_11)
crv_2 = Curve(fillet)

boundarycurve = Curve(fillet)

Z_4 = UnitZ(Factor=Slider(11, range=2..100, expression="x*50"))
boundarycurve_2 = Curve(boundarycurve)
neg = Negative(Value=Z_4)
move_4 = Move(Geometry=boundarycurve_2, Motion=neg)  # -> Geometry, Transform
crv_3 = Curve(move_4.Geometry)

jagged = SettingsSpeed()
# Idea02
jagged_2 = SettingsSpeed()

subtraction_4 = Subtraction(A=number_slider_10, B=number_slider_7)

offset_from_top = Number(subtraction_4)

Z_5 = UnitZ(Factor=offset_from_top)
move_5 = Move(Geometry=pt_2, Motion=Z_5)  # -> Geometry, Transform

panel_4 = Panel(offset_from_top)

Z_6 = UnitZ(Factor=panel_4)
move_6 = Move(Geometry=pt, Motion=Z_6)  # -> Geometry, Transform

xy_2 = XYPlane(Origin=move_5.Geometry)
sph = Sphere(Base=move.Geometry, Radius=num)
sec = BrepPlane(Brep=sph, Plane=xy_2)  # -> Curves, Points
split = SplitBrep(Brep=sph, Cutter=sec.Curves)
item = ListItem(List=split, Index=0, Wrap=True)
geo = Geometry(item)

xy_3 = XYPlane(Origin=move_6.Geometry)
sph_2 = Sphere(Base=move_2.Geometry, Radius=number_slider_9)
sec_2 = BrepPlane(Brep=sph_2, Plane=xy_3)  # -> Curves, Points
split_2 = SplitBrep(Brep=sph_2, Cutter=sec_2.Curves)
item_2 = ListItem(List=split_2, Index=0, Wrap=True)
geo_2 = Geometry(item_2)

sec_3 = BrepPlane(Brep=geo, Plane=xz)  # -> Curves, Points
pcx = CurvePlane(Curve=crv_3, Plane=xz)  # -> Points, ParamsC, ParamsP
crv_4 = Curve(sec_3.Curves)

sec_4 = BrepPlane(Brep=geo, Plane=yz)  # -> Curves, Points
pcx_2 = CurvePlane(Curve=crv_3, Plane=yz)  # -> Points, ParamsC, ParamsP
crv_5 = Curve(sec_4.Curves)

sec_5 = BrepPlane(Brep=geo_2, Plane=xz_2)  # -> Curves, Points
pcx_3 = CurvePlane(Curve=crv_2, Plane=xz_2)  # -> Points, ParamsC, ParamsP
crv_6 = Curve(sec_5.Curves)

sec_6 = BrepPlane(Brep=geo_2, Plane=yz_2)  # -> Curves, Points
pcx_4 = CurvePlane(Curve=crv_2, Plane=yz_2)  # -> Points, ParamsC, ParamsP
crv_7 = Curve(sec_6.Curves)

pdecon = Deconstruct(Point=move_3.Geometry)  # -> XComponent, YComponent, ZComponent

Z_7 = UnitZ(Factor=number_slider_2)
neg_2 = Negative(Value=Z_7)
brep = Brep(sph)

crv_8 = Curve(cir)

divide = DivideCurve(Curve=crv_4, Count=10, Kinks=False)  # -> Points, Tangents, Parameters

lng = ListLength(List=divide.Points)
merge = Merge(Data1=flatten("0"), Data2=flatten(lng))

ins = InsertItems(List=divide.Points, Item=pcx.Points, Indices=merge, Wrap=True)

intcrv = Interpolate(Vertices=ins, Degree=3, Periodic=False, KnotStyle=1)  # -> Curve, Length, Domain

divide_2 = DivideCurve(Curve=crv_5, Count=10, Kinks=False)  # -> reverse(Points), Tangents, Parameters

lng_2 = ListLength(List=divide_2.Points)
merge_2 = Merge(Data1=flatten("0"), Data2=flatten(lng_2))

ins_2 = InsertItems(List=divide_2.Points, Item=pcx_2.Points, Indices=merge_2, Wrap=True)

intcrv_2 = Interpolate(Vertices=ins_2, Degree=3, Periodic=False, KnotStyle=1)  # -> Curve, Length, Domain

merge_3 = Merge(Data1=move_4.Geometry, Data2=intcrv.Curve, Data3=intcrv_2.Curve)  # -> flatten(Result)
patch = Patch(Curves=merge_3, Spans=20, Flexibility=1, Trim=True)

# ----
# Tree
# Tree
bottom_basesrf = Surface(patch)

preview = CustomPreview(Geometry=merge_3, Material=ColourSwatch(SwatchColor=RGB(171, 0, 0)))

brep_cp = BrepClosestPoint(Point=centerpt, Brep=bottom_basesrf)  # -> Point, Normal, Distance

divide_3 = DivideCurve(Curve=crv_6, Count=10, Kinks=False)  # -> Points, Tangents, Parameters

lng_3 = ListLength(List=divide_3.Points)
merge_4 = Merge(Data1=flatten("0"), Data2=flatten(lng_3))

ins_3 = InsertItems(List=divide_3.Points, Item=pcx_3.Points, Indices=merge_4, Wrap=True)

intcrv_3 = Interpolate(Vertices=ins_3, Degree=3, Periodic=False, KnotStyle=1)  # -> Curve, Length, Domain

divide_4 = DivideCurve(Curve=crv_7, Count=10, Kinks=False)  # -> reverse(Points), Tangents, Parameters

lng_4 = ListLength(List=divide_4.Points)
merge_5 = Merge(Data1=flatten("0"), Data2=flatten(lng_4))

ins_4 = InsertItems(List=divide_4.Points, Item=pcx_4.Points, Indices=merge_5, Wrap=True)

intcrv_4 = Interpolate(Vertices=ins_4, Degree=3, Periodic=False, KnotStyle=1)  # -> Curve, Length, Domain

merge_6 = Merge(Data1=boundarycurve, Data2=intcrv_3.Curve, Data3=intcrv_4.Curve)  # -> flatten(Result)
patch_2 = Patch(Curves=merge_6, Spans=20, Flexibility=1, Trim=True)

preview_2 = CustomPreview(Geometry=merge_6, Material=ColourSwatch(SwatchColor=RGB(171, 0, 0)))

preview_3 = CustomPreview(Geometry=patch_2, Material=ColourSwatch(SwatchColor=RGB(98, 168, 189)))

geo_3 = Geometry(patch_2)
panel_5 = Panel(number_slider_8)
mesh = MeshBrep(
    Brep=geo_3,
    Settings={GridMaxCount=0, GridMinCount=16, JaggedSeams=False, MaxEdgeLength=0, MinEdgeLength=0.0001, MinTolerance=0, Refine=True, RefineAngle=0, RelativeTolerance=0.65, SimplePlanes=True, Tolerance=0})
triremesh = TriRemesh(Geometry=mesh, Sharp=Toggle(False), Features=boundarycurve, Length=panel_5, Iterations=Slider(34, range=0..100))  # -> Triangulation, Dual, Creases

faceb = FaceBoundaries(Mesh=triremesh.Triangulation)

disc_2 = Discontinuity(Curve=faceb, Level=1)  # -> Points, Parameters
pt_5 = Point(disc_2.Points)
cullduppoints = RemoveDuplicatePoints(InputPoints=flatten(pt_5), Tolerance=Slider(1, range=0..1))  # -> OutputPoints, FirstPointIndexes
clean = CleanTree(RemoveNulls=True, RemoveInvalid=True, RemoveEmpty=False, Tree=cullduppoints.OutputPoints)

preview_4 = CustomPreview(Geometry=faceb, Material=ColourSwatch(SwatchColor=RGB(98, 168, 189)))

area = Area(Geometry=faceb)  # -> Area, Centroid

untrim = Untrim(Surface=patch)
Z_8 = UnitZ(Factor=1)
mesh_2 = MeshBrep(
    Brep=untrim,
    Settings={GridMaxCount=0, GridMinCount=16, JaggedSeams=False, MaxEdgeLength=0, MinEdgeLength=0.0001, MinTolerance=0, Refine=True, RefineAngle=0, RelativeTolerance=0.65, SimplePlanes=True, Tolerance=0})
rev = Reverse(Vector=Z_8)
meshray = MeshRay(Mesh=mesh_2, Point=area.Centroid, Direction=rev)  # -> Point, Hit

pt_6 = Point(graft(meshray.Point))
cps = ClosestPoints(Point=pt_6, Cloud=meshray.Point, Count=Slider(4, range=0..10))  # -> ClosestPoint, CPIndex, Distance
equals = Equality(FirstNumber=cps.Distance, SecondNumber=Slider(0, range=0..100))  # -> Equality, Inequality
dispatch = Dispatch(List=cps.ClosestPoint, DispatchPattern=equals.Equality)  # -> ListA, ListB

pts_from_bottomroof = Point(pt_6)

cps_2 = ClosestPoints(Point=brep_cp.Point, Cloud=flatten(pts_from_bottomroof), Count=Slider(100, range=0..100))  # -> ClosestPoint, CPIndex, Distance
treestartpoints = Point(cps_2.ClosestPoint)
project = Project(Geometry=treestartpoints, Plane=PlaneXY(0, 0, 0))  # -> Geometry, Transform

hullpt = ConvexHullPoints(Points=project.Geometry, _3D=False)  # -> ConvexHull, Indices
item_3 = ListItem(List=treestartpoints, Index=hullpt.Indices, Wrap=True)
intcrv_5 = Interpolate(Vertices=item_3, Degree=3, Periodic=True, KnotStyle=1)  # -> Curve, Length, Domain
pline = PolyLine(Vertices=item_3, Closed=True)

avr = Average(Input=item_3)
pdecon_2 = Deconstruct(Point=avr)  # -> XComponent, YComponent, ZComponent
xy_4 = XYPlane(Origin=avr)
move_7 = Move(Geometry=xy_4, Motion=neg_2)  # -> Geometry, Transform
sec_7 = BrepPlane(Brep=brep, Plane=move_7.Geometry)  # -> Curves, Points
crv_9 = Curve(sec_7.Curves)

subtraction_5 = Subtraction(A=pdecon_2.ZComponent, B=pdecon.ZComponent)
division = Division(A=subtraction_5, B=2)
Z_9 = UnitZ(Factor=division)
move_8 = Move(Geometry=move_3.Geometry, Motion=Z_9)  # -> Geometry, Transform
cir_2 = Circle(Plane=move_8.Geometry, Radius=Slider(12, range=1..30, expression="x*100"))

pt_7 = Point(item_3)

lng_5 = ListLength(List=pt_7)
divide_5 = DivideCurve(Curve=crv_8, Count=lng_5, Kinks=False)  # -> reverse(Points), Tangents, Parameters

merge_7 = Merge(Data1=flatten(intcrv_5.Curve), Data2=flatten(cir_2), Data3=flatten(cir))
loft = Loft(Curves=merge_7, Options={Adjust=True, Closed=False, LoftEnds=0, LoftSimp=1, LoftType=0, Rebuild=10, Refit=0.01})

shift = ShiftList(List=pt_7, Shift=Slider(8, range=0..10), Wrap=True)

srf = Surface(loft)
mesh_3 = MeshBrep(
    Brep=srf,
    Settings={GridMaxCount=0, GridMinCount=16, JaggedSeams=False, MaxEdgeLength=0, MinEdgeLength=0.0001, MinTolerance=0, Refine=True, RefineAngle=0, RelativeTolerance=0.65, SimplePlanes=True, Tolerance=0})
panel_6 = Panel(number_slider_6)
triremesh_2 = TriRemesh(Geometry=mesh_3, Sharp=Toggle(True), Features=boundarycurve, Length=panel_6, Iterations=Slider(100, range=0..100))  # -> Triangulation, Dual, Creases

shift_2 = ShiftList(List=divide_5.Points, Shift=Slider(5, range=0..10), Wrap=True)

geodesic = Geodesic(Surface=loft, Start=pt_7, End=shift_2)
geodesic_2 = Geodesic(Surface=loft, Start=shift, End=divide_5.Points)

number_slider_12 = Slider(41, range=0..100)
# Idea01
pipe = Pipe(Curve=[geodesic_2, geodesic], Radius=number_slider_12, Caps=0)

faceb_2 = FaceBoundaries(Mesh=triremesh_2.Triangulation)
preview_5 = CustomPreview(Geometry=faceb_2, Material=ColourSwatch(SwatchColor=RGB(98, 168, 189)))

flip = MeshFlip(Mesh=triremesh_2.Triangulation)
offmsh = OffsetMesh(Mesh=flip, Distance=number_slider_4, BothSides=0, CreateSolid=False)
faceb_3 = FaceBoundaries(Mesh=offmsh)
crv_10 = Curve(faceb_2)
crv_11 = Curve(faceb_3)
explode = Explode(Curve=crv_11, Recursive=True)  # -> Segments, Vertices
explode_2 = Explode(Curve=crv_10, Recursive=True)  # -> Segments, Vertices
crv_12 = Curve(explode.Segments)
crv_13 = Curve(explode_2.Segments)
end = EndPoints(Curve=crv_13)  # -> Start, End
end_2 = EndPoints(Curve=crv_12)  # -> Start, End

disc_3 = Discontinuity(Curve=faceb_2, Level=1)  # -> Points, Parameters
facen = FaceNormals(Mesh=triremesh_2.Triangulation)  # -> Centers, Normals
rev_2 = Reverse(Vector=facen.Normals)
amp = Amplitude(Vector=rev_2, Amplitude=number_slider_4)
move_9 = Move(Geometry=facen.Centers, Motion=amp)  # -> Geometry, Transform
ln_2 = Line(StartPoint=simplify(disc_3.Points), EndPoint=graft(move_9.Geometry))

pipe_2 = Pipe(Curve=[cir, cir_2], Radius=number_slider_12, Caps=0)

number_slider_13 = Slider(90, range=0..1000)
contour = Contour(Shape=srf, Point=Point(0, 0, 0), Direction=Vector(0, 0, 1), Distance=number_slider_13)
division_2 = Division(A=number_slider_13, B=2)
divlength = DivideLength(Curve=contour, Length=Slider(500, range=0..1000))  # -> Points, Tangents, Parameters
box = CenterBox(Base=PlaneXY(0, 0, 0), X=Slider(213, range=0..1000), Y=Slider(283, range=0..1000, expression="x/2"), Z=division_2)
pl = ConstructPlane(Origin=divlength.Points, XAxis=divlength.Tangents, YAxis=Vector(0, 1, 0))
orient = Orient(Geometry=box, Source=PlaneXY(0, 0, 0), Target=pl)  # -> Geometry, Transform
mesh_4 = MeshBrep(
    Brep=orient.Geometry,
    Settings={GridMaxCount=0, GridMinCount=16, JaggedSeams=False, MaxEdgeLength=0, MinEdgeLength=0.0001, MinTolerance=0, Refine=True, RefineAngle=0, RelativeTolerance=0.65, SimplePlanes=True, Tolerance=0})

curvepoint = PointOnCurve(crv_13, parameter=0.55)

curvepoint_2 = PointOnCurve(crv_12, parameter=0.55)
item_4 = ListItem(List=end.Start, Index=0, Wrap=True)  # -> Item, Item1, Item2
item_5 = ListItem(List=curvepoint_2, Index=0, Wrap=True)  # -> Item, Item1, Item2
item_6 = ListItem(List=curvepoint, Index=0, Wrap=True)  # -> Item, Item1, Item2
ln_3 = Line(StartPoint=item_6.Item, EndPoint=item_5.Item1)
ln_4 = Line(StartPoint=item_6.Item1, EndPoint=item_5.Item)
ln_5 = Line(StartPoint=item_6.Item2, EndPoint=item_5.Item2)
merge_8 = Merge(Data1=ln_3, Data2=ln_4, Data3=ln_5)

preview_6 = CustomPreview(Geometry=pipe, Material=ColourSwatch(SwatchColor=RGB(184, 184, 184)))

explode_3 = Explode(Curve=faceb_2, Recursive=True)  # -> Segments, Vertices
cullduplines = RemoveDuplicateLines(InputLines=flatten(explode_3.Segments), Tolerance=0.001)  # -> OutputLines, FirstLineIndexes
pipe_3 = Pipe(Curve=cullduplines.OutputLines, Radius=number_slider_5, Caps=0)

curvepoint_3 = PointOnCurve(crv_12, parameter=0.45)

curvepoint_4 = PointOnCurve(crv_13, parameter=0.45)
item_7 = ListItem(List=end.Start, Index=0, Wrap=True)  # -> Item, Item1, Item2
item_8 = ListItem(List=curvepoint_3, Index=0, Wrap=True)  # -> Item, Item1, Item2
item_9 = ListItem(List=curvepoint_4, Index=0, Wrap=True)  # -> Item, Item1, Item2
ln_6 = Line(StartPoint=item_9.Item, EndPoint=item_8.Item1)
ln_7 = Line(StartPoint=item_9.Item1, EndPoint=item_8.Item)
ln_8 = Line(StartPoint=item_9.Item2, EndPoint=item_8.Item2)
merge_9 = Merge(Data1=ln_6, Data2=ln_7, Data3=ln_8)

curvepoint_5 = PointOnCurve(crv_13, parameter=0.5)
curvepoint_6 = PointOnCurve(crv_12, parameter=0.5)
item_10 = ListItem(List=end.Start, Index=0, Wrap=True)  # -> Item, Item1, Item2
item_11 = ListItem(List=curvepoint_6, Index=0, Wrap=True)  # -> Item, Item1, Item2
item_12 = ListItem(List=curvepoint_5, Index=0, Wrap=True)  # -> Item, Item1, Item2
ln_9 = Line(StartPoint=item_12.Item, EndPoint=item_11.Item1)
ln_10 = Line(StartPoint=item_12.Item1, EndPoint=item_11.Item)
ln_11 = Line(StartPoint=item_12.Item2, EndPoint=item_11.Item2)
merge_10 = Merge(Data1=ln_9, Data2=ln_10, Data3=ln_11)

pipe_4 = Pipe(Curve=ln_2, Radius=number_slider_5, Caps=0)
mesh_5 = MeshBrep(Brep=pipe_4, Settings=jagged)
mesh_6 = MeshBrep(Brep=pipe_3, Settings=jagged_2)

preview_7 = CustomPreview(Geometry=mesh_5, Material=ColourSwatch(SwatchColor=RGB(184, 184, 184)))

preview_8 = CustomPreview(Geometry=mesh_6, Material=ColourSwatch(SwatchColor=RGB(184, 184, 184)))

disc_4 = Discontinuity(Curve=faceb, Level=1)  # -> Points, Parameters

# ----
# Idea04
swatch = ColourSwatch(SwatchColor=RGB(117, 96, 43))
preview_9 = CustomPreview(Geometry=mesh_4, Material=swatch)

merge_11 = Merge(Data1=graft(merge_9), Data2=graft(merge_8))
loft_2 = Loft(Curves=merge_11, Options={Adjust=True, Closed=False, LoftEnds=0, LoftSimp=0, LoftType=3, Rebuild=10, Refit=0.01})  # -> flatten(Loft)
join = BrepJoin(Breps=loft_2)  # -> Breps, Closed
# Idea03
smesh = SimpleMesh(Brep=join.Breps)

ln_12 = Line(StartPoint=simplify(graft(pt_6)), EndPoint=simplify(dispatch.ListB))
len = Length(Curve=ln_12)
bnd = Bounds(Numbers=len)
dedomain = DeconstructDomain(Domain=bnd)  # -> Start, End
sort = SortList(Keys=len, ValuesA=ln_12)  # -> Keys, reverse(ValuesA)
subtraction_6 = Subtraction(A=dedomain.End, B=dedomain.Start)
division_3 = Division(A=panel_5, B=Slider(3.6, range=0..10))
larger = LargerThan(FirstNumber=subtraction_6, SecondNumber=division_3)  # -> LargerThan, OrEqualTo
dispatch_2 = Dispatch(List=sort.ValuesA, DispatchPattern=larger.LargerThan)  # -> ListA, ListB

graft = GraftTree(Tree=meshray.Point, IncludeEmptyLists=True, IncludeNullItems=True)
ln_13 = Line(StartPoint=simplify(disc_4.Points), EndPoint=graft)

boundary = BoundarySurfaces(Edges=faceb)
preview_10 = CustomPreview(Geometry=boundary, Material=ColourSwatch(SwatchColor=RGBA(173, 222, 255, 201)))

offmsh_2 = OffsetMesh(Mesh=smesh, Distance=Slider(1, range=0..30, expression="x*100"), BothSides=0, CreateSolid=True)

preview_11 = CustomPreview(Geometry=offmsh_2, Material=ColourSwatch(SwatchColor=RGB(117, 96, 43)))

crv_14 = Curve(dispatch_2.ListB)
cullduplines_2 = RemoveDuplicateLines(InputLines=flatten(crv_14), Tolerance=0.001)  # -> OutputLines, FirstLineIndexes

explode_4 = Explode(Curve=faceb, Recursive=True)  # -> Segments, Vertices
len_2 = Length(Curve=flatten(explode_4.Segments))
bnd_2 = Bounds(Numbers=len_2)  # -> flatten(Domain)
panel_7 = Panel(len_2)
remap = RemapNumbers(Value=len_2, Source=bnd_2, Target=Domain(0, 1))  # -> Mapped, Clipped
gradient = Gradient(LowerLimit=0, UpperLimit=1, Parameter=remap.Mapped, stops=[0: RGB(0, 128, 0), 0.5: RGB(255, 255, 0), 1: RGB(255, 0, 0)])
bar_graph = BarGraph(panel_7, BarColor=RGB(255, 0, 90))
preview_12 = CustomPreview(Geometry=flatten(explode_4.Segments), Material=gradient)

lng_6 = ListLength(List=flatten(explode_4.Segments))
本数 = Panel(lng_6)

crv_15 = Curve(explode_4.Segments)
crv_16 = Curve(ln_13)
crv_17 = Curve(cullduplines_2.OutputLines)
merge_12 = Merge(Data1=crv_17, Data2=crv_16, Data3=crv_15)  # -> flatten(Result)
pipe_5 = Pipe(Curve=merge_12, Radius=Slider(30, range=0..1000), Caps=0)
preview_13 = CustomPreview(Geometry=pipe_5, Material=ColourSwatch(SwatchColor=RGB(184, 184, 184)))
