# Grasshopper definition 20220607_CreativeTree.gh (Grasshopper 1.0.7)
# plug-ins: MeshEdit Components, Weaverbird

number_slider = Slider(400, range=0..1000)
number_slider_2 = Slider(60, range=0..100)
gallery = ImageGallery(CycleDelay=30, Randomize=False, UseLocalImages=True, UseRemoteImages=True)
mesh = Mesh(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)

pt = Point(Point(-657.2688339, 4223.324039, 0))
pt_2 = Point(Point(-426.3287263, 3570.126774, 0))

mesh_2 = Mesh(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)
pt_3 = Point(Point(-1119.149049, 3570.126774, 0))

pt_4 = Point(Point(-657.2688339, 4223.324039, 0))
pt_5 = Point(Point(-426.3287263, 3570.126774, 0))

pt_6 = Point(Point(-657.2688339, 4223.324039, 0))

rotate = Rotate(Geometry=mesh, Angle=degrees(Slider(180, range=0..180)), Plane=pt)  # -> Geometry, Transform
vec2pt = Vector2Pt(PointA=pt, PointB=pt_2, Unitize=False)  # -> Vector, Length
move = Move(Geometry=rotate.Geometry, Motion=vec2pt.Vector)  # -> Geometry, Transform
merge = Merge(Data1=mesh, Data2=move.Geometry)

sqrt = SquareRoot(Value=Slider(3, range=0..10))

vec2pt_2 = Vector2Pt(PointA=pt_3, PointB=pt_6, Unitize=False)  # -> Vector, Length

rotate_2 = Rotate(Geometry=mesh_2, Angle=degrees(Slider(180, range=0..180)), Plane=pt_4)  # -> Geometry, Transform
vec2pt_3 = Vector2Pt(PointA=pt_4, PointB=pt_5, Unitize=False)  # -> Vector, Length
move_2 = Move(Geometry=rotate_2.Geometry, Motion=vec2pt_3.Vector)  # -> Geometry, Transform
merge_2 = Merge(Data1=mesh_2, Data2=move_2.Geometry)

number_slider_3 = Slider(400, range=0..1000)

multiplication = Multiplication(A=number_slider, B=sqrt)
series = Series(Start=0, Step=multiplication, Count=number_slider_2)
X = UnitX(Factor=series)

sqrt_2 = SquareRoot(Value=Slider(3, range=0..10))

# ----
# Color Format
# Input
data = Data(1)
# Method
data_2 = Data(1)
# Output
data_3 = Data(1)
# Display
data_4 = Data(1)
# Unuse
data_5 = Data(1)

pt_7 = ConstructPoint(XCoordinate=0, YCoordinate=0, ZCoordinate=0)
multiplication_2 = Multiplication(A=number_slider_3, B=sqrt_2)
multiplication_3 = Multiplication(A=number_slider_3, B=Slider(2, range=0..10))
series_2 = Series(Start=0, Step=vec2pt_2.Length, Count=number_slider_2)

move_3 = Move(Geometry=graft(merge), Motion=X)  # -> Geometry, Transform
amp = Amplitude(Vector=vec2pt_2.Vector, Amplitude=series_2)
move_4 = Move(Geometry=flatten(move_3.Geometry), Motion=simplify(graft(amp)))  # -> Geometry, Transform
faceb = FaceBoundaries(Mesh=move_4.Geometry)

X_2 = UnitX(Factor=multiplication_2)

move_5 = Move(Geometry=graft(merge_2), Motion=X)  # -> Geometry, Transform
move_6 = Move(Geometry=flatten(move_5.Geometry), Motion=simplify(graft(amp)))  # -> Geometry, Transform
faceb_2 = FaceBoundaries(Mesh=move_6.Geometry)

expression = Expression(Expression="Format(\"{0}, {1}\", x, y)")
move_7 = Move(Geometry=pt_7, Motion=X_2)  # -> Geometry, Transform
merge_3 = Merge(Data1=multiplication_2, Data2=multiplication_3, Data3=multiplication_2)
cir = Circle(Plane=pt_7, Radius=multiplication_3)
cir_2 = Circle(Plane=move_7.Geometry, Radius=multiplication_2)
ccx = CurveCurve(CurveA=cir_2, CurveB=cir)  # -> Points, ParamsA, ParamsB
rint = RegionIntersection()
item = ListItem(List=ccx.Points, Index=0, Wrap=True)
merge_4 = Merge(Data1=pt_7, Data2=move_7.Geometry, Data3=item)  # -> flatten(Result)
merge_5 = Merge()
pline = PolyLine(Vertices=merge_4, Closed=True)
disc = Discontinuity(Curve=pline, Level=1)  # -> Points, Parameters
edges = BrepEdges(Brep=pline)  # -> Naked, Interior, NonManifold
points = PointList(Points=disc.Points, Size=Slider(100, range=0..100))
len = Length(Curve=edges.Naked)
sph = Sphere(Base=disc.Points, Radius=merge_3)

sqrt_3 = SquareRoot(Value=Slider(2, range=0..10))
multiplication_4 = Multiplication(A=number_slider, B=sqrt_3, C="2")
int = Integer(Slider(11, range=0..100))
series_3 = Series(Start=0, Step=multiplication_4, Count=int)
Z = UnitZ(Factor=series_3)

merge_6 = Merge(Data1=flatten(move_4.Geometry), Data2=flatten(move_6.Geometry))
move_8 = Move(Geometry=merge_6, Motion=graft(Z))  # -> Geometry, Transform

panel = Panel(len)
item_2 = ListItem(List=sph, Index=0, Wrap=True)  # -> Item, Item1, Item2
panel_2 = Panel(multiplication_2)

mesh_3 = Mesh(merge_6)
xy = XYPlane(Origin=Point(0, 0, 0))
mirror = Mirror(Geometry=mesh_3, Plane=xy)  # -> Geometry, Transform
move_9 = Move(Geometry=mirror.Geometry, Motion=graft(Z))  # -> Geometry, Transform

pcen = PolygonCenter(Polyline=pline)  # -> CenterV, CenterE, CenterA
debrep = DeconstructBrep()  # -> Faces, Edges, Vertices
bbx = BrepBrep(BrepA=item_2.Item1, BrepB=item_2.Item2)  # -> Curves, Points
preview = CustomPreview(Geometry=item_2.Item, Material=ColourSwatch(SwatchColor=RGBA(158, 90, 90, 83)))
preview_2 = CustomPreview(Geometry=item_2.Item, Material=ColourSwatch(SwatchColor=RGBA(158, 90, 90, 83)))
preview_3 = CustomPreview(Geometry=item_2.Item2, Material=ColourSwatch(SwatchColor=RGBA(158, 90, 90, 83)))
pt_8 = Point(pcen.CenterE)
bcx = BrepCurve(Brep=item_2.Item, Curve=bbx.Curves)  # -> Curves, Points
item_3 = ListItem(List=disc.Points, Index=0, Wrap=True)  # -> Item, Item1, Item2
item_4 = ListItem(List=bcx.Points, Index=0, Wrap=True)  # -> Item1, Item
pt_9 = Point(item_4.Item)
brep = Brep(<brep referenced from the Rhino model>)
merge_7 = Merge(Data1=flatten(item_3.Item), Data2=flatten(item_3.Item1), Data3=flatten(item_4.Item))
merge_8 = Merge(Data1=flatten(item_3.Item1), Data2=flatten(item_3.Item2), Data3=flatten(item_4.Item))
merge_9 = Merge(Data1=flatten(item_3.Item), Data2=flatten(item_3.Item2), Data3=flatten(item_4.Item))
merge_10 = Merge(Data1=move_9.Geometry, Data2=move_8.Geometry)  # -> flatten(Result)
mesh_4 = Mesh(brep)
sqrt_4 = SquareRoot(Value=Slider(2, range=0..10))
project = Project(Geometry=pt_9, Plane=PlaneXY(0, 0, 0))  # -> Geometry, Transform
Y = UnitY(Factor=Slider(2901, range=0..10000))
X_3 = UnitX(Factor=Slider(51372, range=0..100000))
pline_2 = PolyLine(Vertices=merge_7, Closed=True)
pline_3 = PolyLine(Vertices=merge_8, Closed=True)
pline_4 = PolyLine(Vertices=merge_9, Closed=True)
multiplication_5 = Multiplication(A=number_slider_3, B=sqrt_4)
Z_2 = UnitZ(Factor=multiplication_5)
move_10 = Move(Geometry=pcen.CenterV, Motion=Z_2)  # -> Geometry, Transform
dist = Distance(PointA=pt_9, PointB=project.Geometry)
neg = Negative(Value=X_3)
neg_2 = Negative(Value=Y)
ln = Line()
addition = Addition(A=neg, B=neg_2)
move_11 = Move(Geometry=merge_10, Motion=addition)  # -> Geometry, Transform
area = MeshArea(Mesh=move_11.Geometry)  # -> Area, Centroid
meshcp = MeshClosestPoint(Point=area.Centroid, Mesh=mesh_4)  # -> Point, Index, Parameter
edges_2 = BrepEdges(Brep=pline_2)  # -> Naked, Interior, NonManifold
edges_3 = BrepEdges(Brep=pline_3)  # -> Naked, Interior, NonManifold
edges_4 = BrepEdges(Brep=pline_4)  # -> Naked, Interior, NonManifold
panel_3 = Panel(dist)
panel_4 = Panel(multiplication_5)
dist_2 = Distance(PointA=meshcp.Point, PointB=area.Centroid)
len_2 = Length(Curve=edges_2.Naked)
panel_5 = Panel(len_2)
len_3 = Length(Curve=edges_3.Naked)
panel_6 = Panel(len_3)
len_4 = Length(Curve=edges_4.Naked)
panel_7 = Panel(len_4)
smaller = SmallerThan(FirstNumber=dist_2, SecondNumber=Slider(274, range=0..1000))  # -> SmallerThan, OrEqualTo
extr = ExtrudePoint(Base=pline, Point=pt_9)
dispatch = Dispatch(List=move_11.Geometry, DispatchPattern=smaller.SmallerThan)  # -> ListA, ListB
mesh_5 = Mesh(dispatch.ListA)
wbframe = WeaverbirdsPictureFrame(MeshPolylines=mesh_5, Distance=Slider(10, range=0..100), InsetType=0)
faceb_3 = FaceBoundaries(Mesh=mesh_5)
flipm = FlipMesh(Mesh=wbframe, VertexNormals=True, FaceNormals=True, FaceOrientation=True)
wbthicken = WeaverbirdsMeshThicken(MeshCurves=flipm, Distance=Slider(10, range=0..100), OffsetType=Slider(0, range=0..1))
unweld = UnweldMesh(Mesh=wbthicken, Angle=1.570796327)
preview_4 = CustomPreview(Geometry=wbframe, Material=ColourSwatch(SwatchColor=RGB(161, 131, 80)))
