# Grasshopper definition 221124_DLA_Fin.gh (Grasshopper 1.0.7)
# Copyright: KAJIMA DESIGN
# plug-ins: Bifocals, Kangaroo2 Components, Anemone

gallery = ImageGallery(CycleDelay=30, Randomize=False, UseLocalImages=True, UseRemoteImages=True)
brep = Brep(<brep referenced from the Rhino model>)

pt = Point(Point(-34.67831135, 0, 59.98316971))

xy = XYPlane(Origin=Point(0, 0, 0))
triremesh = TriRemesh(Geometry=brep, Iterations=25)  # -> Triangulation, Dual, Creases
faceb = FaceBoundaries(Mesh=triremesh.Triangulation)
Z = UnitZ(Factor=1)
explode = Explode(Curve=faceb, Recursive=True)  # -> Segments, Vertices

crv = Curve(flatten(explode.Segments))

end = EndPoints(Curve=crv)  # -> Start, End
merge = Merge(Data1=end.Start, Data2=end.End)

project = Project(Geometry=crv, Plane=xy)  # -> Geometry, Transform
divide = DivideCurve(Curve=crv, Count=Slider(3, range=0..10), Kinks=False)  # -> Points, Tangents, Parameters

patch = Patch(Points=merge, Spans=20, Flexibility=1, Trim=True)
mesh = MeshBrep(
    Brep=patch,
    Settings={GridMaxCount=0, GridMinCount=16, JaggedSeams=False, MaxEdgeLength=0, MinEdgeLength=0.0001, MinTolerance=0, Refine=True, RefineAngle=0, RelativeTolerance=0.65, SimplePlanes=True, Tolerance=0})

# ----
# Color Format
# Input
data = Data(1)
# Method
data_2 = Data(1)
# Output
data_3 = Data(1)
# Display
data_4 = Data(1)
# Unuse
data_5 = Data(1)

project_2 = ProjectPoint(Point=pt, Direction=Z, Geometry=mesh)  # -> Point, Index
pt_2 = Point(project_2.Point)

panel = Panel("""1
2""")
item = ListItem(List=divide.Points, Index=panel, Wrap=True)
duppt = RemoveDuplicatePts(Points=flatten(item), Tolerance=0.01)
pt_3 = Point(duppt)

cps = ClosestPoints(Point=pt_2, Cloud=pt_3, Count=Slider(6, range=0..10))  # -> ClosestPoint, CPIndex, Distance
pt_4 = Point(cps.ClosestPoint)
cull_i = CullIndex(List=pt_3, Indices=cps.CPIndex, Wrap=True)
ln = Line(StartPoint=pt_2, EndPoint=pt_4)
crv_2 = Curve(ln)
fastloopstart = FastLoopStart(I=Slider(50, range=0..50), D0=cull_i, D1=crv_2)  # -> port, Counter, Data, Data_2, Data_3
cluster = Cluster_3(
    count=fastloopstart.Counter,
    centerpt=pt_2,
    cloudpts=fastloopstart.Data,
    layer1=fastloopstart.Data_2,
    layer2=fastloopstart.Data_3)  # -> R_3, R, brachedcurvenointersect_layer1_2, brachedcurvenointersect_layer2_4, R_2
fastloopend = FastLoopEnd(
    port=fastloopstart.port,
    Exit=False,
    Data=cluster.R,
    Data_2=cluster.brachedcurvenointersect_layer1_2,
    Data_3=cluster.brachedcurvenointersect_layer2_4,
    RecordData=True,
    TimeOutVal=0)  # -> D0, D1, D2

number_slider = Slider(1200, range=0..10000)
cluster_2 = Cluster_4(crv=fastloopend.D1, B=number_slider)
cluster_3 = Cluster_4(crv=fastloopend.D2, B=number_slider)

crv_3 = Curve(cluster_2)
crv_4 = Curve(cluster_3)
number_slider_2 = Slider(300, range=0..1000)
cluster_4 = Cluster_5(C=crv_4, B=number_slider_2)
cluster_5 = Cluster_5(C=crv_3, B=number_slider_2)
panel_2 = Panel("中心")
cluster_6 = Cluster_6(srf=patch, G=cluster_4, Y=Slider(45, range=0..100), F=Slider(125, range=0..1000))
cluster_7 = Cluster_6(srf=patch, G=cluster_5, Y=Slider(45, range=0..100), F=Slider(75, range=0..100))
mesh_2 = MeshBrep(
    Brep=cluster_7,
    Settings={GridMaxCount=0, GridMinCount=16, JaggedSeams=False, MaxEdgeLength=0, MinEdgeLength=0.0001, MinTolerance=0, Refine=True, RefineAngle=0, RelativeTolerance=0.65, SimplePlanes=True, Tolerance=0})
mesh_3 = MeshBrep(
    Brep=cluster_6,
    Settings={GridMaxCount=0, GridMinCount=16, JaggedSeams=False, MaxEdgeLength=0, MinEdgeLength=0.0001, MinTolerance=0, Refine=True, RefineAngle=0, RelativeTolerance=0.65, SimplePlanes=True, Tolerance=0})
preview = CustomPreview(Geometry=mesh_3, Material=ColourSwatch(SwatchColor=RGBA(128, 109, 93, 107)))
preview_2 = CustomPreview(Geometry=mesh_2, Material=ColourSwatch(SwatchColor=RGBA(93, 128, 120, 107)))

# ==== cluster Cluster_3
allcrvs = ClusterInput()
count = ClusterInput()
centerpt = ClusterInput()
cloudpts = ClusterInput()
layer1 = ClusterInput()
layer2 = ClusterInput()
centerpt_2 = Point(simplify(centerpt))
count_2 = Integer(count)
cloudpts_2 = Point(simplify(cloudpts))
panel = Panel("""0
1""")
allcrvs_2 = Curve(allcrvs)
layer2_2 = Curve(layer2)
layer1_2 = Curve(layer1)
merge = Merge(Data1=layer1_2, Data2=layer2_2)  # -> flatten(Result)
entwine = Entwine(Branch00=layer1_2, Branch01=layer2_2, FlattenInputs=True)
end = EndPoints(Curve=entwine)  # -> Start, End
tstat = TreeStatistics(Tree=end.End)  # -> Paths, Length, Count
dpath = DeconstructPath(Branch=end.End)
dup = DuplicateData(Data=graft(panel), Number=graft(tstat.Length), Order=True)  # -> simplify(Data)
flatten = FlattenTree(Tree=entwine, Path="{0}")
pt = Point(end.End)
flatten_2 = FlattenTree(Tree=dup, Path="{0}")
gradient = Gradient(
    LowerLimit=0,
    UpperLimit=1,
    Parameter=flatten_2,
    stops=[0: RGB(234, 38, 0), 0.25: RGB(234, 126, 0), 0.5: RGB(254, 244, 84), 0.75: RGB(173, 203, 249), 1: RGB(75, 107, 169)])
lastcrvs = Curve(flatten)
flatten_3 = FlattenTree(Tree=lastcrvs, Path="{0}")
pt_2 = Point(flatten(end.End))
preview = CustomPreview(Geometry=flatten_3, Material=gradient)
end_2 = EndPoints(Curve=lastcrvs)  # -> Start, End
mod = Modulus(A=count_2, B=Slider(2, range=0..10))
number_slider = Slider(2, range=0..10)
cps = ClosestPoints(Point=graft(pt), Cloud=cloudpts_2, Count=number_slider)  # -> ClosestPoint, CPIndex, Distance
cset = CreateSet(List=flatten(cps.CPIndex))  # -> Set, Map
pt_3 = Point(simplify(cps.ClosestPoint))
item = ListItem(List=cloudpts_2, Index=cset.Set, Wrap=True)
pt_4 = Point(simplify(end_2.End))
pt_5 = Point(end_2.End)
cp = ClosestPoint(Point=item, Cloud=flatten(end.End))  # -> ClosestPoint, CPIndex, Distance
cps_2 = ClosestPoints(Point=graft(pt_5), Cloud=cloudpts_2, Count=number_slider)  # -> ClosestPoint, CPIndex, Distance
equals = Equality(FirstNumber=mod, SecondNumber=Slider(0, range=0..100))  # -> Equality, Inequality
ln = Line(StartPoint=cp.ClosestPoint, EndPoint=item)
cset_2 = CreateSet(List=flatten(cps_2.CPIndex))  # -> Set, Map
end_3 = EndPoints(Curve=ln)  # -> Start, End
item_2 = ListItem(List=cloudpts_2, Index=cset_2.Set, Wrap=True)
cull_i = CullIndex(List=cloudpts_2, Indices=cset_2.Set, Wrap=True)
pgroups = PointGroups(Points=end_3.Start, Distance=Slider(1, range=0..1))  # -> Groups, Indices
cull_i_2 = CullIndex(List=cloudpts_2, Indices=cset.Set, Wrap=True)
flatten_4 = FlattenTree(Tree=item_2, Path="{0}")
cp_2 = ClosestPoint(Point=item_2, Cloud=pt_4)  # -> ClosestPoint, CPIndex, Distance
pt_6 = Point(cull_i)
ln_2 = Line(StartPoint=cp_2.ClosestPoint, EndPoint=item_2)
split = SplitList(List=pgroups.Indices, Index=Slider(2, range=0..10))  # -> ListA, ListB
lng = ListLength(List=layer1_2)
item_3 = ListItem(List=end_3.Start, Index=split.ListA, Wrap=True)
item_4 = ListItem(List=end_3.End, Index=split.ListA, Wrap=True)
join = JoinCurves(Curves=flatten(ln_2), Preserve=False)
ln_3 = Line(StartPoint=item_3, EndPoint=item_4)
crv = Curve(ln_3)
branchcurves = Curve(simplify(crv))
explode = Explode(Curve=join, Recursive=True)  # -> Segments, Vertices
graft = GraftTree(Tree=join, IncludeEmptyLists=True, IncludeNullItems=True)
end_4 = EndPoints(Curve=ln_3)  # -> Start, End
end_5 = EndPoints(Curve=ln_3)  # -> Start, End
lng_2 = ListLength(List=explode.Vertices)  # -> flatten(Length)
crv_2 = Curve(join)
cp_3 = ClosestPoint(Point=end_5.Start, Cloud=pt_2)  # -> ClosestPoint, CPIndex, Distance
larger = LargerThan(FirstNumber=lng_2, SecondNumber=Slider(2, range=0..10))  # -> LargerThan, OrEqualTo
item_5 = ListItem(List=flatten_2, Index=cp_3.CPIndex, Wrap=True)
dispatch = Dispatch(List=simplify(branchcurves), DispatchPattern=simplify(item_5))  # -> ListA, ListB
cluster = Cluster_2(crv=dispatch.ListB, d2=lastcrvs)  # -> R, pt_2
merge_2 = Merge(Data1=cull_i_2, Data2=cluster.pt_2)  # -> flatten(Result)
cluster_2 = Cluster(crv=dispatch.ListA, d2=lastcrvs)  # -> R, L
branchcurves_2 = Curve(simplify(dispatch.ListA))
brachedcurvenointersect_layer2 = Curve(cluster.R)
brachedcurvenointersect_layer2_2 = Curve(cluster_2.L)
R = ClusterOutput(merge_2)
merge_3 = Merge(Data1=brachedcurvenointersect_layer2_2, Data2=brachedcurvenointersect_layer2)
dispatch_2 = Dispatch(List=crv_2, DispatchPattern=larger.LargerThan)  # -> ListA, ListB
explode_2 = Explode(Curve=dispatch_2.ListA, Recursive=True)  # -> Segments, Vertices
item_6 = ListItem(List=explode_2.Vertices, Index=0, Wrap=True)  # -> Item, Item1, Item2
clean = CleanTree(RemoveNulls=True, RemoveInvalid=True, RemoveEmpty=True, Tree=merge_3)
brachedcurvenointersect_layer1 = Curve(flatten(cluster_2.R))
crv_3 = Curve(dispatch_2.ListB)
panel_2 = Panel(item_5)
ln_4 = Line(StartPoint=item_6.Item1, EndPoint=item_6.Item2)
ln_5 = Line(StartPoint=item_6.Item1, EndPoint=item_6.Item)
brachedcurvenointersect_layer2_3 = Curve(flatten(clean))
merge_4 = Merge(Data1=ln_5, Data2=ln_4)
dispatch_3 = Dispatch(List=graft, DispatchPattern=[True, False])  # -> ListA, ListB
merge_5 = Merge(Data1=brachedcurvenointersect_layer1, Data2=brachedcurvenointersect_layer2_3, Data3=lastcrvs)
len = Length(Curve=merge_4)
explode_3 = Explode(Curve=dispatch_3.ListA, Recursive=True)  # -> Segments, Vertices
brachedcurvenointersect_layer2_4 = ClusterOutput(brachedcurvenointersect_layer2_3)
brachedcurvenointersect_layer1_2 = ClusterOutput(brachedcurvenointersect_layer1)
sort = SortList(Keys=len, ValuesA=merge_4)  # -> Keys, ValuesA
item_7 = ListItem(List=sort.ValuesA, Index=0, Wrap=True)  # -> simplify(Item), Item1
R_2 = ClusterOutput(merge_5)
crv_4 = Curve(item_7.Item)
end_6 = EndPoints(Curve=item_7.Item1)  # -> Start, End
midpt = CurveMiddle(Curve=crv_4)
merge_6 = Merge(Data1=dispatch_3.ListB, Data2=crv_4)  # -> flatten(Result)
pt_7 = Point(end_6.End)
ln_6 = Line(StartPoint=simplify(midpt), EndPoint=simplify(end_6.End))  # -> flatten(Line)
clean_2 = CleanTree(RemoveNulls=True, RemoveInvalid=True, RemoveEmpty=False, Tree=merge_6)
clean_3 = CleanTree(RemoveNulls=True, RemoveInvalid=True, RemoveEmpty=False, Tree=ln_6)
project = Project(Geometry=clean_3, Plane=PlaneXY(0, 0, 0))  # -> Geometry, Transform
project_2 = Project(Plane=PlaneXY(0, 0, 0))  # -> Geometry, Transform
ccx = CurveCurve(CurveA=graft(project.Geometry), CurveB=project_2.Geometry)  # -> Points, ParamsA, ParamsB

pshift = ShiftPaths(Data=ccx.Points, Offset=-1)
lng_3 = ListLength(List=pshift)
smaller = SmallerThan(FirstNumber=lng_3, SecondNumber=Slider(1, range=0..1))  # -> SmallerThan, OrEqualTo
cull = CullPattern(List=graft(clean_3), CullPattern=smaller.SmallerThan)  # -> flatten(List)

crv_5 = Curve(dispatch_2.ListB)
layer1_3 = Curve(clean_2)
cull_2 = CullPattern(List=graft(clean_2), CullPattern=smaller.SmallerThan)  # -> flatten(List)
merge_7 = Merge(Data1=pt_6, Data2=pt_7)  # -> flatten(Result)
merge_8 = Merge(Data1=layer1_3, Data2=crv_5)
filter = StreamFilter(Gate=equals.Equality, Stream1=cull)
filter_2 = StreamFilter(Gate=equals.Equality, Stream1=cull)
entwine_2 = Entwine(Branch00=cull_2, Branch01=filter, Branch02=dispatch_2.ListB, FlattenInputs=True)  # -> flatten(Result)
merge_9 = Merge(Data1=flatten(allcrvs_2), Data2=flatten(entwine_2))  # -> flatten(Result)
filter_3 = StreamFilter(Gate=equals.Equality, Stream0=merge_7, Stream1=pt_6)
filter_4 = StreamFilter(Gate=equals.Equality, Stream0=merge_8, Stream1=merge_8)
layer2_3 = Curve(filter)
merge_10 = Merge()
filter_5 = StreamFilter(Gate=equals.Equality, Stream0=merge_8, Stream1=layer2_3)
layer1_4 = Curve(flatten(filter_4))
layer2_4 = Curve(flatten(filter_5))
allcrv = Curve(merge_9)
R_3 = ClusterOutput(entwine_2)
panel_3 = Panel(clean_3)
panel_4 = Panel(smaller.SmallerThan)

# ==== cluster Cluster_4
crv = ClusterInput()
crv_2 = Curve(crv)
len = Length(Curve=crv_2)
B = ClusterInput()
larger = LargerThan(FirstNumber=len, SecondNumber=B)  # -> LargerThan, OrEqualTo
dispatch = Dispatch(List=crv_2, DispatchPattern=larger.LargerThan)  # -> ListA, ListB
B_2 = ClusterOutput(dispatch.ListB)

# ==== cluster Cluster_5
C = ClusterInput()
B = ClusterInput()

crv = Curve(C)
len = Length(Curve=C)
division = Division(A=len, B=B)
round = Round(Number=division)  # -> Nearest, Floor, Ceiling
multiplication = Multiplication(A=round.Ceiling, B=B)
subtraction = Subtraction(A=multiplication, B=len)
division_2 = Division(A=subtraction, B=2)
ext = ExtendCurve(Curve=crv, Type=0, Start=division_2, End=division_2)

C_2 = ClusterOutput(ext)

# ==== cluster Cluster_6
F = ClusterInput()
G = ClusterInput()

Z = UnitZ(Factor=F)
neg = Negative(Value=Z)
move = Move(Geometry=G, Motion=neg)  # -> Geometry, Transform

srf = ClusterInput()
curvepoint = PointOnCurve(move.Geometry, parameter=0.5)
srf_2 = Surface(srf)
crv = Curve(move.Geometry)
srf_cp = SurfaceClosestPoint(Point=curvepoint, Surface=srf_2)  # -> Point, UVPoint, Distance
evalsrf = EvaluateSurface(Surface=srf_2, Point=srf_cp.UVPoint)  # -> Point, Normal, UDirection, VDirection, Frame
deplane = DeconstructPlane(Plane=evalsrf.Frame)  # -> Origin, XAxis, YAxis, ZAxis
pl = PlaneNormal(Origin=curvepoint, ZAxis=evalsrf.Normal)
pl_2 = ConstructPlane(Origin=curvepoint, XAxis=crv, YAxis=evalsrf.Normal)
len = Length(Curve=crv)
align = AlignPlane(Plane=pl, Direction=crv)  # -> Plane, Angle
Y = ClusterInput()
box = CenterBox(Base=pl_2, X=expr("x/2", len), Y=expr("x/2", Y), Z=expr("x/2", Y))
B = ClusterOutput(box)

# ==== cluster Cluster
crv = ClusterInput()

lng = ListLength(List=crv)  # -> flatten(Length)
crv_2 = Curve(crv)
larger = LargerThan(FirstNumber=lng, SecondNumber=Slider(2, range=0..10))  # -> LargerThan, OrEqualTo
dispatch = Dispatch(List=crv_2, DispatchPattern=simplify(graft(larger.OrEqualTo)))  # -> ListA, ListB

two = Curve(dispatch.ListA)
one = Curve(dispatch.ListB)

len = Length(Curve=two)
sort = SortList(Keys=len, ValuesA=two)  # -> Keys, ValuesA
item = ListItem(List=sort.ValuesA, Index=0, Wrap=True)  # -> simplify(Item), Item1

crv_3 = Curve(item.Item)
end = EndPoints(Curve=item.Item1)  # -> Start, End
curvepoint = PointOnCurve(item.Item, parameter=0.25)
midpt = CurveMiddle(Curve=crv_3)
ln = Line(StartPoint=simplify(midpt), EndPoint=simplify(end.End))  # -> flatten(Line)
d2 = ClusterInput()
merge = Merge(Data1=one, Data2=d2)  # -> flatten(Result)
clean = CleanTree(RemoveNulls=True, RemoveInvalid=True, RemoveEmpty=False, Tree=ln)
project = Project(Geometry=clean, Plane=PlaneXY(0, 0, 0))  # -> Geometry, Transform
project_2 = Project(Geometry=merge, Plane=PlaneXY(0, 0, 0))  # -> Geometry, Transform
ccx = CurveCurve(CurveA=graft(project.Geometry), CurveB=project_2.Geometry)  # -> Points, ParamsA, ParamsB
brachedcurve = Curve(clean)
brachedcurve_2 = Curve(crv_3)

pshift = ShiftPaths(Data=ccx.Points, Offset=-1)
lng_2 = ListLength(List=pshift)
smaller = SmallerThan(FirstNumber=lng_2, SecondNumber=Slider(1, range=0..1))  # -> SmallerThan, OrEqualTo
cull = CullPattern(List=graft(brachedcurve), CullPattern=smaller.SmallerThan)  # -> flatten(List)

cull_2 = CullPattern(List=graft(brachedcurve_2), CullPattern=smaller.SmallerThan)  # -> flatten(List)
merge_2 = Merge(Data1=cull_2, Data2=one)
L = ClusterOutput(cull)
R = ClusterOutput(merge_2)

# ==== cluster Cluster_2
crv = ClusterInput()
lng = ListLength(List=crv)  # -> flatten(Length)

crv_2 = Curve(crv)
larger = LargerThan(FirstNumber=lng, SecondNumber=Slider(2, range=0..10))  # -> LargerThan, OrEqualTo
dispatch = Dispatch(List=crv_2, DispatchPattern=simplify(graft(larger.OrEqualTo)))  # -> ListA, ListB

two = Curve(dispatch.ListA)
one = Curve(dispatch.ListB)
join = JoinCurves(Curves=two, Preserve=False)

explode = Explode(Curve=join, Recursive=True)  # -> Segments, Vertices
item = ListItem(List=explode.Vertices, Index=0, Wrap=True)  # -> Item, Item1, Item2
ln = Line(StartPoint=item.Item1, EndPoint=item.Item2)
ln_2 = Line(StartPoint=item.Item1, EndPoint=item.Item)
merge = Merge(Data1=ln_2, Data2=ln)
len = Length(Curve=merge)
sort = SortList(Keys=len, ValuesA=merge)  # -> Keys, ValuesA
item_2 = ListItem(List=sort.ValuesA, Index=0, Wrap=True)  # -> simplify(Item), Item1

crv_3 = Curve(item_2.Item)
end = EndPoints(Curve=item_2.Item1)  # -> Start, End
brachedcurve = Curve(item_2.Item)
d2 = ClusterInput()
merge_2 = Merge(Data1=one, Data2=d2)  # -> flatten(Result)
project = Project(Geometry=brachedcurve, Plane=PlaneXY(0, 0, 0))  # -> Geometry, Transform
project_2 = Project(Geometry=merge_2, Plane=PlaneXY(0, 0, 0))  # -> Geometry, Transform
ccx = CurveCurve(CurveA=graft(project.Geometry), CurveB=project_2.Geometry)  # -> Points, ParamsA, ParamsB
pt = Point(flatten(end.End))
pt_2 = ClusterOutput(pt)

pshift = ShiftPaths(Data=ccx.Points, Offset=-1)
lng_2 = ListLength(List=pshift)

panel = Panel(lng_2)
smaller = SmallerThan(FirstNumber=lng_2, SecondNumber=Slider(1, range=0..1))  # -> SmallerThan, OrEqualTo

cull = CullPattern(List=graft(brachedcurve), CullPattern=smaller.OrEqualTo)  # -> flatten(List)

merge_3 = Merge(Data1=cull, Data2=one)
R = ClusterOutput(merge_3)
