# Grasshopper definition RandomUnitVector.gh (Grasshopper 1.0.7)
# plug-ins: Bifocals

gallery = ImageGallery(CycleDelay=30, Randomize=False, UseLocalImages=True, UseRemoteImages=True)
panel = Panel("phi")
number_slider = Slider(12, range=0..100)
number_slider_2 = Slider(12, range=0..100)
pi = Pi(Factor=Slider(0.3, range=0..1))
panel_3 = Panel("theta")
pi_2 = Pi(Factor=Slider(0.3, range=0..1))
number_slider_3 = Slider(0, range=0..100)
number_slider_4 = Slider(0, range=0..100)
pi_3 = Pi(Factor=Slider(2, range=0..2))
dom = ConstructDomain(DomainStart=Slider(0, range=0..100), DomainEnd=pi)
pi_4 = Pi(Factor=Slider(2, range=0..2))
dom_2 = ConstructDomain(DomainStart=Slider(0, range=0..100), DomainEnd=pi_2)
dom_3 = ConstructDomain(DomainStart=0, DomainEnd=pi_3)
phi = Number(dom)
dom_4 = ConstructDomain(DomainStart=0, DomainEnd=pi_4)
phi_2 = Number(dom_2)
range = Range(Domain=phi, Steps=number_slider)
theta = Number(dom_3)
range_2 = Range(Domain=phi_2, Steps=number_slider_2)
theta_2 = Number(dom_4)
range_3 = Range(Domain=theta, Steps=number_slider)
range_4 = Range(Domain=theta_2, Steps=number_slider_2)

# ----
# Color Format
# Input
data = Data(1)
# Method
data_2 = Data(1)
# Output
data_3 = Data(1)
# Display
data_4 = Data(1)
# Unuse
data_5 = Data(1)

crossref = CrossReference(ListA=range_3, ListB=range, CrossMode=1)  # -> ListA, ListB
crossref_2 = CrossReference(ListA=range_4, ListB=range_2, CrossMode=1)  # -> ListA, ListB
sin = Sine(Value=crossref.ListA)
cos = Cosine(Value=crossref.ListB)
cos_2 = Cosine(Value=crossref.ListA)
sin_2 = Sine(Value=crossref.ListB)
sin_3 = Sine(Value=crossref_2.ListA)
cos_3 = Cosine(Value=crossref_2.ListA)
sin_4 = Sine(Value=crossref_2.ListB)
cos_4 = Cosine(Value=crossref_2.ListB)
expression = Expression(a=range, b=range_3, Expression="Sin(a)*Cos(b)")
expression_2 = Expression(a=range_2, b=range_4, Expression="Sin(a)*Cos(b)")
multiplication = Multiplication(A=sin_2, B=cos_2)
multiplication_2 = Multiplication(A=sin_2, B=sin)
multiplication_3 = Multiplication(A=sin_4, B=cos_3)
multiplication_4 = Multiplication(A=sin_4, B=sin_3)
panel_5 = Panel(multiplication)
panel_6 = Panel(multiplication_3)
vec = VectorXYZ(XComponent=multiplication, YComponent=multiplication_2, ZComponent=cos)  # -> Vector, Length
pt = ConstructPoint(XCoordinate=multiplication, YCoordinate=multiplication_2, ZCoordinate=cos)
vec_2 = VectorXYZ(XComponent=multiplication_3, YComponent=cos_4, ZComponent=multiplication_4)  # -> Vector, Length
pt_2 = ConstructPoint(XCoordinate=0, YCoordinate=0, ZCoordinate=0)
pt_3 = ConstructPoint(XCoordinate=multiplication_3, YCoordinate=cos_4, ZCoordinate=multiplication_4)
pt_4 = ConstructPoint(XCoordinate=0, YCoordinate=0, ZCoordinate=0)
vdis = VectorDisplay(Anchor=pt_2, Vector=vec.Vector)
vdis_2 = VectorDisplay(Anchor=pt_4, Vector=vec_2.Vector)
panel_7 = Panel(pt)
line = LineSDL(Direction=Vector(0, 0, 1), Length=1)
panel_8 = Panel(pt_3)
line_2 = LineSDL(Direction=Vector(0, 0, 1), Length=1)
