# Grasshopper definition DeskParametric.gh (Grasshopper 1.0.7)
# plug-ins: Bifocals

gallery = ImageGallery(CycleDelay=30, Randomize=False, UseLocalImages=True, UseRemoteImages=True)

pt = Point(<point referenced from the Rhino model>)

height = Slider(705, range=500..1000)
width = Slider(958, range=0..1000)
depth = Slider(716, range=0..1000)
thickness = Slider(24, range=0..1000)
back_height = Slider(400, range=100..400)

num = Number(height)
num_2 = Number(width)
num_3 = Number(depth)
num_4 = Number(thickness)
num_5 = Number(back_height)

panel = Panel("2")

division = Division(A=num_5, B="2")

division_2 = Division(A=num_4, B="2")

division_3 = Division(A=num_2, B="2")

division_4 = Division(A=num_3, B="2")

# ----
# Color Format
# Input
data = Data(1)
# Method
data_2 = Data(1)
# Output
data_3 = Data(1)
# Display
data_4 = Data(1)
# Unuse
data_5 = Data(1)

pdecon = Deconstruct(Point=pt)  # -> XComponent, YComponent, ZComponent
division_5 = Division(A=num, B="2")
addition = Addition(A=pdecon.XComponent, B=division_3)
subtraction = Subtraction(A=addition, B=division_2)
pt_2 = ConstructPoint(XCoordinate=subtraction, YCoordinate=pdecon.YComponent, ZCoordinate=division_5)
yz = YZPlane(Origin=pt_2)

pdecon_2 = Deconstruct(Point=pt)  # -> XComponent, YComponent, ZComponent
subtraction_2 = Subtraction(A=num, B=division)
addition_2 = Addition(A=pdecon_2.YComponent, B=division_4)
subtraction_3 = Subtraction(A=addition_2, B=division_2)
subtraction_4 = Subtraction(A=subtraction_2, B=division_2)
pt_3 = ConstructPoint(XCoordinate=pdecon_2.XComponent, YCoordinate=subtraction_3, ZCoordinate=subtraction_4)

pdecon_3 = Deconstruct(Point=pt)  # -> XComponent, YComponent, ZComponent
pt_4 = ConstructPoint(XCoordinate=pdecon_3.XComponent, YCoordinate=pdecon_3.YComponent, ZCoordinate=num)
xy = XYPlane(Origin=pt_4)

division_6 = Division(A=num, B="2")
subtraction_5 = Subtraction(A=division_6, B=division_2)

box = CenterBox(Base=xy, X=division_3, Y=division_4, Z=division_2)

subtraction_6 = Subtraction(A=division_3, B=division_2)
box_2 = CenterBox(Base=pt_3, X=subtraction_6, Y=division_2, Z=division)

box_3 = CenterBox(Base=yz, X=division_4, Y=subtraction_5, Z=division_2)

yz_2 = YZPlane(Origin=Point(0, 0, 0))
mirror = Mirror(Geometry=box_3, Plane=yz_2)  # -> Geometry, Transform

merge = Merge(Data1=box, Data2=mirror.Geometry, Data3=box_3, Data4=box_2)
preview = CustomPreview(Geometry=merge, Material=ColourSwatch(SwatchColor=RGB(168, 153, 103)))
