# Grasshopper definition Class08_GA_Lecture.gh (Grasshopper 1.0.7)
# plug-ins: Bifocals

gallery = ImageGallery(CycleDelay=30, Randomize=False, UseLocalImages=True, UseRemoteImages=True)

number_slider = Slider(10, range=0..10)
sqgrid = Square(Plane=PlaneXY(0, 0, 0), Size=Slider(100, range=0..100), ExtentX=number_slider, ExtentY=number_slider)  # -> Cells, Points
pt = Point(flatten(sqgrid.Points))

number_slider_2 = Slider(100, range=0..100)
neg = Negative(Value=number_slider_2)
dom = ConstructDomain(DomainStart=neg, DomainEnd=number_slider_2)

# ----
# Color Format
# Input
data = Data(1)
# Method
data_2 = Data(1)
# Output
data_3 = Data(1)
# Display
data_4 = Data(1)
# Unuse
data_5 = Data(1)

lng = ListLength(List=pt)
Z = UnitZ(Factor=1)
random = Random(Range=dom, Number=lng, Seed=Slider(513, range=0..1000))
amp = Amplitude(Vector=Z, Amplitude=random)

# ---- group: Make Surface
move = Move(Geometry=pt, Motion=amp)  # -> Geometry, Transform
srfgrid = SurfaceFromPoints(Points=move.Geometry, UCount=expr("x+1", number_slider), Interpolate=False)

# ----
cp = ControlPoints(Curve=srfgrid)  # -> Points, Weights, Knots
project = Project(Geometry=cp.Points, Plane=PlaneXY(0, 0, 0))  # -> Geometry, Transform
vec2pt = Vector2Pt(PointA=cp.Points, PointB=project.Geometry, Unitize=False)  # -> Vector, Length

pdeform = PointDeform(Geometry=srfgrid, Points=cp.Points, Motion=vec2pt.Vector)

number_slider_3 = Slider(20, range=0..100)
sdivide = DivideSurface(Surface=pdeform, UCount=number_slider_3, VCount=number_slider_3)  # -> Points, Normals, Parameters

flip = FlipMatrix(Data=sdivide.Points)
pline = PolyLine(Vertices=sdivide.Points, Closed=False)
pline_2 = PolyLine(Vertices=flip, Closed=False)
