# Grasshopper definition Class08_GA_SearchSite.gh (Grasshopper 1.0.7)

gallery = ImageGallery(CycleDelay=30, Randomize=False, UseLocalImages=True, UseRemoteImages=True)
# ステップ１ 建物の外郭をパラメトリックに決定する
panel = Panel("")
panel_2 = Panel("ガラパゴスを使う際の探索するパラメータを設定する")

# ---- group: Site
crv = Curve(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)

# ----
genes = GenePool(Decimals=2, Maximum=0.3, Minimum=-0.3, Value=[0.3, 0.1, 0.25, -0.01, 0.1, -0.15])

number_slider = Slider(750913, range=0..1000000)
pop2d = Populate2D(Region=crv, Count=Slider(3, range=0..10), Seed=number_slider)

partition = PartitionList(List=genes, Size=Slider(2, range=0..10))
boundary = BoundarySurfaces(Edges=crv)
item = ListItem(List=partition, Index=0, Wrap=True)  # -> Item, Item1
srf_cp = SurfaceClosestPoint(Point=pop2d, Surface=reparameterize(boundary))  # -> Point, UVPoint, Distance
pt = ConstructPoint(XCoordinate=item.Item, YCoordinate=item.Item1, ZCoordinate=0)
vec = VectorXYZ(XComponent=item.Item, YComponent=item.Item1, ZComponent=0)  # -> Vector, Length
move = Move(Geometry=srf_cp.UVPoint, Motion=flatten(vec.Vector))  # -> Geometry, Transform
evalsrf = EvaluateSurface(Surface=reparameterize(boundary), Point=move.Geometry)  # -> Point, Normal, UDirection, VDirection, Frame

area = Area(Geometry=crv)  # -> Area, Centroid
# ステップ１.1
# 各棟のアウトライン分割
scale = Scale(Geometry=crv, Center=area.Centroid, Factor=1.5)  # -> Geometry, Transform
voronoi = Voronoi(Points=evalsrf.Point, Boundary=scale.Geometry, BruteForceOverride=False)
rint = RegionIntersection(CurvesA=crv, CurvesB=graft(voronoi))  # -> flatten(Result)

# ----
# Color Format
# Input
data = Data(1)
# Method
data_2 = Data(1)
# Output
data_3 = Data(1)
# Display
data_4 = Data(1)
# Unuse
data_5 = Data(1)

# ---- group: boundary
敷地の分割 = Curve(rint)

# ----
preview = CustomPreview(Geometry=敷地の分割, Material=ColourSwatch(SwatchColor=RGB(141, 186, 142)))
area_2 = Area(Geometry=敷地の分割)  # -> Area, Centroid
num = Number(area_2.Area)
division = Division(A=num, B=1000000)
panel_4 = Panel(area_2.Area)
round = Round(Number=division)  # -> Nearest, Floor, Ceiling
panel_5 = Panel(round.Nearest)
galapagos = Galapagos(fitness=num_3, gene=[genes, number_slider])

num_2 = Number(area_2.Area)
avr = Average(Input=flatten(area_2.Area))
subtraction = Subtraction(A=num_2, B=avr)

abs = Absolute(Value=subtraction)

ma = MassAddition(Input=abs)  # -> Result, PartialResults
num_3 = Number(ma.Result)

panel_6 = Panel(subtraction)
panel_7 = Panel(num_3)
