# Grasshopper definition Class09_SimpleDayLight.gh (Grasshopper 1.0.7)

panel = Panel("""白色系
0.6、0.7とか
暗色
0.3とか、
高反射塗料
があるものは載っていたりする
0.8とか
灰色0.5とか""")
gallery = ImageGallery(CycleDelay=30, Randomize=False, UseLocalImages=True, UseRemoteImages=True)

# ----
# Reflectance of Surroundings
ref = Slider(0.2, range=0..1)

# ----
# Reflectance of Others
ref_2 = Slider(0.5, range=0..1)

# ----
# Reflectance of Floor
ref_3 = Slider(0.2, range=0..1)

# ----
# Reflectance of Ceiling
ref_4 = Slider(0.7, range=0..1)

column = Brep([<brep referenced from the Rhino model> x3])
ground = Brep(<brep referenced from the Rhino model>)
radopaquematerial = Honeybee_RadianceOpaqueMaterial(materialName="Others", RReflectance=ref_2, GReflectance=ref_2, BReflectance=ref_2, roughness=0.05, specularity=0)  # -> avrgRef, RADMaterial; plug-in component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
radopaquematerial_2 = Honeybee_RadianceOpaqueMaterial(materialName="Surroundings", RReflectance=ref, GReflectance=ref, BReflectance=ref, roughness=0.05, specularity=0)  # -> avrgRef, RADMaterial; plug-in component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
panel_2 = Panel(radopaquematerial_2.avrgRef)
panel_3 = Panel(radopaquematerial.avrgRef)
createhbsrfs = Honeybee_createHBSrfs(geometry=ground, srfName="Surroundings", srfType="6", RADMaterial=radopaquematerial_2.RADMaterial)  # -> readMe, simplify(HBSurface); plug-in component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
createhbsrfs_2 = Honeybee_createHBSrfs(geometry=column, srfName="Others", srfType="6", RADMaterial=radopaquematerial.RADMaterial)  # -> readMe, simplify(HBSurface); plug-in component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

ladybug = Ladybug_Ladybug()  # -> Vviiiiiiiiiizzz; plug-in component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
honeybee = Honeybee_Honeybee()  # -> Vviiiiiiiiiizzz; plug-in component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
panel_4 = Panel(honeybee)

# ----
# Reflectance of Wall
ref_5 = Slider(0.5, range=0..1)

# ----
# Model's Material Data
panel_5 = Panel("Floor")
walls = Geometry(<brep referenced from the Rhino model>)
ceiling = Surface(<surface referenced from the Rhino model>)
floor = Surface(<surface referenced from the Rhino model>)
radopaquematerial_3 = Honeybee_RadianceOpaqueMaterial(materialName=panel_5, RReflectance=ref_3, GReflectance=ref_3, BReflectance=ref_3, roughness=0.05, specularity=0)  # -> avrgRef, RADMaterial; plug-in component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
radopaquematerial_4 = Honeybee_RadianceOpaqueMaterial(materialName="Ceiling", RReflectance=ref_4, GReflectance=ref_4, BReflectance=ref_4, roughness=0.05, specularity=0)  # -> avrgRef, RADMaterial; plug-in component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
radopaquematerial_5 = Honeybee_RadianceOpaqueMaterial(materialName="Wall", RReflectance=ref_5, GReflectance=ref_5, BReflectance=ref_5, roughness=0.05, specularity=0)  # -> avrgRef, RADMaterial; plug-in component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
panel_6 = Panel(radopaquematerial_3.avrgRef)
panel_7 = Panel(radopaquematerial_4.avrgRef)
panel_8 = Panel(radopaquematerial_5.avrgRef)
createhbsrfs_3 = Honeybee_createHBSrfs(geometry=floor, srfName=panel_5, srfType="2", RADMaterial=radopaquematerial_3.RADMaterial)  # -> readMe, simplify(HBSurface); plug-in component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
createhbsrfs_4 = Honeybee_createHBSrfs(geometry=ceiling, srfName="Ceiling", srfType="3", RADMaterial=radopaquematerial_4.RADMaterial)  # -> readMe, simplify(HBSurface); plug-in component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
createhbsrfs_5 = Honeybee_createHBSrfs(geometry=walls, srfName="Wall", srfType="0", RADMaterial=radopaquematerial_5.RADMaterial)  # -> readMe, simplify(HBSurface); plug-in component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

# ----
# Color Format
# Input
data = Data(1)
# Method
data_2 = Data(1)
# Output
data_3 = Data(1)
# Display
data_4 = Data(1)
# Unuse
data_5 = Data(1)

merge = Merge(Data1=createhbsrfs_3.HBSurface, Data2=createhbsrfs_4.HBSurface, Data3=createhbsrfs_5.HBSurface)

# ----
# Transmittance of Window
trans = Slider(0.7, range=0..1)

# ----
# Window's Material Data
panel_9 = Panel("Window")
radglassmaterial = Honeybee_RadianceGlassMaterial(materialName=panel_9, RTransmittance=trans, GTransmittance=trans, BTransmittance=trans, refractiveIndex=1.52)  # -> avrgTrans, RADMaterial; plug-in component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
windows = Geometry([<brep referenced from the Rhino model> x2])
addhbglz = Honeybee_addHBGlz(HBObj=merge, childSurfaces=flatten(windows), RADMaterials=radglassmaterial.RADMaterial)  # -> HBObjWGLZ; plug-in component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
wires = BrepWireframe(Brep=addhbglz, Density=-1)

crv = Curve(<curve referenced from the Rhino model>)

# ----
# Generating Test Mesh
number_slider = Slider(600, range=0..1000)
gentestpts = Honeybee_GenerateTestPoints(testGeometry=floor, gridSize=number_slider, distBaseSrf=Slider(750, range=0..1000), moveTestMesh=True)  # -> readMe, simplify(testPoints), simplify(ptsVectors), simplify(facesArea), simplify(mesh); plug-in component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

# ----
# Date of Analysis
number_slider_2 = Slider(12, range=1..12)

# ----
# Generating Sky Model (Illuminance)
path = FilePath("C:\Users\ykish\OneDrive\デスクトップ\DDK_20210315\JPN_TK_Tokyo.476620_JGMY.epw")
panel_10 = Panel(path)
genstandardciesky = Honeybee_GenerateStandardCIESky(
    north=crv,
    weatherFile=path,
    month=number_slider_2,
    day=Slider(19, range=1..31),
    hour=Slider(15, range=1..24),
    skyType=Slider(0, range=0..5))  # -> skyFilePath; plug-in component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

# ----
# Illuminance Analysis
number_slider_3 = Slider(0, range=0..2)
gridbasedsimulation = Honeybee_GridBasedSimulation(
    skyFile=genstandardciesky,
    testPoints=gentestpts.testPoints,
    ptsVectors=gentestpts.ptsVectors,
    testMesh=gentestpts.mesh,
    simulationType=number_slider_3)  # -> analysisRecipe; plug-in component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

merge_2 = Merge(Data1=addhbglz, Data2=createhbsrfs_2.HBSurface, Data3=createhbsrfs.HBSurface)

# ----
# Run Simulation (Illuminance)
panel_11 = Panel("C:\Users\ykish\test")
rundaylightanalysis = Honeybee_RunDaylightSimulation(
    HBObjects=flatten(merge_2),
    analysisRecipe=gridbasedsimulation,
    writeRad=Toggle(True),
    runRad=Toggle(True),
    numOfCPUs=Slider(4, range=0..24),
    workingDir=panel_11,
    overwriteResults=True)  # -> readMe, analysisType, resultsUnit, illuminance_values, testPts, illuminance_files, radGeoFile, studyFolder, done; plug-in component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

# ----
# Visualization
panel_12 = Panel("750ほしい、1000は大きい")
readradresults = Honeybee_ReadRADResult(
    analysisType=rundaylightanalysis.analysisType,
    resultFiles=rundaylightanalysis.illuminance_files,
    testPts=rundaylightanalysis.testPts,
    writeToFile=False)  # -> readMe, unit, values; plug-in component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
legendpar = Ladybug_LegendParameters(highBound=Slider(750, range=0..1000))  # -> legendPar; plug-in component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
recolormesh = Ladybug_RecolorMesh(
    analysisResult=readradresults.values,
    inputMesh=gentestpts.mesh,
    legendPar=legendpar,
    analysisTitle="DDK TrainingRoom",
    legendTitle=readradresults.unit)  # -> readMe, newMesh, newLegend, legendBasePt, meshColors, legendColors; plug-in component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

panel_13 = Panel(rundaylightanalysis.resultsUnit)
panel_14 = Panel(rundaylightanalysis.readMe)
panel_15 = Panel(rundaylightanalysis.illuminance_values)
