# Grasshopper definition Class1-1.gh (Grasshopper 1.0.7)
# plug-ins: Bifocals

# Class1-1
gallery = ImageGallery(CycleDelay=30, Randomize=False, UseLocalImages=True, UseRemoteImages=True)

# ----
# 3.コンポーネントの表示方法
number_slider = Slider(0.25, range=0..1)
list = ValueList({"One": 1, "Two": 2, "Three": 2² - 1, "Four": Sqrt(16)}, selected="One")
graph = GraphMapper(x0=0, x1=1, y0=0, y1=1, amplitude=0.3, container_name="Perlin", decay=0.3, frequency=0.1, x_offset=0.5, y_offset=0.5)
md_slider = MDSlider(SliderMode=0, slider_value=Point(0.5, 0.5, 0.5), x_domain=Domain(0, 1), y_domain=Domain(0, 1), z_domain=Domain(0, 1))
toggle = BooleanToggle(False)

# ----
# 4.ワイヤの表示
number_slider_2 = Slider(0.25, range=0..1)

panelの名前 = Panel("""0.35
0.14
0.10""")
num = Number(panelの名前)
txt = Text(panelの名前)

panel = Panel("""0.35
0.14
0.10""")
num_2 = Number(panel)
txt_2 = Text(panel)

# ----
# 8.グループ
number_slider_3 = Slider(0.25, range=0..1)
sph = Sphere(Base=PlaneXY(0, 0, 0), Radius=number_slider_3)

panel_2 = Panel("""0.35
0.14
0.10""")
num_3 = Number(panel_2)
txt_3 = Text(panel_2)

sph_2 = Sphere(Base=PlaneXY(0, 0, 0), Radius=Slider(0.25, range=0..1))

sph_3 = Sphere(Base=PlaneXY(0, 0, 0), Radius=Slider(0.25, range=0..1))

# ----
# 1.コンポーネントを繋ぎパラメータを動かす
number_slider_4 = Slider(0.25, range=0..1)
# 2.コンポーネントの種類
number_slider_5 = Slider(0.25, range=0..1)

# ----
# 5.スライダーの使い方
number_slider_6 = Slider(0.25, range=0..1)
# 6.Panelの使い方
スライダーの名前 = Slider(0.25, range=0..1)
number_slider_7 = Slider(5, range=0..10)

# ----
# 2.1.ジオメトリパラメータ
pt = Point()
# 2.2.インプットパラメータ
int = Integer()
vec = Vector()
num_4 = Number()
crv = Curve()
txt_4 = Text()
srf = Surface()
line = Line()
geo = Geometry()

# ----
# 7.MD Sliderの使い方
md_slider_2 = MDSlider(SliderMode=0, slider_value=Point(0.5, 0.5, 0.5), x_domain=Domain(0, 1), y_domain=Domain(0, 1), z_domain=Domain(0, 1))

# ----
# 3.3.ズームアップコンポーネントUI
addition = Addition()
addition_2 = Addition()
addition_3 = Addition()

# ----
# 7.1.グリッド上に配列したSphereの大きさを
#       ある点（アトラクター）からの距離に応じて変化させる
number_slider_8 = Slider(3, range=1..10)
number_slider_9 = Slider(10, range=1..10)
md_slider_3 = MDSlider(SliderMode=0, slider_value=Point(0.5, 0.5, 0.5), x_domain=Domain(0, 1), y_domain=Domain(0, 1), z_domain=Domain(0, 1))

# ----
# 3.1.アイコン表示とコンポーネント名表示
sph_4 = Sphere(Base=PlaneXY(0, 0, 0), Radius=1)
sph_5 = Sphere(Base=PlaneXY(0, 0, 0), Radius=1)

pt_2 = ConstructPoint(XCoordinate=0, YCoordinate=0, ZCoordinate=0)

# ----
# 3.2.コンポーネントの色
# 無効にしている
sph_6 = Sphere(Base=PlaneXY(0, 0, 0), Radius=1)  # disabled

box = CenterBox(Base=PlaneXY(0, 0, 0), X=1, Y=1, Z=1)
box_2 = CenterBox(Base=PlaneXY(0, 0, 0), X=1, Y=1, Z=1)
box_3 = Box2Pt(Plane=PlaneXY(0, 0, 0))
box_4 = Box2Pt(Plane=PlaneXY(0, 0, 0))
circle = CircleCNR(Normal=Vector(0, 0, 1), Radius=1)
circle_2 = CircleCNR(Normal=Vector(0, 0, 1), Radius=1)
circle_3 = Circle3Pt()  # -> Circle, Plane, Radius
circle_4 = Circle3Pt()  # -> Circle, Plane, Radius

# ----
# 警告が出ている
loft = Loft(Curves=pt_2, Options={Adjust=False, Closed=False, LoftEnds=0, LoftSimp=0, LoftType=0, Rebuild=10, Refit=0.01})

sph_7 = Sphere(Base=PlaneXY(0, 0, 0), Radius=Slider(0.25, range=0..1))

sph_8 = Sphere(Base=PlaneXY(0, 0, 0), Radius=Slider(0.25, range=0..1))

sph_9 = Sphere(Base=PlaneXY(0, 0, 0), Radius=Slider(0.25, range=0..1))

# ----
# Hidden
sph_10 = Sphere(Base=PlaneXY(0, 0, 0), Radius=Slider(0.25, range=0..1))

# ----
# Default
sph_11 = Sphere(Base=PlaneXY(0, 0, 0), Radius=number_slider_2)

# ----
# Faint
sph_12 = Sphere(Base=PlaneXY(0, 0, 0), Radius=Slider(0.25, range=0..1))

sph_13 = Sphere(Base=PlaneXY(0, 0, 0), Radius=1)

sph_14 = Sphere(Base=PlaneXY(0, 0, 0), Radius=number_slider_5)

# ----
# 非表示にしている
sph_15 = Sphere(Base=PlaneXY(0, 0, 0), Radius=1)

# ----
# グリッドをつくる
recgrid = Rectangular(Plane=PlaneXY(0, 0, 0), SizeX=number_slider_8, SizeY=number_slider_8, ExtentX=number_slider_9, ExtentY=number_slider_9)  # -> Cells, Points

md_slider_4 = MDSlider(
    SliderMode=0,
    slider_value=Point(0.368437046, 0.5169737281, 0.5),
    x_domain=Domain(0, 1),
    y_domain=Domain(0, 1),
    z_domain=Domain(0, 1))

# ----
# アトラクターをつくる
multiplication = Multiplication(A=number_slider_8, B=number_slider_9)
multiplication_2 = Multiplication(A=multiplication, B=md_slider_3)
pt_3 = Point(multiplication_2)

panel_3 = Panel("""0.35
0.14
0.10""")
num_5 = Number(panel_3)
txt_5 = Text(panel_3)

panel_4 = Panel("""0.35
0.14
0.10""")
num_6 = Number(panel_4)
txt_6 = Text(panel_4)

panel_5 = Panel(sph_9)
panel_6 = Panel(sph_8)
panel_7 = Panel(sph_7)

# ----
# エラーが出ている
line_2 = LineSDL(Direction=Vector(0, 0, 1), Length=1)

sph_16 = Sphere(Base=PlaneXY(0, 0, 0), Radius=Slider(0.25, range=0..1))

sph_17 = Sphere(Base=PlaneXY(0, 0, 0), Radius=Slider(0.25, range=0..1))

sph_18 = Sphere(Base=PlaneXY(0, 0, 0), Radius=Slider(0.25, range=0..1))

# ----
# 機能している
sph_19 = Sphere(Base=PlaneXY(0, 0, 0), Radius=1)

# ----
# Color Format
# Input
data = Data(1)
# Method
data_2 = Data(1)
# Output
data_3 = Data(1)
# Display
data_4 = Data(1)
# Unuse
data_5 = Data(1)

panel_8 = Panel(md_slider_4)

# ----
# 距離に応じた半径の長さをつくる
number_slider_10 = Slider(10, range=1..15)
dist = Distance(PointA=recgrid.Points, PointB=pt_3)
division = Division(A=dist, B=number_slider_10)

sph_20 = Sphere(Base=PlaneXY(0, 0, 0), Radius=Slider(0.25, range=0..1))

sph_21 = Sphere(Base=PlaneXY(0, 0, 0), Radius=Slider(0.25, range=0..1))

sph_22 = Sphere(Base=PlaneXY(0, 0, 0), Radius=Slider(0.25, range=0..1))

sph_23 = Sphere(Base=recgrid.Points, Radius=division)

number_slider_11 = Slider(2, range=1..10)
number_slider_12 = Slider(1, range=1..10)
number_slider_13 = Slider(3, range=1..10)
pt_4 = ConstructPoint(XCoordinate=number_slider_11, YCoordinate=number_slider_11, ZCoordinate=number_slider_11)
pt_5 = ConstructPoint(XCoordinate=number_slider_13, YCoordinate=number_slider_13, ZCoordinate=number_slider_13)
pt_6 = ConstructPoint(XCoordinate=number_slider_12, YCoordinate=number_slider_12, ZCoordinate=number_slider_12)
pt_7 = ConstructPoint(XCoordinate=0, YCoordinate=0, ZCoordinate=0)

number_slider_14 = Slider(5, range=1..10)
pt_8 = ConstructPoint(XCoordinate=number_slider_14, YCoordinate=number_slider_14, ZCoordinate=number_slider_14)
pt_9 = ConstructPoint(XCoordinate=0, YCoordinate=0, ZCoordinate=0)

# ----
# 10.Parametric Modeling
pt_10 = ConstructPoint(XCoordinate=0, YCoordinate=0, ZCoordinate=0)

rectangle = Rectangle(Plane=PlaneXY(0, 0, 0), XSize=Domain(-1, 1), YSize=Domain(-2, 2), Radius=0)  # -> Rectangle, Length

# ----
# 9.Pimitive Surface
number_slider_15 = Slider(5, range=1..10)

dom = ConstructDomain(DomainStart=Slider(1, range=1..10), DomainEnd=Slider(5, range=1..10))
dom_2 = ConstructDomain(DomainStart=Slider(1, range=1..10), DomainEnd=Slider(5, range=1..10))
dom_3 = ConstructDomain(DomainStart=Slider(1, range=1..10), DomainEnd=Slider(5, range=1..10))

pop3d = Populate3D(Region={Plane=PlaneXY(0, 0, 0), X=Domain(0, 10), Y=Domain(0, 10), Z=Domain(0, 2)}, Count=100, Seed=1)

# ----
# 底面となる多角形をつくる
polygon = Polygon(Plane=pt_10, Radius=Slider(4, range=0..10), Segments=Slider(6, range=3..10), FilletRadius=0)  # -> Polygon, Length

sph4pt = Sphere4Pt(Point1=pt_7, Point2=pt_6, Point3=pt_4, Point4=pt_5)  # -> Center, Radius, Sphere

boxrec = BoxRectangle(Rectangle=rectangle.Rectangle, Height=Slider(5, range=1..10))

cone = Cone(Base=PlaneXY(0, 0, 0), Radius=Slider(5, range=1..10), Length=Slider(5, range=1..10))  # -> Cone, Tip

cyl = Cylinder(Base=PlaneXY(0, 0, 0), Radius=Slider(5, range=1..10), Length=Slider(5, range=1..10))

planesrf = PlaneSurface(Plane=PlaneXY(0, 0, 0), XSize=number_slider_15, YSize=Slider(5, range=1..10))

box_5 = Box2Pt(PointA=pt_9, PointB=pt_8, Plane=PlaneXY(0, 0, 0))

box_6 = CenterBox(Base=PlaneXY(0, 0, 0), X=Slider(5, range=1..10), Y=Slider(5, range=1..10), Z=Slider(5, range=1..10))

box_7 = DomainBox(Base=PlaneXY(0, 0, 0), X=dom_2, Y=dom_3, Z=dom)

qsph = QuadSphere(Base=PlaneXY(0, 0, 0), Radius=Slider(5, range=1..10))

sph_24 = Sphere(Base=PlaneXY(0, 0, 0), Radius=Slider(5, range=1..10))

sfit = SphereFit(Points=pop3d)  # -> Center, Radius, Sphere

# ----
# 底面の多角形を移動
Z = UnitZ(Factor=Slider(5, range=0..10))
move = Move(Geometry=polygon.Polygon, Motion=Z)  # -> Geometry, Transform

# ----
# 移動した多角形を移動
Z_2 = UnitZ(Factor=Slider(10, range=0..10))
move_2 = Move(Geometry=move.Geometry, Motion=Z_2)  # -> Geometry, Transform

pln = Plane(planesrf)
brep = Brep(box_5)

brep_2 = Brep(cone.Cone)

bbox = BoundingBox(Content=brep_2, Plane=PlaneXY(0, 0, 0))  # -> Box, Box_2

# ----
# 移動した多角形を回転
pcen = PolygonCenter(Polyline=move.Geometry)  # -> CenterV, CenterE, CenterA
rotate = Rotate(Geometry=move.Geometry, Angle=Slider(0.5, range=0..1), Plane=pcen.CenterV)  # -> Geometry, Transform

pxs = PlaneThroughShape(Plane=pln, Shape=brep, Inflate=1, SectionLogic=False)

# ----
# 移動した多角形をスケール
pcen_2 = PolygonCenter(Polyline=move_2.Geometry)  # -> CenterV, CenterE, CenterA
scale = Scale(Geometry=move_2.Geometry, Center=pcen_2.CenterV, Factor=Slider(0.3, range=0..1))  # -> Geometry, Transform

# ----
# 3つの多角形をロフト
merge = Merge(Data1=polygon.Polygon, Data2=rotate.Geometry, Data3=scale.Geometry)
loft_2 = Loft(Curves=merge, Options={Adjust=False, Closed=False, LoftEnds=0, LoftSimp=0, LoftType=0, Rebuild=10, Refit=0.01})

preview = CustomPreview(Geometry=loft_2, Material=ColourSwatch(SwatchColor=RGB(162, 191, 31)))
