# Grasshopper definition Class1-2_Lecture.gh (Grasshopper 1.0.7)
# plug-ins: Bifocals

# Class1-2
gallery = ImageGallery(CycleDelay=30, Randomize=False, UseLocalImages=True, UseRemoteImages=True)

height = Slider(50, range=1..100)
scalex = Slider(0.5, range=0..1)

number_slider = Slider(10, range=1..10)

# ----
# Rhino上の曲線をセット
crv = Curve(<curve referenced from the Rhino model>)

panel_3 = Panel(crv)

# ----
# Rhino上の曲線をセット
crv_2 = Curve([<curve referenced from the Rhino model> x3])

# ----
# My First GH code!! Yay!!
panel_4 = Panel(crv_2)

# ----
# 曲線を押し出して閉じる
Z = UnitZ(Factor=height)
extr = Extrude(Base=crv, Direction=Z)
cap = CapHoles(Brep=extr)

# ----
# 底面の多角形を作成
polygon = Polygon(Plane=PlaneXY(0, 0, 0), Radius=Slider(8, range=0..10), Segments=6, FilletRadius=0)  # -> Polygon, Length

# ----
# 等差数列をつくり
# 底面の多角形を移動
series = Series(Start=0, Step=Slider(5, range=1..10), Count=number_slider)
Z_2 = UnitZ(Factor=series)
move = Move(Geometry=polygon.Polygon, Motion=Z_2)  # -> Geometry, Transform

# ----
# 回転角をもとに等差数列をつくる
rad = Radians(Degrees=Slider(10, range=0..10))
panel_5 = Panel(rad)
series_2 = Series(Start=0, Step=rad, Count=number_slider)

# ----
# 曲線をロフト
loft = Loft(Curves=crv_2, Options={Adjust=False, Closed=False, LoftEnds=0, LoftSimp=0, LoftType=0, Rebuild=10, Refit=0.01})

# ----
# Color Format
# Input
data = Data(1)
# Method
data_2 = Data(1)
# Output
data_3 = Data(1)
# Display
data_4 = Data(1)
# Unuse
data_5 = Data(1)

# ----
# indexにより曲線を抽出
number_slider_2 = Slider(0, range=0..10)
item = ListItem(List=crv_2, Index=number_slider_2, Wrap=True)
panel_6 = Panel(item)

srf = Surface(loft)

# ----
# x方向にスケール
pcen = PolygonCenter(Polyline=crv)  # -> CenterV, CenterE, CenterA
scale_nu = ScaleNU(Geometry=cap, Plane=pcen.CenterV, ScaleX=scalex, ScaleY=1, ScaleZ=1)  # -> Geometry, Transform

# ----
# 多角形をそれぞれ回転
pcen_2 = PolygonCenter(Polyline=move.Geometry)  # -> CenterV, CenterE, CenterA
rotate = Rotate(Geometry=move.Geometry, Angle=series_2, Plane=pcen_2.CenterV)  # -> Geometry, Transform

# ----
# 多角形をロフト
loft_2 = Loft(Curves=rotate.Geometry, Options={Adjust=False, Closed=False, LoftEnds=0, LoftSimp=0, LoftType=0, Rebuild=10, Refit=0.01})

geo = Geometry(scale_nu.Geometry)

geo_2 = Geometry(loft_2)

preview = CustomPreview(Geometry=geo_2, Material=ColourSwatch(SwatchColor=RGB(111, 178, 209)))
