# Grasshopper definition Class1-3_Lecture_HomeWork.gh (Grasshopper 1.0.7)
# plug-ins: Bifocals

# Class1-3
gallery = ImageGallery(CycleDelay=30, Randomize=False, UseLocalImages=True, UseRemoteImages=True)

height = Slider(50, range=0..100)
number_slider = Slider(5, range=1..10)

# ----
# 最高高さを決めその間を分割
dom = ConstructDomain(DomainStart=0, DomainEnd=height)
range = Range(Domain=dom, Steps=number_slider)
Z = UnitZ(Factor=range)

# ----
# 0-1の範囲を分割
range_2 = Range(Domain=Domain(0, 1), Steps=number_slider)
# スケールのファクターをつくる
bnd = Bounds(Numbers=range_2)
remap = RemapNumbers(Value=range_2, Source=bnd, Target=Domain(0, 1))  # -> Mapped, Clipped

# ----
# 多角形をつくり移動
polygon = Polygon(Plane=PlaneXY(0, 0, 0), Radius=Slider(8, range=0..10), Segments=6, FilletRadius=0)  # -> Polygon, Length
move = Move(Geometry=polygon.Polygon, Motion=Z)  # -> Geometry, Transform

# ----
# 回転角の最大値を決めその間を分割
rad = Radians(Degrees=Slider(50, range=0..100))
dom_2 = ConstructDomain(DomainStart=0, DomainEnd=rad)
range_3 = Range(Domain=dom_2, Steps=number_slider)

# ----
# Color Format
# Input
data = Data(1)
# Method
data_2 = Data(1)
# Output
data_3 = Data(1)
# Display
data_4 = Data(1)
# Unuse
data_5 = Data(1)

# ----
# パーリンノイズをかける
graph = GraphMapper(
    remap.Mapped,
    x0=0,
    x1=1,
    y0=0,
    y1=1,
    amplitude=0.3,
    container_name="Perlin",
    decay=0.3,
    frequency=0.1,
    x_offset=0.5,
    y_offset=0.5)

# ----
# 多角形の中心点を
# それぞれ出力
pcen = PolygonCenter(Polyline=move.Geometry)  # -> CenterV, CenterE, CenterA

# ----
# スケールの範囲を決め値を変換
bnd_2 = Bounds(Numbers=graph)
dom_3 = ConstructDomain(DomainStart=Slider(1, range=0..1), DomainEnd=Slider(2.5, range=1..5))
remap_2 = RemapNumbers(Value=graph, Source=bnd_2, Target=dom_3)  # -> Mapped, Clipped

# ----
# 多角形をスケールし
# 回転したものをロフト
scale = Scale(Geometry=move.Geometry, Center=pcen.CenterV, Factor=remap_2.Mapped)  # -> Geometry, Transform
rotate = Rotate(Geometry=scale.Geometry, Angle=range_3, Plane=pcen.CenterV)  # -> Geometry, Transform
loft = Loft(Curves=rotate.Geometry, Options={Adjust=False, Closed=False, LoftEnds=0, LoftSimp=0, LoftType=0, Rebuild=10, Refit=0.01})

# ----
# Brepを分解
brep = Brep(loft)
debrep = DeconstructBrep(Brep=brep)  # -> Faces, Edges, Vertices

# ----
# 面ごとに塗分け
lng = ListLength(List=debrep.Faces)
range_4 = Range(Domain=Domain(0, 1), Steps=expr("x-1", lng))
gradient = Gradient(LowerLimit=0, UpperLimit=1, Parameter=range_4, stops=[0: RGB(255, 255, 255), 1: RGB(0, 0, 0)])
preview = CustomPreview(Geometry=debrep.Faces, Material=gradient)

# ----
# 曲線ごとに階層をつくり格納
# 曲線のコントロールポイントが
# 2つ以上のもの（直線でないもの）を抽出
crv = Curve(debrep.Edges)
graft = GraftTree(Tree=crv, IncludeEmptyLists=True, IncludeNullItems=True)  # -> simplify(Tree)

# ----
# 曲線のコントロールポイントが
# 2つ以上かどうか判別
cp = ControlPoints(Curve=graft)  # -> Points, Weights, Knots
lng_2 = ListLength(List=cp.Points)  # -> simplify(Length)
larger = LargerThan(FirstNumber=lng_2, SecondNumber=Slider(2, range=0..10))  # -> LargerThan, OrEqualTo

# ----
# ブーリアン値をもとに選別
dispatch = Dispatch(List=graft, DispatchPattern=larger.LargerThan)  # -> ListA, ListB
crv_2 = Curve(flatten(dispatch.ListA))

# ----
# 曲線を分割
number_slider_2 = Slider(25, range=0..50)
divide = DivideCurve(Curve=crv_2, Count=number_slider_2, Kinks=False)  # -> simplify(Points), Tangents, Parameters

# ----
# 階層をオフセット
panel = Panel("{1}(1)")
relitem = RelativeItem(Tree=divide.Points, Offset=panel, WrapPaths=Toggle(True), WrapItems=False)  # -> ItemA, ItemB

# ----
# オフセットしたデータをもとに
# 線分をつくる
ln = Line(StartPoint=relitem.ItemA, EndPoint=relitem.ItemB)
join = JoinCurves(Curves=flatten(ln), Preserve=False)

# ----
# 半径を指定しパイプをつくる
number_slider_3 = Slider(0.6, range=0..1)
merge = Merge(Data1=Slider(0.2, range=0..1), Data2=Slider(0.4, range=0..1), Data3=number_slider_3, Data4=Slider(0.8, range=0..1))
pipe = Pipe(Curve=join, Radius=merge, Caps=0)  # -> flatten(Pipe)

# ----
# パイプごとに塗分け
lng_3 = ListLength(List=pipe)
range_5 = Range(Domain=Domain(0, 1), Steps=expr("x-1", lng_3))
gradient_2 = Gradient(
    LowerLimit=0,
    UpperLimit=1,
    Parameter=range_5,
    stops=[0: RGB(243, 57, 0), 0.1: RGB(236, 27, 60), 0.2: RGB(210, 0, 118), 0.3: RGB(103, 0, 120), 0.4: RGB(39, 72, 161), 0.5: RGB(1, 192, 229), 0.6: RGB(18, 178, 90), 0.7: RGB(79, 186, 8), 0.8: RGB(220, 237, 32), 0.9: RGB(247, 159, 20), 1: RGB(243, 57, 0)])
preview_2 = CustomPreview(Geometry=pipe, Material=gradient_2)
