# Grasshopper definition Class10_Solar Radiation Optimization.gh (Grasshopper 1.0.7)

# ---- group: Step1-2
building_radius = Slider(30, range=20..40)
building_segments = Slider(4, range=0..10)

# ---- group: Step3-4
mesh_edge_length = Slider(10, range=0..20)

# ---- group: Step2-1
city_building_number = Slider(15, range=0..20)
max_city_building_size = Slider(70, range=0..100)
city_building_random_seed = Slider(100, range=0..100)

# ---- group: Step3-2
building_height = Slider(100, range=10..100)

# ---- group: Step3-1
building_twist_angle = Slider(0.5, range=-1..1)

# ---- group: Step2-3
max_city_building_height = Slider(100, range=10..100)

# ---- group: Step5-1 / Step3-3
# Solar Radiation Optimization: An example to do solar radiation optimization using Ladybug & Galapagos.
# 
# Using plugin: Ladybug
building_rotation = Slider(0.866, range=0..2)

# ---- group: Step1 / Step1-1
planesrf = PlaneSurface(Plane=PlaneXY(0, 0, 0), XSize="250", YSize="250")
srf = Surface(planesrf)

# ---- group: Step2 / Step2-1
num = Number(max_city_building_size)
num_2 = Number(city_building_number)
srf_2 = Surface(srf)
division = Division(A=num, B="2")
popgeo = PopulateGeometry(Geometry=srf_2, Count=num_2, Seed=city_building_random_seed)
dom = ConstructDomain(DomainStart=division, DomainEnd=num)
random = Random(Range=dom, Number=num_2, Seed=2)
division_2 = Division(A=random, B="2")
neg = Negative(Value=division_2)
dom_2 = ConstructDomain(DomainStart=neg, DomainEnd=division_2)
rectangle = Rectangle(Plane=popgeo, XSize=dom_2, YSize=dom_2, Radius=0)  # -> Rectangle, Length

# ---- group: Step1 / Step1-2
area = Area(Geometry=srf)  # -> Area, Centroid
num_3 = Number(building_segments)
num_4 = Number(building_radius)
polygon = Polygon(Plane=area.Centroid, Radius=num_4, Segments=num_3, FilletRadius=0)  # -> Polygon, Length
crv = Curve(polygon.Polygon)

# ---- group: Step1
srf_3 = Surface(srf)

# ---- group: Step3 / Step3-1
num_5 = Number(building_twist_angle)
pt = Point(area.Centroid)
pi = Pi(Factor=num_5)
num_6 = Number("10")
range = Range(Domain=pi, Steps=num_6)
rotate = Rotate(Geometry=crv, Angle=range, Plane=pt)  # -> Geometry, Transform
num_7 = Number(num_6)

# ---- group: Step2 / Step2-2
crv_2 = Curve(srf_2)
crv_3 = Curve(crv)
crv_4 = Curve(rectangle.Rectangle)
graft = GraftTree(Tree=crv_4, IncludeEmptyLists=True, IncludeNullItems=True)
ccx = CurveCurve(CurveA=graft, CurveB=crv_3)  # -> Points, ParamsA, ParamsB
lng = ListLength(List=ccx.Points)
equals = Equality(FirstNumber=lng, SecondNumber="0")  # -> simplify(Equality), Inequality
flatten = FlattenTree(Tree=equals.Equality, Path="{0}")
crv_5 = Curve(crv_2)
cull = CullPattern(List=crv_4, CullPattern=flatten)
rint = RegionIntersection(CurvesA=cull, CurvesB=crv_5)

# ---- group: Step2 / Step2-3
num_8 = Number(max_city_building_height)
division_3 = Division(A=num_8, B="2")
srf_4 = Surface(srf_3)
dom_3 = ConstructDomain(DomainStart=division_3, DomainEnd=num_8)
boundary = BoundarySurfaces(Edges=rint)
lng_2 = ListLength(List=boundary)
random_2 = Random(Range=dom_3, Number=lng_2, Seed=2)
Z = UnitZ(Factor=random_2)
srf_5 = Surface(srf_4)
extr = Extrude(Base=boundary, Direction=Z)
merge = Merge(Data1=srf_5, Data2=extr)
flatten_2 = FlattenTree(Tree=merge, Path="{0}")
preview = CustomPreview(Geometry=flatten_2, Shader=ColourSwatch(SwatchColor=RGB(105, 105, 105)))

# ---- group: Step3 / Step3-2
range_2 = Range(Domain=building_height, Steps=num_7)
Z_2 = UnitZ(Factor=range_2)
crv_6 = Curve(rotate.Geometry)
move = Move(Geometry=crv_6, Motion=Z_2)  # -> Geometry, Transform
loft = Loft(Curves=move.Geometry, Options={Adjust=False, Closed=False, LoftEnds=0, LoftSimp=0, LoftType=3, Rebuild=10, Refit=0.01})
cap = CapHoles(Brep=loft)

# ---- group: Step3 / Step3-3
num_9 = Number(building_rotation)
geo = Geometry(cap)
area_2 = Area(Geometry=geo)  # -> Area, Centroid
pi_2 = Pi(Factor=num_9)
rotate_2 = Rotate(Geometry=geo, Angle=pi_2, Plane=area_2.Centroid)  # -> Geometry, Transform

# ---- group: Step4 / Step4-2
panel = Panel("https://www.energyplus.net/weather-download/asia_wmo_region_2/JPN//JPN_Tokyo.Hyakuri.477150_IWEC/all")
epw_stat = Ladybug_OpenEPWAndSTATWeatherFiles(weatherFileURL=panel)  # -> epwFile, statFile; plug-in component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
gencumulativeskymtx = Ladybug_GenCumulativeSkyMtx(epwFile=epw_stat.epwFile, skyDensity=0, useOldRes=True, runIt=Toggle(True))  # -> readMe, cumulativeSkyMtx; plug-in component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
selectskymtx = Ladybug_selectSkyMtx(cumulativeSkyMtx=gencumulativeskymtx.cumulativeSkyMtx, removeDiffuse=False, removeDirect=False)  # -> readMe, selectedSkyMtx; plug-in component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

# ---- group: Step4 / Step4-1
ladybug = Ladybug_Ladybug()  # -> Vviiiiiiiiiizzz; plug-in component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

# ---- group: Step3 / Step3-4
num_10 = Number(mesh_edge_length)
custom_mesh_settings = SettingsCustom(
    StitchSeams=True,
    SimplePlanes=False,
    Refine=True,
    MinCount="5",
    MaxCount=400,
    AspectRatio=20,
    MaxDistance=0,
    MaxAngle=20,
    MinEdge=num_10,
    MaxEdge=num_10)
geo_2 = Geometry(rotate_2.Geometry)
mesh = MeshBrep(Brep=geo_2, Settings=custom_mesh_settings)
tri = Triangulate(Mesh=mesh)  # -> Mesh, Count

# ---- group: Step4 / Step4-3
radiationanalysis = Ladybug_RadiationAnalysis(
    geometry=flatten(tri.Mesh),
    context=flatten(flatten_2),
    disFromBase=".01",
    selectedSkyMtx=flatten(selectskymtx.selectedSkyMtx),
    runIt=Toggle(True))  # -> readMe, contextMesh, analysisMesh, testPts, testVec, port, radiationResult, radiationMesh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; plug-in component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

# ----
num_11 = Number(radiationanalysis.totalRadiation)

# ---- group: Step5 / Step5-1
galapagos = Galapagos(fitness=num_11, gene=building_rotation)
panel_2 = Panel(num_11)
