# Grasshopper definition Class2-2-1_Lecture.gh (Grasshopper 1.0.7)
# plug-ins: Bifocals
# This script is used for DDK...

# Class2-2-1
gallery = ImageGallery(CycleDelay=30, Randomize=False, UseLocalImages=True, UseRemoteImages=True)

number_slider = Slider(20, range=0..100)

srf = Surface(<surface referenced from the Rhino model>)

crv = Curve(<curve referenced from the Rhino model>)

md_slider = MDSlider(SliderMode=0, slider_value=Point(0.5, 0.5, 0.5), x_domain=Domain(0, 1), y_domain=Domain(0, 1), z_domain=Domain(0, 1))

crv_2 = Curve(<curve referenced from the Rhino model>)

crv_3 = Curve(<curve referenced from the Rhino model>)

srf_2 = Surface(srf)

merge = Merge(Data1=crv_2, Data2=crv_3)
crv_4 = Curve(merge)

# ----
# データを抽出するための
# パターンをつくる
merge_2 = Merge(Data1=Toggle(False), Data2=Toggle(True))

panel_5 = Panel(merge_2)

# ----
# サーフェスから
# 点と法線ベクトルを出力
sdivide = DivideSurface(Surface=srf_2, UCount=Slider(10, range=0..10), VCount=Slider(10, range=0..10))  # -> Points, Normals, Parameters

# ----
# グリッドをつくり中心点を出力
recgrid = Rectangular(Plane=PlaneXY(0, 0, 0), SizeX=1, SizeY=2, ExtentX=Slider(5, range=0..10), ExtentY=Slider(10, range=0..10))  # -> Cells, Points
pcen = PolygonCenter(Polyline=recgrid.Cells)  # -> CenterV, CenterE, CenterA

lng = ListLength(List=recgrid.Cells)

panel_6 = Panel(md_slider)

# ----
# 曲線をt値により分割(2)
range = Range(Domain=Domain(0, 1), Steps=number_slider)
eval = EvaluateCurve(Curve=reparameterize(crv), Parameter=range)  # -> Point, Tangent, Angle

# ----
# 等差数列からベクトルを生成
number_slider_2 = Slider(13, range=0..100)
series = Series(Start=0, Step=number_slider_2, Count=10)
Z = UnitZ(Factor=series)

# ----
# インデックスにより中心点を抽出
number_slider_3 = Slider(0, range=0..10)
item = ListItem(List=pcen.CenterV, Index=number_slider_3, Wrap=True)

vdis = VectorDisplay(Anchor=sdivide.Points, Vector=sdivide.Normals)

# ----
# ポリラインを分割しそれぞれの点をつなぐ
divide = DivideCurve(Curve=crv_4, Count=10, Kinks=False)  # -> Points, Tangents, Parameters
bang = ExplodeTree(Data=divide.Points)  # -> Branch0, Branch1
ln = Line(StartPoint=bang.Branch0, EndPoint=bang.Branch1)

viewer = ParamViewer(lng)
panel_7 = Panel(lng)

# ----
# サーフェスのUV方向の
# およその長さを取得
dim = Dimensions(Surface=srf)  # -> UDimension, VDimension

# ----
# サーフェスをu方向，v方向に分割
divide_2 = DivideDomain²(Domain=srf, UCount=Slider(10, range=0..10), VCount=Slider(10, range=0..10))
subsrf = Isotrim(Surface=srf, Domain=divide_2)

# ----
# ポリラインの中心点を
# 原点とする平面をつくる
pcen_2 = PolygonCenter(Polyline=crv_4)  # -> CenterV, CenterE, CenterA
xy = XYPlane(Origin=pcen_2.CenterV)

points = PointList(Points=pcen.CenterV, Size=Slider(1, range=0..1))

# ----
# 全てのトリム箇所を取り除く
untrim = Untrim(Surface=srf)

# ----
# 曲線を等間隔に分割(1)
divide_3 = DivideCurve(Curve=crv, Count=number_slider, Kinks=False)  # -> Points, Tangents, Parameters

pt = Point(sdivide.Points)
# 点を交互に抽出
panel_8 = Panel(merge_2)
dispatch = Dispatch(List=pt, DispatchPattern=panel_8)  # -> ListA, ListB
pt_2 = Point(dispatch.ListA)
pt_3 = Point(dispatch.ListB)

# ----
# Color Format
# Input
data = Data(1)
# Method
data_2 = Data(1)
# Output
data_3 = Data(1)
# Display
data_4 = Data(1)
# Unuse
data_5 = Data(1)

flip = FlipMatrix(Data=pt)
panel_9 = Panel(merge_2)
dispatch_2 = Dispatch(List=flip, DispatchPattern=panel_9)  # -> ListA, ListB
pt_4 = Point(dispatch_2.ListA)
pt_5 = Point(dispatch_2.ListB)

# ----
# 点と法線ベクトルから線分をつくる
number_slider_4 = Slider(31, range=0..100)
line = LineSDL(Start=sdivide.Points, Direction=sdivide.Normals, Length=number_slider_4)

panel_10 = Panel(dim.UDimension)
panel_11 = Panel(dim.VDimension)

# ----
# 法線ベクトルと
# その点で接する平面を出力
evalsrf = EvaluateSurface(Surface=reparameterize(untrim), Point=md_slider)  # -> Point, Normal, UDirection, VDirection, Frame

# ----
# 平面を移動
item_2 = ListItem(List=xy, Index=0, Wrap=True)  # -> Item, Item1
move = Move(Geometry=item_2.Item1, Motion=Z)  # -> Geometry, Transform

# ----
# 分割(1)(2)を切り替える
toggle = BooleanToggle(False)
filter = StreamFilter(Gate=toggle, Stream0=divide_3.Points, Stream1=eval.Point)
filter_2 = StreamFilter(Gate=toggle, Stream0=divide_3.Tangents, Stream1=eval.Tangent)
pt_6 = Point(filter)
vec = Vector(filter_2)

# ----
# ランダムな数を生成
dom = ConstructDomain(DomainStart=Slider(5, range=0..10), DomainEnd=Slider(46, range=0..100))
lng_2 = ListLength(List=pt_6)
random = Random(Range=dom, Number=lng_2, Seed=Slider(625, range=0..1000))

# ----
# 列と行を入れ替え点をつなぐ
flip_2 = FlipMatrix(Data=item)
pline = PolyLine(Vertices=flip_2, Closed=False)

# ----
# Flattenして点をつなぐ
flatten = FlattenTree(Tree=item, Path="{0}")
pline_2 = PolyLine(Vertices=flatten, Closed=False)

# ----
# 中心点をつなぎ分割
pline_3 = PolyLine(Vertices=pcen.CenterV, Closed=False)
divide_4 = DivideCurve(Curve=pline_3, Count=10, Kinks=False)  # -> simplify(graft(Points)), Tangents, Parameters

# ----
# インデックスによりサーフェスを抽出
number_slider_5 = Slider(0, range=0..10)
item_3 = ListItem(List=subsrf, Index=number_slider_5, Wrap=True)

panel_12 = Panel(xy)

amp = Amplitude(Vector=evalsrf.Normal, Amplitude=Slider(100, range=0..100))
vdis_2 = VectorDisplay(Anchor=evalsrf.Point, Vector=amp)

pln = Plane(evalsrf.Frame)

# ----
# 線分をロフト
flip_3 = FlipMatrix(Data=line)
loft = Loft(Curves=flip_3, Options={Adjust=False, Closed=False, LoftEnds=0, LoftSimp=0, LoftType=0, Rebuild=10, Refit=0.01})

# ----
# 線分と平面との交点を出力し，
# それぞれの交点をつなぐ
plx = LinePlane(Line=ln, Plane=graft(move.Geometry))  # -> Point, ParamL, ParamP
pline_4 = PolyLine(Vertices=plx.Point, Closed=True)

# ----
# 曲線に直行し，
# ランダムな長さのベクトルを生成
Z_2 = UnitZ(Factor=1)
xprod = CrossProduct(VectorA=vec, VectorB=expr("-x", Z_2), Unitize=False)  # -> Vector, Length
amp_2 = Amplitude(Vector=xprod.Vector, Amplitude=random)

srf_3 = Surface(srf_2)
srf_cp = SurfaceClosestPoint(Point=pt_4, Surface=srf_3)  # -> Point, UVPoint, Distance
srf_4 = Surface(srf_2)
evalsrf_2 = EvaluateSurface(Surface=srf_4, Point=srf_cp.UVPoint)  # -> Point, Normal, UDirection, VDirection, Frame
amp_3 = Amplitude(Vector=evalsrf_2.Normal, Amplitude=Slider(39, range=0..1000))

srf_5 = Surface(srf_2)
# 抽出した点から法線ベクトルをつくる
srf_cp_2 = SurfaceClosestPoint(Point=pt_2, Surface=srf_5)  # -> Point, UVPoint, Distance
srf_6 = Surface(srf_2)
evalsrf_3 = EvaluateSurface(Surface=srf_6, Point=srf_cp_2.UVPoint)  # -> Point, Normal, UDirection, VDirection, Frame
amp_4 = Amplitude(Vector=evalsrf_3.Normal, Amplitude=Slider(39, range=0..1000))

loft_2 = Loft(Curves=line, Options={Adjust=False, Closed=False, LoftEnds=0, LoftSimp=0, LoftType=0, Rebuild=10, Refit=0.01})

preview = CustomPreview(Geometry=item_3, Material=ColourSwatch(SwatchColor=RGB(217, 100, 100)))

# ----
# Flattenしたデータを別の階層に分割
number_slider_6 = Slider(11, range=1..100)
flatten_2 = FlattenTree(Tree=divide_4.Points, Path="{0}")
partition = PartitionList(List=flatten_2, Size=number_slider_6)

vdis_3 = VectorDisplay(Anchor=pt_6, Vector=vec)

# ----
# パイプをつくる
number_slider_7 = Slider(1, range=0..10)
merge_3 = Merge(Data1=ln, Data2=pline_4)

# ----
# 階層を減らす
pshift = ShiftPaths(Data=divide_4.Points, Offset=-1)

# ----
# Graft
graft = GraftTree(Tree=divide_4.Points, IncludeEmptyLists=True, IncludeNullItems=True)

preview_2 = CustomPreview(Geometry=loft_2, Material=ColourSwatch(SwatchColor=RGB(72, 163, 134)))

preview_3 = CustomPreview(Geometry=loft, Material=ColourSwatch(SwatchColor=RGB(72, 84, 163)))

vdis_4 = VectorDisplay(Anchor=pt_6, Vector=amp_2)

pipe = Pipe(Curve=merge_3, Radius=number_slider_7, Caps=0)

# ----
# 点を移動
move_2 = Move(Geometry=pt_6, Motion=amp_2)  # -> Geometry, Transform

viewer_2 = ParamViewer(partition)
panel_13 = Panel(partition)

viewer_3 = ParamViewer(graft)
panel_14 = Panel(graft)

viewer_4 = ParamViewer(pshift)
panel_15 = Panel(pshift)

preview_4 = CustomPreview(Geometry=pipe, Material=ColourSwatch(SwatchColor=RGB(255, 56, 56)))

# ----
# リストの最後の点を削除
lng_3 = ListLength(List=move_2.Geometry)
cull_i = CullIndex(List=pt_6, Indices=expr("x-1", lng_3), Wrap=True)
cull_i_2 = CullIndex(List=move_2.Geometry, Indices=expr("x-1", lng_3), Wrap=True)

move_3 = Move(Geometry=pt_4, Motion=amp_3)  # -> Geometry, Transform

# ----
# 点を移動
move_4 = Move(Geometry=pt_2, Motion=amp_4)  # -> Geometry, Transform

intcrv = Interpolate(Vertices=move_2.Geometry, Degree=3, Periodic=True, KnotStyle=1)  # -> Curve, Length, Domain

panel_16 = Panel(merge_2)
weave = Weave(Pattern=panel_16, Stream0=pt_5, Stream1=move_3.Geometry, NullGaps=False)

panel_17 = Panel(merge_2)
# 点の順番をはじめに戻す
weave_2 = Weave(Pattern=panel_17, Stream0=pt_3, Stream1=move_4.Geometry, NullGaps=False)

# ----
# 点とベクトルから
# 円弧をつくる
Z_3 = UnitZ(Factor=1)
arc = ArcSED(Start=cull_i_2, End=cull_i, Direction=Z_3)  # -> Arc, Plane, Radius

# ----
# 円弧をロフト
loft_3 = Loft(Curves=arc.Arc, Options={Adjust=False, Closed=True, LoftEnds=0, LoftSimp=0, LoftType=0, Rebuild=10, Refit=0.01})

pline_5 = PolyLine(Vertices=weave, Closed=False)

# ----
# 点をつなぐ
pline_6 = PolyLine(Vertices=weave_2, Closed=False)

preview_5 = CustomPreview(Geometry=pline_5, Material=ColourSwatch(SwatchColor=RGB(186, 0, 0)))

preview_6 = CustomPreview(Geometry=loft_3, Material=ColourSwatch(SwatchColor=RGB(230, 129, 129)))

# ----
# ポリラインを整理し
# 線分に分解
entwine = Entwine(Branch0X=pline_5, Branch1X=pline_6, FlattenInputs=False)  # -> simplify(Result)
explode = Explode(Curve=entwine, Recursive=True)  # -> Segments, Vertices

# ----
# 線分をx軸，z方向をy軸
# にもつ平面をつくる
Z_4 = UnitZ(Factor=1)
pl = ConstructPlane(Origin=explode.Vertices, XAxis=explode.Segments, YAxis=Z_4)

# ----
# 平面を分解し，
# 先の平面と直行する平面をつくる
deplane = DeconstructPlane(Plane=pl)  # -> Origin, XAxis, YAxis, ZAxis
Z_5 = UnitZ(Factor=1)
pl_2 = ConstructPlane(Origin=deplane.Origin, XAxis=deplane.ZAxis, YAxis=Z_5)

# ----
# 基になる曲線と点を入力
crv_5 = Curve(<curve referenced from the Rhino model>)
pt_7 = Point(<point referenced from the Rhino model>)
xy_2 = XYPlane(Origin=pt_7)

# ----
# 曲線を平面を基準に移動
orient = Orient(Geometry=crv_5, Source=xy_2, Target=pl_2)  # -> Geometry, Transform

# ----
# 曲線を押し出し
extrcrv = ExtrudeAlong(Base=orient.Geometry, Curve=explode.Segments)

preview_7 = CustomPreview(Geometry=extrcrv, Material=ColourSwatch(SwatchColor=RGB(130, 255, 0)))
