# Grasshopper definition Class2-2-2_Lecture_sample01.gh (Grasshopper 1.0.7)
# plug-ins: Bifocals

# Class2-2-2
gallery = ImageGallery(CycleDelay=30, Randomize=False, UseLocalImages=True, UseRemoteImages=True)

# ----
# x方向
panel_2 = Panel("""false
true""")

# ----
# y方向
panel_3 = Panel("""true
false""")

srf = Surface(<surface referenced from the Rhino model>)

srf_2 = Surface(srf)

srf_3 = Surface(srf)

# ----
# エッジを抽出
edges = BrepEdges(Brep=srf_2)  # -> Naked, Interior, NonManifold
crv = Curve(edges.Naked)

# ----
# サーフェスを分割し
# 点を出力
sdivide = DivideSurface(Surface=srf_3, UCount=Slider(20, range=0..100), VCount=Slider(20, range=0..100))  # -> Points, Normals, Parameters

# ----
# サーフェスを分割
divide = DivideDomain²(Domain=srf, UCount=Slider(20, range=0..100), VCount=Slider(20, range=0..100))
subsrf = Isotrim(Surface=srf, Domain=divide)  # -> graft(Surface)

srf_4 = Surface(srf)

srf_5 = Surface(srf)

pt = Point(sdivide.Points)
pline = PolyLine(Vertices=pt, Closed=False)

pt_2 = Point(pt)

points = PointList(Points=pt_2, Size=Slider(5, range=0..10))

# ----
# 点を交互に抽出
dispatch = Dispatch(List=pt_2, DispatchPattern=panel_3)  # -> ListA, ListB
pt_3 = Point(dispatch.ListA)
pt_4 = Point(dispatch.ListB)

# ----
# 点をつなぐ
flip = FlipMatrix(Data=pt)
pline_2 = PolyLine(Vertices=flip, Closed=False)

pt_5 = Point(flip)

points_2 = PointList(Points=pt_5, Size=Slider(5, range=0..10))

# ----
# 点を交互に抽出
dispatch_2 = Dispatch(List=pt_5, DispatchPattern=panel_2)  # -> ListA, ListB
pt_6 = Point(dispatch_2.ListA)
pt_7 = Point(dispatch_2.ListB)

# ----
# Color Format
# Input
data = Data(1)
# Method
data_2 = Data(1)
# Output
data_3 = Data(1)
# Display
data_4 = Data(1)
# Unuse
data_5 = Data(1)

# ----
# 抽出した点の
# サーフェスに対する法線ベクトルを生成
srf_cp = SurfaceClosestPoint(Point=pt_6, Surface=reparameterize(srf_4))  # -> Point, UVPoint, Distance
evalsrf = EvaluateSurface(Surface=reparameterize(srf_4), Point=srf_cp.UVPoint)  # -> Point, Normal, UDirection, VDirection, Frame
amp = Amplitude(Vector=evalsrf.Normal, Amplitude=Slider(16, range=0..100))

# ----
# 抽出した点の
# サーフェスに対する法線ベクトルを生成
srf_cp_2 = SurfaceClosestPoint(Point=pt_3, Surface=reparameterize(srf_5))  # -> Point, UVPoint, Distance
evalsrf_2 = EvaluateSurface(Surface=reparameterize(srf_5), Point=srf_cp_2.UVPoint)  # -> Point, Normal, UDirection, VDirection, Frame
amp_2 = Amplitude(Vector=evalsrf_2.Normal, Amplitude=Slider(16, range=0..100))

# ----
# エッジを抽出
edges_2 = BrepEdges(Brep=subsrf)  # -> Naked, Interior, NonManifold

preview = CustomPreview(Geometry=pline, Material=ColourSwatch(SwatchColor=RGB(255, 5, 5)))

preview_2 = CustomPreview(Geometry=pline_2, Material=ColourSwatch(SwatchColor=RGB(5, 101, 255)))

# ----
# エッジを分ける
item = ListItem(List=edges_2.Naked, Index=0, Wrap=True)  # -> Item, Item1

panel_4 = Panel(panel_2)
panel_5 = Panel(panel_3)

join = JoinCurves(Curves=flatten(item.Item), Preserve=False)
item_2 = ListItem(List=join, Index=Slider(14, range=0..20), Wrap=True)

# ----
# 点を移動
move = Move(Geometry=pt_6, Motion=amp)  # -> Geometry, Transform

# ----
# エッジを結合し
# インデックスにより抽出
number_slider = Slider(14, range=0..20)
join_2 = JoinCurves(Curves=flatten(item.Item1), Preserve=False)
item_3 = ListItem(List=join_2, Index=number_slider, Wrap=True)

# ----
# 点を移動
move_2 = Move(Geometry=pt_3, Motion=amp_2)  # -> Geometry, Transform

# ----
# 点の順番をはじめに戻す
weave = Weave(Pattern=panel_4, Stream0=pt_7, Stream1=move.Geometry, NullGaps=False)

# ----
# 点の順番をはじめに戻す
weave_2 = Weave(Pattern=panel_5, Stream0=pt_4, Stream1=move_2.Geometry, NullGaps=False)

preview_3 = CustomPreview(Geometry=item_2, Material=ColourSwatch(SwatchColor=RGB(49, 255, 91)))

preview_4 = CustomPreview(Geometry=item_3, Material=ColourSwatch(SwatchColor=RGB(255, 64, 91)))

# ----
# 点をつなぐ
pline_3 = PolyLine(Vertices=weave, Closed=False)

# ----
# 点をつなぐ
pline_4 = PolyLine(Vertices=weave_2, Closed=False)

# ----
# 始点と終点を出力
end = EndPoints(Curve=pline_3)  # -> Start, End

# ----
# 始点と終点を出力
end_2 = EndPoints(Curve=pline_4)  # -> Start, End

# ----
# 始点のt値を出力
# (ここでは始点のためすべて0)
crv_cp = CurveClosestPoint(Point=end.Start, Curve=pline_3)  # -> Point, Parameter, Distance

# ----
# 始点のt値を出力
# (ここでは始点のためすべて0)
crv_cp_2 = CurveClosestPoint(Point=end_2.Start, Curve=pline_4)  # -> Point, Parameter, Distance

# ----
# 接線ベクトルを出力
eval = EvaluateCurve(Curve=pline_3, Parameter=crv_cp.Parameter)  # -> Point, Tangent, Angle

pt_8 = Point(eval.Point)
vec = Vector(eval.Tangent)
amp_3 = Amplitude(Vector=vec, Amplitude=Slider(10, range=0..10))
vdis = VectorDisplay(Anchor=pt_8, Vector=amp_3)

# ----
# 接線ベクトルを出力
eval_2 = EvaluateCurve(Curve=pline_4, Parameter=crv_cp_2.Parameter)  # -> Point, Tangent, Angle

pt_9 = Point(eval_2.Point)
vec_2 = Vector(eval_2.Tangent)
amp_4 = Amplitude(Vector=vec_2, Amplitude=Slider(10, range=0..10))
vdis_2 = VectorDisplay(Anchor=pt_9, Vector=amp_4)

# ----
# z方向のベクトルとの外積を求める
Z = UnitZ(Factor=1)
xprod = CrossProduct(VectorA=eval.Tangent, VectorB=Z, Unitize=False)  # -> Vector, Length

pt_10 = Point(eval.Point)
vec_3 = Vector(xprod.Vector)
amp_5 = Amplitude(Vector=vec_3, Amplitude=Slider(10, range=0..10))
vdis_3 = VectorDisplay(Anchor=pt_10, Vector=amp_5)

# ----
# z方向のベクトルとの外積を求める
Z_2 = UnitZ(Factor=1)
xprod_2 = CrossProduct(VectorA=eval_2.Tangent, VectorB=Z_2, Unitize=False)  # -> Vector, Length

pt_11 = Point(eval_2.Point)
vec_4 = Vector(xprod_2.Vector)
amp_6 = Amplitude(Vector=vec_4, Amplitude=Slider(10, range=0..10))
vdis_4 = VectorDisplay(Anchor=pt_11, Vector=amp_6)

# ----
# 2つのベクトルから平面をつくる
pl = ConstructPlane(Origin=end.Start, XAxis=eval.Tangent, YAxis=xprod.Vector)

# ----
# 2つのベクトルから平面をつくる
pl_2 = ConstructPlane(Origin=end_2.Start, XAxis=eval_2.Tangent, YAxis=xprod_2.Vector)

# ----
# 平面からx, y, z方向の
# ベクトルを抽出
deplane = DeconstructPlane(Plane=pl)  # -> Origin, XAxis, YAxis, ZAxis

# ----
# 平面からx, y, z方向の
# ベクトルを抽出
deplane_2 = DeconstructPlane(Plane=pl_2)  # -> Origin, XAxis, YAxis, ZAxis

# ----
# ベクトルを入れ替え
# 新しい平面をつくる
pl_3 = ConstructPlane(Origin=deplane.Origin, XAxis=deplane.YAxis, YAxis=deplane.ZAxis)

# ----
# ベクトルを入れ替え
# 新しい平面をつくる
pl_4 = ConstructPlane(Origin=deplane_2.Origin, XAxis=deplane_2.YAxis, YAxis=deplane_2.ZAxis)

# ----
# 曲線と基準点を用意
pt_12 = Point(<point referenced from the Rhino model>)
crv_2 = Curve(<curve referenced from the Rhino model>)

# ----
# 曲線と基準点を用意
crv_3 = Curve(<curve referenced from the Rhino model>)
pt_13 = Point(<point referenced from the Rhino model>)

# ----
# 曲線をそれぞれの
# 平面に配置
orient = Orient(Geometry=crv_2, Source=pt_12, Target=pl_3)  # -> Geometry, Transform

# ----
# 曲線をそれぞれの
# 平面に配置
orient_2 = Orient(Geometry=crv_3, Source=pt_13, Target=pl_4)  # -> Geometry, Transform

# ----
# 曲線をスイープ
crv_4 = Curve(pline_3)
swp1 = Sweep1(Rail=crv_4, Sections=orient.Geometry, Miter=1)

# ----
# 曲線をスイープ
crv_5 = Curve(pline_4)
swp1_2 = Sweep1(Rail=crv_5, Sections=orient_2.Geometry, Miter=1)

preview_5 = CustomPreview(Geometry=[swp1_2, swp1], Material=ColourSwatch(SwatchColor=RGB(117, 87, 74)))
