# Grasshopper definition Class2-2-3_Lecture_sample02.gh (Grasshopper 1.0.7)
# plug-ins: Bifocals

# Class2-2-3
gallery = ImageGallery(CycleDelay=30, Randomize=False, UseLocalImages=True, UseRemoteImages=True)
number_slider = Slider(10, range=0..10)

crv = Curve(<curve referenced from the Rhino model>)

# ----
# ランダムな数を生成
dom = ConstructDomain(DomainStart=Slider(21, range=0..100), DomainEnd=Slider(100, range=0..100))
random = Random(Range=dom, Number=number_slider, Seed=Slider(0, range=0..100))

# ----
# 曲線を等間隔に分割
divide = DivideCurve(Curve=crv, Count=number_slider, Kinks=False)  # -> Points, Tangents, Parameters

# ----
# 曲線に直行し，
# ランダムな長さのベクトルを生成
Z = UnitZ(Factor=1)
xprod = CrossProduct(VectorA=divide.Tangents, VectorB=Z, Unitize=False)  # -> Vector, Length
amp = Amplitude(Vector=expr("-x", xprod.Vector), Amplitude=random)

# ----
# Color Format
# Input
data = Data(1)
# Method
data_2 = Data(1)
# Output
data_3 = Data(1)
# Display
data_4 = Data(1)
# Unuse
data_5 = Data(1)

vdis = VectorDisplay(Anchor=divide.Points, Vector=xprod.Vector)

# ----
# 点を移動
move = Move(Geometry=divide.Points, Motion=amp)  # -> Geometry, Transform

ln = Line(StartPoint=divide.Points, EndPoint=move.Geometry)
linedim = LineDimension(Line=ln, Text="{0:0.00}", Size=Slider(9, range=0..100))

# ----
# 点とベクトルから
# 円弧をつくる
Z_2 = UnitZ(Factor=1)
arc = ArcSED(Start=move.Geometry, End=divide.Points, Direction=Z_2)  # -> Arc, Plane, Radius

# ----
# 円弧をロフト
loft = Loft(Curves=arc.Arc, Options={Adjust=False, Closed=True, LoftEnds=0, LoftSimp=0, LoftType=0, Rebuild=10, Refit=0.01})

srf = Surface(loft)

srf_2 = Surface(srf)

# ----
# サーフェスを分割し，
# 点を生成
sdivide = DivideSurface(Surface=srf_2, UCount=Slider(55, range=0..100), VCount=10)  # -> Points, Normals, Parameters

# ----
# 列と行を入れ替えて点をつなぎ，
# ポリラインを線分に分割
flip = FlipMatrix(Data=sdivide.Points)
pline = PolyLine(Vertices=flip, Closed=False)
explode = Explode(Curve=pline, Recursive=True)  # -> Segments, Vertices

# ----
# 点をつなぐ
pline_2 = PolyLine(Vertices=sdivide.Points, Closed=False)

# ----
# 線分の始点を出力
end = EndPoints(Curve=pline_2)  # -> Start, End

# ----
# 線分の始点を出力
end_2 = EndPoints(Curve=explode.Segments)  # -> Start, End

# ----
# サーフェスと点とが
# 接する平面をつくる
srf_3 = Surface(srf_2)
srf_cp = SurfaceClosestPoint(Point=end.Start, Surface=srf_3)  # -> Point, UVPoint, Distance
evalsrf = EvaluateSurface(Surface=srf_3, Point=srf_cp.UVPoint)  # -> Point, Normal, UDirection, VDirection, Frame

# ----
# サーフェスと点とが
# 接する平面をつくる
srf_4 = Surface(srf_2)
srf_cp_2 = SurfaceClosestPoint(Point=end_2.Start, Surface=srf_4)  # -> Point, UVPoint, Distance
evalsrf_2 = EvaluateSurface(Surface=srf_4, Point=srf_cp_2.UVPoint)  # -> Point, Normal, UDirection, VDirection, Frame

# ----
# 先の平面と直行する平面をつくる
deplane = DeconstructPlane(Plane=evalsrf.Frame)  # -> Origin, XAxis, YAxis, ZAxis
pl = ConstructPlane(Origin=deplane.Origin, XAxis=deplane.XAxis, YAxis=deplane.ZAxis)

# ----
# 先の平面と直行する平面をつくる
deplane_2 = DeconstructPlane(Plane=evalsrf_2.Frame)  # -> Origin, XAxis, YAxis, ZAxis
pl_2 = ConstructPlane(Origin=deplane_2.Origin, XAxis=deplane_2.YAxis, YAxis=deplane_2.ZAxis)

# ----
# 基になる曲線と点を入力
crv_2 = Curve(<curve referenced from the Rhino model>)
pt = Point(<point referenced from the Rhino model>)

# ----
# 基になる曲線と点を入力
crv_3 = Curve(<curve referenced from the Rhino model>)
pt_2 = Point(<point referenced from the Rhino model>)

# ----
# 曲線を平面を基準に移動
orient = Orient(Geometry=crv_2, Source=pt, Target=pl)  # -> Geometry, Transform

# ----
# 曲線を平面を基準に移動
orient_2 = Orient(Geometry=crv_3, Source=pt_2, Target=pl_2)  # -> Geometry, Transform

# ----
# 曲線をスイープ
swp1 = Sweep1(Rail=pline_2, Sections=orient.Geometry, Miter=1)

# ----
# 曲線を押し出し
extrcrv = ExtrudeAlong(Base=orient_2.Geometry, Curve=explode.Segments)

preview = CustomPreview(Geometry=swp1, Material=ColourSwatch(SwatchColor=RGB(128, 128, 128)))

preview_2 = CustomPreview(Geometry=extrcrv, Material=ColourSwatch(SwatchColor=RGB(128, 128, 128)))
