# Grasshopper definition Class3-1-0.gh (Grasshopper 1.0.7)
# plug-ins: Bifocals, LunchBox

# Class3-1-2
gallery = ImageGallery(CycleDelay=30, Randomize=False, UseLocalImages=True, UseRemoteImages=True)

crv = Curve(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)

crv_2 = Curve(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)

# ----
# 曲線をロフト
loft = Loft(Curves=[crv, crv_2], Options={Adjust=False, Closed=False, LoftEnds=0, LoftSimp=0, LoftType=0, Rebuild=10, Refit=0.01})
srf = Surface(loft)

# ----
# サーフェスを再構築し
# ダイヤモンド型のパネルをつくる
rebuildsrf = RebuildSurface(Surface=srf, UDegree=3, VDegree=3, UNumber=10, VNumber=10)
diamond = DiamondPanels(Surface=rebuildsrf, UDivisions=10, VDivisions=10)  # -> DiamondPanels, TriPanels

# ----
# Color Format
# Input
data = Data(1)
# Method
data_2 = Data(1)
# Output
data_3 = Data(1)
# Display
data_4 = Data(1)
# Unuse
data_5 = Data(1)

# ----
# サーフェスのエッジを出力
edges = BrepEdges(Brep=srf)  # -> Naked, Interior, NonManifold

# ----
# テキストが指定したものか判断
panel = Panel(edges.Naked)
item = ListItem(List=panel, Index=0, Wrap=True)
tmatch = MatchText(Text=panel, Pattern=item, Case=True)

# ----
# エッジを分割してuv方向を指定し
# ネットワークサーフェスをつくる
dispatch = Dispatch(List=edges.Naked, DispatchPattern=tmatch)  # -> ListA, ListB
crv_3 = Curve(dispatch.ListB)
netsurf = NetworkSurface(CurvesU=crv_3, CurvesV=dispatch.ListA, Continuity=2)

# ----
# サーフェスをドメインにより分割
number_slider = Slider(6, range=0..100)
divide = DivideDomain²(Domain=netsurf, UCount=10, VCount=number_slider)
subsrf = Isotrim(Surface=netsurf, Domain=divide)

sdivide = DivideSurface(Surface=netsurf, UCount=Slider(20, range=0..100), VCount=10)  # -> Points, Normals, Parameters
flip = FlipMatrix(Data=sdivide.Points)
pline = PolyLine(Vertices=sdivide.Points, Closed=False)
pline_2 = PolyLine(Vertices=flip, Closed=False)  # -> flatten(Polyline)

panel_2 = Panel("""true
false""")
pt = Point(flip)
cull = CullPattern(List=pt, CullPattern=panel_2)

tstat = TreeStatistics(Tree=pt)  # -> Paths, Length, Count
lng = ListLength(List=tstat.Paths)
index = ItemIndex(List=tstat.Paths, Item=tstat.Paths)
series = Series(Start=0, Step=1, Count=lng)

# ----
# サーフェスから千鳥配置の
# 四角形パネルをつくる
quadstag = StaggeredQuadPanels(Surface=netsurf, UDivisions=10, VDivisions=10)

lng_2 = ListLength(List=pline_2)
cull_i = CullIndex(List=pline_2, Indices=expr("x-1", lng_2), Wrap=True)

# ----
# パネルからオフセットされたフレームをつくる
number_slider_2 = Slider(0.8, range=0..1)
frame = PanelFrame(Panel=quadstag, ScaleFactor=number_slider_2)  # -> PanelFrame, Panel

mod = Modulus(A=series, B=Slider(2, range=0..10))  # -> graft(Result)

midpt = CurveMiddle(Curve=cull_i)
pdecon = Deconstruct(Point=midpt)  # -> XComponent, YComponent, ZComponent
flatten = FlattenTree(Tree=pdecon.ZComponent, Path="{0}")
reldif = RelativeDifferences(Values=flatten)
cull_i_2 = CullIndex(List=reldif, Indices=Slider(0, range=0..100), Wrap=True)

explode = Explode(Curve=cull_i, Recursive=True)  # -> Segments, Vertices

not = GateNot(A=panel_2)

srf_2 = Surface(frame.Panel)

srf_3 = Surface(frame.PanelFrame)

weave = Weave(Pattern=mod, Stream0=panel_2, Stream1=not, NullGaps=False)

cull_2 = CullPattern(List=simplify(pt), CullPattern=simplify(weave))
lng_3 = ListLength(List=cull_2)

preview = CustomPreview(Geometry=srf_3, Material=ColourSwatch(SwatchColor=RGB(166, 166, 166)))

preview_2 = CustomPreview(Geometry=srf_2, Material=ColourSwatch(SwatchColor=RGBA(217, 255, 245, 137)))

pline_3 = PolyLine(Vertices=cull_2, Closed=False)
bool = Boolean(simplify(mod))
dispatch_2 = Dispatch(List=pline_3, DispatchPattern=bool)  # -> ListA, ListB
explode_2 = Explode(Curve=dispatch_2.ListA, Recursive=True)  # -> Segments, Vertices
clean = CleanTree(RemoveNulls=True, RemoveInvalid=True, RemoveEmpty=True, Tree=explode_2.Vertices)  # -> simplify(Tree)

graft = GraftTree(Tree=cull_i_2, IncludeEmptyLists=True, IncludeNullItems=True)
Z = UnitZ(Factor=graft)
extr = Extrude(Base=simplify(explode.Segments), Direction=Z)

bool_2 = Boolean(simplify(mod))
dispatch_3 = Dispatch(List=simplify(pt), DispatchPattern=bool_2)  # -> ListA, ListB

clean_2 = CleanTree(RemoveNulls=True, RemoveInvalid=True, RemoveEmpty=True, Tree=dispatch_3.ListA)  # -> simplify(Tree)

item_2 = ListItem(List=clean_2, Index=0, Wrap=True)  # -> simplify(Item1), simplify(Item)

ins = InsertItems(List=clean, Item=item_2.Item, Indices=Slider(0, range=0..100), Wrap=True)
lng_4 = ListLength(List=ins)
ins_2 = InsertItems(List=ins, Item=item_2.Item1, Indices=lng_4, Wrap=True)

pline_4 = PolyLine(Vertices=ins_2, Closed=False)
merge = Merge(Data1=simplify(dispatch_2.ListB), Data2=simplify(pline_4))

extr_2 = Extrude(Base=simplify(merge), Direction=Z)
preview_3 = CustomPreview(Geometry=extr_2, Material=ColourSwatch(SwatchColor=RGB(196, 106, 106)))
