# Grasshopper definition Class3-1-1.gh (Grasshopper 1.0.7)
# plug-ins: Bifocals

# Class3-1-1
gallery = ImageGallery(CycleDelay=30, Randomize=False, UseLocalImages=True, UseRemoteImages=True)

number_slider = Slider(155, range=0..1000)
number_slider_2 = Slider(46, range=0..100)

number_slider_3 = Slider(46, range=0..100)
number_slider_4 = Slider(130, range=0..1000)

crv = Curve(<curve referenced from the Rhino model>)

# ----
# グリッドをつくり，点を出力
recgrid = Rectangular(Plane=PlaneXY(0, 0, 0), SizeX=number_slider_4, SizeY=number_slider_4, ExtentX=number_slider_3, ExtentY=number_slider_3)  # -> Cells, Points
pt = Point(recgrid.Points)

# ----
# グリッドをつくり，点を出力
recgrid_2 = Rectangular(Plane=PlaneXY(0, 0, 0), SizeX=number_slider, SizeY=number_slider, ExtentX=number_slider_2, ExtentY=number_slider_2)  # -> Cells, Points
pt_2 = Point(recgrid_2.Points)

# ----
# 点をx, y, z座標に分解し，x, y座標を-1から1にリマップ
number_slider_5 = Slider(1, range=0..1)
pdecon = Deconstruct(Point=flatten(pt_2))  # -> XComponent, YComponent, ZComponent
neg = Negative(Value=number_slider_5)
dom = ConstructDomain(DomainStart=neg, DomainEnd=number_slider_5)
bnd = Bounds(Numbers=pdecon.YComponent)
bnd_2 = Bounds(Numbers=pdecon.XComponent)
remap = RemapNumbers(Value=pdecon.YComponent, Source=bnd, Target=dom)  # -> Mapped, Clipped
remap_2 = RemapNumbers(Value=pdecon.XComponent, Source=bnd_2, Target=dom)  # -> Mapped, Clipped

# ----
# Color Format
# Input
data = Data(1)
# Method
data_2 = Data(1)
# Output
data_3 = Data(1)
# Display
data_4 = Data(1)
# Unuse
data_5 = Data(1)

# ----
# 点と曲線との距離を出力
pull = PullPoint(Point=pt, Geometry=crv, ClosestOnly=True)  # -> ClosestPoint, Distance

# ----
# 距離をリマップし，点をz軸方向に移動
dom_2 = ConstructDomain(DomainStart=Slider(0, range=0..100), DomainEnd=Slider(1200, range=0..10000))
dom_3 = ConstructDomain(DomainStart=Slider(1000, range=0..1000), DomainEnd=Slider(0, range=0..100))
remap_3 = RemapNumbers(Value=pull.Distance, Source=dom_2, Target=dom_3)  # -> Mapped, Clipped
Z = UnitZ(Factor=remap_3.Clipped)
move = Move(Geometry=pt, Motion=Z)  # -> Geometry, Transform

# ----
# 数式：(1-x/a)*(1+x/b)*(1-y/c)*(1+y/d)*(r-1)
# から数値を出力しスケール，それをz座標に入力
number_slider_6 = Slider(0.4, range=0..1)
eval = Evaluate(
    F="(1-x/a)*(1+x/b)*(1-y/c)*(1+y/d)*(r-1)",
    x=remap_2.Mapped,
    y=remap.Mapped,
    a=number_slider_6,
    b=Slider(0.6, range=0..1),
    c=Slider(0.5, range=0..1),
    d=Slider(0.5, range=0..1),
    r=Slider(1.4, range=0..10))
neg_2 = Negative(Value=Slider(705, range=0..1000))
multiplication = Multiplication(A=eval, B=neg_2)

# ----
# 点を通るサーフェスを出力
srfgrid = SurfaceFromPoints(Points=flatten(move.Geometry), UCount=expr("x+1", number_slider_3), Interpolate=False)

# ----
# サーフェスを分割
divide = DivideDomain²(Domain=srfgrid, UCount=10, VCount=10)
subsrf = Isotrim(Surface=srfgrid, Domain=divide)

# ----
# 点をつくる
pt_3 = ConstructPoint(XCoordinate=pdecon.XComponent, YCoordinate=pdecon.YComponent, ZCoordinate=multiplication)

# ----
# 点を通るサーフェスを出力
srfgrid_2 = SurfaceFromPoints(Points=flatten(pt_3), UCount=expr("x+1", number_slider_2), Interpolate=False)

# ----
# それぞれのサーフェスから
# エッジの始点，終点を抽出
debrep = DeconstructBrep(Brep=subsrf)  # -> Faces, Edges, Vertices
end = EndPoints(Curve=debrep.Edges)  # -> Start, End

# ----
# サーフェスを分割
divide_2 = DivideDomain²(Domain=srfgrid_2, UCount=10, VCount=10)
subsrf_2 = Isotrim(Surface=srfgrid_2, Domain=divide_2)

ln = Line(StartPoint=end.Start, EndPoint=end.End)

# ----
# それぞれのサーフェスから
# エッジの始点，終点を抽出
debrep_2 = DeconstructBrep(Brep=subsrf_2)  # -> Faces, Edges, Vertices
end_2 = EndPoints(Curve=debrep_2.Edges)  # -> Start, End

ln_2 = Line(StartPoint=end_2.Start, EndPoint=end_2.End)
