# Grasshopper definition Class3-1-ImageSampler.gh (Grasshopper 1.0.7)

gallery = ImageGallery(CycleDelay=30, Randomize=False, UseLocalImages=True, UseRemoteImages=True)

number_slider = Slider(20, range=0..100)
srf = Surface(reparameterize(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))
sdivide = DivideSurface(Surface=srf, UCount=number_slider, VCount=number_slider)  # -> Points, Normals, Parameters

image = ImageSampler(
    sdivide.Parameters,
    FilePath="C:\Users\ykish\OneDrive\デスクトップ\download.jpg",
    Filter="Value",
    Interpolate=False,
    Umax=1,
    Umin=0,
    Vmax=1,
    Vmin=0,
    Wrap=1)
image_2 = ImageSampler(
    sdivide.Parameters,
    FilePath="C:\Users\ykish\OneDrive\デスクトップ\download.jpg",
    Filter="Colour",
    Interpolate=False,
    Umax=1,
    Umin=0,
    Vmax=1,
    Vmin=0,
    Wrap=1)

dom = ConstructDomain(DomainStart=Slider(2, range=0..10), DomainEnd=Slider(18, range=0..100))

panel = Panel(sdivide.Parameters)

# ----
# Color Format
# Input
data = Data(1)
# Method
data_2 = Data(1)
# Output
data_3 = Data(1)
# Display
data_4 = Data(1)
# Unuse
data_5 = Data(1)

remap = RemapNumbers(Value=image, Source=Domain(0, 1), Target=dom)  # -> Mapped, Clipped

preview = CustomPreview(Geometry=sdivide.Points, Material=image_2)
cir = Circle(Plane=sdivide.Points, Radius=remap.Mapped)
