# Grasshopper definition Class3-Lecture.gh (Grasshopper 1.0.7)
# plug-ins: Bifocals, LunchBox

gallery = ImageGallery(CycleDelay=30, Randomize=False, UseLocalImages=True, UseRemoteImages=True)
crv = Curve([<curve referenced from the Rhino model> x2])
loft = Loft(Curves=crv, Options={Adjust=False, Closed=False, LoftEnds=0, LoftSimp=0, LoftType=0, Rebuild=10, Refit=0.01})
edges = BrepEdges(Brep=loft)  # -> Naked, Interior, NonManifold
panel = Panel(edges.Naked)
crv_2 = Curve(edges.Naked)
txt = Text(panel)
item = ListItem(List=txt, Index=0, Wrap=True)

# ----
# Color Format
# Input
data = Data(1)
# Method
data_2 = Data(1)
# Output
data_3 = Data(1)
# Display
data_4 = Data(1)
# Unuse
data_5 = Data(1)

panel_2 = Panel(item)
tmatch = MatchText(Text=txt, Pattern=panel_2, Case=True)
crv_3 = Curve(crv_2)
panel_3 = Panel(tmatch)
dispatch = Dispatch(List=crv_3, DispatchPattern=tmatch)  # -> ListA, ListB
line_like_curve = Curve(dispatch.ListA)
planer_curve = Curve(dispatch.ListB)
netsurf = NetworkSurface(CurvesU=planer_curve, CurvesV=line_like_curve, Continuity=2)
srf = Surface(netsurf)
srf_2 = Surface(netsurf)
sdivide = DivideSurface(Surface=srf_2, UCount=Slider(45, range=1..101), VCount=Slider(9, range=0..100))  # -> Points, Normals, Parameters
quads = QuadPanels(Surface=srf, UDivisions=10, VDivisions=10)
trib = TrianglePanelsB(Surface=srf, UDivisions=10, VDivisions=10)
quadrand = RandomQuadPanels(
    Surface=srf,
    UDivisions=Slider(20, range=0..100),
    VDivisions=Slider(37, range=0..100),
    RandomSeed=Slider(2703, range=0..10000))
diamond = DiamondPanels(Surface=srf, UDivisions=10, VDivisions=10)  # -> DiamondPanels, TriPanels
quadstag = StaggeredQuadPanels(Surface=srf, UDivisions=Slider(32, range=0..100), VDivisions=Slider(9, range=0..100))
list = ValueList({"ダイアモンド": 0, "トライアングル": 1, "四角": 2, "ランダムステップ": 3, "ステップ": 4}, selected="ステップ")
flip = FlipMatrix(Data=sdivide.Points)
panel_4 = Panel("""true
false""")
pline = PolyLine(Vertices=sdivide.Points, Closed=False)
pt = Point(simplify(flip))
pline_2 = PolyLine(Vertices=flip, Closed=False)
panel_5 = Panel(list)
tstat = TreeStatistics(Tree=pt)  # -> Paths, Length, Count
filter = StreamFilter(Gate=list, Stream0=diamond.DiamondPanels, Stream1=trib, Stream2=quads, Stream3=quadrand, Stream4=quadstag)
cull = CullPattern(List=pt, CullPattern=panel_4)
index = ItemIndex(List=tstat.Paths, Item=tstat.Paths)
series = Series(Start=0, Step=1, Count=tstat.Count)
preview = CustomPreview(
    Geometry=filter,
    Material={diffuse=RGB(221, 160, 221), emission=RGB(66, 48, 66), shine=0.5, specular=RGB(255, 255, 255), transparency=0})
pt_2 = Point(cull)
not = GateNot(A=panel_4)
mod = Modulus(A=series, B=Slider(2, range=0..10))
graft = GraftTree(Tree=mod, IncludeEmptyLists=True, IncludeNullItems=True)  # -> simplify(Tree)
weave = Weave(Pattern=graft, Stream0=panel_4, Stream1=not, NullGaps=False)
cull_2 = CullPattern(List=pt, CullPattern=weave)
panel_6 = Panel("""true
false""")
pline_3 = PolyLine(Vertices=cull_2, Closed=False)
dispatch_2 = Dispatch(List=flatten(pline_3), DispatchPattern=panel_6)  # -> ListA, ListB
crv_4 = Curve(dispatch_2.ListA)
pt_3 = Point(simplify(pt))
crv_5 = Curve(dispatch_2.ListB)
explode = Explode(Curve=crv_4, Recursive=True)  # -> Segments, simplify(Vertices)
explode_2 = Explode(Curve=crv_5, Recursive=True)  # -> Segments, simplify(Vertices)
lng = ListLength(List=pt_3)
item_2 = ListItem(List=pt_3, Index=expr("x-1", lng), Wrap=True)
item_3 = ListItem(List=pt_3, Index=0, Wrap=True)
cull_3 = CullPattern(List=flatten(item_2), CullPattern=invert([False, True]))  # -> simplify(graft(List))
cull_4 = CullPattern(List=flatten(item_3), CullPattern=[False, True])  # -> simplify(graft(List))
merge = Merge(Data1=explode.Vertices, Data2=cull_3)
merge_2 = Merge(Data1=cull_4, Data2=explode_2.Vertices)
pline_4 = PolyLine(Vertices=merge, Closed=False)  # -> flatten(Polyline)
pline_5 = PolyLine(Vertices=merge_2, Closed=False)  # -> flatten(Polyline)
weave_2 = Weave(Pattern=panel_6, Stream0=pline_5, Stream1=pline_4, NullGaps=False)
crv_6 = Curve(weave_2)
rev = ReverseList(List=crv_6)
item_4 = ListItem(List=rev, Index=Slider(10, range=0..10), Wrap=True)
midpt = CurveMiddle(Curve=rev)
pdecon = Deconstruct(Point=midpt)  # -> XComponent, YComponent, ZComponent
bnd = Bounds(Numbers=pdecon.ZComponent)
reldif = RelativeDifferences(Values=pdecon.ZComponent)
remap = RemapNumbers(Value=pdecon.ZComponent, Source=bnd, Target=Domain(0, 1))  # -> Mapped, Clipped
cull_i = CullIndex(List=reldif, Indices=0, Wrap=True)
Z = UnitZ(Factor=cull_i)
gradient = Gradient(
    LowerLimit=0,
    UpperLimit=1,
    Parameter=remap.Mapped,
    stops=[0: RGB(234, 38, 0), 0.25: RGB(234, 126, 0), 0.5: RGB(254, 244, 84), 0.75: RGB(173, 203, 249), 1: RGB(75, 107, 169)])
extr = Extrude(Base=crv_6, Direction=Z)
preview_2 = CustomPreview(Geometry=extr, Material=gradient)
panel_7 = Panel(pdecon.ZComponent)
