# Grasshopper definition Class4-1-1.gh (Grasshopper 1.0.7)
# plug-ins: Bifocals

# Class4-1-1
gallery = ImageGallery(CycleDelay=30, Randomize=False, UseLocalImages=True, UseRemoteImages=True)
number_slider = Slider(100, range=0..100)

pi = Pi(Factor=Slider(5, range=0..10))

pi_2 = Pi(Factor=Slider(3, range=0..10))
neg = Negative(Value=pi_2)
dom = ConstructDomain(DomainStart=neg, DomainEnd=pi_2)

pi_3 = Pi(Factor=Slider(3, range=0..10))
neg_2 = Negative(Value=pi_3)
dom_2 = ConstructDomain(DomainStart=neg_2, DomainEnd=pi_3)

number_slider_2 = Slider(63, range=0..100)

number_slider_3 = Slider(155, range=0..1000)
number_slider_4 = Slider(46, range=0..100)

number_slider_5 = Slider(46, range=0..100)
number_slider_6 = Slider(130, range=0..1000)
number_slider_7 = Slider(1, range=0..10)
number_slider_8 = Slider(247, range=0..1000)
number_slider_9 = Slider(1, range=0..10)
number_slider_10 = Slider(113, range=0..1000)

range = Range(Domain=Slider(1000, range=0..1000), Steps=Slider(100, range=0..100))

range_2 = Range(Domain=Slider(1000, range=0..1000), Steps=Slider(65, range=0..100))

range_3 = Range(Domain=pi, Steps=number_slider)

c_script = CSharpScript(n1=number_slider_8, n2=Slider(30, range=0..100), a=Slider(0.6, range=0..1), b=Slider(0.5, range=0..1))  # -> out, A; inputs n1: Int32, n2: Int32, a: Double, b: Double
# ---------- c_script: C# ----------
    Component.Description = "Buccoli";
    Component.Message = "Buccoli";

    List<Point3d> plist = new List<Point3d>();
    for(int i = 0; i < n1; i++)
    {
      for(int j = 0; j < n2; j++){
        double x = (a + b * Math.Sin(21.0 * j * Math.PI / 250.0)) * Math.Cos(i * Math.PI / 20.0);
        double y = (a + b * Math.Sin(21.0 * j * Math.PI / 250.0)) * Math.Sin(-i * Math.PI / 20.0);
        double z = 39.0 * i / 1000.0 + 1.5 * Math.Sin(j * Math.PI / 50.0);
        Point3d p = new Point3d(x, y, z);
        plist.Add(p);
      }
    }
    A = plist;
# ---------- end c_script ----------
c_script_2 = CSharpScript(n1=number_slider_10, n2=Slider(131, range=0..200), a=Slider(4.6, range=0..10), b=Slider(2.4, range=0..10))  # -> out, A; inputs n1: Int32, n2: Int32, a: Double, b: Double
# ---------- c_script_2: C# ----------
    Component.Description = "Cavatappi";
    Component.Message = "Cavatappi";

    List<Point3d> plist = new List<Point3d>();
    for(int i = 0; i < n1; i++)
    {
      for(int j = 0; j < n2; j++){
        double x = (a + b * Math.Cos(i * Math.PI / 35.0) + 0.1 * Math.Cos(2.0 * i * Math.PI / 7.0)) * Math.Cos(j * Math.PI / 30.0);
        double y = (a + b * Math.Cos(i * Math.PI / 35.0) + 0.1 * Math.Cos(2.0 * i * Math.PI / 7.0)) * Math.Sin(j * Math.PI / 30.0);
        double z = a + b * Math.Sin(i * Math.PI / 35.0) + 0.1 * Math.Sin(2.0 * i * Math.PI / 7.0) + j / 6.0;
        Point3d p = new Point3d(x, y, z);
        plist.Add(p);
      }
    }
    A = plist;
# ---------- end c_script_2 ----------

pi_4 = Pi(Factor=Slider(5, range=0..100))
dom_3 = ConstructDomain(DomainStart=Slider(0, range=0..100), DomainEnd=pi_4)

pi_5 = Pi(Factor=Slider(10, range=0..100))
dom_4 = ConstructDomain(DomainStart=Slider(0, range=0..100), DomainEnd=pi_5)

# ----
# グリッドをつくり，点を出力
recgrid = Rectangular(Plane=PlaneXY(0, 0, 0), SizeX=number_slider_6, SizeY=number_slider_6, ExtentX=number_slider_5, ExtentY=number_slider_5)  # -> Cells, Points
pt = Point(recgrid.Points)

# ----
# グリッドをつくり，点を出力
recgrid_2 = Rectangular(Plane=PlaneXY(0, 0, 0), SizeX=number_slider_3, SizeY=number_slider_3, ExtentX=number_slider_4, ExtentY=number_slider_4)  # -> Cells, Points
pt_2 = Point(recgrid_2.Points)

# ----
# 点をx, y, z座標に分解し，x, y座標を-1から1にリマップ
number_slider_11 = Slider(1, range=0..1)
pdecon = Deconstruct(Point=flatten(pt_2))  # -> XComponent, YComponent, ZComponent
neg_3 = Negative(Value=number_slider_11)
dom_5 = ConstructDomain(DomainStart=neg_3, DomainEnd=number_slider_11)
bnd = Bounds(Numbers=pdecon.YComponent)
bnd_2 = Bounds(Numbers=pdecon.XComponent)
remap = RemapNumbers(Value=pdecon.YComponent, Source=bnd, Target=dom_5)  # -> Mapped, Clipped
remap_2 = RemapNumbers(Value=pdecon.XComponent, Source=bnd_2, Target=dom_5)  # -> Mapped, Clipped

sin = Sine(Value=range_3)
cos = Cosine(Value=range_3)
merge = Merge(Data1=graft(cos), Data2=graft(sin))

neg_4 = Negative(Value=number_slider_7)
dom_6 = ConstructDomain(DomainStart=neg_4, DomainEnd=number_slider_7)
range_4 = Range(Domain=dom_6, Steps=number_slider_2)

neg_5 = Negative(Value=number_slider_9)
dom_7 = ConstructDomain(DomainStart=neg_5, DomainEnd=number_slider_9)
range_5 = Range(Domain=dom_7, Steps=number_slider_2)

bnd_3 = Bounds(Numbers=range)
remap_3 = RemapNumbers(Value=range, Source=bnd_3, Target=dom_3)  # -> Mapped, Clipped

dom_8 = ConstructDomain(DomainStart=Slider(0, range=0..100), DomainEnd=Slider(42, range=0..100))

bnd_4 = Bounds(Numbers=range_2)
remap_4 = RemapNumbers(Value=range_2, Source=bnd_4, Target=dom_4)  # -> Mapped, Clipped

srfgrid = SurfaceFromPoints(Points=c_script_2.A, UCount=number_slider_10, Interpolate=Toggle(True))

dom_9 = ConstructDomain(DomainStart=Slider(0, range=0..100), DomainEnd=Slider(42, range=0..100))

dom_10 = ConstructDomain(DomainStart=Slider(0, range=0..100), DomainEnd=Slider(62, range=0..100))

dom_11 = ConstructDomain(DomainStart=Slider(0, range=0..100), DomainEnd=Slider(62, range=0..100))

srfgrid_2 = SurfaceFromPoints(Points=c_script.A, UCount=number_slider_8, Interpolate=Toggle(True))

# ----
# Color Format
# Input
data = Data(1)
# Method
data_2 = Data(1)
# Output
data_3 = Data(1)
# Display
data_4 = Data(1)
# Unuse
data_5 = Data(1)

range_6 = Range(Domain=dom, Steps=Slider(10, range=0..10))

number_slider_12 = Slider(20, range=0..100)
range_7 = Range(Domain=dom_2, Steps=number_slider_12)

range_8 = Range(Domain=dom_10, Steps=number_slider)

cos_2 = Cosine(Value=remap_4.Mapped)

sin_2 = Sine(Value=remap_3.Mapped)

preview = CustomPreview(Geometry=srfgrid_2, Material=ColourSwatch(SwatchColor=RGB(204, 183, 143)))

bnd_5 = Bounds(Numbers=flatten(merge))
remap_5 = RemapNumbers(Value=merge, Source=bnd_5, Target=dom_11)  # -> Mapped, Clipped

pt_3 = ConstructPoint(XCoordinate=Slider(0, range=0..1), YCoordinate=Slider(0, range=0..1), ZCoordinate=Slider(0, range=0..1))

pt_4 = ConstructPoint(XCoordinate=Slider(0, range=0..1), YCoordinate=Slider(0, range=0..1), ZCoordinate=Slider(0, range=0..1))

preview_2 = CustomPreview(Geometry=srfgrid, Material=ColourSwatch(SwatchColor=RGB(204, 183, 143)))

bnd_6 = Bounds(Numbers=sin_2)
remap_6 = RemapNumbers(Value=sin_2, Source=bnd_6, Target=dom_8)  # -> Mapped, Clipped

bnd_7 = Bounds(Numbers=cos_2)
remap_7 = RemapNumbers(Value=cos_2, Source=bnd_7, Target=dom_9)  # -> Mapped, Clipped

# ----
# 点を通るサーフェスを出力
srfgrid_3 = SurfaceFromPoints(Points=flatten(pt), UCount=expr("x+1", number_slider_5), Interpolate=False)

expression = Expression(a=remap_7.Mapped, x=Slider(26, range=0..100), y=remap_7.Mapped, Expression="If(a>x , x, a)")

crossref = CrossReference(ListA=range_4, ListB=range_5, CrossMode=1)  # -> ListA, ListB

item = ListItem(List=remap_5.Mapped, Index=0, Wrap=True)  # -> Item, Item1

pt_5 = ConstructPoint(XCoordinate=flatten(item.Item), YCoordinate=flatten(item.Item1), ZCoordinate=flatten(range_8))
pt_6 = Point(pt_5)

# ----
# サーフェスを分割
divide = DivideDomain²(Domain=srfgrid_3, UCount=10, VCount=10)
subsrf = Isotrim(Surface=srfgrid_3, Domain=divide)

pt_7 = ConstructPoint(XCoordinate=crossref.ListA, YCoordinate=crossref.ListB, ZCoordinate=0)
dist = Distance(PointA=pt_7, PointB=pt_4)

pt_8 = ConstructPoint(XCoordinate=range, YCoordinate=remap_6.Mapped, ZCoordinate=0)
pt_9 = Point(pt_8)

pt_10 = ConstructPoint(XCoordinate=range_2, YCoordinate=expression, ZCoordinate=0)
pt_11 = Point(pt_10)

# ----
# 数式：(1-x/a)*(1+x/b)*(1-y/c)*(1+y/d)*(r-1)
# から数値を出力しスケール，それをz座標に入力
number_slider_13 = Slider(0.4, range=0..1)
eval = Evaluate(
    F="(1-x/a)*(1+x/b)*(1-y/c)*(1+y/d)*(r-1)",
    x=remap_2.Mapped,
    y=remap.Mapped,
    a=number_slider_13,
    b=Slider(0.6, range=0..1),
    c=Slider(0.5, range=0..1),
    d=Slider(0.5, range=0..1),
    r=Slider(1.4, range=0..10))
neg_6 = Negative(Value=Slider(705, range=0..1000))
multiplication = Multiplication(A=eval, B=neg_6)

pi_6 = Pi(Factor=Slider(0.21, range=0..1))
neg_7 = Negative(Value=pi_6)
dom_12 = ConstructDomain(DomainStart=neg_7, DomainEnd=pi_6)

crossref_2 = CrossReference(ListA=range_6, ListB=range_7, CrossMode=1)  # -> ListA, ListB
eval_2 = Evaluate(
    F="a*cos(x)+b*sin(y)",
    x=crossref_2.ListA,
    y=crossref_2.ListB,
    a=Slider(0.8, range=0..10),
    b=Slider(0.8, range=0..10),
    c=Slider(4, range=0..100))
pt_12 = ConstructPoint(XCoordinate=crossref_2.ListA, YCoordinate=crossref_2.ListB, ZCoordinate=eval_2)

panel_4 = Panel(expression)
expression_2 = Expression(Expression="Format(\"{0}, {1}\", x, y)")

# ----
# それぞれのサーフェスから
# エッジの始点，終点を抽出
debrep = DeconstructBrep(Brep=subsrf)  # -> Faces, Edges, Vertices
end = EndPoints(Curve=debrep.Edges)  # -> Start, End

pt_13 = Point(pt_6)
index = ItemIndex(List=pt_13, Item=pt_13)
expression_3 = Expression(x="point", y=index, Expression="Format(\"{0}: {1}\", x, y)")
tag = TextTag(Location=pt_13, Text=expression_3)
tag_2 = TextTag3D(Location=pt_13, Text=expression_3, Size=1, Justification=5)

bnd_8 = Bounds(Numbers=dist)
remap_8 = RemapNumbers(Value=dist, Source=bnd_8, Target=dom_12)  # -> Mapped, Clipped
remap_9 = RemapNumbers(Value=dist, Source=bnd_8, Target=Domain(0, 1))  # -> Mapped, Clipped

eval_3 = Evaluate(F="(1-z)*(y*cos(x)+y*cos(x))", x=remap_8.Mapped, y=Slider(0.32, range=0..1), z=remap_9.Mapped)
pt_14 = ConstructPoint(XCoordinate=crossref.ListA, YCoordinate=crossref.ListB, ZCoordinate=eval_3)

ln = Line(StartPoint=end.Start, EndPoint=end.End)

# ----
# 点をつくる
pt_15 = ConstructPoint(XCoordinate=pdecon.XComponent, YCoordinate=pdecon.YComponent, ZCoordinate=multiplication)

addition = Addition(A=number_slider_12, B=1)
srfgrid_4 = SurfaceFromPoints(Points=flatten(pt_12), UCount=addition, Interpolate=False)

# ----
# 点を通るサーフェスを出力
srfgrid_5 = SurfaceFromPoints(Points=flatten(pt_15), UCount=expr("x+1", number_slider_4), Interpolate=False)

number_slider_14 = Slider(-0.12, range=-0.9..0)

# ----
# サーフェスを分割
divide_2 = DivideDomain²(Domain=srfgrid_5, UCount=10, VCount=10)
subsrf_2 = Isotrim(Surface=srfgrid_5, Domain=divide_2)

# ----
# それぞれのサーフェスから
# エッジの始点，終点を抽出
debrep_2 = DeconstructBrep(Brep=subsrf_2)  # -> Faces, Edges, Vertices
end_2 = EndPoints(Curve=debrep_2.Edges)  # -> Start, End

addition_2 = Addition(A=number_slider_2, B=1)
srfgrid_6 = SurfaceFromPoints(Points=flatten(pt_14), UCount=addition_2, Interpolate=True)

ln_2 = Line(StartPoint=end_2.Start, EndPoint=end_2.End)

scale = Scale(Geometry=srfgrid_6, Center=Point(0, 0, 0), Factor=Slider(672, range=0..1000))  # -> Geometry, Transform
number_slider_15 = Slider(20, range=0..100)
sdivide = DivideSurface(Surface=scale.Geometry, UCount=number_slider_15, VCount=number_slider_15)  # -> Points, Normals, Parameters

pline = PolyLine(Vertices=sdivide.Points, Closed=False)
