# Grasshopper definition Class4_MathDDK2.gh (Grasshopper 1.0.7)

gallery = ImageGallery(CycleDelay=30, Randomize=False, UseLocalImages=True, UseRemoteImages=True)
number_slider = Slider(1, range=0..1)

pi = Pi(Factor=Slider(3, range=0..10))
neg = Negative(Value=pi)
dom = ConstructDomain(DomainStart=neg, DomainEnd=pi)

number_slider_2 = Slider(3, range=0..10)

pi_2 = Pi(Factor=Slider(3, range=0..10))
neg_2 = Negative(Value=pi_2)
dom_2 = ConstructDomain(DomainStart=neg_2, DomainEnd=pi_2)

# ----
# Color Format
# Input
data = Data(1)
# Method
data_2 = Data(1)
# Output
data_3 = Data(1)
# Display
data_4 = Data(1)
# Unuse
data_5 = Data(1)

number_slider_3 = Slider(20, range=0..100)
pi_3 = Pi(Factor=Slider(5, range=0..10))
pi_4 = Pi(Factor=Slider(1, range=0..1))
range = Range(Domain=pi_3, Steps=number_slider_3)
range_2 = Range(Domain=pi_4, Steps=Slider(10, range=0..10))
panel = Panel(range_2)
crossref = CrossReference(ListA=range_2, ListB=range, CrossMode=1)  # -> ListA, ListB
pt = ConstructPoint(XCoordinate=graft(range_2), YCoordinate=range, ZCoordinate=0)

range_3 = Range(Domain=dom_2, Steps=Slider(10, range=0..10))

number_slider_4 = Slider(20, range=0..100)
range_4 = Range(Domain=dom, Steps=number_slider_4)

pt_2 = ConstructPoint(XCoordinate=crossref.ListA, YCoordinate=crossref.ListB, ZCoordinate=0)
number_slider_5 = Slider(0.5, range=0..1)
number_slider_6 = Slider(1, range=0..1)
number_slider_7 = Slider(0.8, range=0..1)
number_slider_8 = Slider(0.8, range=0..1)
pdecon = Deconstruct(Point=pt_2)  # -> XComponent, YComponent, ZComponent
expression = Expression(x=pdecon.XComponent, y=pdecon.YComponent, a=number_slider_8, b=number_slider_7, Expression="b*sin(y)")
expression_2 = Expression(x=pdecon.XComponent, y=pdecon.YComponent, a=number_slider_8, b=number_slider_7, Expression="a*cos(x)")
expression_3 = Expression(
    x=pdecon.XComponent,
    y=pdecon.YComponent,
    a=number_slider_5,
    b=number_slider_5,
    Expression="a*sin(x)*sin(x)+b*sin(y)*sin(y)")
expression_4 = Expression(x=pdecon.XComponent, y=pdecon.YComponent, a=number_slider_8, b=number_slider_7, Expression="a*cos(x)+b*sin(y)")
expression_5 = Expression(x=pdecon.XComponent, y=pdecon.YComponent, a=number_slider_6, b=number_slider_6, Expression="a*cos(x)*b*sin(y)")

crossref_2 = CrossReference(ListA=range_3, ListB=range_4, CrossMode=1)  # -> ListA, ListB
eval = Evaluate(F="a*cos(x)+b*sin(y)", x=crossref_2.ListA, y=crossref_2.ListB, a=Slider(0.8, range=0..10), b=Slider(0.8, range=0..10))
pt_3 = ConstructPoint(XCoordinate=crossref_2.ListA, YCoordinate=crossref_2.ListB, ZCoordinate=eval)

pt_4 = ConstructPoint(XCoordinate=pdecon.XComponent, YCoordinate=pdecon.YComponent, ZCoordinate=expression_3)
number_slider_9 = Slider(30, range=0..100)
srfgrid = SurfaceFromPoints(Points=flatten(pt_4), UCount=expr("x+1", number_slider_3), Interpolate=False)
pt_5 = ConstructPoint(XCoordinate=crossref_2.ListA, YCoordinate=crossref_2.ListB, ZCoordinate=0)
sdivide = DivideSurface(Surface=srfgrid, UCount=number_slider_9, VCount=number_slider_9)  # -> Points, Normals, Parameters
flip = FlipMatrix(Data=sdivide.Points)
pline = PolyLine(Vertices=sdivide.Points, Closed=False)
pline_2 = PolyLine(Vertices=flip, Closed=False)

addition = Addition(A=number_slider_4, B=1)
srfgrid_2 = SurfaceFromPoints(Points=flatten(pt_3), UCount=addition, Interpolate=False)
