# Grasshopper definition Class4__MathDDK.gh (Grasshopper 1.0.7)
# plug-ins: Bifocals

gallery = ImageGallery(CycleDelay=30, Randomize=False, UseLocalImages=True, UseRemoteImages=True)
number_slider = Slider(100, range=0..100)
deg = Degrees()
rad = Radians()

# ---- group: Diameter
number_slider_2 = Slider(74, range=0..100)

# ----
range = Range(Domain=Slider(100, range=0..100), Steps=number_slider)
pi = Pi(Factor=Slider(5, range=0..10))
panel = Panel(range)

# ---- group: Theta
range_2 = Range(Domain=pi, Steps=number_slider)

# ----
sin = Sine(Value=range_2)
cos = Cosine(Value=range_2)
dom = ConstructDomain(DomainStart=Slider(0, range=0..100), DomainEnd=number_slider_2)
panel_2 = Panel(range_2)

# ----
# Color Format
# Input
data = Data(1)
# Method
data_2 = Data(1)
# Output
data_3 = Data(1)
# Display
data_4 = Data(1)
# Unuse
data_5 = Data(1)

bnd = Bounds(Numbers=sin)
bnd_2 = Bounds(Numbers=cos)
remap = RemapNumbers(Value=cos, Source=bnd_2, Target=dom)  # -> Mapped, Clipped
remap_2 = RemapNumbers(Value=sin, Source=bnd, Target=dom)  # -> Mapped, Clipped
division = Division(A=number_slider_2, B=Slider(2, range=0..10))
pt = ConstructPoint(XCoordinate=remap.Mapped, YCoordinate=remap_2.Mapped, ZCoordinate=range)
pt_2 = ConstructPoint(XCoordinate=division, YCoordinate=division, ZCoordinate=range)
num = Number(range)
pline = PolyLine(Vertices=pt, Closed=False)
bnd_3 = Bounds(Numbers=num)
pi_2 = Pi(Factor=Slider(13, range=0..100))
remap_3 = RemapNumbers(Value=num, Source=bnd_3, Target=pi_2)  # -> Mapped, Clipped
vec2pt = Vector2Pt(PointA=pt_2, PointB=pt, Unitize=False)  # -> Vector, Length
reldif = RelativeDifferences(Values=num)
panel_3 = Panel(remap_3.Mapped)
sin_2 = Sine(Value=remap_3.Mapped)
graph = GraphMapper(remap_3.Mapped, x0=0, x1=1, y0=0, y1=1, container_name="Sine", Equation_px=[0, 0.05072198436], Equation_py=[0, 1])

# ---- group: Diameter
number_slider_3 = Slider(27, range=0..100)

# ----
num_2 = Number(sin_2)
bnd_4 = Bounds(Numbers=num_2)
dom_2 = ConstructDomain(DomainStart=Slider(0, range=0..100), DomainEnd=number_slider_3)
remap_4 = RemapNumbers(Value=num_2, Source=bnd_4, Target=dom_2)  # -> Mapped, Clipped
amp = Amplitude(Vector=vec2pt.Vector, Amplitude=remap_4.Mapped)
move = Move(Geometry=pt, Motion=amp)  # -> Geometry, Transform
ln = Line(StartPoint=pt_2, EndPoint=move.Geometry)
loft = Loft(Curves=ln, Options={Adjust=False, Closed=False, LoftEnds=0, LoftSimp=0, LoftType=0, Rebuild=10, Refit=0.01})
