# Grasshopper definition Class4__nkmr.gh (Grasshopper 1.0.7)
# Copyright: KAJIMA DESIGN
# plug-ins: EleFront

cyl = Cylinder(Base=PlaneXY(0, 0, 0), Radius=Slider(288, range=0..1000), Length=Slider(648, range=0..1000))
area = Area(Geometry=cyl)  # -> Area, Centroid
panel = Panel("""cylinder
0""")
panel_2 = Panel("""name
ID
Area""")
merge = Merge(Data1=panel, Data2=area.Area)
refbake = ReferenceByBakeName(BakeName="円柱を作る", Key="*", Val="*", maintainStructure=False)
panel_3 = Panel(merge)
reflay = ReferenceByLayer(LayerName="円柱::円柱1")
geo = Geometry(refbake)

panel_4 = Panel("操作に名前を付ける")
attributes = DefineObjectAttributes(UserKeys=panel_2, UserValues=merge, Name="円柱", Layer="円柱::円柱1", Color=ColourSwatch(SwatchColor=RGB(217, 39, 39)))

bake = BakeObjects(Geometry=cyl, Attributes=attributes, BakeName="円柱を作る", Bake=Toggle(False))
