# Grasshopper definition Class5-1-Lecture.gh (Grasshopper 1.0.7)
# plug-ins: Bifocals, Noise 4D

number_slider = Slider(100, range=0..100)
number_slider_2 = Slider(30, range=0..100)
gallery = ImageGallery(CycleDelay=30, Randomize=False, UseLocalImages=True, UseRemoteImages=True)
crv = Curve([<curve referenced from the Rhino model> x2])
boundary = BoundarySurfaces(Edges=crv)
dom = ConstructDomain(DomainStart=Slider(0, range=0..10), DomainEnd=Slider(50, range=0..100))
recgrid = Rectangular(Plane=PlaneXY(0, 0, 0), SizeX=number_slider, SizeY=number_slider, ExtentX=number_slider_2, ExtentY=number_slider_2)  # -> Cells, Points
tstat = TreeStatistics(Tree=recgrid.Points)  # -> Paths, Length, Count
random = Random(Range=dom, Number=Slider(10, range=0..10), Seed=Slider(3, range=0..10))
random_2 = Random(Range=Domain(0, 1), Number=Slider(31, range=0..100), Seed=Slider(82, range=0..100))
number_slider_3 = Slider(100, range=0..100)
number_slider_4 = Slider(30, range=0..100)

# ---- group: Panel Pattern
geo = Geometry(boundary)
geo_2 = Geometry(<brep referenced from the Rhino model>)
geo_3 = Geometry(<brep referenced from the Rhino model>)
geo_4 = Geometry(<brep referenced from the Rhino model>)
merge = Merge(Data1=geo, Data2=geo_2, Data3=geo_3, Data4=geo_4)

# ----
lng = ListLength(List=recgrid.Points)
random_3 = Random(Range=Slider(100, range=0..100), Number=tstat.Count, Seed=Slider(0, range=0..100))
panel = Panel(random)
perlin = PerlinNoise(Values=recgrid.Points, Time=Slider(28.0356, range=0..100), Scale=Slider(0.00083, range=0..0.01))
simplex = SimplexNoise(Values=recgrid.Points, Time=0, Scale=1)
int = Integer(graft(random_3))
random_4 = Random(Range=Domain(0, 1), Number=lng, Seed=int)
lng_2 = ListLength(List=merge)
recgrid_2 = Rectangular(Plane=PlaneXY(0, 0, 0), SizeX=number_slider_3, SizeY=number_slider_3, ExtentX=number_slider_4, ExtentY=number_slider_4)  # -> Cells, Points
tstat_2 = TreeStatistics(Tree=recgrid_2.Cells)  # -> Paths, Length, Count
lng_3 = ListLength(List=recgrid_2.Cells)

merge_2 = Merge(
    Data1=ColourSwatch(SwatchColor=RGB(214, 84, 84)),
    Data2=ColourSwatch(SwatchColor=RGB(162, 214, 84)),
    Data3=ColourSwatch(SwatchColor=RGB(93, 148, 142)),
    Data4=ColourSwatch(SwatchColor=RGB(139, 92, 196)))

# ----
# Color Format
# Input
data = Data(1)
# Method
data_2 = Data(1)
# Output
data_3 = Data(1)
# Display
data_4 = Data(1)
# Unuse
data_5 = Data(1)

random_5 = Random(Range=Slider(100, range=0..100), Number=tstat_2.Count, Seed=Slider(0, range=0..100))
cset = CreateSet(List=flatten(random_4))  # -> Set, Map
item = ListItem(List=flatten(recgrid_2.Cells), Index=0, Wrap=True)
panel_2 = Panel(random_4)
int_2 = Integer(graft(random_5))
subtraction = Subtraction(A=lng_2, B=Slider(1, range=0..1))
random_6 = Random(Range=Domain(0, 1), Number=lng_3, Seed=int_2)
toggle = BooleanToggle(True)
bbox = BoundingBox(Content=recgrid_2.Cells, Plane=PlaneXY(0, 0, 0))  # -> Box, Box_2
bnd = Bounds(Numbers=random_4)
area = Area(Geometry=recgrid_2.Cells)  # -> Area, Centroid
perlin_2 = PerlinNoise(Values=area.Centroid, Time=Slider(35.6719, range=0..100), Scale=Slider(0.00198, range=0..0.01))
num = Number(random_4)
num_2 = Number(perlin)
lng_4 = ListLength(List=merge_2)
panel_3 = Panel(cset.Set)
debrep = DeconstructBrep(Brep=bbox.Box_2)  # -> Faces, Edges, Vertices
multiplication = Multiplication(A=Slider(0.6, range=0..1), B=random_6)
bnd_2 = Bounds(Numbers=flatten(perlin_2))
subtraction_2 = Subtraction(A=lng_4, B=1)
remap = RemapNumbers(Value=random_4, Source=bnd, Target=subtraction_2)  # -> Mapped, Clipped
pt = Point(debrep.Vertices)

dom_2 = ConstructDomain(DomainStart=Slider(10, range=0..20), DomainEnd=Slider(50, range=0..100))

remap_2 = RemapNumbers(Value=perlin_2, Source=bnd_2, Target=Domain(0, 1))  # -> Mapped, Clipped
item_2 = ListItem(List=pt, Index=0, Wrap=True)
range = Range(Domain=Domain(0, 1), Steps=subtraction_2)

int_3 = Integer(remap.Mapped)

merge_3 = Merge(
    Data1=Slider(24, range=0..100),
    Data2=Slider(15, range=0..100),
    Data3=Slider(43, range=0..100),
    Data4=Slider(17, range=0..100))
pshift = ShiftPaths(Data=item_2, Offset=-1)
graph = GraphMapper(
    range,
    x0=0,
    x1=1,
    y0=0,
    y1=1,
    container_name="Bezier",
    cpx=[0, 0.3373191953, 1, 1],
    cpy=[0, 0.1608692408, 0.6072458029, 1])
addition = Addition(A=remap_2.Mapped, B=multiplication)
item_3 = ListItem(List=graph, Index=int_3, Wrap=True)
filter = StreamFilter(Gate=Slider(2, range=0..10), Stream0=num_2, Stream1=num, Stream2=item_3)
item_4 = ListItem(List=merge_3, Index=int_3, Wrap=True)
item_5 = ListItem(List=merge_2, Index=int_3, Wrap=True)

bnd_3 = Bounds(Numbers=flatten(filter))
remap_3 = RemapNumbers(Value=filter, Source=bnd_3, Target=Domain(0, 1))  # -> Mapped, Clipped

bnd_4 = Bounds(Numbers=filter)
remap_4 = RemapNumbers(Value=filter, Source=bnd_4, Target=dom_2)  # -> Mapped, Clipped

cset_2 = CreateSet(List=flatten(item_3))  # -> Set, Map
panel_4 = Panel(int_3)
num_3 = Number(addition)
bnd_5 = Bounds(Numbers=flatten(num_3))
panel_5 = Panel(cset_2.Set)
panel_6 = Panel(perlin_2)
remap_5 = RemapNumbers(Value=num_3, Source=bnd_5, Target=subtraction)  # -> Mapped, Clipped
panel_7 = Panel(range)

cir = Circle(Plane=recgrid.Points, Radius=remap_4.Mapped)

gradient = Gradient(
    LowerLimit=0,
    UpperLimit=1,
    Parameter=remap_3.Mapped,
    stops=[0: RGB(0, 98, 0), 0.25: RGB(81, 175, 17), 0.5: RGB(159, 198, 146), 0.75: RGB(170, 235, 41), 1: RGB(221, 255, 53)])
int_4 = Integer(remap_5.Mapped)
item_6 = ListItem(List=merge, Index=int_4, Wrap=True)
panel_8 = Panel(remap_4.Mapped)
geo_5 = Geometry(item_6)
bbox_2 = BoundingBox(Content=geo_5, Plane=PlaneXY(0, 0, 0))  # -> Box, Box_2
bnd_6 = Bounds(Numbers=flatten(int_4))
boundary_2 = BoundarySurfaces(Edges=cir)
debrep_2 = DeconstructBrep(Brep=bbox_2.Box_2)  # -> Faces, Edges, Vertices
remap_6 = RemapNumbers(Value=int_4, Source=bnd_6, Target=Domain(0, 1))  # -> Mapped, Clipped
area_2 = Area(Geometry=geo_5)  # -> Area, Centroid
pt_2 = Point(debrep_2.Vertices)
preview = CustomPreview(Geometry=boundary_2, Material=gradient)
preview_2 = CustomPreview(Geometry=boundary_2, Material=item_5)
item_7 = ListItem(List=pt_2, Index=0, Wrap=True)
pshift_2 = ShiftPaths(Data=item_7, Offset=-1)
orient = Orient(Geometry=geo_5, Source=pshift_2, Target=pshift)  # -> Geometry, Transform
gradient_2 = Gradient(
    LowerLimit=0,
    UpperLimit=1,
    Parameter=remap_6.Mapped,
    stops=[0: RGB(234, 38, 0), 0.273: RGB(234, 126, 0), 0.576: RGB(254, 244, 84), 0.822: RGB(173, 203, 249), 1: RGB(75, 107, 169)])
tag = TextTag(Location=area.Centroid, Text=int_4)
preview_3 = CustomPreview(Geometry=orient.Geometry, Material=ColourSwatch(SwatchColor=RGB(150, 122, 122)))
preview_4 = CustomPreview(Geometry=orient.Geometry, Material=gradient_2)
