# Grasshopper definition Class5-1.gh (Grasshopper 1.0.7)
# plug-ins: Noise 4D

gallery = ImageGallery(CycleDelay=30, Randomize=False, UseLocalImages=True, UseRemoteImages=True)

xz = XZPlane(Origin=Point(0, 0, 0))
recgrid = Rectangular(
    Plane=xz,
    SizeX=Slider(1000, range=0..1000),
    SizeY=Slider(2000, range=0..10000),
    ExtentX=Slider(20, range=0..100),
    ExtentY=Slider(27, range=0..100))  # -> Cells, Points

dom = ConstructDomain(DomainStart=Slider(0, range=0..100), DomainEnd=Slider(20, range=0..100))

xz_2 = XZPlane(Origin=Point(0, 0, 0))
recgrid_2 = Rectangular(
    Plane=xz_2,
    SizeX=Slider(1000, range=0..1000),
    SizeY=Slider(2000, range=0..10000),
    ExtentX=Slider(20, range=0..100),
    ExtentY=Slider(27, range=0..100))  # -> Cells, Points

xz_3 = XZPlane(Origin=Point(0, 0, 0))
recgrid_3 = Rectangular(
    Plane=xz_3,
    SizeX=Slider(1000, range=0..1000),
    SizeY=Slider(2000, range=0..10000),
    ExtentX=Slider(20, range=0..100),
    ExtentY=Slider(27, range=0..100))  # -> Cells, Points

xz_4 = XZPlane(Origin=Point(0, 0, 0))
recgrid_4 = Rectangular(
    Plane=xz_4,
    SizeX=Slider(1000, range=0..1000),
    SizeY=Slider(2000, range=0..10000),
    ExtentX=Slider(20, range=0..100),
    ExtentY=Slider(27, range=0..100))  # -> Cells, Points

xz_5 = XZPlane(Origin=Point(0, 0, 0))
recgrid_5 = Rectangular(
    Plane=xz_5,
    SizeX=Slider(1000, range=0..1000),
    SizeY=Slider(2000, range=0..10000),
    ExtentX=Slider(20, range=0..100),
    ExtentY=Slider(27, range=0..100))  # -> Cells, Points

xz_6 = XZPlane(Origin=Point(0, 0, 0))
recgrid_6 = Rectangular(
    Plane=xz_6,
    SizeX=Slider(1000, range=0..1000),
    SizeY=Slider(2000, range=0..10000),
    ExtentX=Slider(94, range=0..100),
    ExtentY=Slider(27, range=0..100))  # -> Cells, Points

xz_7 = XZPlane(Origin=Point(0, 0, 0))
recgrid_7 = Rectangular(
    Plane=xz_7,
    SizeX=Slider(1000, range=0..1000),
    SizeY=Slider(2000, range=0..10000),
    ExtentX=Slider(94, range=0..100),
    ExtentY=Slider(27, range=0..100))  # -> Cells, Points

srf = Surface(<surface referenced from the Rhino model>)
srf_2 = Surface(<surface referenced from the Rhino model>)
srf_3 = Surface(<surface referenced from the Rhino model>)
srf_4 = Surface(<surface referenced from the Rhino model>)
srf_5 = Surface(<surface referenced from the Rhino model>)
merge = Merge(Data1=srf, Data2=srf_2, Data3=srf_3, Data4=srf_4, Data5=srf_5)
lng = ListLength(List=merge)
area = Area(Geometry=merge)  # -> Area, Centroid

deplane = DeconstructPlane(Plane=xz_2)  # -> Origin, XAxis, YAxis, ZAxis
srf_6 = Surface(recgrid.Cells)

random = Random(Range=dom, Number=Slider(20, range=0..100), Seed=2)

srf_7 = Surface(recgrid_2.Cells)
area_2 = Area(Geometry=recgrid_3.Cells)  # -> Area, Centroid
area_3 = Area(Geometry=recgrid_4.Cells)  # -> Area, Centroid
area_4 = Area(Geometry=recgrid_5.Cells)  # -> Area, Centroid
disc = Discontinuity(Curve=srf_7, Level=1)  # -> Points, Parameters

dom_2 = ConstructDomain(DomainStart=Slider(0, range=0..100), DomainEnd=Slider(2112, range=0..3000))

area_5 = Area(Geometry=recgrid_6.Cells)  # -> Area, Centroid
area_6 = Area(Geometry=recgrid_7.Cells)  # -> Area, Centroid

dom_3 = ConstructDomain(DomainStart=Slider(0.524, range=0..1), DomainEnd=Slider(0.907, range=0..1))

tstat = TreeStatistics(Tree=srf_6)  # -> Paths, Length, Count
lng_2 = ListLength(List=tstat.Paths)

# ----
# Color Format
# Input
data = Data(1)
# Method
data_2 = Data(1)
# Output
data_3 = Data(1)
# Display
data_4 = Data(1)
# Unuse
data_5 = Data(1)

random_2 = Random(Range=Slider(52, range=0..100), Number=lng_2, Seed=Slider(28, range=0..100))  # -> graft(Random)

dom_4 = ConstructDomain(DomainStart=Slider(0.524, range=0..1), DomainEnd=Slider(0.907, range=0..1))

dom_5 = ConstructDomain(DomainStart=Slider(0.524, range=0..1), DomainEnd=Slider(0.907, range=0..1))

tstat_2 = TreeStatistics(Tree=disc.Points)  # -> Paths, Length, Count
lng_3 = ListLength(List=tstat_2.Paths)

panel = Panel(random)

tstat_3 = TreeStatistics(Tree=area_2.Centroid)  # -> Paths, Length, Count
lng_4 = ListLength(List=tstat_3.Paths)

random_3 = Random(Range=Slider(1000, range=0..1000), Number=lng_4, Seed=Slider(374, range=0..1000))

perlin = PerlinNoise(Values=area_5.Centroid, Time=Slider(754, range=0..1000), Scale=Slider(3.2e-05, range=0..0.001))

perlin_2 = PerlinNoise(Values=area_6.Centroid, Time=Slider(754, range=0..1000), Scale=Slider(3.2e-05, range=0..0.001))

tstat_4 = TreeStatistics(Tree=area_3.Centroid)  # -> Paths, Length, Count
lng_5 = ListLength(List=tstat_4.Paths)

random_4 = Random(Range=Slider(1000, range=0..1000), Number=lng_5, Seed=Slider(183, range=0..1000))

ma = MassAddition(Input=tstat_2.Length)  # -> Result, PartialResults

tstat_5 = TreeStatistics(Tree=area_4.Centroid)  # -> Paths, Length, Count
lng_6 = ListLength(List=tstat_5.Paths)

random_5 = Random(Range=Slider(1000, range=0..1000), Number=lng_6, Seed=Slider(183, range=0..1000))

reduce = RandomReduce(List=srf_6, Reduction=Slider(20, range=0..100), Seed=random_2)
srf_8 = Surface(reduce)

random_6 = Random(Range=dom_3, Number=tstat_3.Length, Seed=random_3)

random_7 = Random(Range=dom_4, Number=tstat_4.Length, Seed=random_4)

random_8 = Random(Range=dom_5, Number=tstat_5.Length, Seed=random_5)

dom_6 = ConstructDomain(DomainStart=Slider(0.975, range=0..1), DomainEnd=Slider(1, range=0..1))

dom_7 = ConstructDomain(DomainStart=Slider(0, range=0..1), DomainEnd=Slider(3, range=0..10))
bnd = Bounds(Numbers=random_7)
remap = RemapNumbers(Value=random_7, Source=bnd, Target=dom_7)  # -> Mapped, Clipped
int = Integer(remap.Mapped)

preview = CustomPreview(Geometry=srf_8, Material=ColourSwatch(SwatchColor=RGB(178, 118, 118)))

range = Range(Domain=dom_6, Steps=lng_6)
match = MatchTree(Tree=random_6, Guide=recgrid_3.Cells)
scale = Scale(Geometry=recgrid_3.Cells, Center=area_2.Centroid, Factor=random_6)  # -> Geometry, Transform
bnd_2 = Bounds(Numbers=perlin)
graph = GraphMapper(range, x0=0, x1=1, y0=0, y1=1, container_name="Sine", Equation_px=[0, 0.6355484724], Equation_py=[0, 1])
scale_2 = Scale(Geometry=recgrid_4.Cells, Center=area_3.Centroid, Factor=random_7)  # -> Geometry, Transform
dom_8 = ConstructDomain(DomainStart=Slider(0.449, range=0..1), DomainEnd=Slider(0.892, range=0..1))
gradient = Gradient(
    LowerLimit=0,
    UpperLimit=1,
    Parameter=random_6,
    stops=[0: RGB(234, 38, 0), 0.25: RGB(234, 126, 0), 0.5: RGB(254, 244, 84), 0.75: RGB(173, 203, 249), 1: RGB(75, 107, 169)])
multiplication = Multiplication(A=graph, B=random_8)

dom_9 = ConstructDomain(DomainStart=Slider(0.524, range=0..1), DomainEnd=Slider(0.907, range=0..1))

remap_2 = RemapNumbers(Value=perlin, Source=bnd_2, Target=dom_8)  # -> Mapped, Clipped

number_slider = Slider(3, range=0..10)
bnd_3 = Bounds(Numbers=multiplication)
remap_3 = RemapNumbers(Value=multiplication, Source=bnd_3, Target=number_slider)  # -> Mapped, Clipped
range_2 = Range(Domain=dom_9, Steps=number_slider)
item = ListItem(List=range_2, Index=remap_3.Mapped, Wrap=True)

merge_2 = Merge(
    Data1=ColourSwatch(SwatchColor=RGB(121, 237, 160)),
    Data2=ColourSwatch(SwatchColor=RGB(212, 61, 61)),
    Data3=ColourSwatch(SwatchColor=RGB(39, 112, 93)),
    Data4=ColourSwatch(SwatchColor=RGB(235, 169, 169)))
item_2 = ListItem(List=merge_2, Index=int, Wrap=True)

boundary = BoundarySurfaces(Edges=scale.Geometry)

boundary_2 = BoundarySurfaces(Edges=scale_2.Geometry)

preview_2 = CustomPreview(Geometry=boundary, Material=gradient)
preview_3 = CustomPreview(Geometry=boundary_2, Material=item_2)
scale_3 = Scale(Geometry=recgrid_6.Cells, Center=area_5.Centroid, Factor=remap_2.Mapped)  # -> Geometry, Transform

match_2 = MatchTree(Tree=item, Guide=recgrid_5.Cells)
scale_4 = Scale(Geometry=recgrid_5.Cells, Center=area_4.Centroid, Factor=match_2)  # -> Geometry, Transform

boundary_3 = BoundarySurfaces(Edges=scale_3.Geometry)

boundary_4 = BoundarySurfaces(Edges=scale_4.Geometry)

gradient_2 = Gradient(
    LowerLimit=0,
    UpperLimit=1,
    Parameter=remap_2.Mapped,
    stops=[0: RGB(234, 38, 0), 0.25: RGB(234, 126, 0), 0.5: RGB(254, 244, 84), 0.75: RGB(173, 203, 249), 1: RGB(75, 107, 169)])
gradient_3 = Gradient(
    LowerLimit=0,
    UpperLimit=1,
    Parameter=item,
    stops=[0: RGB(234, 38, 0), 0.25: RGB(234, 126, 0), 0.5: RGB(254, 244, 84), 0.75: RGB(173, 203, 249), 1: RGB(75, 107, 169)])
preview_4 = CustomPreview(Geometry=boundary_3, Material=gradient_2)
preview_5 = CustomPreview(Geometry=boundary_4, Material=gradient_3)

random_9 = Random(Range=dom_2, Number=ma.Result, Seed=Slider(68, range=0..100))  # -> graft(Random)

amp = Amplitude(Vector=deplane.ZAxis, Amplitude=random_9)

partition = PartitionList(List=flatten(amp), Size=tstat_2.Length)
match_3 = MatchTree(Tree=partition, Guide=disc.Points)

move = Move(Geometry=simplify(disc.Points), Motion=simplify(match_3))  # -> Geometry, Transform

split = SplitList(List=move.Geometry, Index=Slider(3, range=0..10))  # -> ListA, ListB
panel_2 = Panel(partition)

pline = PolyLine(Vertices=split.ListA, Closed=True)
boundary_5 = BoundarySurfaces(Edges=pline)

shift = ShiftList(List=move.Geometry, Shift=Slider(2, range=0..10), Wrap=True)

swatch = ColourSwatch(SwatchColor=RGB(178, 118, 118))
preview_6 = CustomPreview(Geometry=boundary_5, Material=swatch)

split_2 = SplitList(List=shift, Index=Slider(3, range=0..10))  # -> ListA, ListB
pline_2 = PolyLine(Vertices=split_2.ListA, Closed=True)
boundary_6 = BoundarySurfaces(Edges=pline_2)
preview_7 = CustomPreview(Geometry=boundary_6, Material=swatch)

tstat_6 = TreeStatistics(Tree=perlin_2)  # -> Paths, Length, Count
lng_7 = ListLength(List=tstat_6.Paths)
dom_10 = ConstructDomain(DomainStart=Slider(0, range=0..1), DomainEnd=Slider(0.173, range=0..1))

random_10 = Random(Range=Slider(1000, range=0..1000), Number=lng_7, Seed=Slider(826, range=0..1000))

random_11 = Random(Range=dom_10, Number=tstat_6.Length, Seed=random_10)

addition = Addition(A=perlin_2, B=random_11)
bnd_4 = Bounds(Numbers=addition)
remap_4 = RemapNumbers(Value=addition, Source=bnd_4, Target=lng)  # -> Mapped, Clipped
int_2 = Integer(remap_4.Mapped)
item_3 = ListItem(List=merge, Index=int_2, Wrap=True)
xz_8 = XZPlane(Origin=area_6.Centroid)
item_4 = ListItem(List=area.Centroid, Index=int_2, Wrap=True)

orient = Orient(Geometry=item_3, Source=item_4, Target=xz_8)  # -> Geometry, Transform
preview_8 = CustomPreview(
    Geometry=orient.Geometry,
    Material={diffuse=RGB(221, 160, 221), emission=RGB(66, 48, 66), shine=0.5, specular=RGB(255, 255, 255), transparency=0})
