# Grasshopper definition Class5-homework_.gh (Grasshopper 1.0.7)
# Copyright: Arup
# plug-ins: Bifocals

crv = Curve(<curve referenced from the Rhino model>)
crv_2 = Curve(<curve referenced from the Rhino model>)
crv_3 = Curve(<curve referenced from the Rhino model>)
crv_4 = Curve(<curve referenced from the Rhino model>)
loft = Loft(Curves=[crv, crv_2], Options={Adjust=False, Closed=False, LoftEnds=0, LoftSimp=0, LoftType=0, Rebuild=10, Refit=0.01})
loft_2 = Loft(Curves=[crv_3, crv_4], Options={Adjust=False, Closed=False, LoftEnds=0, LoftSimp=0, LoftType=0, Rebuild=10, Refit=0.01})
srf = Surface(loft)
pt = Point(<point referenced from the Rhino model>)
srf_2 = Surface(loft_2)
edges = BrepEdges(Brep=srf)  # -> Naked, Interior, NonManifold
recgrid = Rectangular(
    Plane=pt,
    SizeX=Slider(10, range=0..10),
    SizeY=Slider(6, range=0..10),
    ExtentX=Slider(15, range=0..100),
    ExtentY=Slider(10, range=0..10))  # -> Cells, Points
edges_2 = BrepEdges(Brep=srf_2)  # -> Naked, Interior, NonManifold
pt_2 = Point(recgrid.Points)
panel = Panel(edges.Naked)
X = UnitX(Factor="90")
panel_2 = Panel(edges_2.Naked)
panel_3 = Panel("""0
2""")
rotax = RotateAxis(Geometry=pt_2, Angle=degrees(X), Axis=Line((0, 0, 0), (10, 0, 0)))  # -> Geometry, Transform
panel_4 = Panel("""0
2""")
item = ListItem(List=panel, Index=panel_3, Wrap=True)
pt_3 = Point(rotax.Geometry)
item_2 = ListItem(List=panel_2, Index=panel_4, Wrap=True)
tmatch = MatchText(Text=panel, Pattern=item, Case=True)
tmatch_2 = MatchText(Text=panel_2, Pattern=item_2, Case=True)
tstat = TreeStatistics(Tree=pt_3)  # -> Paths, Length, Count
dispatch = Dispatch(List=edges.Naked, DispatchPattern=tmatch)  # -> ListA, ListB
panel_5 = Panel("""true
false""")
lng = ListLength(List=tstat.Paths)
index = ItemIndex(List=tstat.Paths, Item=tstat.Paths)
dispatch_2 = Dispatch(List=edges_2.Naked, DispatchPattern=tmatch_2)  # -> ListA, ListB
crv_5 = Curve(dispatch.ListB)
series = Series(Start=0, Step=1, Count=lng)
crv_6 = Curve(dispatch_2.ListB)
cull = CullPattern(List=pt_3, CullPattern=panel_5)
netsurf = NetworkSurface(CurvesU=crv_5, CurvesV=dispatch.ListA, Continuity=2)
divide = DivideDomain²(Domain=netsurf, UCount=Slider(11, range=0..100), VCount=Slider(17, range=0..100))
subsrf = Isotrim(Surface=netsurf, Domain=divide)  # -> graft(Surface)
viewer = ParamViewer(subsrf)
netsurf_2 = NetworkSurface(CurvesU=crv_6, CurvesV=dispatch_2.ListA, Continuity=2)
crv_7 = Curve(<curve referenced from the Rhino model>)
sdivide = DivideSurface(Surface=netsurf, UCount=Slider(16, range=0..100), VCount=10)  # -> Points, Normals, Parameters
dim = Dimensions(Surface=subsrf)  # -> graft(UDimension), graft(VDimension)
viewer_2 = ParamViewer(dim.VDimension)
area = Area(Geometry=subsrf)  # -> Area, graft(Centroid)
mod = Modulus(A=series, B=Slider(2, range=0..10))  # -> graft(Result)
sdivide_2 = DivideSurface(Surface=netsurf_2, UCount=Slider(16, range=0..100), VCount=10)  # -> Points, Normals, Parameters
dom = ConstructDomain(DomainStart=Slider(1000, range=0..1000), DomainEnd=Slider(0, range=0..100))
not = GateNot(A=panel_5)
viewer_3 = ParamViewer(area.Centroid)
dom_2 = ConstructDomain(DomainStart=Slider(0, range=0..100), DomainEnd=Slider(1300, range=0..10000))

pt_4 = Point(sdivide.Points)
tstat_2 = TreeStatistics(Tree=pt_4)  # -> Paths, Length, Count
lng_2 = ListLength(List=tstat_2.Paths)
index_2 = ItemIndex(List=tstat_2.Paths, Item=tstat_2.Paths)
panel_6 = Panel("""true
false""")
series_2 = Series(Start=0, Step=1, Count=lng_2)
cull_2 = CullPattern(List=pt_4, CullPattern=panel_6)
mod_2 = Modulus(A=series_2, B=Slider(2, range=0..10))  # -> graft(Result)
# 市松状にポイントを取る
not_2 = GateNot(A=panel_6)
weave = Weave(Pattern=mod_2, Stream0=panel_6, Stream1=not_2, NullGaps=False)
cull_3 = CullPattern(List=simplify(pt_4), CullPattern=simplify(weave))

pt_5 = Point(sdivide_2.Points)
weave_2 = Weave(Pattern=mod, Stream0=panel_5, Stream1=not, NullGaps=False)
panel_7 = Panel(pt_4)
extr = Extrude(Base=subsrf)
pull = PullPoint(Point=pt_5, Geometry=crv_7, ClosestOnly=True)  # -> ClosestPoint, Distance
cull_4 = CullPattern(List=simplify(pt_3), CullPattern=simplify(weave_2))
number_slider = Slider(292, range=0..1000)
tstat_3 = TreeStatistics(Tree=cull_4)  # -> Paths, Length, Count
pt_6 = Point(cull_4)
lng_3 = ListLength(List=cull_4)
remap = RemapNumbers(Value=pull.Distance, Source=dom_2, Target=dom)  # -> Mapped, Clipped
panel_8 = Panel("""false
false
false
false
false
false
false
false
false
false
true""")
random = Random(Range=Slider(1000, range=0..1000), Number=tstat_3.Count, Seed=Slider(252, range=0..1000))
random_2 = Random(Range=Slider(1, range=0..1), Number=lng_3, Seed=random)
geo = Geometry([<brep referenced from the Rhino model> x2])
graph = GraphMapper(
    remap.Mapped,
    x0=0,
    x1=1,
    y0=0,
    y1=1,
    container_name="Sine Summation",
    Equation0_px=[0.2003792971, 0.3386354446],
    Equation0_py=[0.1359706521, 0.364253819],
    Equation1_px=[0.6, 0.9],
    Equation1_py=[0.3, 0.5])
pt_7 = Point(<point referenced from the Rhino model>)
cull_5 = CullPattern(List=pt_4, CullPattern=panel_8)
int = Integer(random_2)
item_3 = ListItem(List=geo, Index=int, Wrap=True)
xz = XZPlane(Origin=pt_7)
pt_8 = Point(cull_5)
円弧の中心点 = Point(<point referenced from the Rhino model>)
orient = Orient(Geometry=item_3, Source=pt_7, Target=pt_6)  # -> Geometry, Transform
viewer_4 = ParamViewer(pt_8)
lng_4 = ListLength(List=pt_6)
panel_9 = Panel(int)
vec2pt = Vector2Pt(PointA=pt_8, PointB=円弧の中心点, Unitize=False)  # -> Vector, Length
number_slider_2 = Slider(4, range=0..10)
number_slider_3 = Slider(4, range=0..10)
number_slider_4 = Slider(4, range=0..10)
dom_3 = ConstructDomain(DomainStart=Slider(0, range=0..100), DomainEnd=Slider(10, range=0..10))
pt_9 = Point(cull_3)
X_2 = UnitX(Factor=Slider(13, range=0..100))
X_3 = UnitX(Factor=Slider(13, range=0..100))
remap_2 = RemapNumbers(Value=graph, Source=Domain(0, 1), Target=dom_3)  # -> Mapped, Clipped
viewer_5 = ParamViewer(vec2pt.Vector)
X_4 = UnitX(Factor=Slider(13, range=0..100))
move = Move(Geometry=pt_6, Motion=X_2)  # -> Geometry, Transform
division = Division(A=pull.Distance, B="10")
X_5 = UnitX(Factor=remap_2.Clipped)
move_2 = Move(Geometry=pt_6, Motion=X_3)  # -> Geometry, Transform
vec = VectorXYZ(XComponent="-3", YComponent=number_slider_2, ZComponent=0)  # -> Vector, Length
vec_2 = VectorXYZ(XComponent="-1", YComponent=number_slider_3, ZComponent=0)  # -> Vector, Length
vec_3 = VectorXYZ(XComponent="-3", YComponent=number_slider_2, ZComponent=0)  # -> Vector, Length
vec_4 = VectorXYZ(XComponent="-1", YComponent=number_slider_3, ZComponent=0)  # -> Vector, Length
division_2 = Division(A=vec2pt.Vector, B=Slider(22, range=0..30))
move_3 = Move(Geometry=pt_6, Motion=X_4)  # -> Geometry, Transform
vec_5 = VectorXYZ(XComponent="-3", YComponent=number_slider_4, ZComponent=0)  # -> Vector, Length
vec_6 = VectorXYZ(XComponent="-3", YComponent=number_slider_4, ZComponent=0)  # -> Vector, Length
move_4 = Move(Geometry=move.Geometry, Motion=vec.Vector)  # -> Geometry, Transform
move_5 = Move(Geometry=move_2.Geometry, Motion=vec_2.Vector)  # -> Geometry, Transform
move_6 = Move(Geometry=pt_6, Motion=vec_3.Vector)  # -> Geometry, Transform
move_7 = Move(Geometry=pt_6, Motion=vec_4.Vector)  # -> Geometry, Transform
move_8 = Move(Geometry=pt_5, Motion=X_5)  # -> Geometry, Transform
move_9 = Move(Geometry=move_3.Geometry, Motion=vec_5.Vector)  # -> Geometry, Transform
move_10 = Move(Geometry=pt_6, Motion=vec_6.Vector)  # -> Geometry, Transform
viewer_6 = ParamViewer(division_2)
srf4pt = _4PointSurface(CornerA=pt_6, CornerB=move_2.Geometry, CornerC=move_5.Geometry, CornerD=move_7.Geometry)
srf4pt_2 = _4PointSurface(CornerA=pt_6, CornerB=move.Geometry, CornerC=move_4.Geometry, CornerD=move_6.Geometry)
sph = Sphere(Base=move_8.Geometry, Radius=division)
move_11 = Move(Geometry=pt_8, Motion=division_2)  # -> Geometry, Transform
srf4pt_3 = _4PointSurface(CornerA=pt_6, CornerB=move_3.Geometry, CornerC=move_9.Geometry, CornerD=move_10.Geometry)
Z = UnitZ(Factor="6")
Z_2 = UnitZ(Factor="6")
Z_3 = UnitZ(Factor="6")
extr_2 = Extrude(Base=srf4pt_2, Direction=Z)
preview = CustomPreview(
    Geometry=sph,
    Material={diffuse=RGB(221, 160, 221), emission=RGB(66, 48, 66), shine=0.5, specular=RGB(255, 255, 255), transparency=0})
extr_3 = Extrude(Base=srf4pt, Direction=Z_2)
extr_4 = Extrude(Base=srf4pt_3, Direction=Z_3)
list = ValueList({"A": 0, "B": 1}, selected="B")
filter = StreamFilter(Gate=list, Stream0=graft(extr_2), Stream1=graft(extr_3))
viewer_7 = ParamViewer(filter)
lng_5 = ListLength(List=filter)
viewer_8 = ParamViewer(lng_5)
remap_3 = RemapNumbers(Value=lng_5, Source=Domain(0, 1), Target=Domain(0, 1))  # -> Mapped, Clipped
graph_2 = GraphMapper(
    remap_3.Mapped,
    x0=0,
    x1=1,
    y0=0,
    y1=1,
    container_name="Sinc",
    Equation_X0=0.5072463751,
    Equation_X1=0.6717794538,
    Equation_Y0=0.7463768125,
    Equation_Y1=0.3405814767)
dom_4 = ConstructDomain(DomainStart=Slider(0, range=0..100), DomainEnd=Slider(10, range=0..10))
random_3 = Random(Range=lng_5, Number=lng_4, Seed=Slider(500, range=0..1000))
remap_4 = RemapNumbers(Value=graph_2, Source=Domain(0, 1), Target=dom_4)  # -> Mapped, Clipped
int_2 = Integer(random_3)
item_4 = ListItem(List=filter, Index=int_2, Wrap=True)
panel_10 = Panel(int_2)
viewer_9 = ParamViewer(remap_4.Mapped)
preview_2 = CustomPreview(Geometry=item_4, Material=ColourSwatch(SwatchColor=RGB(24, 217, 165)))
