# Grasshopper definition Class7_LadyBugTools_Radiance+Grapagos.gh (Grasshopper 1.0.7)
# plug-ins: LunchBox

gallery = ImageGallery(CycleDelay=30, Randomize=False, UseLocalImages=True, UseRemoteImages=True)

ladybug = Ladybug_Ladybug()  # -> Vviiiiiiiiiizzz; plug-in component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
# 環境データを読み込む
honeybee = Honeybee_Honeybee()  # -> Vviiiiiiiiiizzz; plug-in component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

downloadepw = Ladybug_downloadEPWWeatherFile(download=Toggle(False))  # -> readMe; plug-in component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

# ----
# Color Format
# Input
data = Data(1)
# Method
data_2 = Data(1)
# Output
data_3 = Data(1)
# Display
data_4 = Data(1)
# Unuse
data_5 = Data(1)

# ---- group: 環境データの読み込み
panel = Panel("http://climate.onebuilding.org/WMO_Region_2_Asia/JPN_Japan/TK_Tokyo/JPN_TK_Tokyo.476620_JGMY.zip")
epw_stat = Ladybug_OpenEPWAndSTATWeatherFiles(weatherFileURL=panel)  # -> epwFile, statFile; plug-in component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
genclimatebasedsky = Honeybee_GenerateClimateBasedSky(weatherFile=epw_stat.epwFile, month="6", day="21", hour="9")  # -> radiationValues, skyFilePath; plug-in component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

# ----
周辺の障害物_建物 = Brep([<brep referenced from the Rhino model> x4])
mesh = MeshBrep(
    Brep=周辺の障害物_建物,
    Settings={GridMaxCount=0, GridMinCount=16, JaggedSeams=False, MaxEdgeLength=0, MinEdgeLength=0.0001, MinTolerance=0, Refine=True, RefineAngle=0, RelativeTolerance=0.65, SimplePlanes=True, Tolerance=0})

屋根の面 = Surface(<surface referenced from the Rhino model>)
genes = GenePool(Decimals=2, Maximum=0.99, Minimum=0.1, Value=[0.19, 0.66, 0.99, 0.54, 0.63, 0.22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])
quads = QuadPanels(Surface=屋根の面, UDivisions=Slider(20, range=0..100), VDivisions=Slider(10, range=0..100))

gencumulativeskymtx = Ladybug_GenCumulativeSkyMtx(epwFile=epw_stat.epwFile, skyDensity=0, useOldRes=True, runIt=Toggle(True))  # -> readMe, cumulativeSkyMtx; plug-in component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
selectskymtx = Ladybug_selectSkyMtx(cumulativeSkyMtx=gencumulativeskymtx.cumulativeSkyMtx, removeDiffuse=False, removeDirect=False)  # -> readMe, selectedSkyMtx; plug-in component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

md_slider = MDSlider(SliderMode=0, slider_value=Point(0.5, 0.5, 0.5), x_domain=Domain(0, 1), y_domain=Domain(0, 1), z_domain=Domain(0, 1))

area = Area(Geometry=quads)  # -> Area, Centroid
scale = Scale(Geometry=quads, Center=area.Centroid, Factor=genes)  # -> Geometry, Transform

crv = Curve(<curve referenced from the Rhino model>)
boundary = BoundarySurfaces(Edges=crv)

divide = DivideDomain²(Domain=boundary, UCount=Slider(20, range=0..100), VCount=Slider(10, range=0..100))
subsrf = Isotrim(Surface=boundary, Domain=divide)

dom = ConstructDomain(DomainStart=Slider(500, range=0..1000), DomainEnd=Slider(0, range=0..100))

wires = BrepWireframe(Brep=scale.Geometry, Density=-1)
join = JoinCurves(Curves=wires, Preserve=False)
srf = Surface(scale.Geometry)

evalsrf = EvaluateSurface(Surface=quads, Point=md_slider)  # -> Point, Normal, UDirection, VDirection, Frame

mjoin = MeshJoin(Meshes=subsrf)

remap = RemapNumbers(Value=genes, Source=Domain(0, 1), Target=dom)  # -> Mapped, Clipped
amp = Amplitude(Vector=evalsrf.Normal, Amplitude=remap.Mapped)
move = Move(Geometry=join, Motion=graft(amp))  # -> Geometry, Transform

wires_2 = BrepWireframe(Brep=quads, Density=-1)
join_2 = JoinCurves(Curves=wires_2, Preserve=False)
merge = Merge(Data1=join_2, Data2=move.Geometry)
loft = Loft(Curves=merge, Options={Adjust=False, Closed=False, LoftEnds=0, LoftSimp=0, LoftType=0, Rebuild=10, Refit=0.01})
mesh_2 = Mesh(loft)
mjoin_2 = MeshJoin(Meshes=mesh_2)

preview = CustomPreview(Geometry=loft, Material=ColourSwatch(SwatchColor=RGBA(191, 191, 191, 229)))

toggle = BooleanToggle(True)

radiationanalysis = Ladybug_RadiationAnalysis(
    geometry=flatten(mjoin),
    context=flatten([mjoin_2, mesh]),
    gridSize=Slider(0.1, range=0..0.1),
    disFromBase=Slider(0.001, range=0..0.001),
    selectedSkyMtx=flatten(selectskymtx.selectedSkyMtx),
    parallel=toggle,
    runIt=toggle)  # -> readMe, contextMesh, analysisMesh, testPts, testVec, port, radiationResult, radiationMesh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; plug-in component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

number_slider = Slider(400, range=0..1000)
avr = Average(Input=flatten(radiationanalysis.radiationResult))

subtraction = Subtraction(A=radiationanalysis.radiationResult, B=avr)
abs = Absolute(Value=subtraction)
ma = MassAddition(Input=abs)  # -> Result, PartialResults

galapagos = Galapagos(fitness=ma, gene=genes)
# Visualize the results
panel_2 = Panel(ma.Result)
