# Grasshopper definition Class_6_SessionAll_WithoutAutoGraph.gh (Grasshopper 1.0.7)
# Copyright: KAJIMA DESIGN
# plug-ins: EleFront, Bifocals, LunchBox

# ---- group: Divide Surface
# Step 01-1　楕円をサーフェスとして切り取る
# Step 02　パネルのポイントをつくる
number_slider = Slider(1, range=0..1)
xy = XYPlane(Origin=Point(0, 0, 0))
sph = Sphere(Base=xy, Radius=number_slider)
dom²num = ConstructDomain²(
    UMin=Slider(0, range=0..1),
    UMax=Slider(0.25, range=0..1),
    VMin=Slider(0.445, range=0..1),
    VMax=Slider(0.653, range=0..1))
scale_nu = ScaleNU(
    Geometry=sph,
    Plane=xy,
    ScaleX=Slider(100000, range=0..100000),
    ScaleY=Slider(80000, range=0..100000),
    ScaleZ=Slider(44700, range=0..100000))  # -> Geometry, Transform
subsrf = Isotrim(Surface=reparameterize(scale_nu.Geometry), Domain=dom²num)

# ----
# Input & Parameter
# Step 01　ベースサーフェスをつくる
data = Data(1)

# ----
# Method
data_2 = Data(2)

# ----
# Step 02-0　Step01でベイクしたジオメトリをインプットに入れる
panel = Panel("Base Surface")
refbake = ReferenceByBakeName(BakeName=panel, Key="*", Val="*", maintainStructure=False)

# ----
# Step 06-0　Step05でベイクしたPointsをインプットに入れる
list = ValueList({"Base Sub Sphere", "Frame Center Wires", "Gls Ref  Srf": "Gls Ref Srf", "Panel Corner Pts", "Panel Ref Pts", "Panel Ref Srfs", "Panel Ref Srfs Types"}, selected="Panel Corner Pts")
refbake_2 = ReferenceByBakeName(BakeName=list, Key="*", Val="*", maintainStructure=False)

# ----
# Step 06　フレーム用のラインをつくる。
# Step 06-0　Step04でベイクしSurfaceをインプットに入れる
list_2 = ValueList({"Base Sub Sphere", "Frame Center Wires", "Gls Ref  Srf": "Gls Ref Srf", "Panel Corner Pts", "Panel Ref Pts", "Panel Ref Srfs", "Panel Ref Srfs Types"}, selected="Panel Ref Srfs Types")
refbake_3 = ReferenceByBakeName(BakeName=list_2, Key="*", Val="*", maintainStructure=False)

# ----
# Output
data_3 = Data(2)

# ----
# Step 07　ガラス面をつくる
# Step 07-0　Step05でベイクしたSurfaceをインプットに入れる
list_3 = ValueList({"Base Sub Sphere", "Frame Center Wires", "Frame Lines", "Gls Ref  Srf": "Gls Ref Srf", "Panel Corner Pts", "Panel Ref Pts", "Panel Ref Srfs", "Panel Ref Srfs Types"}, selected="Panel Ref Srfs Types")
refbake_4 = ReferenceByBakeName(BakeName=list_3, Key="*", Val="*", maintainStructure=False)

# ----
# Step 08　パネルを図面化する
# Step 08-0　Step07でベイクしたSurfaceをインプットに入れる
list_4 = ValueList({"Base Sub Sphere", "Frame Lines", "Glz Ref Srf", "Glz Titleblock", "Panel Corner Pts", "Panel Ref Pts", "Panel Ref Srfs", "Panel Ref Srfs Types"}, selected="Glz Ref Srf")
refbake_5 = ReferenceByBakeName(BakeName=list_4, Key="*", Val="*", maintainStructure=False)

# ----
# Step 03　パネルのベースサーフェスをつくる
# Step 03-0　Step02でベイクしたジオメトリをインプットに入れる
list_5 = ValueList({"Base Surface", "Panel Ref Pts"}, selected="Panel Ref Pts")
refbake_6 = ReferenceByBakeName(BakeName=list_5, Key="*", Val="*", maintainStructure=False)  # -> graft(PanelRefPts)

# ----
# Step 05　パネルのコーナーポイントを入れ子レイヤーとしてベイクする
# Step 05-0　Step04でベイクしたジオメトリをインプットに入れる
list_6 = ValueList({"Base Sub Sphere", "Panel Ref Pts", "Panel Ref Srfs", "Panel Ref Srfs Types"}, selected="Panel Ref Srfs Types")
refbake_7 = ReferenceByBakeName(BakeName=list_6, Key="*", Val="*", maintainStructure=False)

# ----
# Step 04　パネルの色を追加する
# Step 04-0　Step04でベイクしたジオメトリをインプットに入れる
list_7 = ValueList({"Base Sub Sphere", "Panel Ref Pts", "Panel Ref Srfs"}, selected="Panel Ref Srfs")
refbake_8 = ReferenceByBakeName(BakeName=list_7, Key="*", Val="*", maintainStructure=False)

# ----
# Visualization
data_4 = Data(2)

# ----
# Unused
data_5 = Data(2)

graft = GraftTree(Tree=refbake_4, IncludeEmptyLists=True, IncludeNullItems=True)
graft_2 = GraftTree(Tree=refbake_4, IncludeEmptyLists=True, IncludeNullItems=True)
graft_3 = GraftTree(Tree=refbake_8, IncludeEmptyLists=True, IncludeNullItems=True)

# ---- group: 表示する個数を指定
表示するパネルの数 = Slider(18, range=0..100)
split = SplitList(List=refbake_5, Index=表示するパネルの数)  # -> ListA, ListB

# ----
graft_4 = GraftTree(Tree=refbake_7, IncludeEmptyLists=True, IncludeNullItems=True)

# ----
# Unused
data_6 = Data(2)

list_8 = ValueList({"Column Index", "Panel ID", "Ref Pln", "Row Index"}, selected="Column Index")
list_9 = ValueList({"Column Index", "Panel ID", "Ref Pln", "Row Index"}, selected="Row Index")
getuv = GetUserValue(Geometry=graft_3, Key=list_9)
getuv_2 = GetUserValue(Geometry=graft_3, Key=list_8)

# ----
# Step 06-1　Lineをつくる
list_10 = ValueList({"Column Index", "Panel ID", "Ref Pln", "Rel X", "Rel Y", "Row Index", "Type", "Vertex ID", "Vertex Index"}, selected="Panel ID")
list_11 = ValueList({"Column Index", "Panel ID", "Ref Pln", "Row Index", "Type"}, selected="Panel ID")
getuv_3 = GetUserValue(Geometry=refbake_3, Key=list_11)
filteratt = FilterByUserAttributes(Attributes=refbake_2, Key=list_10, Val=getuv_3)  # -> G, Key, Val
list_12 = ValueList({"Column Index", "Panel ID", "Ref Pln", "Rel X", "Rel Y", "Row Index", "Type", "Vertex ID", "Vertex Index"}, selected="Vertex Index")
panel_2 = Panel("""0.0
1.0
1.1
0.1""")
filteratt_2 = FilterByUserAttributes(Attributes=filteratt.G, Key=list_12, Val=panel_2)  # -> O, Key, Val
shiftm = ShiftMatch(Data=filteratt_2.O, Guide=filteratt.G)
shift = ShiftList(List=shiftm, Shift="1", Wrap=True)
ln = Line(StartPoint=shiftm, EndPoint=shift)

list_13 = ValueList({"Column Index", "Panel ID", "Ref Pln", "Row Index", "Type"}, selected="Ref Pln")
getuv_4 = GetUserValue(Geometry=graft_4, Key=list_13)
strtopln = StringToPlane(S=getuv_4)

debrep = DeconstructBrep(Brep=graft_4)  # -> Faces, Edges, Vertices

# ---- group: Bake geometry
# Step 01-2　Rhino側にベイクする
panel_3 = Panel("Base Surface")
attributes = DefineObjectAttributes(Name=panel_3, Layer="Base Surface", Color=ColourSwatch(SwatchColor=RGB(65, 176, 40)))
bake = BakeObjects(Geometry=subsrf, Attributes=attributes, BakeName="Base Surface", Bake=False)

# ----
graft_5 = GraftTree(Tree=split.ListA, IncludeEmptyLists=True, IncludeNullItems=True)

# ---- group: Panel Offset
neg = Negative(Value=Slider(86, range=0..100))

# ----
list_14 = ValueList({"Column Index", "Panel ID", "Ref Pln", "Row Index", "Type"}, selected="Ref Pln")
getuv_5 = GetUserValue(Geometry=graft_2, Key=list_14)
debrep_2 = DeconstructBrep(Brep=graft_2)  # -> Faces, Edges, Vertices
strtopln_2 = StringToPlane(S=getuv_5)
join = JoinCurves(Curves=debrep_2.Edges, Preserve=False)
offset = Offset(Curve=join, Distance=neg, Plane=strtopln_2, Corners=1)
boundary = BoundarySurfaces(Edges=offset)

# ----
# Step 05-1　ポイントをプロジェクトする
plcoord = PlaneCoordinates(Point=debrep.Vertices, System=strtopln)  # -> XCoordinate, YCoordinate, ZCoordinate
larger = LargerThan(FirstNumber=plcoord.YCoordinate, SecondNumber="0")  # -> LargerThan, OrEqualTo
larger_2 = LargerThan(FirstNumber=plcoord.XCoordinate, SecondNumber="0")  # -> LargerThan, OrEqualTo

dup = DuplicateDataMatch(SourceDataTree=debrep.Vertices, SecondaryData1=graft_4)  # -> Vertices, SecondaryData1

material = CreateMaterial(
    Diffuse=ColourSwatch(SwatchColor=RGB(213, 230, 213)),
    Specular=RGB(255, 255, 255),
    Emission=RGB(0, 0, 0),
    Transparency=Slider(0.8, range=0..1),
    Shine=0)
layer = DefineLayer(Name="Bake::Panel Specific::Glz Ref Srf", Color=ColourSwatch(SwatchColor=RGB(213, 230, 213)), Material=material)
modatt = ModifyElefrontAttributes(ReferencedGeometryOrElefrontAttributes=graft, Layer=layer, Material=material)
bake_2 = BakeObjects(Geometry=boundary, Attributes=modatt, BakeName="Glz Ref Srf", Bake=False)

graft_6 = GraftTree(Tree=debrep.Vertices, IncludeEmptyLists=True, IncludeNullItems=True)
graft_7 = GraftTree(Tree=larger_2.LargerThan, IncludeEmptyLists=True, IncludeNullItems=True)
graft_8 = GraftTree(Tree=larger.LargerThan, IncludeEmptyLists=True, IncludeNullItems=True)
graft_9 = GraftTree(Tree=dup.SecondaryData1, IncludeEmptyLists=True, IncludeNullItems=True)

# ----
# Step 05-2　ポイントの名前を作り、ツリーを整理する
list_15 = ValueList({"Column Index", "Panel ID", "Ref Pln", "Row Index", "Type"}, selected="Panel ID")
weave = Weave(Pattern=graft_7, Stream0="0", Stream1="1", NullGaps=False)
weave_2 = Weave(Pattern=graft_8, Stream0="0", Stream1="1", NullGaps=False)
getuv_6 = GetUserValue(Geometry=graft_9, Key=list_15)
concat = Concatenate(FragmentA=weave, FragmentB=weave_2, JoinSeparator=".")
concat_2 = Concatenate(FragmentA=getuv_6, FragmentB=concat, JoinSeparator="-")

# ----
# Step 06-2　Rhino側にベイクする
panel_4 = Panel("""Bottom
Right
Top
Left""")
graft_10 = GraftTree(Tree=refbake_3, IncludeEmptyLists=True, IncludeNullItems=True)
dup_2 = DuplicateDataMatch(SourceDataTree=ln, SecondaryData1=graft_10)  # -> RefLines, PanelRefSrfsTypes
short = ShortestList(ListA=ln, ListB=panel_4, TrimMode=2)  # -> ListA, ListB
graft_11 = GraftTree(Tree=dup_2.PanelRefSrfsTypes, IncludeEmptyLists=True, IncludeNullItems=True)
graft_12 = GraftTree(Tree=short.ListA, IncludeEmptyLists=True, IncludeNullItems=True)
graft_13 = GraftTree(Tree=short.ListB, IncludeEmptyLists=True, IncludeNullItems=True)
graft_14 = GraftTree(Tree=short.ListA, IncludeEmptyLists=True, IncludeNullItems=True)
modatt_2 = ModifyElefrontAttributes(
    ReferencedGeometryOrElefrontAttributes=graft_11,
    UserKeys="RelPos",
    UserValues=graft_13,
    Layer="Bake::Panel Specific::Frame Lines",
    Color=ColourSwatch(SwatchColor=RGB(95, 221, 255)))
bake_3 = BakeObjects(Geometry=graft_12, Attributes=modatt_2, BakeName="Frame Lines", Bake=False)

# ----
# Step 05-3　Rhino側にベイクする
panel_5 = Panel("""Rel X
Rel Y
Vertex Index
Vertex ID""")
merge = Merge(Data1=simplify(weave), Data2=simplify(weave_2), Data3=simplify(concat), Data4=simplify(concat_2))
modatt_3 = ModifyElefrontAttributes(
    ReferencedGeometryOrElefrontAttributes=graft_9,
    UserKeys=panel_5,
    UserValues=merge,
    Name=concat_2,
    Layer="Bake::Panel Specific::Panel Corner Pts",
    Color=ColourSwatch(SwatchColor=RGB(110, 185, 255)))
bake_4 = BakeObjects(Geometry=graft_6, Attributes=modatt_3, BakeName="Panel Corner Pts", Bake=False)

# ----
# Step 02-1　リビルドをしてサーフェスを整えた後、パネルの点をつくる
number_slider_2 = Slider(41, range=0..100)
rebuildsrf = RebuildSurface(Surface=refbake, UDegree=3, VDegree=3, UNumber=10, VNumber=10)
sdivide = DivideSurface(Surface=rebuildsrf, UCount=number_slider_2, VCount=Slider(10, range=0..100))  # -> simplify(graft(Points)), Normals, Parameters
tstat = TreeStatistics(Tree=sdivide.Points)  # -> simplify(graft(Paths)), Length, Count
match = MatchTree(Tree=tstat.Paths, Guide=sdivide.Points)
dpath = DeconstructPath(Branch=match)
dispatch = Dispatch(List=dpath, DispatchPattern=[True, False])  # -> ListA, ListB

# ----
# Step 02-2　点の名前をつける
panel_6 = Panel("-")
concat_3 = Concatenate(FragmentA="Pt_", FragmentB=dispatch.ListB, FragmentC=panel_6, FragmentD=dispatch.ListA)

merge_2 = Merge(Data1=dispatch.ListA, Data2=dispatch.ListB, Data3=concat_3)

# ----
# Step 02-3　Rhino側にベイクする
panel_7 = Panel("""Column Index
Row Index
Point ID""")
attributes_2 = DefineObjectAttributes(
    UserKeys=panel_7,
    UserValues=merge_2,
    Name=concat_3,
    Layer="Panel Ref Pts",
    Color=ColourSwatch(SwatchColor=RGB(0, 0, 255)))
bake_5 = BakeObjects(Geometry=sdivide.Points, Attributes=attributes_2, BakeName="Panel Ref Pts", Bake=False)

# ----
# Step 03-1　Surfaceをつくる
list_16 = ValueList({"Column Index", "Point ID", "Row Index"}, selected="Row Index")
list_17 = ValueList({"Column Index", "Point ID", "Row Index"}, selected="Column Index")
pt = Point(refbake_6)
pt_2 = Point(refbake_6)
pt_3 = Point(refbake_6)
pt_4 = Point(refbake_6)
pt_5 = Point(refbake_6)
pt_6 = Point(refbake_6)
getuv_7 = GetUserValue(Geometry=pt_2, Key=list_17)
getuv_8 = GetUserValue(Geometry=pt, Key=list_16)
addition = Addition(A=getuv_8, B="1")
addition_2 = Addition(A=getuv_7, B="1")
concat_4 = Concatenate(FragmentA="Pt_", FragmentB=getuv_8, FragmentC="-", FragmentD=addition_2)
concat_5 = Concatenate(FragmentA="Pt_", FragmentB=addition, FragmentC="-", FragmentD=addition_2)
concat_6 = Concatenate(FragmentA="Pt_", FragmentB=addition, FragmentC="-", FragmentD=getuv_7)
list_18 = ValueList({"Column Index", "Point ID", "Row Index"}, selected="Point ID")
list_19 = ValueList({"Column Index", "Point ID", "Row Index"}, selected="Point ID")
list_20 = ValueList({"Column Index", "Point ID", "Row Index"}, selected="Point ID")
filteratt_3 = FilterByUserAttributes(Attributes=flatten(pt_4), Key=list_18, Val=concat_6)  # -> Pt, Key, Val
filteratt_4 = FilterByUserAttributes(Attributes=flatten(pt_5), Key=list_19, Val=concat_4)  # -> Pt, Key, Val
filteratt_5 = FilterByUserAttributes(Attributes=flatten(pt_6), Key=list_20, Val=concat_5)  # -> Pt, Key, Val
pt_7 = Point(pt_3)
ln_2 = Line(StartPoint=pt_7, EndPoint=filteratt_3.Pt)
ln_3 = Line(StartPoint=pt_7, EndPoint=filteratt_4.Pt)
ln_4 = Line(StartPoint=filteratt_4.Pt, EndPoint=filteratt_5.Pt)
ln_5 = Line(StartPoint=pt_7, EndPoint=filteratt_4.Pt)

# ---- group: サーフェス
merge_3 = Merge(Data1=simplify(ln_2), Data2=simplify(ln_4))
loft = Loft(Curves=merge_3, Options={Adjust=False, Closed=False, LoftEnds=0, LoftSimp=0, LoftType=0, Rebuild=10, Refit=0.01})

# ---- group: Plane
area = Area(Geometry=loft)  # -> Area, Centroid
pl = ConstructPlane(Origin=area.Centroid, XAxis=ln_3, YAxis=ln_2)
plntostr = PlaneToString(P=pl)

# ---- group: Name
concat_7 = Concatenate(FragmentC="PAN", FragmentA=getuv_8, FragmentB=getuv_7, JoinSeparator="-")

# ----
merge_4 = Merge(Data1=simplify(getuv_8), Data2=simplify(getuv_7), Data3=simplify(concat_7), Data4=simplify(plntostr))

# ----
# Step 04-1　イメージマッパーで色を配置する
flatten = FlattenTree(Tree=getuv, Path="{0}")
flatten_2 = FlattenTree(Tree=getuv_2, Path="{0}")

bnd = Bounds(Numbers=flatten_2)
bnd_2 = Bounds(Numbers=flatten)
remap = RemapNumbers(Value=getuv_2, Source=bnd, Target="1 to 705")  # -> Mapped, Clipped
remap_2 = RemapNumbers(Value=getuv, Source=bnd_2, Target="1 to 705")  # -> Mapped, Clipped
pt_8 = ConstructPoint(XCoordinate=remap.Mapped, YCoordinate=remap_2.Mapped, ZCoordinate=0)

image = ImageSampler(
    pt_8,
    FilePath="C:\Users\yishizu\OneDrive - Cadmakers\Projects\005_KajimaGHWorkshop\Class5\cloud-2.jpg",
    Filter="Colour",
    Interpolate=False,
    Umax=705,
    Umin=1,
    Vmax=705,
    Vmin=1,
    Wrap=1)

# ----
# Step 04-2　Rhino側にベイクする
panel_8 = Panel("Panel Ref Srfs Types")
modatt_4 = ModifyElefrontAttributes(
    ReferencedGeometryOrElefrontAttributes=graft_3,
    UserKeys="Type",
    UserValues=image,
    Layer=panel_8,
    Color=image,
    Material=image)
bake_6 = BakeObjects(Geometry=graft_3, Attributes=modatt_4, BakeName="Panel Ref Srfs Types", Bake=False)

list_21 = ValueList({"Column Index", "Panel ID", "Ref Pln", "Row Index", "Type"}, selected="Ref Pln")
tstat_2 = TreeStatistics(Tree=graft_5)  # -> Paths, Length, Count
getuv_9 = GetUserValue(Geometry=graft_5, Key=list_21)
sqrt = SquareRoot(Value=tstat_2.Count)
pln = StringToPlane(S=getuv_9)
round = Round(Number=sqrt)  # -> Nearest, Floor, Ceiling
recgrid = Rectangular(
    Plane=PlaneXY(0, 0, 0),
    SizeX=Slider(9000, range=0..10000),
    SizeY=Slider(6000, range=0..10000),
    ExtentX=round.Ceiling,
    ExtentY=round.Floor)  # -> Cells, simplify(Points)
flip = FlipMatrix(Data=recgrid.Points)
xz = XZPlane(Origin=Point(0, 0, 0))
mirror = Mirror(Geometry=flip, Plane=xz)  # -> Geometry, Transform
xy_2 = XYPlane(Origin=mirror.Geometry)
data_7 = Data(graft_5)

data_8 = Data(pln)
flatten_3 = FlattenTree(Tree=data_8, Path="{0}")
flatten_4 = FlattenTree(Tree=xy_2, Path="{0}")

short_2 = ShortestList(ListA=flatten_3, ListB=flatten_4, TrimMode=2)  # -> ListA, ListB
unflatten = UnflattenTree(Tree=short_2.ListB, Guide=data_8)

list_22 = ValueList({"Column Index", "Panel ID", "Ref Pln", "Row Index", "Type"}, selected="Panel ID")
list_23 = ValueList({"Column Index", "Panel ID", "Ref Pln", "Row Index", "Type"}, selected="Type")
neg_2 = Negative(Value=Slider(2693, range=0..10000))
getuv_10 = GetUserValue(Geometry=data_7, Key=list_22)
getuv_11 = GetUserValue(Geometry=data_7, Key=list_23)
move_pln = MovePlane(plane=unflatten, y_amp=neg_2)
inblock = InsertBlock(BlockName="TitleBlock", SourcePlane=unflatten)
concat_8 = Concatenate(FragmentA="Panel Name: ", FragmentB=getuv_10, FragmentD="Panel Type: ", FragmentE=getuv_11)
text = DefineTextObject(Text=concat_8, Plane=move_pln, DimensionStyle="Default", Size="150", Font="Arial Narrow", OutputType="Text")

orient = Orient(Geometry=data_7, Source=data_8, Target=unflatten)  # -> Geometry, Transform
debrep_3 = DeconstructBrep(Brep=orient.Geometry)  # -> Faces, Edges, Vertices
shift_2 = ShiftList(List=debrep_3.Vertices, Shift="1", Wrap=True)
shift_3 = ShiftList(List=debrep_3.Vertices, Shift="-1", Wrap=True)
join_2 = JoinCurves(Curves=debrep_3.Edges, Preserve=False)
list_24 = ValueList({"Default", "Millimeter Architectural", "Millimeter Large", "Millimeter Small"}, selected="Millimeter Large")
list_25 = ValueList({"Default", "Millimeter Architectural", "Millimeter Large", "Millimeter Small"}, selected="Millimeter Large")
angulardim = DefineAngularDimension(Origin=debrep_3.Vertices, Point1=shift_2, Point2=shift_3, Offset="450", Flip=Toggle(False), DimensionStyle=list_25)
lineardim = DefineLinearDimension(Point1=debrep_3.Vertices, Point2=shift_2, Offset="-250", DimensionStyle=list_24)

data_9 = Data(data_7)

layer_2 = DefineLayer(Name="Bake::Glz DWG::Outline", Color=ColourSwatch(SwatchColor=RGB(0, 255, 255)))
layer_3 = DefineLayer(Name="Bake::Glz DWG::Linear Dimension", Color=ColourSwatch(SwatchColor=RGB(255, 0, 0)))
layer_4 = DefineLayer(Name="Bake::Glz DWG::Angular Dimension", Color=ColourSwatch(SwatchColor=RGB(255, 0, 0)))
layer_5 = DefineLayer(Name="Bake::Glz DWG::Titleblock", Color=ColourSwatch(SwatchColor=RGB(0, 255, 0)))
layer_6 = DefineLayer(Name="Bake::Glz DWG::Text", Color=ColourSwatch(SwatchColor=RGB(0, 255, 0)))
modatt_5 = ModifyElefrontAttributes(ReferencedGeometryOrElefrontAttributes=data_9, Layer=layer_2)
modatt_6 = ModifyElefrontAttributes(ReferencedGeometryOrElefrontAttributes=data_9, Layer=layer_3)
modatt_7 = ModifyElefrontAttributes(ReferencedGeometryOrElefrontAttributes=data_9, Layer=layer_4)
modatt_8 = ModifyElefrontAttributes(ReferencedGeometryOrElefrontAttributes=data_9, Layer=layer_5)
modatt_9 = ModifyElefrontAttributes(ReferencedGeometryOrElefrontAttributes=data_9, Layer=layer_6)
button = Button()
bake_7 = BakeObjects(Geometry=lineardim, Attributes=modatt_6, BakeName="Glz Linear Dimension", Bake=button)
bake_8 = BakeObjects(Geometry=angulardim, Attributes=modatt_7, BakeName="Glz Angular Dimension", Bake=button)
bake_9 = BakeObjects(Geometry=inblock, Attributes=modatt_8, BakeName="Glz Titleblock", Bake=button)
bake_10 = BakeObjects(Geometry=join_2, Attributes=modatt_5, BakeName="Glz Outline", Bake=button)
bake_11 = BakeObjects(Geometry=text, Attributes=modatt_9, BakeName="Glz Text", Bake=button)

# ----
# Step 03-2　Rhino側にベイクする
clean = CleanParallel(PrimaryData=loft, SecondaryData1=merge_4, removeEmpty=True)  # -> PrimaryData, SecondaryData1
panel_9 = Panel("""Row Index
Column Index
Panel ID
Ref Pln""")

item = ListItem(List=clean.SecondaryData1, Index="2", Wrap=True)

attributes_3 = DefineObjectAttributes(
    UserKeys=panel_9,
    UserValues=clean.SecondaryData1,
    Name=item,
    Layer="Panel Ref Srfs",
    Color=ColourSwatch(SwatchColor=RGB(156, 89, 255)))
bake_12 = BakeObjects(Geometry=clean.PrimaryData, Attributes=attributes_3, BakeName="Panel Ref Srfs", Bake=False)

# ==== cluster PlaneToString: Converts a plane into a text string
P = ClusterInput()  # Plane to convert to string
P_2 = Plane(P)
graft = GraftTree(Tree=P_2, IncludeEmptyLists=True, IncludeNullItems=True)
pcomp = PlaneComponents(Plane=graft)  # -> Origin, XAxis, YAxis, ZAxis
merge = Merge(Data1=pcomp.Origin, Data2=pcomp.XAxis, Data3=pcomp.YAxis)
join = StringJoin(Strings=merge, Join=";")
pshift = ShiftPaths(Data=join, Offset=-1)
clean = CleanTree(RemoveNulls=True, RemoveInvalid=True, RemoveEmpty=False, Tree=pshift)
S = String(clean)
plane_string = ClusterOutput(S)  # String describing plane: Origin;Xdir;Ydir

# ==== cluster StringToPlane: Converts a text string into a plane
S = ClusterInput()  # Text string that describes plane.
S_2 = String(S)
strtopln = VBScript(P=S_2)  # -> out, A
# ---------- strtopln: VB ----------
    If IsNothing(P) Then
      Return
    End If


    Dim vectors() As String
    '    Dim vList As New List(Of String)

    P = P.Replace("{", "")
    P = P.Replace("}", "")

    vectors = P.Split(";")
    ' For Each tempStr As String In vectors
    '  tempStr = tempStr.Replace("{", "")
    ' tempStr = tempStr.Replace("}", "")
    ' vList.Add(tempStr)
    'Next

    Dim oStr() As String = vectors(0).Split(",")
    Dim xStr() As String = vectors(1).Split(",")
    Dim yStr() As String = vectors(2).Split(",")


    Dim origin As Point3d
    Dim xVect As Vector3d
    Dim yVect As Vector3d

    origin.X = CDbl(oStr(0))
    origin.Y = CDbl(oStr(1))
    origin.z = CDbl(oStr(2))

    xVect.X = CDbl(xStr(0))
    xVect.Y = CDbl(xStr(1))
    xVect.Z = CDbl(xStr(2))

    yVect.X = CDbl(yStr(0))
    yVect.Y = CDbl(yStr(1))
    yVect.Z = CDbl(yStr(2))

    Dim myPlane As New Plane(origin, xVect, yVect)

    A = myPlane
# ---------- end strtopln ----------
P = Plane(strtopln.A)
P_2 = ClusterOutput(P)  # Recreated plane

# ==== cluster MovePlane: Move a plane in a combination of its XYZ directions
plane = ClusterInput()  # Plane to move
x_amp = ClusterInput()  # Amplitude in X-Direction
y_amp = ClusterInput()  # Amplitude in Y-Direction
z_amp = ClusterInput()  # Amplitude in Z-Direction
P = Plane(plane)
X = Number(x_amp)
Y = Number(y_amp)
Z = Number(z_amp)
P_2 = DataDescription(P)
X_2 = DataDescription(X)
Y_2 = DataDescription(Y)
Z_2 = DataDescription(Z)
X_3 = DataDescription(X_2)
Y_3 = DataDescription(Y_2)
Z_3 = DataDescription(Z_2)
P_3 = DataDescription(P_2)
P_4 = DataDescription(P_2)
deplane = DeconstructPlane(Plane=P_3)  # -> Origin, XAxis, YAxis, ZAxis
X_4 = DataDescription(X_3)
Y_4 = DataDescription(Y_3)
Z_4 = DataDescription(Z_3)
X_5 = DataDescription(deplane.XAxis)
Y_5 = DataDescription(deplane.YAxis)
Z_5 = DataDescription(deplane.ZAxis)
P_5 = DataDescription(P_4)
X_6 = DataDescription(X_4)
Y_6 = DataDescription(Y_4)
Z_6 = DataDescription(Z_4)
X_7 = DataDescription(X_5)
Y_7 = DataDescription(Y_5)
Z_7 = DataDescription(Z_5)
P_6 = DataDescription(P_5)
amp = Amplitude(Vector=X_7, Amplitude=X_6)
amp_2 = Amplitude(Vector=Y_7, Amplitude=Y_6)
amp_3 = Amplitude(Vector=Z_7, Amplitude=Z_6)
X_8 = DataDescription(amp)
Y_8 = DataDescription(amp_2)
Z_8 = DataDescription(amp_3)
P_7 = DataDescription(P_6)
Y_9 = DataDescription(Y_8)
Z_9 = DataDescription(Z_8)
X_9 = DataDescription(X_8)
P_8 = DataDescription(P_7)
addition = Addition(A=X_9, B=Y_9, C=Z_9)
V = DataDescription(addition)
P_9 = DataDescription(P_8)
P_10 = DataDescription(P_9)
V_2 = DataDescription(V)
move = Move(Geometry=P_10, Motion=V_2)  # -> Geometry, Transform
P_11 = Plane(move.Geometry)
plane_2 = ClusterOutput(P_11)  # Moved Plane
