# Grasshopper definition 3_ImageSampler.gh (Grasshopper 1.0.7)

gallery = ImageGallery(CycleDelay=30, Randomize=False, UseLocalImages=True, UseRemoteImages=True)

number_slider = Slider(20, range=0..100)
srf = Surface(reparameterize(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))
sdivide = DivideSurface(Surface=srf, UCount=number_slider, VCount=number_slider)  # -> Points, Normals, Parameters

image = ImageSampler(sdivide.Parameters, Filter="Value", Interpolate=False, Umax=1, Umin=0, Vmax=1, Vmin=0, Wrap=1)
image_2 = ImageSampler(sdivide.Parameters, Filter="Colour", Interpolate=False, Umax=1, Umin=0, Vmax=1, Vmin=0, Wrap=1)

# ----
# Color Format
# Input
data = Data(1)
# Method
data_2 = Data(1)
# Output
data_3 = Data(1)
# Display
data_4 = Data(1)
# Unuse
data_5 = Data(1)

panel = Panel(sdivide.Parameters)
arc = Arc(Plane=PlaneXY(0, 0, 0), Radius=Slider(1000, range=0..1000), Angle=Domain(0, 3.141592654))  # -> Arc, Length
Z = UnitZ(Factor=Slider(1000, range=0..1000))
extr = Extrude(Base=arc.Arc, Direction=Z)

dom = ConstructDomain(DomainStart=Slider(2, range=0..10), DomainEnd=Slider(18, range=0..100))

preview = CustomPreview(Geometry=sdivide.Points, Material=image_2)
flip = Flip(Surface=extr)  # -> Surface, Result
divide = DivideDomain²(Domain=flip.Surface, UCount=Slider(16, range=0..100), VCount=Slider(40, range=0..100))

remap = RemapNumbers(Value=image, Source=Domain(0, 1), Target=dom)  # -> Mapped, Clipped

srf_2 = Surface(reparameterize(flip.Surface))
subsrf = Isotrim(Surface=flip.Surface, Domain=divide)
debrep = DeconstructBrep(Brep=subsrf)  # -> Faces, Edges, Vertices
avr = Average(Input=debrep.Vertices)  # -> flatten(ArithmeticMean)
srf_cp = SurfaceClosestPoint(Point=avr, Surface=srf_2)  # -> Point, UVPoint, Distance

dom_2 = ConstructDomain(DomainStart=Slider(-90, range=-90..100), DomainEnd=Slider(63, range=0..100))

cir = Circle(Plane=sdivide.Points, Radius=remap.Mapped)
srf_cp_2 = SurfaceClosestPoint(Point=avr, Surface=subsrf)  # -> Point, UVPoint, Distance

dom_3 = ConstructDomain(DomainStart=Slider(0, range=0..100), DomainEnd=Slider(30, range=0..100))

evalsrf = EvaluateSurface(Surface=subsrf, Point=srf_cp_2.UVPoint)  # -> Point, Normal, UDirection, VDirection, Frame
pl_origin = PlaneOrigin(Base=evalsrf.Frame, Origin=avr)
graft = GraftTree(Tree=evalsrf.Frame, IncludeEmptyLists=True, IncludeNullItems=True)
deplane = DeconstructPlane(Plane=pl_origin)  # -> Origin, XAxis, YAxis, ZAxis
lng = ListLength(List=pl_origin)
pl = ConstructPlane(Origin=deplane.Origin, XAxis=deplane.XAxis, YAxis=deplane.ZAxis)
random = Random(Range=dom_3, Number=lng, Seed=Slider(534, range=0..1000))
random_2 = Random(Range=dom_2, Number=lng, Seed=Slider(337, range=0..1000))
rotate = Rotate(Geometry=pl_origin, Angle=degrees(random), Plane=pl)  # -> Geometry, Transform
number_slider_2 = Slider(100, range=0..100)
rotate_2 = Rotate(Geometry=rotate.Geometry, Angle=degrees(random_2), Plane=pl_origin)  # -> Geometry, Transform
random_3 = Random(Range=number_slider_2, Number=lng, Seed=2)
project = Project(Geometry=debrep.Vertices, Plane=graft(rotate_2.Geometry))  # -> Geometry, Transform
project_2 = Project(Geometry=debrep.Vertices, Plane=graft)  # -> Geometry, Transform
neg = Negative(Value=number_slider_2)
amp = Amplitude(Vector=graft(evalsrf.Normal), Amplitude=graft(neg))
move = Move(Geometry=project.Geometry, Motion=amp)  # -> Geometry, Transform
pline = PolyLine(Vertices=move.Geometry, Closed=True)
pline_2 = PolyLine(Vertices=project_2.Geometry, Closed=True)
merge = Merge(Data1=simplify(pline_2), Data2=simplify(pline))
loft = Loft(Curves=merge, Options={Adjust=False, Closed=False, LoftEnds=0, LoftSimp=0, LoftType=0, Rebuild=10, Refit=0.01})
cap = CapHoles(Brep=loft)
preview_2 = CustomPreview(Geometry=cap, Material=graft(ColourSwatch(SwatchColor=RGB(173, 163, 163))))
