# Grasshopper definition 2_PerlinNoise.gh (Grasshopper 1.0.7)
# plug-ins: LunchBox, Noise 4D

gallery = ImageGallery(CycleDelay=30, Randomize=False, UseLocalImages=True, UseRemoteImages=True)
pt = Point(<point referenced from the Rhino model>)
# パーリンノイズの模様+フチ
# Step1‐1 ベースの屋根サーフェスをつくる
crv = Curve(<curve referenced from the Rhino model>)
pt_2 = Point(<point referenced from the Rhino model>)
# パーリンノイズの模様
# Step1‐1 ベースの屋根サーフェスをつくる
crv_2 = Curve(<curve referenced from the Rhino model>)
patch = Patch(Curves=crv, Points=pt, Spans=20, Flexibility=1, Trim=True)
patch_2 = Patch(Curves=crv_2, Points=pt_2, Spans=20, Flexibility=1, Trim=True)

number_slider = Slider(64, range=0..190)
number_slider_2 = Slider(15, range=0..100)
quadstag = StaggeredQuadPanels(Surface=patch, UDivisions=number_slider_2, VDivisions=Slider(44, range=0..100))
quads = QuadPanels(Surface=patch, UDivisions=number_slider, VDivisions=number_slider)
quadrand = RandomQuadPanels(Surface=patch, UDivisions=number_slider_2, VDivisions=number_slider, RandomSeed=Slider(3938, range=0..10000))

number_slider_3 = Slider(64, range=0..190)
number_slider_4 = Slider(15, range=0..100)
quadstag_2 = StaggeredQuadPanels(Surface=patch_2, UDivisions=number_slider_4, VDivisions=Slider(44, range=0..100))
quads_2 = QuadPanels(Surface=patch_2, UDivisions=number_slider_3, VDivisions=number_slider_3)
quadrand_2 = RandomQuadPanels(Surface=patch_2, UDivisions=number_slider_4, VDivisions=number_slider_3, RandomSeed=Slider(3938, range=0..10000))

list = ValueList({"Random": 0, "Brick": 2, "Rect": 1}, selected="Rect")
list_2 = ValueList({"Random": 0, "Brick": 2, "Rect": 1}, selected="Rect")

# ----
# Color Format
# Input
data = Data(1)
# Method
data_2 = Data(1)
# Output
data_3 = Data(1)
# Display
data_4 = Data(1)
# Unuse
data_5 = Data(1)

filter = StreamFilter(Gate=list, Stream0=quadrand, Stream1=quads, Stream2=quadstag)
# Step1‐2 カーブの内外判定
dam = DataDam(DataA=filter, BufferDelay=10000000, BufferMode=0)

filter_2 = StreamFilter(Gate=list_2, Stream0=quadrand_2, Stream1=quads_2, Stream2=quadstag_2)
# Step1‐2 カーブの内外判定
dam_2 = DataDam(DataA=filter_2, BufferDelay=10000000, BufferMode=0)

outline = Curve(crv)
xy = XYPlane(Origin=Point(0, 0, 0))
projecta = ProjectAlong(Geometry=outline, Plane=xy, Direction=Vector(0, 0, -1))  # -> Geometry, Transform

outline_2 = Curve(crv_2)
xy_2 = XYPlane(Origin=Point(0, 0, 0))
projecta_2 = ProjectAlong(Geometry=outline_2, Plane=xy_2, Direction=Vector(0, 0, -1))  # -> Geometry, Transform

area = Area(Geometry=dam)  # -> Area, Centroid
projecta_3 = ProjectAlong(Geometry=area.Centroid, Plane=xy, Direction=Vector(0, 0, -1))  # -> Geometry, Transform

area_2 = Area(Geometry=dam_2)  # -> Area, Centroid
projecta_4 = ProjectAlong(Geometry=area_2.Centroid, Plane=xy_2, Direction=Vector(0, 0, -1))  # -> Geometry, Transform

incurve = PointInCurve(Point=projecta_3.Geometry, Curve=projecta.Geometry)  # -> Relationship, Point
equals = Equality(FirstNumber=incurve.Relationship, SecondNumber=Slider(2, range=0..10))  # -> Equality, Inequality

incurve_2 = PointInCurve(Point=projecta_4.Geometry, Curve=projecta_2.Geometry)  # -> Relationship, Point
equals_2 = Equality(FirstNumber=incurve_2.Relationship, SecondNumber=Slider(2, range=0..10))  # -> Equality, Inequality

dispatch = Dispatch(List=dam, DispatchPattern=equals.Equality)  # -> ListA, ListB

dispatch_2 = Dispatch(List=dam_2, DispatchPattern=equals_2.Equality)  # -> ListA, ListB

area_3 = Area(Geometry=dispatch.ListA)  # -> Area, Centroid
# Step1‐3　パーリンノイズ
pt_3 = Point(flatten(area_3.Centroid))

area_4 = Area(Geometry=dispatch_2.ListA)  # -> Area, Centroid
# Step1‐3　パーリンノイズ
pt_4 = Point(flatten(area_4.Centroid))

dom = ConstructDomain(DomainStart=Slider(0.529, range=0..1), DomainEnd=Slider(0, range=0..100))

dom_2 = ConstructDomain(DomainStart=Slider(0.948, range=0..1), DomainEnd=Slider(0, range=0..100))

dom_3 = ConstructDomain(DomainStart=Slider(0.948, range=0..1), DomainEnd=Slider(0, range=0..100))

pull = PullPoint(Point=pt_3, Geometry=crv, ClosestOnly=True)  # -> ClosestPoint, Distance

perlin = PerlinNoise(Values=pt_3, Time=Slider(294, range=0..300), Scale=Slider(0.0417, range=0.001..0.11))
bnd = Bounds(Numbers=flatten(perlin))
remap = RemapNumbers(Value=perlin, Source=bnd, Target=dom_2)  # -> Mapped, Clipped

perlin_2 = PerlinNoise(Values=pt_4, Time=Slider(294, range=0..300), Scale=Slider(0.0417, range=0.001..0.11))
bnd_2 = Bounds(Numbers=flatten(perlin_2))
remap_2 = RemapNumbers(Value=perlin_2, Source=bnd_2, Target=dom_3)  # -> Mapped, Clipped

# ----
# Step3‐２　創造の木を生成（カーブから）
# Step4　柱（カーブから）
bnd_3 = Bounds(Numbers=flatten(pull.Distance))
remap_3 = RemapNumbers(Value=pull.Distance, Source=bnd_3, Target=Domain(0, 1))  # -> Mapped, Clipped
graph = GraphMapper(
    remap_3.Mapped,
    x0=0,
    x1=1,
    y0=0,
    y1=1,
    container_name="Bezier",
    cpx=[0, 0.4043481946, 0.2217398435, 1],
    cpy=[0, 0.7289844751, 1, 1])

larger = LargerThan(FirstNumber=remap_2.Mapped, SecondNumber="0.5")  # -> LargerThan, OrEqualTo
dispatch_3 = Dispatch(List=dispatch_2.ListA, DispatchPattern=larger.LargerThan)  # -> ListA, ListB

remap_4 = RemapNumbers(Value=graph, Source=Domain(0, 1), Target=dom)  # -> Mapped, Clipped
addition = Addition(A=remap.Mapped, B=remap_4.Mapped)

larger_2 = LargerThan(FirstNumber=addition, SecondNumber="0.5")  # -> LargerThan, OrEqualTo
dispatch_4 = Dispatch(List=dispatch.ListA, DispatchPattern=larger_2.LargerThan)  # -> ListA, ListB

preview = CustomPreview(Geometry=dispatch_4.ListB, Material=ColourSwatch(SwatchColor=RGB(255, 255, 255)))

preview_2 = CustomPreview(Geometry=dispatch_4.ListA, Material=ColourSwatch(SwatchColor=RGB(38, 255, 197)))

preview_3 = CustomPreview(Geometry=dispatch_3.ListB, Material=ColourSwatch(SwatchColor=RGB(255, 255, 255)))

preview_4 = CustomPreview(Geometry=dispatch_3.ListA, Material=ColourSwatch(SwatchColor=RGB(38, 255, 197)))
