# Grasshopper definition 1_Random.gh (Grasshopper 1.0.7)
# plug-ins: Bifocals

gallery = ImageGallery(CycleDelay=30, Randomize=False, UseLocalImages=True, UseRemoteImages=True)

arc = Arc(Plane=PlaneXY(0, 0, 0), Radius=Slider(1000, range=0..1000), Angle=Domain(0, 3.141592654))  # -> Arc, Length
Z = UnitZ(Factor=Slider(1000, range=0..1000))
extr = Extrude(Base=arc.Arc, Direction=Z)

# ----
# Color Format
# Input
data = Data(1)
# Method
data_2 = Data(1)
# Output
data_3 = Data(1)
# Display
data_4 = Data(1)
# Unuse
data_5 = Data(1)

flip = Flip(Surface=extr)  # -> Surface, Result
divide = DivideDomain²(Domain=flip.Surface, UCount=Slider(16, range=0..100), VCount=Slider(40, range=0..100))
subsrf = Isotrim(Surface=flip.Surface, Domain=divide)

debrep = DeconstructBrep(Brep=subsrf)  # -> Faces, Edges, Vertices
avr = Average(Input=debrep.Vertices)  # -> flatten(ArithmeticMean)
srf_cp = SurfaceClosestPoint(Point=avr, Surface=subsrf)  # -> Point, UVPoint, Distance
evalsrf = EvaluateSurface(Surface=subsrf, Point=srf_cp.UVPoint)  # -> Point, Normal, UDirection, VDirection, Frame

dom = ConstructDomain(DomainStart=Slider(-90, range=-90..100), DomainEnd=Slider(63, range=0..100))

dom_2 = ConstructDomain(DomainStart=Slider(0, range=0..100), DomainEnd=Slider(30, range=0..100))

neg = Negative(Value=Slider(100, range=0..100))

graft = GraftTree(Tree=evalsrf.Frame, IncludeEmptyLists=True, IncludeNullItems=True)
project = Project(Geometry=debrep.Vertices, Plane=graft)  # -> Geometry, Transform

pline = PolyLine(Vertices=project.Geometry, Closed=True)

pl_origin = PlaneOrigin(Base=evalsrf.Frame, Origin=avr)
deplane = DeconstructPlane(Plane=pl_origin)  # -> Origin, XAxis, YAxis, ZAxis
pl = ConstructPlane(Origin=deplane.Origin, XAxis=deplane.XAxis, YAxis=deplane.ZAxis)

lng = ListLength(List=pl_origin)
random = Random(Range=dom_2, Number=lng, Seed=Slider(534, range=0..1000))

random_2 = Random(Range=dom, Number=lng, Seed=Slider(337, range=0..1000))

rotate = Rotate(Geometry=pl_origin, Angle=degrees(random), Plane=pl)  # -> Geometry, Transform
rotate_2 = Rotate(Geometry=rotate.Geometry, Angle=degrees(random_2), Plane=pl_origin)  # -> Geometry, Transform
project_2 = Project(Geometry=debrep.Vertices, Plane=graft(rotate_2.Geometry))  # -> Geometry, Transform

amp = Amplitude(Vector=graft(evalsrf.Normal), Amplitude=graft(neg))
move = Move(Geometry=project_2.Geometry, Motion=amp)  # -> Geometry, Transform
pline_2 = PolyLine(Vertices=move.Geometry, Closed=True)

merge = Merge(Data1=simplify(pline), Data2=simplify(pline_2))
loft = Loft(Curves=merge, Options={Adjust=False, Closed=False, LoftEnds=0, LoftSimp=0, LoftType=0, Rebuild=10, Refit=0.01})
cap = CapHoles(Brep=loft)
preview = CustomPreview(Geometry=cap, Material=graft(ColourSwatch(SwatchColor=RGB(173, 163, 163))))
