# Grasshopper definition 020_tensile_fabric.gh (Grasshopper 1.0.7)
# plug-ins: Human, Bifocals, Kangaroo2 Components

gallery = ImageGallery(CycleDelay=30, Randomize=False, UseLocalImages=True, UseRemoteImages=True)

resolution = Slider(3, range=0..10)

number_slider = Slider(20, range=0..100)
number_slider_2 = Slider(12, range=0..100)

anchorpts = Point([<point referenced from the Rhino model> x10])

anchorcrvs = Curve([<curve referenced from the Rhino model> x2])

pt = ConstructPoint(XCoordinate=0, YCoordinate=0, ZCoordinate=Slider(5, range=0..100))
rectangle = Rectangle(Plane=pt, XSize=number_slider, YSize=number_slider_2, Radius=0)  # -> Rectangle, Length

# ----
# Color Format
# Input
data = Data(1)
# Method
data_2 = Data(1)
# Output
data_3 = Data(1)
# Display
data_4 = Data(1)
# Unuse
data_5 = Data(1)

multiplication = Multiplication(A=number_slider, B=resolution)
multiplication_2 = Multiplication(A=number_slider_2, B=resolution)
mesh_uv = MeshSurface(Surface=rectangle.Rectangle, UCount=multiplication, VCount=multiplication_2, Overhang=True, Equalize=False)

demesh = DeconstructMesh(Mesh=mesh_uv)  # -> Vertices, Faces, Colours, Normals

pt_2 = Point(anchorpts)
cp = ClosestPoint(Point=pt_2, Cloud=demesh.Vertices)  # -> ClosestPoint, CPIndex, Distance
ln = Line(StartPoint=pt_2, EndPoint=cp.ClosestPoint)

edgelengths = EdgeLengths(Mesh=mesh_uv, LengthFactor=Slider(0.6, range=0..1), Strength=1)

length_line = LengthLine(Line=ln, Strength=10)

anchor = Anchor(Point=pt_2, Target=pt_2, Strength=10000)

show = Show(G=mesh_uv)
show_2 = Show(G=ln)

pt_3 = Point(demesh.Vertices)

project = Project(Geometry=pt_3, Plane=PlaneXY(0, 0, 0))  # -> Geometry, Transform
pull = PullPoint(Point=project.Geometry, Geometry=anchorcrvs, ClosestOnly=True)  # -> ClosestPoint, Distance
smaller = SmallerThan(FirstNumber=pull.Distance, SecondNumber=Slider(0.5, range=0..1))  # -> SmallerThan, OrEqualTo

crv = Curve(anchorcrvs)
incurves = PointInCurves(Point=project.Geometry, Curves=crv)  # -> Relationship, Index, Point
equals = Equality(FirstNumber=incurves.Relationship, SecondNumber=Slider(2, range=0..10))  # -> Equality, Inequality

or = GateOr(A=smaller.OrEqualTo, B=equals.Equality)
cull = CullPattern(List=pt_3, CullPattern=or)
anchor_2 = Anchor(Point=cull, Target=cull, Strength=10000)

entwine = Entwine(Branch00=show, Branch01=show_2, Branch02=[edgelengths, length_line, anchor, anchor_2], FlattenInputs=True)
solver = Solver(GoalObjects=entwine, Reset=Button(), Threshold=1e-15, Tolerance=0.01, On=Toggle(True))  # -> I, V, O

bang = ExplodeTree(Data=solver.O)  # -> Branch0, Branch1, Branch2
mesh = Mesh(bang.Branch0)
line = Line(bang.Branch1)

previewlw = CustomPreviewLineweights(Geometry=line, Shader=ColourSwatch(SwatchColor=RGB(113, 133, 115)), Thickness=Slider(6.39, range=0..100), Absolute=False)

preview = CustomPreview(Geometry=mesh, Material=ColourSwatch(SwatchColor=RGB(128, 128, 128)))
