# Grasshopper definition 021__SimpleKangaroo.gh (Grasshopper 1.0.7)
# plug-ins: MeshEdit Components, Human, Kangaroo2 Components

gallery = ImageGallery(CycleDelay=30, Randomize=False, UseLocalImages=True, UseRemoteImages=True)

number_slider = Slider(20, range=0..100)
number_slider_2 = Slider(12, range=0..100)

pt = ConstructPoint(XCoordinate=0, YCoordinate=0, ZCoordinate=0)
X = UnitX(Factor=1)
line = LineSDL(Start=pt, Direction=X, Length=Slider(2, range=0..10))
end = EndPoints(Curve=line)  # -> Start, End
length_line = LengthLine(Line=line, Length=Slider(1.5, range=0..10), Strength=10)
show = Show(G=line)
entwine = Entwine(Branch00=show, Branch01=length_line, FlattenInputs=True)
solver = Solver(GoalObjects=entwine, Reset=Button(), Threshold=1e-15, Tolerance=0.0001, On=True)  # -> I, V, O

rectangle = Rectangle(Plane=PlaneXY(0, 0, 0), XSize=number_slider, YSize=number_slider_2, Radius=0)  # -> Rectangle, Length
mesh_uv = MeshSurface(Surface=rectangle.Rectangle, UCount=number_slider, VCount=number_slider_2, Overhang=True, Equalize=False)

nakededge = MeshNakedEdge(Mesh=mesh_uv)  # -> V, A, B
crv = Curve(rectangle.Rectangle)
crv_cp = CurveClosestPoint(Point=nakededge.V, Curve=crv)  # -> Point, Parameter, Distance
smaller = SmallerThan(FirstNumber=crv_cp.Distance, SecondNumber=Slider(0.1, range=0..1))  # -> SmallerThan, OrEqualTo
cull = CullPattern(List=nakededge.V, CullPattern=smaller.SmallerThan)

# ----
# Color Format
# Input
data = Data(1)
# Method
data_2 = Data(1)
# Output
data_3 = Data(1)
# Display
data_4 = Data(1)
# Unuse
data_5 = Data(1)

faceb = FaceBoundaries(Mesh=mesh_uv)
explode = Explode(Curve=faceb, Recursive=True)  # -> Segments, Vertices
len = Length(Curve=explode.Segments)
length_line_2 = LengthLine(Line=explode.Segments, Length=len, Strength=10)

demesh = DeconstructMesh(Mesh=mesh_uv)  # -> Vertices, Faces, Colours, Normals
pt_2 = Point(demesh.Vertices)
Z = UnitZ(Factor=1)
load = Load(Point=pt_2, ForceVector=Z, Weighting=1)

bang = ExplodeTree(Data=solver.O)  # -> Branch0, Branch1
previewlw = CustomPreviewLineweights(
    Geometry=bang.Branch0,
    Shader=ColourSwatch(SwatchColor=RGBA(255, 0, 0, 111)),
    Thickness=Slider(0.1, range=0..0.1),
    Absolute=True)

show_2 = Show(G=mesh_uv)

pt_3 = Point(cull)
anchor = Anchor(Point=pt_3, Target=pt_3, Strength=10000)
entwine_2 = Entwine(Branch00=show_2, Branch01=[anchor, load, length_line_2], FlattenInputs=True)
solver_2 = Solver(GoalObjects=entwine_2, Reset=Button(), Threshold=1e-15, Tolerance=0.0001, On=True)  # -> I, V, O

bang_2 = ExplodeTree(Data=solver_2.O)  # -> Branch0, Branch1
previewlw_2 = CustomPreviewLineweights(
    Geometry=bang_2.Branch0,
    Shader=ColourSwatch(SwatchColor=RGBA(255, 0, 0, 103)),
    Thickness=Slider(0.1, range=0..0.1),
    Absolute=True)
