# Grasshopper definition 022_SimpleGridShell.gh (Grasshopper 1.0.7)
# plug-ins: Human, Bifocals, Kangaroo2 Components

gallery = ImageGallery(CycleDelay=30, Randomize=False, UseLocalImages=True, UseRemoteImages=True)

number_slider = Slider(12, range=0..100)
square = Square(Plane=PlaneXY(0, 0, 0), Size=Slider(1.36, range=0..2), ExtentX=number_slider, ExtentY=number_slider)  # -> Cells, Points

number_slider_2 = Slider(10, range=0..100)
square_2 = Square(Plane=PlaneXY(0, 0, 0), Size=Slider(1.36, range=0..2), ExtentX=number_slider_2, ExtentY=number_slider_2)  # -> Cells, Points

# ----
# Color Format
# Input
data = Data(1)
# Method
data_2 = Data(1)
# Output
data_3 = Data(1)
# Display
data_4 = Data(1)
# Unuse
data_5 = Data(1)

bounding_box = BoundingBox(Content=flatten(square.Cells), Plane=PlaneXY(0, 0, 0), UnionBox=True)  # -> Box, Box_2
rectangle = Rectangle(bounding_box.Box)
discontinuity = Discontinuity(Curve=rectangle, Level=1)  # -> Points, Parameters

preview = CustomPreview(Geometry=discontinuity.Points, Material=ColourSwatch(SwatchColor=RGB(189, 108, 108)))

pt = Point(square.Points)
curve = Curve(square.Cells)
flip = FlipMatrix(Data=pt)
explode = Explode(Curve=curve, Recursive=True)  # -> Segments, Vertices
pline = PolyLine(Vertices=flip, Closed=False)  # -> flatten(Polyline)
pline_2 = PolyLine(Vertices=pt, Closed=False)  # -> flatten(Polyline)
merge = Merge(Data1=pline_2, Data2=pline)
grab = Grab(On=True, Strength=1, Range=3)

average = Average(Input=discontinuity.Points)
scale = Scale(Geometry=discontinuity.Points, Center=average, Factor=Slider(0.71, range=0..1))  # -> Geometry, Transform

preview_2 = CustomPreview(Geometry=scale.Geometry, Material=ColourSwatch(SwatchColor=RGB(189, 108, 108)))

number_slider_3 = Slider(1, range=0..10)
rod = Rod(Polyline=merge, LengthFactor=number_slider_3, AngleFactor=number_slider_3, AxialStrength=10, BendStrength=1)

anchor = Anchor(Point=discontinuity.Points, Target=scale.Geometry, Strength=10000)
show = Show(G=merge)
merge_2 = Merge(Data1=flatten(show), Data2=flatten(anchor), Data3=flatten(rod), Data4=flatten(grab))

solver = Solver(GoalObjects=merge_2, Reset=Button(), Threshold=1e-15, Tolerance=0.01, On=Toggle(True))  # -> I, V, O
geo = Geometry(solver.O)

previewlw = CustomPreviewLineweights(Geometry=geo, Shader=ColourSwatch(SwatchColor=RGB(186, 166, 166)), Thickness=Slider(0.153, range=0..0.5), Absolute=True)

pt_2 = Point(square_2.Points)
curve_2 = Curve(square_2.Cells)
flip_2 = FlipMatrix(Data=pt_2)
explode_2 = Explode(Curve=curve_2, Recursive=True)  # -> Segments, Vertices
pline_3 = PolyLine(Vertices=flip_2, Closed=False)  # -> flatten(Polyline)
pline_4 = PolyLine(Vertices=pt_2, Closed=False)  # -> flatten(Polyline)
number_slider_4 = Slider(0, range=0..1)
merge_3 = Merge(Data1=pline_4, Data2=pline_3)
grab_2 = Grab(On=True, Strength=1, Range=3)

item = ListItem(List=pline_4, Index=0, Wrap=True)  # -> Item1, Item
merge_4 = Merge(Data1=item.Item1, Data2=item.Item)
cp = ControlPoints(Curve=merge_4)  # -> Points, Weights, Knots

number_slider_5 = Slider(1, range=0..10)
rod_2 = Rod(Polyline=merge_3, LengthFactor=number_slider_5, AngleFactor=number_slider_5, AxialStrength=10, BendStrength=1)

Z = UnitZ(Factor=Slider(4.7, range=0..10))
load = Load(Point=pt_2, ForceVector=Z, Weighting=1)

curvepoint = PointOnCurve(item.Item, parameter=0.5)
curvepoint_2 = PointOnCurve(item.Item1, parameter=0.5)
avr = Average(Input=[curvepoint_2, curvepoint])
vec2pt = Vector2Pt(PointA=curvepoint, PointB=avr, Unitize=False)  # -> Vector, Length
vec2pt_2 = Vector2Pt(PointA=curvepoint_2, PointB=avr, Unitize=False)  # -> Vector, Length
multiplication = Multiplication(A=vec2pt.Vector, B=number_slider_4)
multiplication_2 = Multiplication(A=vec2pt_2.Vector, B=number_slider_4)
move = Move(Geometry=item.Item1, Motion=multiplication_2)  # -> Geometry, Transform
move_2 = Move(Geometry=item.Item, Motion=multiplication)  # -> Geometry, Transform
merge_5 = Merge(Data1=move.Geometry, Data2=move_2.Geometry)

number_slider_6 = Slider(22, range=0..100)

neg = Negative(Value=number_slider_6)

rotate = Rotate(Geometry=merge_5, Angle=degrees([number_slider_6, neg]), Plane=[curvepoint_2, curvepoint])  # -> Geometry, Transform

cp_2 = ControlPoints(Curve=rotate.Geometry)  # -> Points, Weights, Knots

anchor_2 = Anchor(Point=cp.Points, Target=cp_2.Points, Strength=10000)
show_2 = Show(G=merge_3)
merge_6 = Merge(Data1=flatten(show_2), Data2=flatten(anchor_2), Data3=flatten(rod_2), Data4=flatten(grab_2), Data5=flatten(load))

solver_2 = Solver(GoalObjects=merge_6, Reset=Button(), Threshold=1e-15, Tolerance=0.01, On=Toggle(True))  # -> I, V, O
geo_2 = Geometry(solver_2.O)

previewlw_2 = CustomPreviewLineweights(
    Geometry=geo_2,
    Shader=ColourSwatch(SwatchColor=RGB(186, 166, 166)),
    Thickness=Slider(0.153, range=0..0.5),
    Absolute=True)
