# Grasshopper definition 4_Tensegrity.gh (Grasshopper 1.0.7)
# plug-ins: Bifocals, Kangaroo2 Components

gallery = ImageGallery(CycleDelay=30, Randomize=False, UseLocalImages=True, UseRemoteImages=True)

polygon = Polygon(Plane=PlaneXY(0, 0, 0), Radius=3, Segments=Slider(3, range=0..10), FilletRadius=0)  # -> Polygon, Length
discontinuity = Discontinuity(Curve=polygon.Polygon, Level=1)  # -> Points, Parameters

unit_z = UnitZ(Factor=Slider(3, range=0..10))
move = Move(Geometry=polygon.Polygon, Motion=unit_z)  # -> Geometry, Transform

# ----
# Color Format
# Input
data = Data(1)
# Method
data_2 = Data(1)
# Output
data_3 = Data(1)
# Display
data_4 = Data(1)
# Unuse
data_5 = Data(1)

discontinuity_2 = Discontinuity(Curve=move.Geometry, Level=1)  # -> Points, Parameters
shift_list = ShiftList(List=discontinuity_2.Points, Shift=1, Wrap=True)

explode = Explode(Curve=[polygon.Polygon, move.Geometry], Recursive=True)  # -> Segments, Vertices
line = Line(StartPoint=discontinuity.Points, EndPoint=discontinuity_2.Points)
line_2 = Line(flatten([explode.Segments, line]))

range = Range(Domain=Domain(0, 1), Steps=10)
shatter = Shatter(Curve=reparameterize(line_2), Parameters=range)

cables = Line(shatter)

line_3 = Line(StartPoint=discontinuity.Points, EndPoint=shift_list)
rigids = Line(line_3)
length_line = LengthLine(Line=rigids, Strength=Slider(100, range=0..100))

length = Length(Curve=cables)
multiplication = Multiplication(A=length, B=Slider(0.62, range=0..1))
length_line_2 = LengthLine(Line=cables, Length=multiplication, Strength=10)

grab = Grab(On=True, Strength=1, Range=3)

show = Show(G=rigids)
show_2 = Show(G=cables)

entwine = Entwine(Branch00=show, Branch01=show_2, Branch02=[length_line_2, length_line, grab], FlattenInputs=True)

boolean_toggle = BooleanToggle(True)
button = Button()
bouncysolver = BouncySolver(GoalObjects=entwine, Reset=button, Threshold=1e-15, Tolerance=0.01, Damping=0.99, Iterations=10, On=boolean_toggle)  # -> I, V, O

solver = Solver(GoalObjects=entwine, Reset=button, Threshold=1e-15, Tolerance=0.01, On=boolean_toggle)  # -> I, V, O; disabled

unflatten_tree = UnflattenTree(Tree=bouncysolver.O, Guide=entwine)
explode_tree = ExplodeTree(Data=unflatten_tree)  # -> Branch0, Branch1, Branch2
pipe = Pipe(Curve=explode_tree.Branch0, Radius=Slider(0.1, range=0..1), Caps=0)
preview = CustomPreview(Geometry=explode_tree.Branch1, Material=ColourSwatch(SwatchColor=RGB(196, 0, 0)))
