# Grasshopper definition LadyBug+Shadow.gh (Grasshopper 1.0.7)
# Copyright: GEL
# plug-ins: Bifocals, Kangaroo2 Components, ShapeDiverForGrasshopper, LunchBox, Weaverbird, Noise 4D

sddp = ShapeDiverDocumentPayload({AbsoluteTolerance=0, AngleTolerance=0, DistanceDisplayPrecision=0, GltfVersion="Gltf2", InputGroups="{}", OutputGroups="{}", RelativeTolerance=0, UnitSystem=0, VersionCreated="1.13.1.0", VersionSaved="1.13.1.0"})
gallery = ImageGallery(CycleDelay=30, Randomize=False, UseLocalImages=True, UseRemoteImages=True)

dom = ConstructDomain(DomainStart=Slider(3000, range=0..10000), DomainEnd=Slider(10000, range=0..10000))

dom_2 = ConstructDomain(DomainStart=Slider(0, range=0..10000), DomainEnd=Slider(1400, range=0..10000))

number_slider = Slider(22, range=10..25)
number_slider_2 = Slider(15870, range=0..100000)
genes = GenePool(Decimals=0, Maximum=1, Minimum=0, Value=[1, 1, 1, 1, 1, 1, 1, 1, 0, 0, 0, 1, 1, 1, 1])

敷地線 = Curve(<curve referenced from the Rhino model>)

crv = Curve(<curve referenced from the Rhino model>)
srf = Surface(crv)

neg = Negative(Value=Slider(615, range=0..10000))
offset = OffsetCurve(Curve=敷地線, Distance=neg, Corners=1)
srf_2 = Surface(offset)
popgeo = PopulateGeometry(Geometry=srf_2, Count=100, Seed=number_slider_2)

flip = Flip(Surface=srf)  # -> Surface, Result

# ----
# Color Format
# Input
data = Data(1)
# Method
data_2 = Data(1)
# Output
data_3 = Data(1)
# Display
data_4 = Data(1)
# Unuse
data_5 = Data(1)

duppt = RemoveDuplicatePts(Points=popgeo, Tolerance=Slider(3000, range=0..10000))
split = SplitList(List=duppt, Index=number_slider)  # -> ListA, ListB

preview = CustomPreview(Geometry=duppt, Material=ColourSwatch(SwatchColor=RGB(73, 168, 0)))

pt = Point(split.ListA)
del = DelaunayMesh(Points=pt, Plane=PlaneXY(0, 0, 0))

neg_2 = Negative(Value=Slider(500, range=0..10000))
dom_3 = ConstructDomain(DomainStart=neg_2, DomainEnd=Slider(200, range=0..10000))

faceb = FaceBoundaries(Mesh=del)
cluster = Cluster(C=faceb, D=Slider(45, range=0..100))
galapagos = Galapagos(fitness=num, gene=[genes, number_slider_2, number_slider])
number_slider_3 = Slider(20, range=0..100)

dom_4 = ConstructDomain(DomainStart=Slider(50, range=0..10000), DomainEnd=Slider(300, range=0..10000))

number_slider_4 = Slider(20, range=0..100)
Z = UnitZ(Factor=1)
lng = ListLength()
number_slider_5 = Slider(15, range=0..100)
pl = PlaneNormal(Origin=Point(0, 0, 0), ZAxis=Vector(0, 0, 1))
number_slider_6 = Slider(200, range=0..1000)
number_slider_7 = Slider(80, range=0..1000)
shift = Shift()
sort = SortList()  # -> Keys, ValuesA

dom_5 = ConstructDomain(DomainStart=Slider(300, range=0..10000), DomainEnd=Slider(60, range=0..10000))

panel = Panel("http://climate.onebuilding.org/WMO_Region_2_Asia/JPN_Japan/TK_Tokyo/JPN_TK_Tokyo.476620_JGMY.zip")
number_slider_8 = Slider(6, range=0..10)
number_slider_9 = Slider(24, range=0..100)
downloadepw = LBDownloadWeather(weather_URL=panel)  # -> epw_file, stat_file, ddy_file; plug-in component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
importloc = LBImportLocation(epw_file=downloadepw.epw_file)  # -> location; plug-in component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
analysisperiod = LBAnalysisPeriod(
    start_month=number_slider_8,
    start_day=number_slider_9,
    start_hour=Slider(10, range=8..18),
    end_month=number_slider_8,
    end_day=number_slider_9,
    end_hour=Slider(18, range=8..18))  # -> period, hoys, dates; plug-in component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
sunpath = LBSunPath(location=importloc, hoys=analysisperiod.hoys, scale=1)  # -> report, vectors, altitudes, azimuths, hoys, sun_pts, analemma, daily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; plug-in component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

number_slider_10 = Slider(53, range=0..100)
number_slider_11 = Slider(2, range=0..10)
quads = QuadPanels(Surface=flip.Surface, UDivisions=number_slider_10, VDivisions=number_slider_10)
sdivide = DivideSurface(Surface=quads, UCount=number_slider_11, VCount=number_slider_11)  # -> Points, Normals, Parameters
shift_2 = Shift(data=sdivide.Points)

area = Area(Geometry=quads)  # -> Area, Centroid
perlin = PerlinNoise(Values=area.Centroid, Time=Slider(7.15, range=0..10), Scale=Slider(0.0001, range=0.0001..0.0005))
bnd = Bounds(Numbers=flatten(perlin))
remap = RemapNumbers(Value=perlin, Source=bnd, Target=Domain(0, 1))  # -> Mapped, Clipped
gradient = Gradient(LowerLimit=0, UpperLimit=1, Parameter=remap.Mapped, stops=[0: RGB(255, 255, 255), 1: RGB(0, 0, 0)])
preview_2 = CustomPreview(Geometry=quads, Material=gradient)

triangle = MeshTriangle(CornerA=0, CornerB=1, CornerC=2)

explode = Explode(Curve=cluster, Recursive=True)  # -> Segments, Vertices
dupln = RemoveDuplicateLines(Lines=flatten(explode.Segments), Tolerance=0.01)
index = ItemIndex(List=dupln, Item=dupln)

conmesh = ConstructMesh(Vertices=explode.Vertices, Faces=triangle)
demesh = DeconstructMesh(Mesh=conmesh)  # -> Vertices, Faces, Colours, Normals

duppt_2 = RemoveDuplicatePts(Points=flatten(demesh.Vertices), Tolerance=0.01)  # -> simplify(UniquePoints)

pull = PullPoint(Point=simplify(graft(duppt_2)), Geometry=dupln, ClosestOnly=False)  # -> ClosestPoint, Distance
smaller = SmallerThan(FirstNumber=pull.Distance, SecondNumber=Slider(0.01, range=0..0.01))  # -> SmallerThan, OrEqualTo
cull = CullPattern(List=index, CullPattern=smaller.OrEqualTo)
item = ListItem(List=dupln, Index=cull, Wrap=True)

pt_2 = Point(duppt_2)
pt_3 = Point(duppt_2)

midpt = CurveMiddle(Curve=item)
merge = Merge(Data1=simplify(midpt), Data2=simplify(graft(pt_3)))
panel_2 = Panel("300")

hull = ConvexHull(Points=merge, Plane=PlaneXY(0, 0, 0))  # -> Hull, HullZ, Indices
cull_2 = CullPattern(List=flatten(hull.Hull), CullPattern=genes)
filter = StreamFilter(Gate=Toggle(True), Stream0=hull.Hull, Stream1=cull_2)

boundary = BoundarySurfaces(Edges=filter)  # -> graft(Surfaces)
pcen = PolygonCenter(Polyline=boundary)  # -> CenterV, CenterE, CenterA
pt_4 = Point(pcen.CenterV)

area_2 = Area(Geometry=boundary)  # -> Area, Centroid
bnd_2 = Bounds(Numbers=flatten(area_2.Area))
remap_2 = RemapNumbers(Value=area_2.Area, Source=bnd_2, Target=dom_4)  # -> Mapped, Clipped
line = LineSDL(Start=pt_4, Direction=Z, Length=Slider(3000, range=0..10000))

debrep = DeconstructBrep(Brep=boundary)  # -> Faces, Edges, Vertices
number_slider_12 = Slider(10, range=0..10)
area_3 = Area(Geometry=debrep.Faces)  # -> Area, Centroid
cir = Circle(Plane=pt_4, Radius=remap_2.Mapped)
range = Range(Domain=Domain(0, 1), Steps=number_slider_12)
crv_cp = CurveClosestPoint(Point=debrep.Vertices, Curve=cir)  # -> Point, Parameter, Distance
intcrv = Interpolate(Vertices=debrep.Vertices, Degree=3, Periodic=True, KnotStyle=1)  # -> Curve, Length, Domain
graph = GraphMapper(
    range,
    x0=0,
    x1=1,
    y0=0,
    y1=1,
    container_name="Bezier",
    cpx=[0, 0.08956422657, 0.01826101169, 1],
    cpy=[0, 0.6608210802, 1, 1])
pline = PolyLine(Vertices=crv_cp.Point, Closed=True)
panel_3 = Panel(area_3.Area)
tweencrv = TweenCurve(CurveA=intcrv.Curve, CurveB=pline, Factor=reverse(graph), BlendType=0)

area_4 = Area(Geometry=boundary)  # -> Area, Centroid
lng_2 = ListLength(List=debrep.Vertices)
bnd_3 = Bounds(Numbers=flatten(lng_2))
bnd_4 = Bounds(Numbers=flatten(area_4.Area))
remap_3 = RemapNumbers(Value=lng_2, Source=bnd_3, Target=dom)  # -> Mapped, Clipped
remap_4 = RemapNumbers(Value=area_4.Area, Source=bnd_4, Target=dom_2)  # -> Mapped, Clipped
addition = Addition(A=remap_3.Mapped, B=remap_4.Mapped)

range_2 = Range(Domain=addition, Steps=number_slider_12)  # -> simplify(Range)
Z_2 = UnitZ(Factor=range_2)

bnd_5 = Bounds(Numbers=flatten(addition))
remap_5 = RemapNumbers(Value=addition, Source=bnd_5, Target=Domain(0, 1))  # -> Mapped, Clipped

move = Move(Geometry=simplify(graft(tweencrv)), Motion=graft(Z_2))  # -> Geometry, Transform
shift_3 = Shift(data=move.Geometry)
item_2 = ListItem(List=reverse(shift_3), Index=0, Wrap=True)
Z_3 = UnitZ(Factor=Slider(500, range=0..1000))
move_2 = Move(Geometry=item_2, Motion=Z_3)  # -> Geometry, Transform
merge_2 = Merge(Data1=simplify(shift_3), Data2=simplify(move_2.Geometry))

cir_2 = Circle(Plane=pt_4, Radius=Slider(304, range=0..1000))
loft = Loft(Curves=merge_2, Options={Adjust=False, Closed=False, LoftEnds=0, LoftSimp=0, LoftType=1, Rebuild=10, Refit=0.01})
pframes = PerpFrames(Curve=cir_2, Count=number_slider_4, Align=True)  # -> Frames, Parameters
loft_2 = Loft(Curves=merge_2, Options={Adjust=False, Closed=False, LoftEnds=0, LoftSimp=0, LoftType=1, Rebuild=10, Refit=0.01})
mesh = Mesh(loft_2)
split_2 = SplitList(List=pframes.Frames, Index=expr("x*0.5", number_slider_4))  # -> ListA, ListB
mjoin = MeshJoin(Meshes=flatten(mesh))
wboffset = WeaverbirdsOffsetMesh(MeshCurves=mjoin, Distance=Slider(200, range=0..1000), OffsetType=0)
sec = MeshPlane(Mesh=loft_2, Plane=split_2.ListA)
shift_4 = Shift(data=simplify(sec))
cap = CapHoles(Brep=loft)
sec_2 = BrepPlane(Brep=cap, Plane=PlaneXY(0, 0, 0))  # -> Curves, Points
flip_2 = FlipCurve(Curve=shift_4, Guide=line)  # -> Curve, Flag
len = Length(Curve=flip_2.Curve)
planar = Planar(Curve=flip_2.Curve)  # -> Planar, Plane, Deviation
graft = GraftTree(Tree=simplify(flip_2.Curve), IncludeEmptyLists=True, IncludeNullItems=True)
bnd_6 = Bounds(Numbers=len)
graft_2 = GraftTree(Tree=simplify(planar.Plane), IncludeEmptyLists=True, IncludeNullItems=True)
dedomain = DeconstructDomain(Domain=bnd_6)  # -> Start, End
subtraction = Subtraction(A=dedomain.End, B=dedomain.Start)
divide = DivideCurve(Curve=reparameterize(flip_2.Curve), Count=number_slider_5, Kinks=False)  # -> Points, Tangents, Parameters
deplane = DeconstructPlane(Plane=graft_2)  # -> Origin, XAxis, YAxis, ZAxis
project = Project(Geometry=divide.Tangents, Plane=graft_2)  # -> Geometry, Transform

dom_6 = ConstructDomain(DomainStart=subtraction, DomainEnd=1)

remap_6 = RemapNumbers(Value=len, Source=bnd_6, Target=dom_6)  # -> graft(Mapped), Clipped
xprod = CrossProduct(VectorA=project.Geometry, VectorB=deplane.ZAxis, Unitize=False)  # -> Vector, Length

gradient_2 = Gradient(
    LowerLimit=0,
    UpperLimit=1,
    Parameter=remap_5.Mapped,
    stops=[0: RGB(0, 98, 0), 0.25: RGB(81, 175, 17), 0.5: RGB(159, 198, 146), 0.75: RGB(170, 235, 41), 1: RGB(221, 255, 53)])
preview_3 = CustomPreview(Geometry=cap, Material=gradient_2)

range_3 = Range(Domain=remap_6.Mapped, Steps=number_slider_5)
Z_4 = UnitZ(Factor=range_3)
move_3 = Move(Geometry=divide.Points, Motion=Z_4)  # -> Geometry, Transform
panel_4 = Panel(dom_6)
move_4 = Move(Geometry=move_3.Geometry, Motion=Vector(0, 0, 10))  # -> Geometry, Transform
index_2 = ItemIndex(List=move_3.Geometry, Item=move_3.Geometry)
bnd_7 = Bounds(Numbers=flatten(index_2))
remap_7 = RemapNumbers(Value=index_2, Source=bnd_7, Target=dom_5)  # -> Mapped, Clipped
points = PointList(Points=move_3.Geometry, Size=Slider(300, range=0..1000))
neg_3 = Negative(Value=remap_7.Mapped)
amp = Amplitude(Vector=xprod.Vector, Amplitude=neg_3)
move_5 = Move(Geometry=move_3.Geometry, Motion=amp)  # -> Geometry, Transform
ln = Line(StartPoint=move_3.Geometry, EndPoint=move_5.Geometry)  # -> simplify(Line)
path_mapper = PathMapper(ln, source="{A;B}[i]", target="{A;i}[B]")
midpt_2 = CurveMiddle(Curve=path_mapper)
avr = Average(Input=midpt_2)
cir_3 = Circle(Plane=avr, Radius=1)
alongcrv = SortAlongCurve(Points=midpt_2, Curve=cir_3)  # -> Points, Indices
item_3 = ListItem(List=path_mapper, Index=alongcrv.Indices, Wrap=True)
loft_3 = Loft(Curves=ln, Options={Adjust=False, Closed=False, LoftEnds=0, LoftSimp=0, LoftType=0, Rebuild=10, Refit=0.01})
loft_4 = Loft(Curves=item_3, Options={Adjust=False, Closed=True, LoftEnds=0, LoftSimp=0, LoftType=0, Rebuild=10, Refit=0.01})
geo = Geometry([loft_3, loft_4])
ungroup = Ungroup(Group=geo)
offset_2 = OffsetSurface(Surface=ungroup, Distance=0, Retrim=True)
mesh_2 = Mesh(ungroup)
mjoin_2 = MeshJoin(Meshes=flatten(mesh_2))

occ = Occlusion(Samples=shift_2, Obstructions=mjoin_2, Rays=sunpath.vectors)  # -> Hits, Occlusion
ma = MassAddition(Input=occ.Hits)  # -> Result, PartialResults
bnd_8 = Bounds(Numbers=flatten(ma.Result))
remap_8 = RemapNumbers(Value=ma.Result, Source=bnd_8, Target=Domain(0, 1))  # -> flatten(Mapped), Clipped
gradient_3 = Gradient(LowerLimit=0, UpperLimit=1, Parameter=remap_8.Mapped, stops=[0: RGB(255, 255, 255), 1: RGB(0, 0, 0)])
preview_4 = CustomPreview(Geometry=quads, Material=gradient_3)
panel_5 = Panel(remap_8.Mapped)

wboffset_2 = WeaverbirdsOffsetMesh(MeshCurves=mesh_2, Distance=Slider(100, range=0..100), OffsetType=1)

directsunhours = LBDirectSunHours(
    vectors=flatten(sunpath.vectors),
    geometry=flatten(flip.Surface),
    context=flatten(mjoin_2),
    grid_size=Slider(500, range=0..1000),
    run=Toggle(True))  # -> report, points, results, mesh, legend, title, int_mtx; plug-in component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

preview_5 = CustomPreview(Geometry=wboffset_2, Material=ColourSwatch(SwatchColor=RGB(163, 150, 150)))
bnd_9 = Bounds(Numbers=flatten(directsunhours.results))
subtraction_2 = Subtraction(A=remap_8.Mapped, B=remap.Mapped)
abs = Absolute(Value=subtraction_2)
pt_5 = Point(directsunhours.points)
remap_9 = RemapNumbers(Value=directsunhours.results, Source=bnd_9, Target=dom_3)  # -> Mapped, Clipped
ma_2 = MassAddition(Input=abs)  # -> Result, PartialResults
num = Number(ma_2.Result)
Z_5 = UnitZ(Factor=remap_9.Mapped)
move_6 = Move(Geometry=pt_5, Motion=Z_5)  # -> Geometry, Transform
panel_6 = Panel(num)
panel_7 = Panel(directsunhours.results)
move_7 = Move(Geometry=remap_9.Mapped, Motion=Vector(0, 0, 10))  # -> Geometry, Transform
patch = Patch(Curves=crv, Points=move_6.Geometry, Spans=Slider(63, range=0..100), Flexibility=1, Trim=True)
preview_6 = CustomPreview(Geometry=patch, Material=ColourSwatch(SwatchColor=RGB(255, 255, 255)))
contour = Contour(Shape=patch, Point=Point(0, 0, 0), Direction=Vector(0, 0, 1), Distance=Slider(100, range=0..1000))
preview_7 = CustomPreview(Geometry=contour, Material=ColourSwatch(SwatchColor=RGB(158, 158, 158)))
shift_5 = Shift(data=loft_3)
shift_6 = Shift(data=loft_4)
merge_3 = Merge(Data1=shift_6, Data2=shift_5)
group = Group(Objects=merge_3)
panel_8 = Panel(path_mapper)

# ==== cluster Shift
data = ClusterInput()
data_2 = Data(data)
tstat = TreeStatistics(Tree=data_2)  # -> Paths, Length, Count
dpath = DeconstructPath(Branch=tstat.Paths)
lng = ListLength(List=dpath)  # -> flatten(Length)
sort = SortList(Keys=lng)  # -> Keys, ValuesA
item = ListItem(List=reverse(sort.Keys), Index=0, Wrap=True)
pshift = ShiftPaths(Data=data_2, Offset=-1)
flatten = FlattenTree(Tree=data_2, Path="{0}")
larger = LargerThan(FirstNumber=item, SecondNumber=1)  # -> LargerThan, OrEqualTo
filter = StreamFilter(Gate=larger.LargerThan, Stream0=flatten, Stream1=pshift)
D = Data(filter)
D_2 = ClusterOutput(D)

# ==== cluster Cluster
C = ClusterInput()
explode = Explode(Curve=C, Recursive=True)  # -> Segments, Vertices
lng = ListLength(List=explode.Segments)
equals = Equality(FirstNumber=lng, SecondNumber=Slider(3, range=0..10))  # -> Equality, Inequality
cull = CullPattern(List=explode.Segments, CullPattern=equals.Equality)
D = ClusterInput()
shift = ShiftList(List=cull, Shift=1, Wrap=True)
shift_2 = ShiftList(List=cull, Shift=-1, Wrap=True)
rad = Radians(Degrees=D)
angle = Angle(VectorA=cull, VectorB=shift_2)  # -> Angle, Reflex
angle_2 = Angle(VectorA=cull, VectorB=shift)  # -> Angle, Reflex
merge = Merge(Data1=angle_2.Angle, Data2=angle.Angle)
smaller = SmallerThan(FirstNumber=merge, SecondNumber=rad)  # -> SmallerThan, OrEqualTo
ma = MassAddition(Input=smaller.SmallerThan)  # -> Result, PartialResults
larger = LargerThan(FirstNumber=ma.Result, SecondNumber=Slider(1, range=0..1))  # -> flatten(LargerThan), OrEqualTo
cull_2 = CullPattern(List=explode.Segments, CullPattern=equals.Inequality)
cull_3 = CullPattern(List=flatten(C), CullPattern=invert(larger.LargerThan))
merge_2 = Merge(Data1=cull_3, Data2=cull_2)  # -> flatten(Result)
panel = Panel(larger.LargerThan)
R = ClusterOutput(merge_2)
