# Grasshopper definition 01_Accord.gh (Grasshopper 1.0.7)
# plug-ins: Bifocals, LunchBoxML, ShapeDiverForGrasshopper

# ---- group: Training Geometry
crv = Curve([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])

# ----
sddp = ShapeDiverDocumentPayload({AbsoluteTolerance=0, AngleTolerance=0, DistanceDisplayPrecision=0, GltfVersion="Gltf2", InputGroups="{}", OutputGroups="{}", RelativeTolerance=0, UnitSystem=0, VersionCreated="1.13.1.0", VersionSaved="1.13.1.0"})
# 01_Regression
gallery = ImageGallery(CycleDelay=30, Randomize=False, UseLocalImages=True, UseRemoteImages=True)

# ----
# B. Logistic
number_slider = Slider(216, range=0..1000)
srf = Surface(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)
srf_2 = Surface(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)
srf_3 = Surface(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)
popgeo = PopulateGeometry(Geometry=srf_2, Count=number_slider, Seed=1)
popgeo_2 = PopulateGeometry(Geometry=srf, Count=number_slider, Seed=1)
popgeo_3 = PopulateGeometry(Geometry=srf_3, Count=Slider(225, range=0..1000), Seed=1)  # -> graft(Population)
merge = Merge(Data1=flatten(popgeo_2), Data2=flatten(popgeo))
lng = ListLength(List=popgeo)
lng_2 = ListLength(List=popgeo_2)
pdecon = Deconstruct(Point=merge)  # -> XComponent, YComponent, ZComponent
dup = DuplicateData(Data=Toggle(True), Number=lng_2, Order=True)
dup_2 = DuplicateData(Data=Toggle(False), Number=lng, Order=True)
merge_2 = Merge(Data1=graft(pdecon.XComponent), Data2=graft(pdecon.YComponent))  # -> simplify(Result)
merge_3 = Merge(Data1=dup, Data2=dup_2)  # -> simplify(Result)
pt = Point(<point referenced from the Rhino model>)
logreg = LogisticRegression(
    TestData=popgeo_3,
    TrainingInputs=merge_2,
    TrainingOutput=merge_3,
    Tolerance=0.0001,
    MaximumIterations=100,
    RegularizationValue=0,
    RandomSeed=5)  # -> Result, Score
gradient = Gradient(LowerLimit=0, UpperLimit=1, Parameter=graft(logreg.Score), stops=[0: RGB(255, 255, 255), 1: RGB(0, 0, 0)])
panel = Panel(logreg.Score)
preview = CustomPreview(Geometry=popgeo_3, Material=gradient)

# ----
# A. Linear
number_slider_2 = Slider(29, range=0..30)
expression = Expression(x=number_slider_2, Expression="23*x-89")
panel_2 = Panel(expression)
panel_3 = Panel("""87
33
124
125
93
10
148
182
61
139
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""")
panel_4 = Panel("""1912
670
2763
2786
2050
141
3315
4097
1314
3108
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""")
linereg = LinearRegression(TestData=Slider(29, range=0..30), TrainingInputs=panel_3, TrainingOutput=panel_4, RandomSeed=5)
panel_5 = Panel(linereg)

# ----
# C. Nonlinear
number_slider_3 = Slider(3, range=0..30)
x = Panel("""87
33
124
125
93
10
148
182
61
139
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""")
y = Panel("""15.911262
-3.785897
-3.9745
-1.591726
2.986906
20.195304
18.91805
-14.515988
-4.3719
23.32818
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""")
pt_2 = ConstructPoint(XCoordinate=x, YCoordinate=y, ZCoordinate=0)
nonlinereg = NonlinearRegression(
    TestData=number_slider_3,
    TrainingInputs=simplify(graft(x)),
    TrainingOutput=y,
    Sigma=Slider(24, range=0..100),
    Complexity=100,
    RandomSeed=5)  # -> Result, Score, Error
pt_3 = ConstructPoint(XCoordinate=number_slider_3, YCoordinate=nonlinereg.Result, ZCoordinate=0)
preview_2 = CustomPreview(Geometry=pt_3, Material=ColourSwatch(SwatchColor=RGB(0, 144, 255)))
panel_6 = Panel(nonlinereg.Error)

# ---- group: Test Geometry
crv_2 = Curve(<curve referenced from the Rhino model>)

# ---- group: Attributes
bbox = BoundingBox(Content=crv_2, Plane=PlaneXY(0, 0, 0))  # -> Box, Box_2
debox = DeconstructBox(Box=bbox.Box)  # -> Plane, X, Y, Z
dedomain = DeconstructDomain(Domain=debox.Y)  # -> Start, End
dedomain_2 = DeconstructDomain(Domain=debox.X)  # -> Start, End
area = Area(Geometry=crv_2)  # -> Area, Centroid
subtraction = Subtraction(A=dedomain.End, B=dedomain.Start)
subtraction_2 = Subtraction(A=dedomain_2.End, B=dedomain_2.Start)
area_2 = Panel(area.Area)
length = Panel(subtraction_2)
width = Panel(subtraction)

# ---- group: Labels
space_name = Panel("""Phone Booth
Phone Booth
Small Office
Small Office
Medium Office
Medium Office
Large Office
Large Office
Conference Room
Conference Room""")
space_index = Panel("""0
1
2
3
4
5
6
7
8
9""")

# ---- group: Attributes
bbox_2 = BoundingBox(Content=crv, Plane=PlaneXY(0, 0, 0))  # -> Box, Box_2
debox_2 = DeconstructBox(Box=bbox_2.Box)  # -> Plane, X, Y, Z
dedomain_3 = DeconstructDomain(Domain=debox_2.Y)  # -> Start, End
dedomain_4 = DeconstructDomain(Domain=debox_2.X)  # -> Start, End
area_3 = Area(Geometry=crv)  # -> Area, Centroid
subtraction_3 = Subtraction(A=dedomain_3.End, B=dedomain_3.Start)
subtraction_4 = Subtraction(A=dedomain_4.End, B=dedomain_4.Start)
area_4 = Panel(area_3.Area)
length_2 = Panel(subtraction_4)
width_2 = Panel(subtraction_3)
tag = TextTag3D(Location=area_3.Centroid, Text=space_name, Size=1, Justification=5)

# ----
# Color Format
# Input
data = Data(1)
# Method
data_2 = Data(1)
# Output
data_3 = Data(1)
# Display
data_4 = Data(1)
# Unuse
data_5 = Data(1)

# ----
# Training Data
bnd = Bounds(Numbers=area_4)

# ---- group: Remapped Vectors
bnd_2 = Bounds(Numbers=length_2)
bnd_3 = Bounds(Numbers=width_2)
remap = RemapNumbers(Value=area_4, Source=bnd, Target=Domain(0, 1))  # -> Mapped, Clipped
remap_2 = RemapNumbers(Value=length_2, Source=bnd_2, Target=Domain(0, 1))  # -> Mapped, Clipped
remap_3 = RemapNumbers(Value=width_2, Source=bnd_3, Target=Domain(0, 1))  # -> Mapped, Clipped
entwine = Entwine(Branch00=remap.Mapped, Branch01=remap_2.Mapped, Branch02=remap_3.Mapped, FlattenInputs=True)
flip = FlipMatrix(Data=entwine)

# ----
# Data to Test
bnd_4 = Bounds(Numbers=area_4)

# ---- group: Remapped Vectors
bnd_5 = Bounds(Numbers=length_2)
bnd_6 = Bounds(Numbers=width_2)
remap_4 = RemapNumbers(Value=area_2, Source=bnd_4, Target=Domain(0, 1))  # -> Mapped, Clipped
remap_5 = RemapNumbers(Value=length, Source=bnd_5, Target=Domain(0, 1))  # -> Mapped, Clipped
remap_6 = RemapNumbers(Value=width, Source=bnd_6, Target=Domain(0, 1))  # -> Mapped, Clipped
entwine_2 = Entwine(Branch00=remap_4.Mapped, Branch01=remap_5.Mapped, Branch02=remap_6.Mapped, FlattenInputs=True)
flip_2 = FlipMatrix(Data=entwine_2)

# ----
number_slider_4 = Slider(0, range=0..10)

# ----
# The formula is not linear. So it won't work well.
number_slider_5 = Slider(20, range=0..30)
expression_2 = Expression(x=number_slider_5, Expression="Sin(2*x)*25")

panel_7 = Panel(flip)

number_slider_6 = Slider(100, range=0..100)
series = Series(Start=0, Step=1, Count=Slider(200, range=0..1000))
expression_3 = Expression(x=series, Expression="Sin(0.1*x)*24")
reduce = RandomReduce(List=series, Reduction=number_slider_6, Seed=1)
panel_8 = Panel(reduce)
panel_9 = Panel(expression_3)
reduce_2 = RandomReduce(List=expression_3, Reduction=number_slider_6, Seed=1)
panel_10 = Panel(reduce_2)

# ---- group: Neural Network
neural = NeuralNetwork(
    TestData=flip_2,
    TraingInputs=flip,
    Labels=space_index,
    HiddenNeurons=5,
    Alpha=2,
    Iterations=Slider(15, range=0..20),
    RandomSeed=5)

# ----
neural_network_trainer = NeuralNetworkTrainer(HiddenNeurons=6, LearningAlgorithm=1, ActivationFunction=0, Alpha=2, Iterations=500)  # -> TrainedNueralNetwork, ErrorsDynamics

number_slider_7 = Slider(100, range=0..100)
series_2 = Series(Start=0, Step=1, Count=Slider(200, range=0..1000))
expression_4 = Expression(x=series_2, Expression="23*x-89")
reduce_3 = RandomReduce(List=series_2, Reduction=number_slider_7, Seed=1)
panel_11 = Panel(reduce_3)
panel_12 = Panel(expression_4)
reduce_4 = RandomReduce(List=expression_4, Reduction=number_slider_7, Seed=1)
panel_13 = Panel(reduce_4)

# ---- group: Result
item = ListItem(List=space_name, Index=neural, Wrap=True)
space_selection = Panel(item)
tag_2 = TextTag3D(Location=area.Centroid, Text=item, Size=1, Colour=ColourSwatch(SwatchColor=RGB(255, 255, 255)), Justification=5)
