# Grasshopper definition BinaryClassifier-FFTrainer.gh (Grasshopper 1.0.7)
# plug-ins: LunchBoxML

# ---- group: Boundary 1
crv = Curve(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)

# ---- group: Boundary 2
# Train the model with different
# boundary inclusion tests...
crv_2 = Curve(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)

# ---- group: Boundary 3
crv_3 = Curve(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)

# ---- group: Scatter plot
# Fast Forest Binary Classifier Trainer + Tester
# Company Info: Authored by Proving Ground
# 
# https://ProvingGround.io
# Copyright (c) 2023 Proving Ground LLC
pt = Point([Point(12.22037485, 29.92744861, 0), Point(10.8570133, 28.76360339, 0), Point(8.928355502, 25.97037485, 0), Point(7.86426844, 28.2980653, 0), Point(4.971281741, 28.59733978, 0), Point(5.004534462, 25.43833132, 0)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])

# ----
crv_4 = Curve(crv)
pt_2 = Point(pt)
incurve = PointInCurve(Point=pt_2, Curve=crv_4)  # -> Relationship, Point
sqgrid = Square(Plane=PlaneXY(0, 0, 0), Size=1, ExtentX=40, ExtentY=40)  # -> Cells, flatten(Points)
pdecon = Deconstruct(Point=pt_2)  # -> XComponent, YComponent, ZComponent
bool = Boolean(incurve.Relationship)
pt_3 = Point(sqgrid.Points)
merge = Merge(Data1=graft(pdecon.XComponent), Data2=graft(pdecon.YComponent), Data3=graft(bool))
# Description: A Binary Classifier is trained using random point coordinates and a curve region. Points included within the boundary recieve a 'true' label.
# 
# The model is then tested to predict the label of a grid of new points.
panel = Panel("""X
Y
Contains""")
lng = ListLength(List=pt_3)
dup = DuplicateData(Data="0", Number=lng, Order=True)  # -> flatten(Data)
pdecon_2 = Deconstruct(Point=pt_3)  # -> XComponent, YComponent, ZComponent
create = CreateDataSet(Labels=panel, Data=merge)
bool_2 = Boolean(dup)
column_label = GetColumnLabel(Data=create, columns="X,Y,Contains")  # -> X, Y, Contains
fast_forest = FastForestBinaryClassifier(
    NumberOfLeaves=Slider(42, range=0..100),
    NumberOfTrees=Slider(19, range=0..100),
    MinimumExampleCountPerLeaf=Slider(8, range=0..100))
merge_2 = Merge(Data1=graft(pdecon_2.XComponent), Data2=graft(pdecon_2.YComponent), Data3=graft(bool_2))
panel_2 = Panel("""X
Y
Contains""")
create_2 = CreateDataSet(Labels=panel_2, Data=merge_2)
binary_classifier_trainer = BinaryClassifierTrainer(
    TrainingDataSet=create,
    FeatureNames=[column_label.X, column_label.Y],
    LabelName=column_label.Contains,
    TrainerType=fast_forest)
binary_classifier_tester = BinaryClassifierTester(Model=binary_classifier_trainer, TestingDataSet=create_2)  # -> Predictions, Scores
pt_4 = Point(pt_3)

# ---- group: View Scores
bnd = Bounds(Numbers=flatten(binary_classifier_tester.Scores))
dedomain = DeconstructDomain(Domain=bnd)  # -> Start, End
gradient = Gradient(
    LowerLimit=dedomain.Start,
    UpperLimit=dedomain.End,
    Parameter=binary_classifier_tester.Scores,
    stops=[0: RGB(70, 130, 180), 0.5: RGB(255, 255, 0), 1: RGB(255, 0, 0)])
# Turn on this preview to view
# a gradient of prediction scores....
preview = CustomPreview(Geometry=graft(pt_4), Material=gradient)

# ---- group: Classification
cull = CullPattern(List=graft(pt_4), CullPattern=binary_classifier_tester.Predictions)
cull_2 = CullPattern(List=graft(pt_4), CullPattern=invert(binary_classifier_tester.Predictions))
preview_2 = CustomPreview(Geometry=cull, Material=ColourSwatch(SwatchColor=RGB(255, 0, 115)))
preview_3 = CustomPreview(Geometry=cull_2, Material=ColourSwatch(SwatchColor=RGB(255, 255, 255)))
