# Grasshopper definition BinaryClassifier-MultiLabel.gh (Grasshopper 1.0.7)
# plug-ins: LunchBoxML

# ----
# Multilabel using Binary Classifier Trainers + Testers
# Company Info: Authored by Proving Ground
# 
# https://ProvingGround.io
# Copyright (c) 2023 Proving Ground LLC
# Random points for training
number_slider = Slider(2000, range=0..2000)
# Points are tested for inclusion
# among 3 different 3D Brep zones.
number_slider_2 = Slider(68, range=0..300)
dom = ConstructDomain(DomainStart=0, DomainEnd=Slider(68, range=0..300))
# Description: Three Binary Classifier models are trained using random points and 3 zones for inclusion.
# 
# The models are then tested to predict three labels of a grid of new points.
# 
# 3D box geometry is the created with sizes and colors indicated the number of labels assigned to each point.
random = Random(Range=dom, Number=number_slider, Seed=2)
random_2 = Random(Range=dom, Number=number_slider, Seed=Slider(157, range=0..300))
random_3 = Random(Range=dom, Number=number_slider, Seed=number_slider_2)
pt = ConstructPoint(XCoordinate=random, YCoordinate=random_2, ZCoordinate=random_3)

# ---- group: Test Zone 3
brep = Brep(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)

# ---- group: Test Zone 2
brep_2 = Brep(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)

# ---- group: Test Zone 1
brep_3 = Brep(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)

# ---- group: Test Point Inclusion
brepsinc = PointInBreps(Brep=brep_3, Point=pt, Strict=False)  # -> Inside, Index
brepsinc_2 = PointInBreps(Brep=brep_2, Point=pt, Strict=False)  # -> Inside, Index
brepsinc_3 = PointInBreps(Brep=brep, Point=pt, Strict=False)  # -> Inside, Index

# ----
dom_2 = ConstructDomain(DomainStart=0, DomainEnd=Slider(68, range=0..300))
pdecon = Deconstruct(Point=pt)  # -> XComponent, YComponent, ZComponent
pdecon_2 = Deconstruct(Point=pt)  # -> XComponent, YComponent, ZComponent
pdecon_3 = Deconstruct(Point=pt)  # -> XComponent, YComponent, ZComponent
bool = Boolean(brepsinc.Inside)
bool_2 = Boolean(brepsinc_3.Inside)
bool_3 = Boolean(brepsinc_2.Inside)
# A regular grid of points for testing
range = Range(Domain=dom_2, Steps=Slider(10, range=0..100))
panel = Panel("""X
Y
Z
Contains""")
merge = Merge(Data1=graft(pdecon.XComponent), Data2=graft(pdecon.YComponent), Data3=graft(pdecon.ZComponent), Data4=graft(bool))
panel_2 = Panel("""X
Y
Z
Contains""")
merge_2 = Merge(
    Data1=graft(pdecon_2.XComponent),
    Data2=graft(pdecon_2.YComponent),
    Data3=graft(pdecon_2.ZComponent),
    Data4=graft(bool_2))
panel_3 = Panel("""X
Y
Z
Contains""")
merge_3 = Merge(
    Data1=graft(pdecon_3.XComponent),
    Data2=graft(pdecon_3.YComponent),
    Data3=graft(pdecon_3.ZComponent),
    Data4=graft(bool_3))
crossref = CrossReference(ListA=range, ListB=range, CrossMode=1)  # -> ListA, ListB
create = CreateDataSet(Labels=panel, Data=merge)
create_2 = CreateDataSet(Labels=panel_2, Data=merge_2)
create_3 = CreateDataSet(Labels=panel_3, Data=merge_3)
pt_2 = ConstructPoint(XCoordinate=crossref.ListA, YCoordinate=crossref.ListB, ZCoordinate=graft(range))  # -> flatten(Point)
fast_forest = FastForestBinaryClassifier(
    NumberOfLeaves=Slider(42, range=0..100),
    NumberOfTrees=Slider(19, range=0..100),
    MinimumExampleCountPerLeaf=Slider(8, range=0..100))
# 3 Binary Classifiers are trained with the
# different boundary inclusion labels.
column_label = GetColumnLabel(Data=create, columns="X,Y,Z,Contains")  # -> X, Y, Z, Contains
column_label_2 = GetColumnLabel(Data=create_2, columns="X,Y,Z,Contains")  # -> X, Y, Z, Contains
column_label_3 = GetColumnLabel(Data=create_3, columns="X,Y,Z,Contains")  # -> X, Y, Z, Contains
lng = ListLength(List=pt_2)
bool_4 = Boolean(False)
dup = DuplicateData(Data=bool_4, Number=lng, Order=True)  # -> flatten(Data)
pdecon_4 = Deconstruct(Point=pt_2)  # -> XComponent, YComponent, ZComponent
bool_5 = Boolean(dup)

# ---- group: Train Multiple Labels
binary_classifier_trainer = BinaryClassifierTrainer(
    TrainingDataSet=create,
    FeatureNames=[column_label.X, column_label.Y, column_label.Z],
    LabelName=column_label.Contains,
    TrainerType=fast_forest)
binary_classifier_trainer_2 = BinaryClassifierTrainer(
    TrainingDataSet=create_2,
    FeatureNames=[column_label_2.X, column_label_2.Y, column_label_2.Z],
    LabelName=column_label_2.Contains,
    TrainerType=fast_forest)
binary_classifier_trainer_3 = BinaryClassifierTrainer(
    TrainingDataSet=create_3,
    FeatureNames=[column_label_3.X, column_label_3.Y, column_label_3.Z],
    LabelName=column_label_3.Contains,
    TrainerType=fast_forest)

# ----
panel_4 = Panel("""X
Y
Z
Contains""")
merge_4 = Merge(
    Data1=graft(pdecon_4.XComponent),
    Data2=graft(pdecon_4.YComponent),
    Data3=graft(pdecon_4.ZComponent),
    Data4=graft(bool_5))
# A 3D grid of points is tested against each
# of the 3 Binary Classifier models...
create_4 = CreateDataSet(Labels=panel_4, Data=merge_4)

# ---- group: Test Multi-Label Classification
binary_classifier_tester = BinaryClassifierTester(Model=binary_classifier_trainer, TestingDataSet=create_4)  # -> Predictions, Scores
binary_classifier_tester_2 = BinaryClassifierTester(Model=binary_classifier_trainer_3, TestingDataSet=create_4)  # -> Predictions, Scores
binary_classifier_tester_3 = BinaryClassifierTester(Model=binary_classifier_trainer_2, TestingDataSet=create_4)  # -> Predictions, Scores

# ----
ma = MassAddition(Input=[binary_classifier_tester.Predictions, binary_classifier_tester_2.Predictions, binary_classifier_tester_3.Predictions])  # -> Result, PartialResults
pt_3 = Point(graft(pt_2))
bnd = Bounds(Numbers=flatten(ma.Result))
dedomain = DeconstructDomain(Domain=bnd)  # -> Start, End
dom_3 = ConstructDomain(DomainStart=Slider(0.417, range=0..1), DomainEnd=Slider(2.857, range=0..10))
gradient = Gradient(
    LowerLimit=dedomain.Start,
    UpperLimit=dedomain.End,
    Parameter=ma.Result,
    stops=[0: RGB(255, 0, 0), 0.353: RGB(70, 130, 180), 1: RGB(255, 255, 0)])
remap = RemapNumbers(Value=ma.Result, Source=bnd, Target=dom_3)  # -> Mapped, Clipped
box = CenterBox(Base=pt_3, X=remap.Mapped, Y=remap.Mapped, Z=remap.Mapped)
wires = BrepWireframe(Brep=box, Density=-1)
preview = CustomPreview(Geometry=wires, Material=ColourSwatch(SwatchColor=RGB(0, 0, 0)))
# Box size and colors visualize the number
# of labels assigned to each point.
preview_2 = CustomPreview(Geometry=box, Material=gradient)
