# Grasshopper definition LinearRegression-SDCTrainer.gh (Grasshopper 1.0.7)
# plug-ins: LunchBoxML

# ---- group: Scatter plot 1
# SDC Linear Regression Trainer + Tester
# Company Info: Authored by Proving Ground
# 
# https://ProvingGround.io
# Copyright (c) 2023 Proving Ground LLC
pt = Point([Point(1.341609501, 14.14259546, 0), Point(3.241697128, 13.18264083, 0), Point(6.870139612, 12.02359364, 0), Point(6.019904134, 9.26447605, 0), Point(3.989263427, 9.311169317, 0), Point(2.020758371, 10.760707, 0)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])

# ---- group: Scatter plot 2
pt_2 = Point([Point(1.659178434, 3.636071887, 0), Point(3.706675225, 4.906931964, 0), Point(6.530808729, 3.424261874, 0), Point(11.68485237, 4.836328626, 0), Point(11.40243902, 8.437098845, 0), Point(9.354942234, 6.672015404, 0), Point(15.00320924, 10.48459564, 0), Point(16.27406932, 7.025032092, 0), Point(18.32156611, 8.719512195, 0), Point(20.08664955, 10.20218228, 0), Point(23.05198973, 10.27278562, 0), Point(27.35879332, 13.94415918, 0), Point(21.21630295, 14.3677792, 0), Point(19.31001284, 11.5436457, 0), Point(16.11844544, 8.748268935, 0), Point(14.45082285, 7.35858344, 0), Point(1.851007702, 1.429258665, 0), Point(20.51151926, 7.853823492, 0), Point(26.30099294, 6.582963415, 0), Point(9.638605263, 12.23123042, 0)])

# ---- group: Scatter plot 3
pt_3 = Point([Point(16.61073262, 6.95652774, 0), Point(5.733905664, 6.973064678, 0), Point(1.944347255, 3.924585421, 0), Point(6.791297103, 3.667540352, 0), Point(26.98934283, 6.117072099, 0), Point(31.34843012, 5.584727657, 0)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])

# ----
pt_4 = Point(pt_2)
pdecon = Deconstruct(Point=pt_4)  # -> XComponent, YComponent, ZComponent
merge = Merge(Data1=graft(pdecon.XComponent), Data2=graft(pdecon.YComponent))
panel = Panel("""X
Y""")
num = Number(merge)
series = Series(Start=0, Step=1, Count=30)  # -> flatten(Series)
# Descrption: Provided a scatter plot of points, use a SDC Regression trainer and test it to createa a linear predictive plot.
create = CreateDataSet(Labels=panel, Data=num)
sdca = SdcaRegression(
    L1Regularization=Slider(0, range=0..1),
    L2Regularization=Slider(2, range=0..2),
    MaximumNumberOfIterations=Slider(500, range=0..1000))
lng = ListLength(List=series)
column_label = GetColumnLabel(Data=create, columns="X,Y")  # -> X, Y
dup = DuplicateData(Data="0", Number=lng, Order=True)  # -> flatten(Data)
regression_trainer = RegressionTrainer(TrainingDataSet=create, FeatureNames=column_label.X, LabelName=column_label.Y, TrainerType=sdca)
merge_2 = Merge(Data1=graft(series), Data2=graft(dup))
panel_2 = Panel("""X
Y""")
num_2 = Number(merge_2)
create_2 = CreateDataSet(Labels=panel_2, Data=num_2)
regression_tester = RegressionTester(Model=regression_trainer, TestingDataSet=create_2)  # -> flatten(Predictions), R2, AbsoluteLoss, SquaredLoss, RootMeanSquaredLoss

# ---- group: Linear prediction
pt_5 = ConstructPoint(XCoordinate=series, YCoordinate=regression_tester.Predictions, ZCoordinate=0)

# ----
intcrv = Interpolate(Vertices=pt_5, Degree=3, Periodic=False, KnotStyle=1)  # -> Curve, Length, Domain
preview = CustomPreview(Geometry=pt_5, Material=ColourSwatch(SwatchColor=RGB(255, 166, 0)))
