# Grasshopper definition NonlinearRegression-FFTrainer.gh (Grasshopper 1.0.7)
# plug-ins: LunchBoxML

# ---- group: Scatter plot 2
pt = Point([Point(0.7744314749, 16.84702146, 0), Point(1.902923035, 16.98191833, 0), Point(5.805467605, 14.44779848, 0), Point(8.491634646, 11.40685466, 0), Point(10.36688334, 6.338614961, 0), Point(10.56961292, 2.537435185, 0)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])

# ---- group: Scatter plot 1
# Fast Forest Nonlinear Regression Trainer + Tester
# Company Info: Authored by Proving Ground
# 
# https://ProvingGround.io
# Copyright (c) 2023 Proving Ground LLC
pt_2 = Point([Point(1.119402561, 1.518652104, 0), Point(2.791921662, 7.043033378, 0), Point(4.413758366, 10.74284836, 0), Point(6.339689453, 8.3607757, 0), Point(9.076538891, 9.475788434, 0), Point(11.05315237, 10.84421315, 0)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])

# ----
pt_3 = Point(pt_2)
pdecon = Deconstruct(Point=pt_3)  # -> XComponent, YComponent, ZComponent
merge = Merge(Data1=graft(pdecon.XComponent), Data2=graft(pdecon.YComponent))
panel = Panel("""X
Y""")
num = Number(merge)
series = Series(Start=0, Step=0.5, Count=60)  # -> flatten(Series)
# Descrption: Provided a scatter plot of points, use a Fast Forest Regression trainer and test it to create a nonlinear predictive plot.
create = CreateDataSet(Labels=panel, Data=num)
fast_forest = FastForestRegression(
    NumberOfLeaves=Slider(7, range=0..10),
    NumberOfTrees=Slider(61, range=0..100),
    MinimumExampleCountPerLeaf=Slider(6, range=0..10))
lng = ListLength(List=series)
column_label = GetColumnLabel(Data=create, columns="X,Y")  # -> X, Y
dup = DuplicateData(Data="0", Number=lng, Order=True)  # -> flatten(Data)
regression_trainer = RegressionTrainer(TrainingDataSet=create, FeatureNames=column_label.X, LabelName=column_label.Y, TrainerType=fast_forest)
merge_2 = Merge(Data1=graft(series), Data2=graft(dup))
panel_2 = Panel("""X
Y""")
num_2 = Number(merge_2)
create_2 = CreateDataSet(Labels=panel_2, Data=num_2)
regression_tester = RegressionTester(Model=regression_trainer, TestingDataSet=create_2)  # -> flatten(Predictions), R2, AbsoluteLoss, SquaredLoss, RootMeanSquaredLoss

# ---- group: Linear prediction
pt_4 = ConstructPoint(XCoordinate=series, YCoordinate=regression_tester.Predictions, ZCoordinate=0)

# ----
intcrv = Interpolate(Vertices=pt_4, Degree=3, Periodic=False, KnotStyle=1)  # -> Curve, Length, Domain
preview = CustomPreview(Geometry=pt_4, Material=ColourSwatch(SwatchColor=RGB(255, 166, 0)))
