# Grasshopper definition NonlinearRegression3D-GMBTrainer.gh (Grasshopper 1.0.7)
# plug-ins: LunchBoxML

# ---- group: Scatter plot 1
# Fast Forest Nonlinear Regression Trainer + Tester
# Company Info: Authored by Proving Ground
# 
# https://ProvingGround.io
# Copyright (c) 2023 Proving Ground LLC
pt = Point([Point(6.676690615, 22.4337124, 0), Point(12.42407444, 24.3201498, 0), Point(11.52091412, 27.97512226, 0), Point(0.2724629295, 14.12159762, 0), Point(3.269313065, 6.457945686, 0), Point(6.01984675, 3.392484914, 0)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])

# ---- group: Scatter plot 2
pt_2 = Point([Point(23.864287, 23.01397842, 0), Point(12.65945024, 21.02081034, 0), Point(12.06688675, 19.72794456, 0), Point(16.75352521, 21.66724323, 0), Point(11.95914794, 22.96010901, 0), Point(11.85140912, 16.65738833, 0)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])

# ----
pt_3 = Point(pt_2)
pdecon = Deconstruct(Point=pt_3)  # -> XComponent, YComponent, ZComponent
merge = Merge(Data1=graft(pdecon.XComponent), Data2=graft(pdecon.YComponent), Data3=graft(pdecon.ZComponent))
series = Series(Start=0, Step=0.5, Count=60)  # -> flatten(Series)
series_2 = Series(Start=0, Step=0.5, Count=60)  # -> graft(Series)
panel = Panel("""X
Y
Z""")
num = Number(merge)
pt_4 = ConstructPoint(XCoordinate=series, YCoordinate=series_2, ZCoordinate=0)  # -> flatten(Point)
create = CreateDataSet(Labels=panel, Data=num)
pdecon_2 = Deconstruct(Point=pt_4)  # -> XComponent, YComponent, ZComponent
light_gbm = LightGBMRegression(
    NumberOfLeaves=Slider(5, range=0..10),
    NumberOfIterations=Slider(225, range=0..300),
    MinimumExampleCountPerLeaf=Slider(11, range=0..20),
    LearningRate=Slider(0.246, range=0..0.5))
lng = ListLength(List=series)
# Descrption: Provided a scatter plot of points, use a Light GMB Regression trainer and test it to create a nonlinear predictive 3D surface.
column_label = GetColumnLabel(Data=create, columns="X,Y,Z")  # -> X, Y, Z
dup = DuplicateData(Data="0", Number=lng, Order=True)  # -> flatten(Data)
regression_trainer = RegressionTrainer(TrainingDataSet=create, FeatureNames=[column_label.X, column_label.Y], LabelName=column_label.Z, TrainerType=light_gbm)
merge_2 = Merge(Data1=graft(pdecon_2.XComponent), Data2=graft(pdecon_2.YComponent), Data3=graft(dup))
panel_2 = Panel("""X
Y
Z""")
num_2 = Number(merge_2)
create_2 = CreateDataSet(Labels=panel_2, Data=num_2)
regression_tester = RegressionTester(Model=regression_trainer, TestingDataSet=create_2)  # -> flatten(Predictions), R2, AbsoluteLoss, SquaredLoss, RootMeanSquaredLoss

# ---- group: Linear prediction
pt_5 = ConstructPoint(XCoordinate=pdecon_2.XComponent, YCoordinate=pdecon_2.YComponent, ZCoordinate=regression_tester.Predictions)

# ----
lng_2 = ListLength(List=series)
srfgrid = SurfaceFromPoints(Points=pt_5, UCount=lng_2, Interpolate=True)
mesh = Mesh(srfgrid)
demesh = DeconstructMesh(Mesh=mesh)  # -> Vertices, Faces, Colours, Normals
pdecon_3 = Deconstruct(Point=demesh.Vertices)  # -> XComponent, YComponent, ZComponent
bnd = Bounds(Numbers=pdecon_3.ZComponent)
dedomain = DeconstructDomain(Domain=bnd)  # -> Start, End
gradient = Gradient(
    LowerLimit=dedomain.Start,
    UpperLimit=dedomain.End,
    Parameter=pdecon_3.ZComponent,
    stops=[0: RGB(234, 38, 0), 0.25: RGB(234, 126, 0), 0.5: RGB(254, 244, 84), 0.75: RGB(173, 203, 249), 1: RGB(75, 107, 169)])
conmesh = ConstructMesh(Vertices=demesh.Vertices, Faces=demesh.Faces, Colours=gradient)
