# Grasshopper definition LBML_GaussianMixture-PanelGroupings.gh (Grasshopper 0.9.76)
# plug-ins: LunchBoxML, LunchBox

# ---- group: Panelization
# Company Info: Authored by Proving Ground
# 
# http://ProvingGround.io
# Copyright (c) 2018 Proving Ground LLC
number_slider = Slider(17, range=0..50)
# Gaussian Mixture - Simple Space Prediction
# Version:  2018.03.10
srf = Surface(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)
quads = QuadPanels(Surface=srf, UDivisions=number_slider, VDivisions=Slider(25, range=0..50))

# ---- group: Bounding Box
pt = Point(Point(0.5, 0.5, 0))
evalsrf = EvaluateSurface(Surface=reparameterize(quads), Point=pt)  # -> Point, Normal, Frame
bbox = BoundingBox(Content=graft(quads), Plane=graft(evalsrf.Point))  # -> Box, Box_2
debox = DeconstructBox(Box=bbox.Box)  # -> Plane, X, Y, Z
dedomain = DeconstructDomain(Domain=debox.Y)  # -> Start, End
dedomain_2 = DeconstructDomain(Domain=debox.X)  # -> Start, End
dedomain_3 = DeconstructDomain(Domain=debox.Z)  # -> Start, End

# ---- group: Geometric Characteristics / Area
area = Area(Geometry=quads)  # -> Area, Centroid
bnd = Bounds(Numbers=area.Area)
remap = RemapNumbers(Value=area.Area, Source=bnd, Target=Domain(0, 1))  # -> Mapped, Clipped
multiplication = Multiplication(A=remap.Mapped, B=Slider(1, range=0..1))

# ---- group: Geometric Characteristics / Out of plane
flat = FlatnessCheck(PanelList=quads)  # -> FlatPanels, Planes, Deviations
bnd_2 = Bounds(Numbers=flat.Deviations)
remap_2 = RemapNumbers(Value=flat.Deviations, Source=bnd_2, Target=Domain(0, 1))  # -> Mapped, Clipped
multiplication_2 = Multiplication(A=remap_2.Mapped, B=Slider(0.5, range=0..1))

# ---- group: Geometric Characteristics / Length
subtraction = Subtraction(A=dedomain_2.End, B=dedomain_2.Start)
bnd_3 = Bounds(Numbers=flatten(subtraction))
remap_3 = RemapNumbers(Value=subtraction, Source=bnd_3, Target=Domain(0, 1))  # -> Mapped, Clipped
multiplication_3 = Multiplication(A=remap_3.Mapped, B=Slider(0.7, range=0..1))

# ---- group: Geometric Characteristics / Width
subtraction_2 = Subtraction(A=dedomain.End, B=dedomain.Start)
bnd_4 = Bounds(Numbers=flatten(subtraction_2))
remap_4 = RemapNumbers(Value=subtraction_2, Source=bnd_4, Target=Domain(0, 1))  # -> Mapped, Clipped
multiplication_4 = Multiplication(A=remap_4.Mapped, B=Slider(0.5, range=0..1))

# ---- group: Geometric Characteristics / Height
subtraction_3 = Subtraction(A=dedomain_3.End, B=dedomain_3.Start)
bnd_5 = Bounds(Numbers=flatten(subtraction_3))
remap_5 = RemapNumbers(Value=subtraction_3, Source=bnd_5, Target=Domain(0, 1))  # -> Mapped, Clipped
multiplication_5 = Multiplication(A=remap_5.Mapped, B=Slider(0.5, range=0..1))

# ---- group: Geometric Characteristics
entwine = Entwine(
    Branch00=flatten(multiplication),
    Branch01=flatten(multiplication_2),
    Branch02=flatten(multiplication_3),
    Branch03=flatten(multiplication_4),
    Branch04=flatten(multiplication_5),
    FlattenInputs=True)
flip = FlipMatrix(Data=entwine)
panel = Panel(flip)

# ---- group: Gaussian Mixture
gaussianmix = GaussianMixture(TrainingInputs=panel, Components=Slider(30, range=0..50), RandomSeed=5)  # -> Result, Likelihood, Probability

# ---- group: Visualization of Panel Groups based on Geometric Characteristics
bnd_6 = Bounds(Numbers=gaussianmix.Result)
dedomain_4 = DeconstructDomain(Domain=bnd_6)  # -> Start, End
gradient = Gradient(
    LowerLimit=dedomain_4.Start,
    UpperLimit=dedomain_4.End,
    Parameter=gaussianmix.Result,
    stops=[0: RGB(243, 57, 0), 0.1: RGB(236, 27, 60), 0.2: RGB(210, 0, 118), 0.3: RGB(103, 0, 120), 0.4: RGB(39, 72, 161), 0.5: RGB(1, 192, 229), 0.6: RGB(18, 178, 90), 0.7: RGB(79, 186, 8), 0.8: RGB(220, 237, 32), 0.9: RGB(247, 159, 20), 1: RGB(243, 57, 0)])
preview = CustomPreview(Geometry=quads, Shader=gradient)
