# Grasshopper definition LBML_GaussianMixture-PointScanGroups.gh (Grasshopper 1.0.7)
# plug-ins: LunchBoxML

# ---- group: Points
# Gaussian Mixture - Point Scan Groups
# Version:  2018.10.29
# Company Info: Authored by Proving Ground
# 
# http://ProvingGround.io
# Copyright (c) 2018 Proving Ground LLC
pt = Point([<point referenced from the Rhino model> x5000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])
pdecon = Deconstruct(Point=pt)  # -> XComponent, YComponent, ZComponent
panel = Panel("6")

# ----
gaussianmix = GaussianMixture(TrainingInputs=graft(pdecon.YComponent), Components=panel, RandomSeed=5)  # -> Result, Likelihood, Probability

cset = CreateSet(List=gaussianmix.Result)  # -> Set, Map
lng = ListLength(List=cset.Set)
gradient = Gradient(
    LowerLimit=0,
    UpperLimit=lng,
    Parameter=cset.Map,
    stops=[0: RGB(234, 38, 0), 0.25: RGB(234, 126, 0), 0.5: RGB(254, 244, 84), 0.75: RGB(173, 203, 249), 1: RGB(75, 107, 169)])
argb = SplitARGB(Colour=gradient, IntegerChannels=True)  # -> Alpha, Red, Green, Blue
rgb = ColourRGB(Alpha=Slider(122, range=0..255), Red=argb.Red, Green=argb.Green, Blue=argb.Blue)
preview = CustomPreview(Geometry=pt, Shader=rgb)
