# Grasshopper definition LBML_NaiveBase-FacadeType.gh (Grasshopper 1.0.7)
# plug-ins: treesloth01, LunchBoxML, LunchBox

# ---- group: Reference Geometry
panel = Panel("""Office
Retail
Residential""")
# ML Building Facade Evaluation
# Version:  2016.6.27
# Company Info: Authored by Proving Ground
# 
# http://ProvingGround.io
# Copyright (c) 2017 Proving Ground LLC
# Test Data
toggle = BooleanToggle(True)
layer_ref = LayerReference(ReferenceToggle=toggle, LayerName=panel)  # -> Geometry, Name, UserStrings, GUID

# ---- group: Format Data
lng = ListLength(List=layer_ref.Geometry)
brep = Brep(flatten(layer_ref.Geometry))
dup = DuplicateData(Data=graft(panel), Number=lng, Order=True)  # -> flatten(Data)
facen = FaceNormals(Mesh=brep)  # -> Centers, Normals
Y = UnitY(Factor=1)
facen_2 = FaceNormals(Mesh=brep)  # -> Centers, Normals
X = UnitX(Factor=1)
area = Area(Geometry=brep)  # -> Area, Centroid
python_script = PythonScript(x=flatten(area.Area))  # -> out, a; inputs x: list
# ---------- python_script: Python ----------
a=[]
for i in x:
    print i
    if i>12000:
        a.append("Large")
    elif 6000<=i<=12000:
        a.append("Medium")
    elif i<6000:
        a.append("Small")
# ---------- end python_script ----------
angle = Angle(VectorA=facen.Normals, VectorB=Y)  # -> Angle, Reflex
angle_2 = Angle(VectorA=facen_2.Normals, VectorB=X)  # -> Angle, Reflex
deg = Degrees(Radians=angle_2.Angle)
deg_2 = Degrees(Radians=angle.Angle)
first_last = FirstLast(List=deg)  # -> FirstValue, LastValue
first_last_2 = FirstLast(List=deg_2)  # -> FirstValue, LastValue
python_script_2 = PythonScript(x=first_last.FirstValue, y=first_last_2.FirstValue)  # -> out, flatten(a)
# ---------- python_script_2: Python ----------
if 0<=x<22.5 and 67.5<y<112.5:
    a="East"
elif 22.5<=x<=67.5 and 22.5<=y<=67.5:
    a="North-East"
elif 22.5<=x<=67.5 and 112.5<=y<=157.5:
    a="South-East"
elif 67.5<x<112.5 and 0<=y<22.5:
    a="North"
elif 67.5<x<112.5 and 157.5<y<=180:
    a="South"
elif 112.5<=x<=157.5 and  22.5<=y<=67.5:
    a="North-West"
elif 112.5<=x<=157.5 and  112.5<=y<=157.5:
    a="South-West"
elif 157.5<x<=180 and 67.5<y<112.5:
    a="West"
# ---------- end python_script_2 ----------
program = Panel(dup)
area_sf = Panel(python_script.a)
orientation = Panel(python_script_2.a)
entwine = Entwine(Branch00=orientation, Branch01=area_sf, Branch02=program, FlattenInputs=True)
flip = FlipMatrix(Data=entwine)
test_data = Panel(flip)

# ---- group: Excel Worksheet
panel_2 = Panel("G:\My Drive\PROVING GROUND\Research\Internal R&D\Summer 2017\ML Building Test\Facade ML\PerformanceSelection.xlsx")
excelread = ExcelReader(ReadExcelData=Toggle(True), WorkbookPath=panel_2, WorksheetName="PerformanceSelection")  # -> Exceptions, ExcelData

# ----
# Training Data
item = ListItem(List=excelread.ExcelData, Index=0, Wrap=True)  # -> flatten(Item)

# ---- group: Data Table of Training Data
cull_i = CullIndex(List=excelread.ExcelData, Indices=0, Wrap=True)
datatable = CreateDataTable(TableName="PerformanceTraining", TableHeaders=item, ValueTree=cull_i)

# ---- group: Output Column Name
item_2 = ListItem(List=item, Index="4", Wrap=True)  # -> flatten(Item)
panel_3 = Panel(item_2)

# ---- group: Input Column Names
panel_4 = Panel("""1
2
3""")
item_3 = ListItem(List=item, Index=panel_4, Wrap=True)  # -> flatten(Item)
panel_5 = Panel(item_3)

# ----
naivebayes = NaiveBayesClassification(TestData=test_data, TrainingData=datatable, InputColumnNames=panel_5, OutputColumnName=panel_3, RandomSeed=5)  # -> flatten(Result), Numeric, Probabilities

# ---- group: Probabilities
dom = ConstructDomain(DomainStart="0", DomainEnd="100")
remap = RemapNumbers(Value=naivebayes.Probabilities, Source=Domain(0, 1), Target=dom)  # -> Mapped, Clipped
expression = Expression(x=remap.Mapped, Expression="Round(x,3)")
format = Format(Format="{0}%", Culture=127, Data0=expression)
panel_6 = Panel(format)
panel_7 = Panel("""Medium
High
Low""")

# ---- group: Selection / Facade Selection
medium = ColourSwatch(SwatchColor=RGB(255, 204, 0))
high = ColourSwatch(SwatchColor=RGB(255, 123, 0))
low = ColourSwatch(SwatchColor=RGB(0, 106, 255))

# ---- group: Selection
sort_duplicate_values = SortDuplicateValues(ValueList=naivebayes.Result)  # -> UniqueValues, Indices
list_item = ListItem(List=brep, Index=sort_duplicate_values.Indices, Wrap=True)
merge = Merge(Data1=high, Data2=low, Data3=medium)
custom_preview = CustomPreview(Geometry=list_item, Shader=graft(merge))
