# Grasshopper definition LBML_LogisticRegression-PointPlot.gh (Grasshopper 0.9.76)
# plug-ins: LunchBoxML

# ---- group: False
pt = Point([<point referenced from the Rhino model> x46])

# ---- group: True
pt_2 = Point([<point referenced from the Rhino model> x67])

# ----
# Logistic Regression
# Version:  2017.7.27
# Company Info: Authored by Proving Ground
# 
# http://ProvingGround.io
# Copyright (c) 2017 Proving Ground LLC
merge = Merge(Data1=pt, Data2=pt_2)
swatch = ColourSwatch(SwatchColor=RGB(255, 0, 115))
lng = ListLength(List=pt)
lng_2 = ListLength(List=pt_2)
pdecon = Deconstruct(Point=merge)  # -> XComponent, YComponent, ZComponent
dup = DuplicateData(Data="0", Number=lng, Order=True)
dup_2 = DuplicateData(Data="1", Number=lng_2, Order=True)
entwine = Entwine(Branch00=pdecon.XComponent, Branch01=pdecon.YComponent, FlattenInputs=True)
merge_2 = Merge(Data1=dup, Data2=dup_2)
flip = FlipMatrix(Data=entwine)
dots = DotDisplay(Point=pt, Colour=swatch, Size=Slider(0.467, range=0..1))
dots_2 = DotDisplay(Point=pt_2, Colour=swatch, Size=Slider(0.313, range=0..1))

# ---- group: Sample Data
bnd = Bounds(Numbers=pdecon.XComponent)
bnd_2 = Bounds(Numbers=pdecon.YComponent)
range = Range(Domain=bnd, Steps=expr("x-1", Slider(50, range=0..50)))
range_2 = Range(Domain=bnd_2, Steps=expr("x-1", Slider(50, range=0..50)))
pt_3 = ConstructPoint(XCoordinate=range, YCoordinate=graft(range_2), ZCoordinate=0)  # -> flatten(Point)
pdecon_2 = Deconstruct(Point=pt_3)  # -> XComponent, YComponent, ZComponent
entwine_2 = Entwine(Branch00=pdecon_2.XComponent, Branch01=pdecon_2.YComponent, FlattenInputs=True)
flip_2 = FlipMatrix(Data=entwine_2)

# ----
logreg = LogisticRegression(
    TestData=flip_2,
    Inputs=flip,
    Output=merge_2,
    Tolerance=0.0001,
    MaximumIterations=100,
    RegularizationValue=0,
    RandomSeed=5)  # -> Result, Score

bnd_3 = Bounds(Numbers=logreg.Score)
dedomain = DeconstructDomain(Domain=bnd_3)  # -> Start, End
gradient = Gradient(
    LowerLimit=dedomain.Start,
    UpperLimit=dedomain.End,
    Parameter=logreg.Score,
    stops=[0: RGB(234, 38, 0), 0.25: RGB(234, 126, 0), 0.5: RGB(254, 244, 84), 0.75: RGB(173, 203, 249), 1: RGB(75, 107, 169)])

preview = CustomPreview(Geometry=pt_3, Shader=gradient)
