# Grasshopper definition LBML_NeuralNetwork-SpacePrediction.gh (Grasshopper 0.9.76)
# plug-ins: LunchBoxML

# ---- group: Training Geometry
crv = Curve([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])

# ---- group: Test Geometry
# Neural Network - Simple Space Prediction
# Version:  2018.03.10
# Company Info: Authored by Proving Ground
# 
# http://ProvingGround.io
# Copyright (c) 2018 Proving Ground LLC
crv_2 = Curve(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)

# ---- group: Attributes
bbox = BoundingBox(Content=crv_2, Plane=PlaneXY(0, 0, 0))  # -> Box, Box_2
debox = DeconstructBox(Box=bbox.Box)  # -> Plane, X, Y, Z
dedomain = DeconstructDomain(Domain=debox.Y)  # -> Start, End
dedomain_2 = DeconstructDomain(Domain=debox.X)  # -> Start, End
area = Area(Geometry=crv_2)  # -> Area, Centroid
subtraction = Subtraction(A=dedomain.End, B=dedomain.Start)
subtraction_2 = Subtraction(A=dedomain_2.End, B=dedomain_2.Start)
area_2 = Panel(area.Area)
length = Panel(subtraction_2)
width = Panel(subtraction)

# ---- group: Labels
space_name = Panel("""Phone Booth
Phone Booth
Small Office
Small Office
Medium Office
Medium Office
Large Office
Large Office
Conference Room
Conference Room""")
space_index = Panel("""0
1
2
3
4
5
6
7
8
9""")

# ---- group: Attributes
bbox_2 = BoundingBox(Content=crv, Plane=PlaneXY(0, 0, 0))  # -> Box, Box_2
debox_2 = DeconstructBox(Box=bbox_2.Box)  # -> Plane, X, Y, Z
dedomain_3 = DeconstructDomain(Domain=debox_2.Y)  # -> Start, End
dedomain_4 = DeconstructDomain(Domain=debox_2.X)  # -> Start, End
area_3 = Area(Geometry=crv)  # -> Area, Centroid
subtraction_3 = Subtraction(A=dedomain_3.End, B=dedomain_3.Start)
subtraction_4 = Subtraction(A=dedomain_4.End, B=dedomain_4.Start)
area_4 = Panel(area_3.Area)
length_2 = Panel(subtraction_4)
width_2 = Panel(subtraction_3)
tag = TextTag3D(Location=area_3.Centroid, Text=space_name, Size=1, Justification=5)

# ----
# Training Data
bnd = Bounds(Numbers=area_4)

# ---- group: Remapped Vectors
bnd_2 = Bounds(Numbers=length_2)
bnd_3 = Bounds(Numbers=width_2)
remap = RemapNumbers(Value=area_4, Source=bnd, Target=Domain(0, 1))  # -> Mapped, Clipped
remap_2 = RemapNumbers(Value=length_2, Source=bnd_2, Target=Domain(0, 1))  # -> Mapped, Clipped
remap_3 = RemapNumbers(Value=width_2, Source=bnd_3, Target=Domain(0, 1))  # -> Mapped, Clipped
entwine = Entwine(Branch00=remap.Mapped, Branch01=remap_2.Mapped, Branch02=remap_3.Mapped, FlattenInputs=True)
flip = FlipMatrix(Data=entwine)

# ----
# Data to Test
bnd_4 = Bounds(Numbers=area_4)

# ---- group: Remapped Vectors
bnd_5 = Bounds(Numbers=length_2)
bnd_6 = Bounds(Numbers=width_2)
remap_4 = RemapNumbers(Value=area_2, Source=bnd_4, Target=Domain(0, 1))  # -> Mapped, Clipped
remap_5 = RemapNumbers(Value=length, Source=bnd_5, Target=Domain(0, 1))  # -> Mapped, Clipped
remap_6 = RemapNumbers(Value=width, Source=bnd_6, Target=Domain(0, 1))  # -> Mapped, Clipped
entwine_2 = Entwine(Branch00=remap_4.Mapped, Branch01=remap_5.Mapped, Branch02=remap_6.Mapped, FlattenInputs=True)
flip_2 = FlipMatrix(Data=entwine_2)

# ---- group: Neural Network
neural = NeuralNetwork(
    TestData=flip_2,
    TraingInputs=flip,
    Labels=space_index,
    HiddenNeurons=5,
    Alpha=2,
    Iterations=Slider(15, range=0..20),
    RandomSeed=5)

# ---- group: Result
item = ListItem(List=space_name, Index=neural, Wrap=True)
space_selection = Panel(item)
tag_2 = TextTag3D(Location=area.Centroid, Text=item, Size=1, Colour=ColourSwatch(SwatchColor=RGB(255, 255, 255)), Justification=5)
