# Grasshopper definition LBML_NonlinearRegression-PointCloudEdgePrediction.gh (Grasshopper 1.0.7)
# plug-ins: Human, LunchBoxML

# ---- group: Test Points
# Nonlinear Regression - Point Cloud Plot
# Version:  2018.10.29
# Company Info: Authored by Proving Ground
# 
# http://ProvingGround.io
# Copyright (c) 2018 Proving Ground LLC
pt = Point(<point referenced from the Rhino model>)
pdecon = Deconstruct(Point=pt)  # -> graft(XComponent), YComponent, ZComponent
series = Series(Start=pdecon.XComponent, Step=1, Count=Slider(34, range=0..100))  # -> simplify(graft(Series))
Y = Data(pdecon.YComponent)
Z = Data(pdecon.ZComponent)
S = Data(series)

# ---- group: Training Data (Point Cloud Edge)
pt_2 = Point([<point referenced from the Rhino model> x1463])
pdecon_2 = Deconstruct(Point=pt_2)  # -> simplify(graft(XComponent)), YComponent, ZComponent

# ----
nonlinereg = NonlinearRegression(
    TestData=S,
    TrainingInputs=pdecon_2.XComponent,
    TrainingOutput=pdecon_2.YComponent,
    Sigma=Slider(1, range=0..1),
    Complexity=5,
    RandomSeed=5)  # -> Result, Score, Error

# ---- group: Prediction Curve
X = Data(S)
Y_2 = Data(nonlinereg.Result)
Z_2 = Data(Z)
pt_3 = ConstructPoint(XCoordinate=flatten(X), YCoordinate=Y_2, ZCoordinate=Z_2)
intcrv = Interpolate(Vertices=pt_3, Degree=3, Periodic=False, KnotStyle=1)  # -> Curve, Length, Domain
previewlw = CustomPreviewLineweights(
    Geometry=intcrv.Curve,
    Shader=ColourSwatch(SwatchColor=RGB(255, 0, 115)),
    Thickness=Slider(6, range=0..8),
    Absolute=False)
pt_4 = Data(pt_3)

# ---- group: Test Plot
X_2 = Data(S)
Y_3 = Data(Y)
Z_3 = Data(Z)
B = Data(pt_4)
pt_5 = ConstructPoint(XCoordinate=flatten(X_2), YCoordinate=Y_3, ZCoordinate=Z_3)
panel = Panel(""".25
.25""")
ln = Line(StartPoint=pt_5, EndPoint=B)
dash = DashPattern(Curve=ln, Pattern=panel)  # -> Dashes, Gaps
