# Grasshopper definition FloorPlanSelection-Tester.gh (Grasshopper 1.0.7)
# plug-ins: LunchBoxML

# ---- group: Test Plan
# Adjust input values to predict
# the plan ID and load the plan...
has_garage = BooleanToggle(False)
# Floor Plan Selection Tester
# Company Info: Authored by Proving Ground
# 
# https://ProvingGround.io
# Copyright (c) 2023 Proving Ground LLC
width = Slider(17.112, range=5..30)
length = Slider(8.992, range=5..20)
bedrooms = Slider(1, range=1..5)
bathrooms = Slider(1, range=1..3)
bedrooms_2 = Panel(bedrooms)
bathrooms_2 = Panel(bathrooms)
has_garage_2 = Panel(has_garage)
width_2 = Panel(width)
length_2 = Panel(length)
num = Number(width_2)
num_2 = Number(length_2)
num_3 = Number(bedrooms_2)
num_4 = Number(bathrooms_2)
num_5 = Number(has_garage_2)
division = Division(A=num, B=2)
division_2 = Division(A=num_2, B=2)
dom = ConstructDomain(DomainStart=division, DomainEnd=expr("-x", division))
dom_2 = ConstructDomain(DomainStart=division_2, DomainEnd=expr("-x", division_2))
planid = Slider(1, range=1..3)
labels = Panel("""Width
Length
Bedrooms
Bathrooms
HasGarage
PlanID""")
rectangle = Rectangle(Plane=PlaneXY(0, 0, 0), XSize=dom, YSize=dom_2, Radius=0)  # -> Rectangle, Length
merge = Merge(Data1=num, Data2=num_2, Data3=num_3, Data4=num_4, Data5=num_5, Data6=planid)
crv = Curve(rectangle.Rectangle)
txt = Text(labels)
dash = DashPattern(Curve=crv, Pattern=Slider(0.109, range=0..1))  # -> Dashes, Gaps
create = CreateDataSet(Labels=txt, Data=merge)
peek_data = PeekAtData(Data=create, NumberOfRows=5)  # -> Values, Columns
preview = CustomPreview(Geometry=dash.Dashes, Material=ColourSwatch(SwatchColor=RGB(99, 99, 99)))
panel = Panel(peek_data.Values)

# ---- group: Connect to Trained Model
# Select the existing trained
# model (ZIP file)...
path = FilePath("C:\Users\nate\Proving Ground Dropbox\Proving Ground Team Folder\Products\Lunchbox\LunchBoxML Examples\Plan Selector\Grasshopper\PlanSelector-TrainingModel.zip")
panel_2 = Panel(path)
load_model = LoadSavedModel(FilePath=path)

# ---- group: Test Trained Model
multiclass_classifier_tester = MulticlassClassifierTester(Model=load_model, TestingDataSet=create)  # -> Predictions, Scores
prediction = Panel(multiclass_classifier_tester.Predictions)

# ---- group: Load Predicted Model / Select Plan Directory
# Select the root directory containing
# plan the plan folders and files...
path_2 = FilePath("C:\Users\nate\Proving Ground Dropbox\Proving Ground Team Folder\Products\Lunchbox\LunchBoxML Examples\Plan Selector\Plans\")

# ----
panel_3 = Panel(path_2)

# ---- group: Load Predicted Model
concat = Concatenate(FragmentA=path_2, FragmentB=multiclass_classifier_tester.Predictions, FragmentC="\model.3dm")
panel_4 = Panel(concat)
panel_5 = Panel("""0
boundary""")
read3dm = CSharpScript(F=panel_4, L=panel_5)  # -> out, G, U, A, C; inputs F: String, L: String
# ---------- read3dm: C# usings ----------
using System.IO;
using System.Linq;
using System.Data;
using System.Drawing;
using System.Reflection;
using System.Windows.Forms;
using System.Xml;
using System.Xml.Linq;
using System.Runtime.InteropServices;

using Rhino.DocObjects;
using Rhino.Collections;
using Rhino.FileIO;
using GH_IO;
using GH_IO.Serialization;
# ---------- read3dm: C# ----------
    var doc = Rhino.RhinoDoc.ActiveDoc;
    doc.Objects.Clear();

    File3dm refFile = File3dm.Read(F);
    var layers = refFile.AllLayers.ToList();

    List<GeometryBase> fileObjects = new List<GeometryBase>();
    List<GeometryBase> hatchObjects = new List<GeometryBase>();
    List<ObjectAttributes> atts = new List<ObjectAttributes>();
    List<Color> colors = new List<Color>();
    foreach(File3dmObject o in refFile.Objects){
      bool addObj = String.IsNullOrEmpty(L) ? true : layers[o.Attributes.LayerIndex].FullPath.Contains(L);
      if(addObj){
        if(o.Geometry.GetType() != typeof(Rhino.Geometry.Hatch))
        {
          fileObjects.Add(o.Geometry);
          atts.Add(o.Attributes);
          colors.Add(o.Attributes.DrawColor(doc));
        }
      }
    }
    G = fileObjects;
    Print(refFile.DumpSummary());
    U = refFile.Settings.ModelUnitSystem;
    A = atts;
    C = colors;
# ---------- end read3dm ----------
viewer = ParamViewer(read3dm.G)
item = ListItem(List=viewer, Index=0, Wrap=True)
item_2 = ListItem(List=viewer, Index=1, Wrap=True)
branch = TreeBranch(Tree=read3dm.G, Path=item, MaintainPaths=True)
branch_2 = TreeBranch(Tree=read3dm.G, Path=item_2, MaintainPaths=True)
bbox = BoundingBox(Content=branch_2, Plane=PlaneXY(0, 0, 0), UnionBox=True)  # -> Box, Box_2
area = Area(Geometry=bbox.Box)  # -> flatten(Area), Centroid
area_2 = Area(Geometry=crv)  # -> Area, Centroid
vec2pt = Vector2Pt(PointA=area.Centroid, PointB=area_2.Centroid, Unitize=False)  # -> Vector, Length
move = Move(Geometry=branch, Motion=vec2pt.Vector)  # -> Geometry, Transform
branch_3 = TreeBranch(Tree=read3dm.C, Path=item, MaintainPaths=True)
preview_2 = CustomPreview(Geometry=move.Geometry, Material=branch_3)

# ---- group: Dimension Lines
move_2 = Move(Geometry=bbox.Box, Motion=vec2pt.Vector)  # -> Geometry, Transform
explode = Explode(Curve=rectangle.Rectangle, Recursive=True)  # -> Segments, Vertices
rec = Rectangle(move_2.Geometry)
explode_2 = Explode(Curve=rec, Recursive=True)  # -> Segments, Vertices
offset = OffsetCurve(Curve=explode.Segments, Distance=1, Plane=PlaneXY(0, 0, 0), Corners=1)  # -> flatten(Curve)
offset_2 = OffsetCurve(Curve=explode_2.Segments, Distance=0.75, Plane=PlaneXY(0, 0, 0), Corners=1)  # -> flatten(Curve)
item_3 = ListItem(List=offset, Index=[0, 1], Wrap=True)
item_4 = ListItem(List=offset_2, Index=[0, 1], Wrap=True)
end = EndPoints(Curve=item_3)  # -> Start, End
end_2 = EndPoints(Curve=item_4)  # -> Start, End
item_5 = ListItem(List=end.Start, Index=1, Wrap=True)
item_6 = ListItem(List=end_2.End, Index=1, Wrap=True)
item_7 = ListItem(List=end.Start, Index=0, Wrap=True)
item_8 = ListItem(List=end_2.End, Index=0, Wrap=True)
item_9 = ListItem(List=end_2.Start, Index=1, Wrap=True)
item_10 = ListItem(List=end_2.Start, Index=0, Wrap=True)
pdecon = Deconstruct(Point=item_9)  # -> XComponent, YComponent, ZComponent
pdecon_2 = Deconstruct(Point=item_6)  # -> XComponent, YComponent, ZComponent
pdecon_3 = Deconstruct(Point=item_5)  # -> XComponent, YComponent, ZComponent
pdecon_4 = Deconstruct(Point=item_10)  # -> XComponent, YComponent, ZComponent
pdecon_5 = Deconstruct(Point=item_8)  # -> XComponent, YComponent, ZComponent
pdecon_6 = Deconstruct(Point=item_7)  # -> XComponent, YComponent, ZComponent
max = Maximum(A=pdecon.XComponent, B=pdecon_3.XComponent)
min = Minimum(A=pdecon_4.YComponent, B=pdecon_6.YComponent)
pt = ConstructPoint(XCoordinate=max, YCoordinate=pdecon.YComponent, ZCoordinate=pdecon_3.ZComponent)
pt_2 = ConstructPoint(XCoordinate=max, YCoordinate=pdecon_2.YComponent, ZCoordinate=pdecon_2.ZComponent)
pt_3 = ConstructPoint(XCoordinate=pdecon_4.XComponent, YCoordinate=min, ZCoordinate=pdecon_6.ZComponent)
pt_4 = ConstructPoint(XCoordinate=pdecon_5.XComponent, YCoordinate=min, ZCoordinate=pdecon_5.ZComponent)
ln = Line(StartPoint=pt, EndPoint=pt_2)
ln_2 = Line(StartPoint=pt_3, EndPoint=pt_4)
lineardim = LinearDimension(Line=[ln_2, ln], PointA=end.Start, PointB=end.End, Text="{0:0.00}", Size=Slider(0.392, range=0..1))
