# Grasshopper definition FloorPlanSelection-Trainer.gh (Grasshopper 1.0.7)
# plug-ins: LunchBoxML

# ---- group: Load Data / Training Data CSV
# Floor Plan Selection Trainer
# Company Info: Authored by Proving Ground
# 
# https://ProvingGround.io
# Copyright (c) 2023 Proving Ground LLC
path = FilePath("C:\Users\nate\Proving Ground Dropbox\Proving Ground Team Folder\Products\Lunchbox\LunchBoxML Examples\Plan Selector\PlanTrainer.csv")

# ---- group: Load Data
panel = Panel(path)
load_data = LoadDataFromFile(FilePath=path, SeparatorCharacter=",", HasHeader=True)

# ---- group: Peek At Data
peek_data = PeekAtData(Data=load_data, NumberOfRows=100)  # -> Values, Columns
panel_2 = Panel(peek_data.Values)

# ----
lbfgs_maximum_entropy = LbfgsMaximumEntropyMulticlass(EnforceNonNegativity=False, L1Regularization=1, L2Regularization=1, HistorySize=20, OptimizationTolerance=1e-06)
column_names = GetColumnNames(Data=load_data, columns="PlanID,Width,Length,Bedrooms,Bathrooms,HasGarage")  # -> PlanID, Width, Length, Bedrooms, Bathrooms, HasGarage
# Right-Click to save the training model...
# Trains a Multiclass Classifier Trainer with dimensions and quantities as the input features with an output label of "PlanID".
multiclass_classifier_trainer = MulticlassClassifierTrainer(
    TrainingDataSet=load_data,
    FeatureNames=[column_names.Width, column_names.Length, column_names.Bedrooms, column_names.Bathrooms, column_names.HasGarage],
    LabelName=column_names.PlanID,
    TrainerType=lbfgs_maximum_entropy)
