# Grasshopper definition RegressionTest.gh (Grasshopper 1.0.7)
# plug-ins: LunchBox, treesloth01, LunchBoxML

path = FilePath("C:\Users\ykish\OneDrive\デスクトップ\Examples\Naive Bayes\PerformanceSelection.xlsx")

# ----
# ML Building Facade Evaluation
# Version:  2020.9.23
# Company Info: Authored by Proving Ground
# 
# http://ProvingGround.io
# Copyright (c) 2020 Proving Ground LLC
# Training Data
file_path = Panel("C:\Development\lunchboxml\Examples\Naive Bayes\PerformanceSelection.xlsx")
sheet_name = Panel("PerformanceSelection")
excelread = ExcelReader(ReadExcelData=Toggle(True), WorkbookPath=path, WorksheetName=sheet_name)  # -> Exceptions, ExcelData
split = SplitList(List=excelread.ExcelData, Index=1)  # -> flatten(ListA), ListB
bang = ExplodeTree(Data=split.ListB)  # -> Branch0, Branch1, Branch2, Branch3, Branch4
item = ListItem(List=split.ListA, Index=1, Wrap=True)
item_2 = ListItem(List=split.ListA, Index=2, Wrap=True)
item_3 = ListItem(List=split.ListA, Index=3, Wrap=True)
item_4 = ListItem(List=split.ListA, Index=4, Wrap=True)
program = Panel(bang.Branch3)
size = Panel(bang.Branch2)
orientation = Panel(bang.Branch1)
facade_type = Panel(bang.Branch4)

srf = Surface(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)
srf_2 = Surface(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)
preview = CustomPreview(Geometry=srf, Material=ColourSwatch(SwatchColor=RGBA(35, 102, 89, 103)))
popgeo = PopulateGeometry(Geometry=srf, Count=Slider(959, range=0..1000), Seed=1)
popgeo_2 = PopulateGeometry(Geometry=srf_2, Count=Slider(824, range=0..1000), Seed=1)
pdecon = Deconstruct(Point=popgeo)  # -> XComponent, YComponent, ZComponent
panel = Panel("""X
Y
Z""")
merge = Merge(Data1=graft(pdecon.XComponent), Data2=graft(pdecon.YComponent), Data3=graft(pdecon.ZComponent))
create = CreateDataSet(Labels=panel, Data=merge)
light_gbm = LightGBMRegression(NumberOfLeaves=20, NumberOfIterations=100, MinimumExampleCountPerLeaf=10, LearningRate=0.2)
column_label = GetColumnLabel(Data=create, columns="X,Y,Z")  # -> X, Y, Z
merge_2 = Merge(Data1=column_label.X, Data2=column_label.Y)
regression_trainer = RegressionTrainer(TrainingDataSet=create, FeatureNames=merge_2, LabelName=column_label.Z, TrainerType=light_gbm)
pt = Point(<point referenced from the Rhino model>)
pdecon_2 = Deconstruct(Point=popgeo_2)  # -> XComponent, YComponent, ZComponent
merge_3 = Merge(Data1=graft(pdecon_2.XComponent), Data2=graft(pdecon_2.YComponent), Data3=graft(pdecon_2.ZComponent))
panel_2 = Panel("""X
Y
Z""")
create_2 = CreateDataSet(Labels=panel_2, Data=merge_3)
regression_tester = RegressionTester(Model=regression_trainer, TestingDataSet=create_2)  # -> Predictions, R2, AbsoluteLoss, SquaredLoss, RootMeanSquaredLoss
pt_2 = ConstructPoint(
    XCoordinate=graft(pdecon_2.XComponent),
    YCoordinate=graft(pdecon_2.YComponent),
    ZCoordinate=regression_tester.Predictions)
preview_2 = CustomPreview(Geometry=pt_2, Material=ColourSwatch(SwatchColor=RGB(0, 60, 255)))

# ----
# Define Naive Bayes
# Inputs & Classifications
panel_3 = Panel(item)
panel_4 = Panel(item_4)
panel_5 = Panel(item_2)
panel_6 = Panel(item_3)
codify_data = CodifyData(Label=panel_5, Data=bang.Branch2, DataType=1)
codify_data_2 = CodifyData(Label=panel_3, Data=bang.Branch1, DataType=1)
codify_data_3 = CodifyData(Label=panel_4, Data=bang.Branch4, DataType=1)
codify_data_4 = CodifyData(Label=panel_6, Data=bang.Branch3, DataType=1)
merge_4 = Merge(Data1=codify_data_2, Data2=codify_data, Data3=codify_data_4)  # -> flatten(Result)

# ----
# Note: You can right-click on the Naive Bayes Trainer component to save the classifier to a file. Then use the Load Saved Model to deserialize this model back into the scene without having to retrain the model every time.
path_2 = FilePath("C:\Projects\Lunchbox ML\Examples\NaiveBayes_FacadeType.bin")
file_path_2 = Panel(path_2)
load_model = LoadSavedModel(FilePath=path_2)

naive_bayes_classification_trainer = NaiveBayesClassificationTrainer(TrainingInputs=merge_4, TrainingClassifications=codify_data_3)

confusion_matrix = ConfusionMatrixProperties()  # -> Accuracy, Error, Precision, Recall, Variance, ChanceAgreement, GeometricAgreement, CohensKappaStatistic, ChiSquare
format = Format(Format="{0:P2}", Culture=1033, Data0=confusion_matrix.Accuracy)
model_accuracy = Panel(format)

# ----
# Test Data
toggle = BooleanToggle(True)
panel_7 = Panel("""Office
Retail
Residential""")
layer_ref = LayerReference(ReferenceToggle=toggle, LayerName=panel_7)  # -> Geometry, Name, UserStrings, GUID, UserStringValues, GUID_2
lng = ListLength(List=layer_ref.Geometry)
dup = DuplicateData(Data=graft(panel_7), Number=lng, Order=True)  # -> flatten(Data)
brep = Brep(flatten(layer_ref.Geometry))
facen = FaceNormals(Mesh=brep)  # -> Centers, Normals
Y = UnitY(Factor=1)
facen_2 = FaceNormals(Mesh=brep)  # -> Centers, Normals
X = UnitX(Factor=1)
area = Area(Geometry=brep)  # -> Area, Centroid
python_script = PythonScript(x=flatten(area.Area))  # -> out, a; inputs x: list
# ---------- python_script: Python ----------
a=[]
for i in x:
    print i
    if i>12000:
        a.append("Large")
    elif 6000<=i<=12000:
        a.append("Medium")
    elif i<6000:
        a.append("Small")
# ---------- end python_script ----------
angle = Angle(VectorA=facen.Normals, VectorB=Y)  # -> Angle, Reflex
angle_2 = Angle(VectorA=facen_2.Normals, VectorB=X)  # -> Angle, Reflex
deg = Degrees(Radians=angle_2.Angle)
deg_2 = Degrees(Radians=angle.Angle)
first_last = FirstLast(List=deg)  # -> FirstValue, LastValue
first_last_2 = FirstLast(List=deg_2)  # -> FirstValue, LastValue
program_2 = Panel(dup)
size_2 = Panel(python_script.a)

item_5 = ListItem(List=deg, Index=0, Wrap=True)
item_6 = ListItem(List=deg_2, Index=0, Wrap=True)

python_script_2 = PythonScript(x=item_5, y=item_6)  # -> out, flatten(a)
# ---------- python_script_2: Python ----------
if 0<=x<22.5 and 67.5<y<112.5:
    a="East"
elif 22.5<=x<=67.5 and 22.5<=y<=67.5:
    a="North-East"
elif 22.5<=x<=67.5 and 112.5<=y<=157.5:
    a="South-East"
elif 67.5<x<112.5 and 0<=y<22.5:
    a="North"
elif 67.5<x<112.5 and 157.5<y<=180:
    a="South"
elif 112.5<=x<=157.5 and  22.5<=y<=67.5:
    a="North-West"
elif 112.5<=x<=157.5 and  112.5<=y<=157.5:
    a="South-West"
elif 157.5<x<=180 and 67.5<y<112.5:
    a="West"
# ---------- end python_script_2 ----------
orientation_2 = Panel(python_script_2.a)

# ----
# Define New Test
# Input Data
panel_8 = Panel(panel_6)
panel_9 = Panel(panel_5)
panel_10 = Panel(panel_3)
codify_data_5 = CodifyData(Label=panel_8, Data=flatten(dup), DataType=1)
codify_data_6 = CodifyData(Label=panel_9, Data=flatten(python_script.a), DataType=1)
codify_data_7 = CodifyData(Label=panel_10, Data=flatten(python_script_2.a), DataType=1)
merge_5 = Merge(Data1=codify_data_7, Data2=codify_data_6, Data3=codify_data_5)  # -> flatten(Result)

naive_bayes_classification_tester = NaiveBayesClassificationTester(NaiveBayesClassifier=naive_bayes_classification_trainer, TestInputData=merge_5)  # -> Classifications, Probabilties

facade_types = Panel(naive_bayes_classification_tester.Classifications)
sort_duplicate_values = SortDuplicateValues(ValueList=naive_bayes_classification_tester.Classifications)  # -> UniqueValues, Indices
medium = ColourSwatch(SwatchColor=RGB(255, 204, 0))
high = ColourSwatch(SwatchColor=RGB(255, 123, 0))
low = ColourSwatch(SwatchColor=RGB(0, 106, 255))
list_item = ListItem(List=brep, Index=sort_duplicate_values.Indices, Wrap=True)
merge_6 = Merge(Data1=high, Data2=low, Data3=medium)
custom_preview = CustomPreview(Geometry=list_item, Shader=graft(merge_6))

format_2 = Format(Format="{0:P2}", Culture=1033, Data0=naive_bayes_classification_tester.Probabilties)
probabilities = Panel(format_2)
