# Grasshopper definition sample.gh (Grasshopper 1.0.7)
# plug-ins: LunchBox, treesloth01, LunchBoxML

path = FilePath("C:\Users\ykish\OneDrive\デスクトップ\Examples\Naive Bayes\PerformanceSelection.xlsx")

# ----
# ML Building Facade Evaluation
# Version:  2020.9.23
# Company Info: Authored by Proving Ground
# 
# http://ProvingGround.io
# Copyright (c) 2020 Proving Ground LLC
# Training Data
file_path = Panel("C:\Development\lunchboxml\Examples\Naive Bayes\PerformanceSelection.xlsx")
sheet_name = Panel("PerformanceSelection")
excelread = ExcelReader(ReadExcelData=Toggle(True), WorkbookPath=path, WorksheetName=sheet_name)  # -> Exceptions, ExcelData
split = SplitList(List=excelread.ExcelData, Index=1)  # -> flatten(ListA), ListB
bang = ExplodeTree(Data=split.ListB)  # -> Branch0, Branch1, Branch2, Branch3, Branch4
item = ListItem(List=split.ListA, Index=1, Wrap=True)
item_2 = ListItem(List=split.ListA, Index=2, Wrap=True)
item_3 = ListItem(List=split.ListA, Index=3, Wrap=True)
item_4 = ListItem(List=split.ListA, Index=4, Wrap=True)
program = Panel(bang.Branch3)
size = Panel(bang.Branch2)
orientation = Panel(bang.Branch1)
facade_type = Panel(bang.Branch4)

srf = Surface(<surface referenced from the Rhino model>)
popgeo = PopulateGeometry(Geometry=srf, Count=100, Seed=1)
create = CreateDataSet()
light_gbm = LightGBMRegression(NumberOfLeaves=20, NumberOfIterations=100, MinimumExampleCountPerLeaf=10, LearningRate=0.2)
column_label = GetColumnLabel(Data=create)
create_2 = CreateDataSet()
svm_trainer = KernelSVMTrainer(KernelType=1, KFolds=10)  # -> SupportVectorMachine, SupportVectors, ConfusionMatrix
fast_forest = FastForestRegression(NumberOfLeaves=20, NumberOfTrees=100, MinimumExampleCountPerLeaf=10)
hiddenmark = HiddenMarkovModel(Generations=3, RandomSeed=5, States=4)
encoding = OneHotEncoding(OutputKind=2)
svm_tester = KernelSVMTester()  # -> Classifications, Probabilties
regression_trainer = RegressionTrainer(TrainerType=light_gbm)
confusion_matrix = ConfusionMatrixProperties()  # -> Accuracy, Error, Precision, Recall, Variance, ChanceAgreement, GeometricAgreement, CohensKappaStatistic, ChiSquare
gam = GeneralizedAdditiveModelsRegression(NumberOfIterations=9500, MaximumBinCountPerFeature=255, LearningRate=0.002)
codify_data = CodifyData(DataType=1)
resboltz = RestrictedBoltzmannMachine(Momentum=0, LearningRate=0.1, Decay=0, Alpha=0.5, Iterations=5000, RandomSeed=5)

# ----
# Define Naive Bayes
# Inputs & Classifications
panel = Panel(item)
panel_2 = Panel(item_4)
panel_3 = Panel(item_2)
panel_4 = Panel(item_3)
codify_data_2 = CodifyData(Label=panel_3, Data=bang.Branch2, DataType=1)
codify_data_3 = CodifyData(Label=panel, Data=bang.Branch1, DataType=1)
codify_data_4 = CodifyData(Label=panel_2, Data=bang.Branch4, DataType=1)
codify_data_5 = CodifyData(Label=panel_4, Data=bang.Branch3, DataType=1)
merge = Merge(Data1=codify_data_3, Data2=codify_data_2, Data3=codify_data_5)  # -> flatten(Result)

# ----
# Note: You can right-click on the Naive Bayes Trainer component to save the classifier to a file. Then use the Load Saved Model to deserialize this model back into the scene without having to retrain the model every time.
path_2 = FilePath("C:\Projects\Lunchbox ML\Examples\NaiveBayes_FacadeType.bin")
file_path_2 = Panel(path_2)
load_model = LoadSavedModel(FilePath=path_2)

naive_bayes_classification_trainer = NaiveBayesClassificationTrainer(TrainingInputs=merge, TrainingClassifications=codify_data_4)

confusion_matrix_2 = ConfusionMatrixProperties()  # -> Accuracy, Error, Precision, Recall, Variance, ChanceAgreement, GeometricAgreement, CohensKappaStatistic, ChiSquare
format = Format(Format="{0:P2}", Culture=1033, Data0=confusion_matrix_2.Accuracy)
model_accuracy = Panel(format)

# ----
# Test Data
toggle = BooleanToggle(True)
panel_5 = Panel("""Office
Retail
Residential""")
layer_ref = LayerReference(ReferenceToggle=toggle, LayerName=panel_5)  # -> Geometry, Name, UserStrings, GUID, UserStringValues, GUID_2
lng = ListLength(List=layer_ref.Geometry)
dup = DuplicateData(Data=graft(panel_5), Number=lng, Order=True)  # -> flatten(Data)
brep = Brep(flatten(layer_ref.Geometry))
facen = FaceNormals(Mesh=brep)  # -> Centers, Normals
Y = UnitY(Factor=1)
facen_2 = FaceNormals(Mesh=brep)  # -> Centers, Normals
X = UnitX(Factor=1)
area = Area(Geometry=brep)  # -> Area, Centroid
python_script = PythonScript(x=flatten(area.Area))  # -> out, a; inputs x: list
# ---------- python_script: Python ----------
a=[]
for i in x:
    print i
    if i>12000:
        a.append("Large")
    elif 6000<=i<=12000:
        a.append("Medium")
    elif i<6000:
        a.append("Small")
# ---------- end python_script ----------
angle = Angle(VectorA=facen.Normals, VectorB=Y)  # -> Angle, Reflex
angle_2 = Angle(VectorA=facen_2.Normals, VectorB=X)  # -> Angle, Reflex
deg = Degrees(Radians=angle_2.Angle)
deg_2 = Degrees(Radians=angle.Angle)
first_last = FirstLast(List=deg)  # -> FirstValue, LastValue
first_last_2 = FirstLast(List=deg_2)  # -> FirstValue, LastValue
program_2 = Panel(dup)
size_2 = Panel(python_script.a)

item_5 = ListItem(List=deg, Index=0, Wrap=True)
item_6 = ListItem(List=deg_2, Index=0, Wrap=True)

python_script_2 = PythonScript(x=item_5, y=item_6)  # -> out, flatten(a)
# ---------- python_script_2: Python ----------
if 0<=x<22.5 and 67.5<y<112.5:
    a="East"
elif 22.5<=x<=67.5 and 22.5<=y<=67.5:
    a="North-East"
elif 22.5<=x<=67.5 and 112.5<=y<=157.5:
    a="South-East"
elif 67.5<x<112.5 and 0<=y<22.5:
    a="North"
elif 67.5<x<112.5 and 157.5<y<=180:
    a="South"
elif 112.5<=x<=157.5 and  22.5<=y<=67.5:
    a="North-West"
elif 112.5<=x<=157.5 and  112.5<=y<=157.5:
    a="South-West"
elif 157.5<x<=180 and 67.5<y<112.5:
    a="West"
# ---------- end python_script_2 ----------
orientation_2 = Panel(python_script_2.a)

# ----
# Define New Test
# Input Data
panel_6 = Panel(panel_4)
panel_7 = Panel(panel_3)
panel_8 = Panel(panel)
codify_data_6 = CodifyData(Label=panel_6, Data=flatten(dup), DataType=1)
codify_data_7 = CodifyData(Label=panel_7, Data=flatten(python_script.a), DataType=1)
codify_data_8 = CodifyData(Label=panel_8, Data=flatten(python_script_2.a), DataType=1)
merge_2 = Merge(Data1=codify_data_8, Data2=codify_data_7, Data3=codify_data_6)  # -> flatten(Result)

naive_bayes_classification_tester = NaiveBayesClassificationTester(NaiveBayesClassifier=naive_bayes_classification_trainer, TestInputData=merge_2)  # -> Classifications, Probabilties

facade_types = Panel(naive_bayes_classification_tester.Classifications)
sort_duplicate_values = SortDuplicateValues(ValueList=naive_bayes_classification_tester.Classifications)  # -> UniqueValues, Indices
medium = ColourSwatch(SwatchColor=RGB(255, 204, 0))
high = ColourSwatch(SwatchColor=RGB(255, 123, 0))
low = ColourSwatch(SwatchColor=RGB(0, 106, 255))
list_item = ListItem(List=brep, Index=sort_duplicate_values.Indices, Wrap=True)
merge_3 = Merge(Data1=high, Data2=low, Data3=medium)
custom_preview = CustomPreview(Geometry=list_item, Shader=graft(merge_3))

format_2 = Format(Format="{0:P2}", Culture=1033, Data0=naive_bayes_classification_tester.Probabilties)
probabilities = Panel(format_2)
