# Grasshopper definition RandomCurveDiv.gh (Grasshopper 1.0.8)

gallery = ImageGallery(CycleDelay=30, Randomize=False, UseLocalImages=True, UseRemoteImages=True)

crv = Curve(<curve referenced from the Rhino model>)
crv_2 = Curve(<curve referenced from the Rhino model>)

reb = RebuildCurve(Curve=crv, Count=10, Tangents=False)
divide = DivideCurve(Curve=crv_2, Count=Slider(83, range=0..100), Kinks=False)  # -> Points, Tangents, Parameters
crv_cp = CurveClosestPoint(Point=divide.Points, Curve=reparameterize(reb))  # -> Point, Parameter, Distance

# ----
# Color Format
# Input
data = Data(1)
# Method
data_2 = Data(1)
# Output
data_3 = Data(1)
# Display
data_4 = Data(1)
# Unuse
data_5 = Data(1)

item = ListItem(List=divide.Points, Index=0, Wrap=True)  # -> Item, Item1
dist = Distance(PointA=item.Item, PointB=item.Item1)
panel = Panel(dist)
crv_cp_2 = CurveClosestPoint(Point=crv_cp.Point, Curve=crv_2)  # -> Point, Parameter, Distance
crv_cp_3 = CurveClosestPoint(Point=crv_cp_2.Point, Curve=crv)  # -> Point, Parameter, Distance
sph = Sphere(Base=crv_cp_3.Point, Radius=1)

bnd = Bounds(Numbers=flatten(crv_cp.Distance))
dom = ConstructDomain(DomainStart=Slider(1.5, range=0..10), DomainEnd=Slider(5, range=0..10))
remap = RemapNumbers(Value=crv_cp.Distance, Source=bnd, Target=dom)  # -> Mapped, Clipped
ma = MassAddition(Input=remap.Mapped)  # -> Result, PartialResults
bnd_2 = Bounds(Numbers=flatten(ma.PartialResults))
remap_2 = RemapNumbers(Value=ma.PartialResults, Source=bnd_2, Target=Domain(0, 1))  # -> Mapped, Clipped

eval = EvaluateCurve(Curve=reparameterize(crv), Parameter=remap_2.Mapped)  # -> Point, Tangent, Angle
pl = ConstructPlane(Origin=eval.Point, XAxis=eval.Tangent, YAxis=Vector(0, 1, 0))

preview = CustomPreview(Geometry=eval.Point, Material=ColourSwatch(SwatchColor=RGB(255, 0, 0)))

pt = Point(eval.Point)
shift = ShiftList(List=pt, Shift=1, Wrap=True)
dist_2 = Distance(PointA=graft(pt), PointB=graft(shift))  # -> flatten(Distance)
lng = ListLength(List=dist_2)
cull_i = CullIndex(List=dist_2, Indices=expr("x-1", lng), Wrap=True)

lng_2 = ListLength(List=pl)
cull_i_2 = CullIndex(List=pl, Indices=expr("x-1", lng_2), Wrap=True)

multiplication = Multiplication(A=cull_i, B=Slider(0.5, range=0..1))
subtraction = Subtraction(A=multiplication, B=Slider(0.3, range=0..1))

box = CenterBox(Base=cull_i_2, X=subtraction, Y=subtraction, Z=subtraction)

division = Division(A=subtraction, B=2)
Z = UnitZ(Factor=division)
move = Move(Geometry=box, Motion=Z)  # -> Geometry, Transform

panel_2 = Panel(subtraction)

preview_2 = CustomPreview(Geometry=move.Geometry, Material=ColourSwatch(SwatchColor=RGBA(162, 255, 0, 88)))
