# Grasshopper definition Rhino8.gh (Grasshopper 1.0.8)
# plug-ins: RhinoCodePluginGH

gallery = ImageGallery(CycleDelay=30, Randomize=False, UseLocalImages=True, UseRemoteImages=True)
object = ModelObject(<model object referenced from the Rhino model>)
object_2 = ModelObject(<model object referenced from the Rhino model>)
block_instance = BlockInstance()
S = Script()  # -> out, a; unedited script template
contains = ContainsTextFilter(Case=True, Culture=127, ContainsTextMode=0)
attribute = ModelAttributeKey(AttributesSource=0, SelectedIndex=0)
block_definition = ModelBlockDefinition()
object_3 = ModelObject()
linetype = ModelLinetype()
display_mode = ModelDisplayMode()
viewport = ModelViewport()
layout = PageLayout()
import = ImportContent(Name="*", Layer="*", Linetype="*", HatchPattern="*", AnnotationStyles="*", Materials="*", BlockDefinitions="*")  # -> ModelTransform, Objects, Layers, Linetypes, HatchPatterns, AnnotationStyles, Materials, BlockDefinitions
layer = ModelLayer()
style = ModelAnnotationStyle()
print_width = ModelPrintWidth()
environment = ModelEnvironment()
material = ModelMaterial()
brep = Brep()
cache = ContentCache()
equals = EqualityFilter(Value=0)  # -> Equal, Unequal
filter = FilterContent()
annotation_style = AnnotationStyle()  # -> AnnotationStyle, Name, ModelScale, TextSettings, DimensionSettings, ArrowSettings, UnitsSettings, LeaderSettings, ToleranceSettings
l_hide = HideModelLayer()  # -> Layer, Model, NewDetail
as_arrows = AnnotationArrowSettings()  # -> ArrowSettings, Arrow1, Arrow2, ArrowSize, FitArrow, DimensionInline, LeaderArrow, LeaderArrowSize
annotation_dot = AnnotationDot()  # -> AnnotationDot, Location, PrimaryText, TextHeight
object_4 = ModelObject()  # -> Object, Geometry, Name, Layer, Visibility, Display, Drafting, Render
linetype_2 = ModelLinetype()  # -> ModelLinetype, Name, Segments, CapStyle, JoinStyle, Width, WidthUnits
aligned_dimension = AlignedDimension()  # -> AlignedDimension, PointA, PointB, Offset, Plane
object_5 = ModelObject(Object=object)  # -> Object, Geometry, Name, Layer, Visibility, Display, Drafting, Render
explode = ExplodeObject(Object=object_2, Recursive=False)
py3 = Python3Script()  # -> out, a; unedited script template
details = ContentDetails()  # -> Content, Id, Path, Attributes
group = GroupContent()  # -> Content, Values
directory = QueryDirectory()  # -> Directories, Files
c_script = CSharpScript()  # -> out, a
# ---------- c_script: C# ----------
// Grasshopper Script Instance
#region Usings
using System;
using System.Linq;
using System.Collections;
using System.Collections.Generic;
using System.Drawing;

using Rhino;
using Rhino.Geometry;

using Grasshopper;
using Grasshopper.Kernel;
using Grasshopper.Kernel.Data;
using Grasshopper.Kernel.Types;
#endregion

public class Script_Instance : GH_ScriptInstance
{
    #region Notes
    /* 
      Members:
        RhinoDoc RhinoDocument
        GH_Document GrasshopperDocument
        IGH_Component Component
        int Iteration

      Methods (Virtual & overridable):
        Print(string text)
        Print(string format, params object[] args)
        Reflect(object obj)
        Reflect(object obj, string method_name)
    */
    #endregion

    private void RunScript(object x, object y, ref object a)
    {
        // Write your logic here
        a = null;
    }
}
# ---------- end c_script ----------
greater = GreaterThanFilter(Value=0)  # -> GreaterThan, OrEqual
match = MatchTextFilter(Pattern="*", Case=True, Culture=127, MatchTextMode=1)
layer_2 = ModelLayer()  # -> Layer, Name, Hidden, Locked, DisplayColour, Material, Linetype
objects = QueryModelObjects(Locked=True, Hidden=True, AutoUpdateState=True)  # disabled
centermark = Centermark()  # -> Centermark, CenterPoint, Radius
linetypes = QueryModelLinetypes(AutoUpdateState=True)
arc_dimension = AngleDimensionArc()  # -> AngleDimension, Arc, Offset
panel = Panel(explode)
a_style = AnnotationStyleOverrides()  # -> Annotation, Style, ModelScale, TextSettings, DimensionSettings, ArrowSettings, UnitsSettings, LeaderSettings, ToleranceSettings
panel_2 = Panel(object_5.Display)
panel_3 = Panel(object_5.Drafting)
panel_4 = Panel(object_5.Render)
panel_5 = Panel(object_5.Object)
panel_6 = Panel(object_5.Geometry)
panel_7 = Panel(object_5.Name)
layer_3 = ModelLayer(object_5.Layer)
l_hide_2 = HideModelLayer(Layer=layer_3, Model=Toggle(False), NewDetail=Toggle(False))  # -> Layer, Model, NewDetail
panel_8 = Panel(object_5.Visibility)
as_leaders = AnnotationLeaderSettings()  # -> LeaderSettings, LeaderCurveType, HasLanding, LandingLength, ViewOriented, HorizontalTextAlignment, VerticalTextAlignment, LeaderTextOrientation
order = OrderContent()  # -> Content, Values
panel_9 = Panel(l_hide_2.Layer)
ipy2 = IronPython2Script()  # -> out, a
# ---------- ipy2: IronPython ----------
"""Grasshopper Script"""
a = "Hello IronPython 2 in Grasshopper!"
print(a)
# ---------- end ipy2 ----------
intersection = IntersectionFilter()
information = ContentInformation()  # -> Content, Parent, Name, Tags
layers = QueryModelLayers(AutoUpdateState=True)
leader = Leader()  # -> Leader, Curve, Text, Plane
panel_10 = Panel(layer_3)
display = DisplayAttributes()  # -> Display, DisplayColour, DisplayMode
colour_gradient = ColourGradient()  # -> Gradient, StartPoint, EndPoint, Repeat, Type, Colours
angle_dimension = AngleDimensionLines()  # -> AngleDimension, LineA, LineB, DimensionLocation
panel_11 = Panel(layers)
less = LessThanFilter(Value=0)  # -> LessThan, OrEqual
a_text = AnnotationTextOverrides()  # -> Annotation, Text, ViewOriented
c_units = ConvertUnits(Data=1, Source=1, Target=1)
linear_dimension = LinearDimension()  # -> LinearDimension, BaseLine, PointA, PointB
as_dimension = AnnotationDimensionSettings()  # -> DimensionSettings, ViewOriented, TextLocation, TextRotation, RadialViewOriented, RadialTextLocation, RadialTextRotation, DimensionLineExtension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
explode_2 = ExplodeObject(Recursive=False)
display_colour = DisplayColour()  # -> DisplayColour, Source, Colour
colour_stop = GradientColourStop()  # -> ColorStop, Colour, Position
and = LogicalAndFilter()
angle_dimension_from_points = AngleDimensionPoints()  # -> AngleDimension, Center, PointA, PointB, DimensionLocation
styles = QueryAnnotationStyles(AutoUpdateState=True)
c_duplicate = DuplicateContent()
ordinate_dimension = OrdinateDimension()  # -> OrdinateDimension, Plane, Direction, FeatureLocation, DimensionLocation, Offset1, Offset2
block_instance_2 = ModelBlockInstance()  # -> BlockInstance, Transform, BlockDefinition
drafting = DraftingAttributes()  # -> Drafting, Linetype, LinetypeScale

# ----
# Color Format
# Input
data = Data(1)
# Method
data_2 = Data(1)
# Output
data_3 = Data(1)
# Display
data_4 = Data(1)
# Unuse
data_5 = Data(1)

hatch = ModelHatch()  # -> Hatch, Boundary, HatchPattern, BasePoint, Rotation, Scale, ShowBoundary, Background, FillStyle
as_text = AnnotationTextSettings()  # -> TextSettings, Font, TextHeight, TextGap, MaskFrame, MaskColour, MaskMargins, ViewOriented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
not = LogicalNotFilter()
radial_dimension = RadialDimension()  # -> RadialDimension, DimensionType, CenterPoint, CurvePoint, DimensionLocation
evaluate = EvaluateTextFields()  # -> Text, Values
object_linetype = ObjectLinetype()  # -> Linetype, Source, ModelLinetype
export_definition = ExportModelBlockDefinition(Overwrite=False)  # -> BlockDefinition, FilePath, Exported
hatch_line = HatchLine()  # -> HatchLine, Start, Direction, Shift, Offset, Segments
or = LogicalOrFilter()
text_entity = TextEntity()  # -> TextEntity, Plane, Text
print_colour = PrintColour()  # -> PrintColour, Source, Colour
field_expression = TextFieldExpression()
as_tolerance = AnnotationToleranceSettings()  # -> ToleranceSettings, ToleranceFormat, ToleranceResolution, AltToleranceResolution, ToleranceUpperValue, ToleranceLowerValue, ToleranceHeightScale
i_hatch = ImportHatchPattern()
union = UnionFilter()
print_width_2 = PrintWidth()  # -> PrintWidth, Source, Width
import_definition = ImportModelBlockDefinition(UpdateType=0)
u_system = UnitSystem(UnitSystem=4)  # -> UnitSystem, Name, Meters
as_units = AnnotationUnitsSettings()  # -> UnitsSettings, LengthUnitsFormat, LengthFactor, LinearResolution, Roundoff, Prefix, Suffix, ZeroSuppression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
hatch_pattern = ModelHatchPattern()  # -> HatchPattern, Name, HatchLines
render = RenderAttributes()  # -> Render, ObjectMaterial, CastsShadows, ReceivesShadows
u_text = UserText(UserTextMode=1)  # -> Content, Keys, Values
block_definition_2 = ModelBlockDefinition()  # -> BlockDefinition, Objects, Name
font = ModelFont()  # -> Font, FontFamily, FontWeight, FontStyle
hatches = QueryModelHatchPatterns(AutoUpdateState=True)
object_material = RenderMaterial()  # -> ObjectMaterial, Source, Material
block_definition_3 = QueryModelBlockDefinitions(AutoUpdateState=True)
fonts = QueryInstalledFonts(FontWeight=4, FontStyle=1, FontStretch=5, Symbol=False)
ms_scale = ModelSpaceScale()  # -> LinetypeScale, HatchScale, HatchScaleEnabled
visibility = VisibilityAttributes()  # -> Visibility, Hidden, Locked
earth_location = ModelEarthLocation()  # -> Location, Name, Anchor, degrees(Latitude), degrees(Longitude), Elevation
model_location = QueryModelLocation(AutoUpdateState=True)
