# Grasshopper definition paper.gh (Grasshopper 1.0.8)
# plug-ins: Noise 4D

number_slider = Slider(10, range=0..10)
number_slider_2 = Slider(10, range=0..10)
point = Point(<point referenced from the Rhino model>)
negative = Negative(Value=number_slider)
negative_2 = Negative(Value=number_slider_2)
construct_domain = ConstructDomain(DomainStart=number_slider, DomainEnd=negative)
construct_domain_2 = ConstructDomain(DomainStart=number_slider_2, DomainEnd=negative_2)
number_slider_3 = Slider(1, range=0..1)
number_slider_4 = Slider(5, range=0..10)
rectangle = Rectangle(Plane=point, XSize=construct_domain, YSize=construct_domain_2, Radius=0)  # -> Rectangle, Length
negative_3 = Negative(Value=number_slider_4)
discontinuity = Discontinuity(Curve=rectangle.Rectangle, Level=1)  # -> Points, Parameters
construct_domain_3 = ConstructDomain(DomainStart=number_slider_4, DomainEnd=negative_3)
negative_4 = Negative(Value=Slider(1, range=0..1))
list_length = ListLength(List=discontinuity.Points)
random = Random(Range=construct_domain_3, Number=list_length, Seed=Slider(794, range=0..1000))
list_item = ListItem(Index=0, Wrap=True)
unit_z = UnitZ(Factor=random)
move = Move(Geometry=discontinuity.Points, Motion=unit_z)  # -> Geometry, Transform
unit_z_2 = UnitZ(Factor=negative_4)
area = Area(Geometry=rectangle.Rectangle)  # -> Area, Centroid
polyline = PolyLine(Vertices=move.Geometry, Closed=True)
move_2 = Move(Geometry=area.Centroid, Motion=unit_z_2)  # -> Geometry, Transform
patch = Patch(Curves=polyline, Points=move_2.Geometry, Spans=20, Flexibility=1, Trim=True)
untrim = Untrim(Surface=patch)
brep_edges = BrepEdges(Brep=untrim)  # -> Naked, Interior, NonManifold
extrude_point = ExtrudePoint(Base=polyline, Point=move_2.Geometry)
divide_curve = DivideCurve(Curve=brep_edges.Naked, Count=10, Kinks=False)  # -> Points, Tangents, Parameters
number_slider_5 = Slider(33, range=0..100)
divide_surface = DivideSurface(Surface=untrim, UCount=number_slider_5, VCount=number_slider_5)  # -> Points, Normals, Parameters
divide_surface_2 = DivideSurface(Surface=untrim, UCount=number_slider_5, VCount=number_slider_5)  # -> Points, Normals, Parameters
distance = Distance(PointA=point, PointB=divide_surface_2.Points)
evaluate_surface = EvaluateSurface(Surface=reparameterize(untrim), Point=divide_surface_2.Points)  # -> Point, Normal, UDirection, VDirection, Frame
construct_domain_4 = ConstructDomain(DomainStart=Slider(5.284, range=0..10), DomainEnd=Slider(0, range=0..1))
bounds = Bounds(Numbers=flatten(distance))
perlinnoise = PerlinNoise(Values=divide_surface_2.Points, Time=0, Scale=Slider(1, range=0..1))
remap_numbers = RemapNumbers(Value=distance, Source=bounds, Target=construct_domain_4)  # -> Mapped, Clipped
multiplication = Multiplication(A=perlinnoise, B=remap_numbers.Mapped)
unit_z_3 = UnitZ(Factor=multiplication)
move_3 = Move(Geometry=divide_surface_2.Points, Motion=unit_z_3)  # -> Geometry, Transform
number_slider_6 = Slider(2000, range=0..10000)
surface_from_points = SurfaceFromPoints(Points=flatten(move_3.Geometry), UCount=expr("x+1", number_slider_5), Interpolate=False)
populate_geometry = PopulateGeometry(Geometry=surface_from_points, Count=Slider(980, range=0..1000), Seed=1)
surface_closest_point = SurfaceClosestPoint(Point=populate_geometry, Surface=reparameterize(untrim))  # -> Point, UVPoint, Distance
list_length_2 = ListLength(List=populate_geometry)
image_sampler = ImageSampler(
    surface_closest_point.UVPoint,
    FilePath="C:\Users\U53511\Box\仮想万博の提案\Group5\R.jpg",
    Filter="Value",
    Interpolate=False,
    Umax=1,
    Umin=0,
    Vmax=1,
    Vmin=0,
    Wrap=1)
random_2 = Random(Range=Domain(0, 1), Number=list_length_2, Seed=2)
random_3 = Random(Range=image_sampler, Number=1, Seed=2)  # -> flatten(Random)
construct_domain_5 = ConstructDomain(DomainStart=Slider(1, range=0..1), DomainEnd=Slider(0.118, range=0..10))
remap_numbers_2 = RemapNumbers(Value=random_3, Source=Domain(0, 1), Target=construct_domain_5)  # -> Mapped, Clipped
smaller_than = SmallerThan(FirstNumber=random_2, SecondNumber=remap_numbers_2.Mapped)  # -> SmallerThan, OrEqualTo
cull_pattern = CullPattern(List=populate_geometry, CullPattern=flatten(smaller_than.SmallerThan))
merge = Merge(Data1=cull_pattern, Data2=divide_curve.Points)  # -> flatten(Result)
delaunay_mesh = DelaunayMesh(Points=merge, Plane=PlaneXY(0, 0, 0))
panel = Panel(remap_numbers_2.Mapped)
panel_2 = Panel(random_2)
face_boundaries = FaceBoundaries(Mesh=delaunay_mesh)
