# Grasshopper definition ツノ.gh (Grasshopper 1.0.8)
# plug-ins: Kangaroo2 Components

num = Number(Slider(0, range=0..20000))
num_2 = Number(Slider(100, range=0..100))
num_3 = Number(Slider(16130, range=0..20000))
planesrf = PlaneSurface(Plane=PlaneXY(0, 0, 0), XSize=num_3, YSize=num_3)
pop2d = Populate2D(Region=planesrf, Count=Slider(3, range=0..10), Seed=1)
pt = Point([<point referenced from the Rhino model> x3])
voronoi = Voronoi(Points=pt, Boundary=planesrf, BruteForceOverride=False)
explode = Explode(Curve=voronoi, Recursive=True)  # -> Segments, Vertices
len = Length(Curve=explode.Segments)
pcen = PolygonCenter(Polyline=voronoi)  # -> CenterV, CenterE, CenterA
division = Division(A=len, B=Slider(1247, range=0..10000))
merge = Merge(Data1=Slider(5123, range=0..100000), Data2=Slider(8855, range=0..100000), Data3=Slider(5803, range=0..100000))
divide = DivideCurve(Curve=explode.Segments, Count=division, Kinks=False)  # -> Points, Tangents, Parameters
pt_2 = Point(pt)
pshift = ShiftPaths(Data=divide.Points, Offset=-1)
Z = UnitZ(Factor=merge)
move = Move(Geometry=pt_2, Motion=Z)  # -> Geometry, Transform
ln = Line(StartPoint=graft(move.Geometry), EndPoint=simplify(pshift))
number_slider = Slider(30, range=0..1000)
dupln = RemoveDuplicateLines(Lines=ln, Tolerance=0.01)
Z_2 = UnitZ(Factor=Slider(7021, range=0..10000))
end = EndPoints(Curve=dupln)  # -> Start, End
midpt = CurveMiddle(Curve=dupln)
neg = Negative(Value=Z_2)
move_2 = Move(Geometry=midpt, Motion=neg)  # -> Geometry, Transform
merge_2 = Merge(Data1=graft(end.Start), Data2=graft(move_2.Geometry), Data3=graft(end.End))
intcrv = Interpolate(Vertices=merge_2, Degree=3, Periodic=False, KnotStyle=1)  # -> Curve, Length, Domain
pshift_2 = ShiftPaths(Data=simplify(intcrv.Curve), Offset=-1)
loft = Loft(Curves=pshift_2, Options={Adjust=False, Closed=True, LoftEnds=0, LoftSimp=0, LoftType=3, Rebuild=10, Refit=0.01})
contour = Contour(Shape=loft, Point=Point(0, 0, 0), Direction=Vector(0, 0, 1), Distance=Slider(926, range=0..10000))
