# Grasshopper definition Ripple.gh (Grasshopper 1.0.8)

number_slider = Slider(100, range=0..100)
srf = Surface(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)
pt = Point([Point(68.58472635, 35.82994359, 14.68409801), Point(109.9980261, 35.82994359, 0)])

gallery = ImageGallery(CycleDelay=30, Randomize=False, UseLocalImages=True, UseRemoteImages=True)

sdivide = DivideSurface(Surface=srf, UCount=number_slider, VCount=number_slider)  # -> Points, Normals, Parameters
pt_2 = Point(flatten(sdivide.Points))
vec = Vector(flatten(sdivide.Normals))

srf_cp = SurfaceClosestPoint(Point=pt, Surface=srf)  # -> Point, UVPoint, Distance

# ----
# Color Format
# Input
data = Data(1)
# Method
data_2 = Data(1)
# Output
data_3 = Data(1)
# Display
data_4 = Data(1)
# Unuse
data_5 = Data(1)

dist = Distance(PointA=pt_2, PointB=graft(srf_cp.Point))

bnd = Bounds(Numbers=flatten(dist))
remap = RemapNumbers(Value=dist, Source=bnd, Target=Domain(0, 1))  # -> Mapped, Clipped

pi = Pi(Factor=Slider(29, range=0..100))
pi_2 = Pi(Factor=Slider(6, range=0..10))
dom = ConstructDomain(DomainStart=pi, DomainEnd=pi_2)
remap_2 = RemapNumbers(Value=dist, Source=bnd, Target=dom)  # -> Mapped, Clipped

expression = Expression(x=remap.Mapped, y=Slider(0.8, range=0..1), t=remap_2.Mapped, A=Slider(3, range=0..10), Expression="Sin(x*t + y)*A")

flip = FlipMatrix(Data=expression)
ma = MassAddition(Input=flip)  # -> Result, PartialResults
flip_2 = FlipMatrix(Data=ma.Result)

amp = Amplitude(Vector=vec, Amplitude=flip_2)
move = Move(Geometry=pt_2, Motion=amp)  # -> Geometry, Transform

srfgrid = SurfaceFromPoints(Points=move.Geometry, UCount=expr("x+1", number_slider), Interpolate=False)
