# Grasshopper definition 3-2_AttractorOrient.gh (Grasshopper 1.0.8)
# plug-ins: Bifocals, LunchBox

gallery = ImageGallery(CycleDelay=30, Randomize=False, UseLocalImages=True, UseRemoteImages=True)
number_slider = Slider(100, range=0..100)

md_slider = MDSlider(
    SliderMode=0,
    slider_value=Point(0.07489243949, 0.3464850449, 0.5),
    x_domain=Domain(0, 1),
    y_domain=Domain(0, 1),
    z_domain=Domain(0, 1))

pt = Point(<point referenced from the Rhino model>)

number_slider_2 = Slider(100, range=0..100)
md_slider_2 = MDSlider(
    SliderMode=0,
    slider_value=Point(0.4048780116, 0.7682926829, 0.5),
    x_domain=Domain(0, 1),
    y_domain=Domain(0, 1),
    z_domain=Domain(0, 1))

crv = Curve(<curve referenced from the Rhino model>)

crv_2 = Curve([<curve referenced from the Rhino model> x2])

crv_3 = Curve([<curve referenced from the Rhino model> x3])

brep = Brep(<brep referenced from the Rhino model>)
pt_2 = Point(<point referenced from the Rhino model>)

cone = Cone(Base=PlaneXY(0, 0, 0), Radius=Slider(2, range=0..10), Length=1)  # -> Cone, Tip

rectangle = Rectangle(Plane=pt, XSize=number_slider_2, YSize=number_slider_2, Radius=0)  # -> Rectangle, Length
evalsrf = EvaluateSurface(Surface=reparameterize(rectangle.Rectangle), Point=md_slider_2)  # -> Point, Normal, UDirection, VDirection, Frame

rectangle_2 = Rectangle(Plane=PlaneXY(0, 0, 0), XSize=number_slider, YSize=number_slider, Radius=0)  # -> Rectangle, Length
evalsrf_2 = EvaluateSurface(Surface=reparameterize(rectangle_2.Rectangle), Point=md_slider)  # -> Point, Normal, UDirection, VDirection, Frame

loft = Loft(Curves=crv_2, Options={Adjust=True, Closed=False, LoftEnds=0, LoftSimp=0, LoftType=0, Rebuild=10, Refit=0.01})
rebuildsrf = RebuildSurface(Surface=loft, UDegree=3, VDegree=3, UNumber=10, VNumber=10)
sdivide = DivideSurface(Surface=reparameterize(rebuildsrf), UCount=Slider(15, range=5..15), VCount=Slider(15, range=5..15))  # -> Points, Normals, Parameters
evalsrf_3 = EvaluateSurface(Surface=reparameterize(rebuildsrf), Point=sdivide.Parameters)  # -> Point, Normal, UDirection, VDirection, Frame

loft_2 = Loft(Curves=crv_3, Options={Adjust=True, Closed=False, LoftEnds=0, LoftSimp=0, LoftType=0, Rebuild=10, Refit=0.01})
rebuildsrf_2 = RebuildSurface(Surface=loft_2, UDegree=3, VDegree=3, UNumber=10, VNumber=10)
sdivide_2 = DivideSurface(Surface=reparameterize(rebuildsrf_2), UCount=Slider(15, range=5..30), VCount=Slider(27, range=5..30))  # -> Points, Normals, Parameters
evalsrf_4 = EvaluateSurface(Surface=reparameterize(rebuildsrf_2), Point=sdivide_2.Parameters)  # -> Point, Normal, UDirection, VDirection, Frame

sdivide_3 = DivideSurface(Surface=rectangle_2.Rectangle, UCount=Slider(7, range=5..15), VCount=Slider(5, range=5..15))  # -> Points, Normals, Parameters
flatten = FlattenTree(Tree=sdivide_3.Points, Path="{0}")

sdivide_4 = DivideSurface(Surface=rectangle.Rectangle, UCount=Slider(15, range=5..15), VCount=Slider(15, range=5..15))  # -> Points, Normals, Parameters
flatten_2 = FlattenTree(Tree=sdivide_4.Points, Path="{0}")

# ----
# Color Format
# Input
data = Data(1)
# Method
data_2 = Data(1)
# Output
data_3 = Data(1)
# Display
data_4 = Data(1)
# Unuse
data_5 = Data(1)

number_slider_3 = Slider(7, range=0..10)

crv_4 = Curve(<curve referenced from the Rhino model>)

number_slider_4 = Slider(7, range=0..10)

crv_5 = Curve(<curve referenced from the Rhino model>)

pull = PullPoint(Point=evalsrf_3.Point, Geometry=crv_4, ClosestOnly=True)  # -> ClosestPoint, Distance
bnd = Bounds(Numbers=flatten(pull.Distance))
dom = ConstructDomain(DomainStart=Slider(0, range=0..10), DomainEnd=Slider(10, range=0..10))
remap = RemapNumbers(Value=pull.Distance, Source=bnd, Target=dom)  # -> Mapped, Clipped

dom_2 = ConstructDomain(DomainStart=Slider(0, range=0..10), DomainEnd=Slider(4, range=0..10))

pull_2 = PullPoint(Point=flatten_2, Geometry=crv, ClosestOnly=True)  # -> ClosestPoint, Distance
bnd_2 = Bounds(Numbers=pull_2.Distance)
remap_2 = RemapNumbers(Value=pull_2.Distance, Source=bnd_2, Target=dom_2)  # -> Mapped, Clipped

dom_3 = ConstructDomain(DomainStart=Slider(4, range=0..10), DomainEnd=Slider(10, range=0..10))

dist = Distance(PointA=flatten, PointB=evalsrf_2.Point)
bnd_3 = Bounds(Numbers=dist)
remap_3 = RemapNumbers(Value=dist, Source=bnd_3, Target=dom_3)  # -> Mapped, Clipped

panel = Panel(dist)

curvature = SurfaceCurvature(Surface=reparameterize(rebuildsrf_2), Point=sdivide_2.Parameters)  # -> Frame, Gaussian, Mean
bnd_4 = Bounds(Numbers=flatten(curvature.Mean))
remap_4 = RemapNumbers(Value=curvature.Mean, Source=bnd_4, Target=Domain(0, 1))  # -> Mapped, Clipped

pull_3 = PullPoint(Point=evalsrf_4.Point, Geometry=crv_5, ClosestOnly=True)  # -> ClosestPoint, Distance
bnd_5 = Bounds(Numbers=flatten(curvature.Mean))
dom_4 = ConstructDomain(DomainStart=Slider(0.5, range=0..1), DomainEnd=Slider(1.5, range=0..1.5))
remap_5 = RemapNumbers(Value=curvature.Mean, Source=bnd_5, Target=dom_4)  # -> Mapped, Clipped

orient = Orient(Geometry=cone.Cone, Source=PlaneXY(0, 0, 0), Target=evalsrf_4.Frame)  # -> Geometry, Transform

cir = Circle(Plane=flatten_2, Radius=remap_2.Mapped)

sph = Sphere(Base=flatten, Radius=remap_3.Mapped)

amp = Amplitude(Vector=evalsrf_3.Normal, Amplitude=remap.Mapped)
move = Move(Geometry=evalsrf_3.Point, Motion=amp)  # -> Geometry, Transform

scale = Scale(Geometry=orient.Geometry, Center=evalsrf_4.Frame, Factor=remap_5.Mapped)  # -> Geometry, Transform

multiplication = Multiplication(A=remap_5.Mapped, B=Slider(6, range=0..10))

pline = PolyLine(Vertices=sdivide.Points, Closed=False)
pline_2 = PolyLine(Vertices=move.Geometry, Closed=False)
merge = Merge(Data1=pline, Data2=pline_2)

scale_nu = ScaleNU(Geometry=orient.Geometry, Plane=evalsrf_4.Frame, ScaleX=remap_5.Mapped, ScaleY=remap_5.Mapped, ScaleZ=multiplication)  # -> Geometry, Transform

gradient = Gradient(
    LowerLimit=0,
    UpperLimit=1,
    Parameter=remap_4.Mapped,
    stops=[0: RGB(234, 38, 0), 0.25: RGB(234, 126, 0), 0.5: RGB(254, 244, 84), 0.75: RGB(173, 203, 249), 1: RGB(75, 107, 169)])
preview = CustomPreview(Geometry=scale_nu.Geometry, Material=gradient)

loft_3 = Loft(Curves=merge, Options={Adjust=False, Closed=False, LoftEnds=0, LoftSimp=0, LoftType=0, Rebuild=10, Refit=0.01})
Z = UnitZ(Factor=1)
extr = Extrude(Base=loft_3, Direction=Z)

preview_2 = CustomPreview(Geometry=extr, Material=ColourSwatch(SwatchColor=RGB(156, 118, 42)))
