# Grasshopper definition BOXArray_Points.gh (Grasshopper 1.0.8)

gallery = ImageGallery(CycleDelay=30, Randomize=False, UseLocalImages=True, UseRemoteImages=True)

number_slider = Slider(3, range=0..10)

pt = Point([<point referenced from the Rhino model> x2])

series = Series(Start=0, Step=number_slider, Count=Slider(14, range=0..100))
series_2 = Series(Start=0, Step=number_slider, Count=Slider(17, range=0..100))
pt_2 = ConstructPoint(XCoordinate=series_2, YCoordinate=graft(series), ZCoordinate=0)
points = PointList(Points=pt_2, Size=Slider(2, range=0..10))

# ----
# Color Format
# Input
data = Data(1)
# Method
data_2 = Data(1)
# Output
data_3 = Data(1)
# Display
data_4 = Data(1)
# Unuse
data_5 = Data(1)

pull = PullPoint(Point=pt_2, Geometry=pt, ClosestOnly=True)  # -> ClosestPoint, Distance
bnd = Bounds(Numbers=flatten(pull.Distance))
dom = ConstructDomain(DomainStart=Slider(0.1, range=0..0.1), DomainEnd=Slider(1, range=0..10))
remap = RemapNumbers(Value=pull.Distance, Source=bnd, Target=dom)  # -> Mapped, Clipped

box = CenterBox(Base=simplify(pt_2), X=simplify(remap.Mapped), Y=simplify(remap.Mapped), Z=simplify(remap.Mapped))

volume = Volume(Geometry=box)  # -> Volume, Centroid
bnd_2 = Bounds(Numbers=flatten(volume.Volume))
dedomain = DeconstructDomain(Domain=bnd_2)  # -> Start, End
gradient = Gradient(
    LowerLimit=dedomain.Start,
    UpperLimit=dedomain.End,
    Parameter=volume.Volume,
    stops=[0: RGB(234, 38, 0), 0.25: RGB(234, 126, 0), 0.5: RGB(254, 244, 84), 0.75: RGB(173, 203, 249), 1: RGB(75, 107, 169)])
preview = CustomPreview(Geometry=box, Material=gradient)

display_colour = DisplayColour(Colour=gradient)  # -> DisplayColour, Source, Colour
object_material = RenderMaterial(Material=gradient)  # -> ObjectMaterial, Source, Material
display = DisplayAttributes(DisplayColour=display_colour.DisplayColour)  # -> Display, DisplayColour, DisplayMode
render = RenderAttributes(ObjectMaterial=object_material.ObjectMaterial)  # -> Render, ObjectMaterial, CastsShadows, ReceivesShadows
object = ModelObject(Geometry=box, Display=display.Display, Render=render.Render)  # -> Object, Geometry, Name, Layer, Visibility, Display, Drafting, Render
