# Grasshopper definition BrepOnSurface_PerlinHeight_MultipleAttaractors.gh (Grasshopper 1.0.8)
# plug-ins: LunchBox

gallery = ImageGallery(CycleDelay=30, Randomize=False, UseLocalImages=True, UseRemoteImages=True)

number_slider = Slider(10, range=0..10)
random = Random(Range=Slider(4, range=0..10), Number=number_slider, Seed=2)
pop2d = Populate2D(Region={Plane=PlaneXY(0, 0, 0), Size=Domain2(u=0..20, v=0..10)}, Count=number_slider, Seed=1)
Z = UnitZ(Factor=random)
move = Move(Geometry=pop2d, Motion=Z)  # -> Geometry, Transform

# ----
# Color Format
# Input
data = Data(1)
# Method
data_2 = Data(1)
# Output
data_3 = Data(1)
# Display
data_4 = Data(1)
# Unuse
data_5 = Data(1)

patch = Patch(Points=move.Geometry, Spans=20, Flexibility=1, Trim=True)
rebuildsrf = RebuildSurface(Surface=patch, UDegree=3, VDegree=3, UNumber=10, VNumber=10)
dim = Dimensions(Surface=rebuildsrf)  # -> UDimension, VDimension

division = Division(A=dim.UDimension, B=Slider(2, range=0..10))
division_2 = Division(A=dim.VDimension, B=Slider(2, range=0..10))
int = Integer(division)
int_2 = Integer(division_2)
range = Range(Domain=Domain(0, 1), Steps=int)
range_2 = Range(Domain=Domain(0, 1), Steps=int_2)
pt = ConstructPoint(XCoordinate=range, YCoordinate=graft(range_2), ZCoordinate=0)

crv = Curve(<curve referenced from the Rhino model>)
pt_2 = Point([<point referenced from the Rhino model> x2])

evalsrf = EvaluateSurface(Surface=reparameterize(rebuildsrf), Point=pt)  # -> Point, Normal, UDirection, VDirection, Frame

pull = PullPoint(Point=evalsrf.Point, Geometry=[pt_2, crv], ClosestOnly=True)  # -> ClosestPoint, Distance
panel = Panel(pull.Distance)

bnd = Bounds(Numbers=flatten(pull.Distance))
dom = ConstructDomain(DomainStart=Slider(0.3, range=0..10), DomainEnd=Slider(1.1, range=0..10))
remap = RemapNumbers(Value=pull.Distance, Source=bnd, Target=dom)  # -> Mapped, Clipped
multiplication = Multiplication(A=remap.Mapped, B=Slider(3, range=0..10))

cone = Cone(Base=evalsrf.Frame, Radius=remap.Mapped, Length=multiplication)  # -> Cone, Tip

preview = CustomPreview(Geometry=cone.Cone, Material=ColourSwatch(SwatchColor=RGB(229, 83, 255)))
