# Grasshopper definition Louver_Curve.gh (Grasshopper 1.0.8)

gallery = ImageGallery(CycleDelay=30, Randomize=False, UseLocalImages=True, UseRemoteImages=True)

srf = Surface(<surface referenced from the Rhino model>)

crv = Curve(<curve referenced from the Rhino model>)

# ----
# Color Format
# Input
data = Data(1)
# Method
data_2 = Data(1)
# Output
data_3 = Data(1)
# Display
data_4 = Data(1)
# Unuse
data_5 = Data(1)

dom = ConstructDomain(DomainStart=Slider(1, range=0..10), DomainEnd=Slider(0, range=0..0.1))

sdivide = DivideSurface(Surface=srf, UCount=Slider(19, range=0..100), VCount=Slider(9, range=0..10))  # -> Points, Normals, Parameters
line = LineSDL(Start=sdivide.Points, Direction=sdivide.Normals, Length=Slider(4, range=0..10))
evalsrf = EvaluateSurface(Surface=srf, Point=sdivide.Parameters)  # -> Point, Normal, UDirection, VDirection, Frame
deplane = DeconstructPlane(Plane=evalsrf.Frame)  # -> Origin, XAxis, YAxis, ZAxis
pl = ConstructPlane(Origin=deplane.Origin, XAxis=deplane.YAxis, YAxis=deplane.ZAxis)

pull = PullPoint(Point=sdivide.Points, Geometry=crv, ClosestOnly=True)  # -> ClosestPoint, Distance
bnd = Bounds(Numbers=flatten(pull.Distance))
remap = RemapNumbers(Value=pull.Distance, Source=bnd, Target=dom)  # -> Mapped, Clipped

rotate = Rotate(Geometry=line, Angle=remap.Mapped, Plane=pl)  # -> Geometry, Transform

flip = FlipMatrix(Data=rotate.Geometry)
loft = Loft(Curves=flip, Options={Adjust=False, Closed=False, LoftEnds=0, LoftSimp=0, LoftType=0, Rebuild=10, Refit=0.01})

preview = CustomPreview(Geometry=loft, Material=ColourSwatch(SwatchColor=RGB(161, 36, 255)))
