# Grasshopper definition 20240823_Waffle_Structure.gh (Grasshopper 1.0.8)

gallery = ImageGallery(CycleDelay=30, Randomize=False, UseLocalImages=True, UseRemoteImages=True)
# Base Geometry
number_slider = Slider(180, range=0..1000)
hight = Slider(80, range=0..1000)
center_point_ratio = Slider(0.4, range=0..1)
plate_height = Slider(20, range=0..100)
scale_factor = Slider(0.88, range=0..1)
divide_count = Slider(20, range=0..100)
plate_width = Slider(2.7, range=0..10)
slot_width = Slider(2.65, range=0..10)

rectangle = Rectangle(Plane=PlaneXY(0, 0, 0), XSize=number_slider, YSize=number_slider, Radius=0)  # -> Rectangle, Length
edges = BrepEdges(Brep=rectangle.Rectangle)  # -> Naked, Interior, NonManifold
crv = Curve(edges.Naked)
midpt = CurveMiddle(Curve=crv)
Z = UnitZ(Factor=hight)
end = EndPoints(Curve=crv)  # -> Start, End
move = Move(Geometry=midpt, Motion=Z)  # -> Geometry, Transform

# ----
# Base Geometry
rectangle_2 = Curve(rectangle.Rectangle)

area = Area(Geometry=rectangle_2)  # -> Area, Centroid
scale = Scale(Geometry=rectangle_2, Center=area.Centroid, Factor=scale_factor)  # -> Geometry, Transform

multiplication = Multiplication(A=hight, B=center_point_ratio)
area_2 = Area(Geometry=rectangle.Rectangle)  # -> Area, Centroid
Z_2 = UnitZ(Factor=multiplication)
move_2 = Move(Geometry=area_2.Centroid, Motion=Z_2)  # -> Geometry, Transform

number_slider_2 = Slider(12, range=0..100)
drec = DeconstuctRectangle(Rectangle=scale.Geometry)  # -> BasePlane, XInterval, YInterval

# ----
# Color Format
# Input
data = Data(1)
# Method
data_2 = Data(1)
# Output
data_3 = Data(1)
# Display
data_4 = Data(1)
# Unuse
data_5 = Data(1)

pt = Point(drec.BasePlane)
range = Range(Domain=drec.XInterval, Steps=number_slider_2)
X = UnitX(Factor=range)
move_3 = Move(Geometry=pt, Motion=X)  # -> Geometry, Transform
yz = YZPlane(Origin=move_3.Geometry)

range_2 = Range(Domain=drec.YInterval, Steps=number_slider_2)
Y = UnitY(Factor=range_2)
move_4 = Move(Geometry=pt, Motion=Y)  # -> Geometry, Transform
xz = XZPlane(Origin=move_4.Geometry)

split = SplitList(List=move.Geometry, Index=Slider(2, range=0..10))  # -> ListA, ListB
merge = Merge(Data1=graft(split.ListA), Data2=graft(split.ListB))

merge_2 = Merge(Data1=graft(end.Start), Data2=graft(move.Geometry), Data3=graft(end.End))
intcrv = Interpolate(Vertices=merge_2, Degree=3, Periodic=False, KnotStyle=1)  # -> Curve, Length, Domain

ins = InsertItems(List=merge, Item=move_2.Geometry, Indices=Slider(1, range=0..1), Wrap=True)

intcrv_2 = Interpolate(Vertices=ins, Degree=3, Periodic=False, KnotStyle=1)  # -> Curve, Length, Domain
merge_3 = Merge(Data1=intcrv.Curve, Data2=intcrv_2.Curve)  # -> flatten(Result)

patch = Patch(Curves=merge_3, Spans=20, Flexibility=1, Trim=True)

merge_4 = Merge(Data1=yz, Data2=xz)
srf = Surface(patch)
sec = BrepPlane(Brep=srf, Plane=merge_4)  # -> Curves, Points
Z_3 = UnitZ(Factor=divide_count)
extr = Extrude(Base=sec.Curves, Direction=Z_3)

multiplication_2 = Multiplication(A=plate_height, B=0.5)
basecrv = Curve(flatten(sec.Curves))
lng = ListLength(List=yz)
Z_4 = UnitZ(Factor=multiplication_2)
extr_2 = Extrude(Base=basecrv, Direction=Z_4)
split_2 = SplitList(List=extr_2, Index=lng)  # -> ListA, ListB

baseboundary = Curve(flatten(extr))
lng_2 = ListLength(List=yz)
split_3 = SplitList(List=baseboundary, Index=lng_2)  # -> ListA, ListB

srf_2 = Surface(split_2.ListB)
move_5 = Move(Geometry=srf_2, Motion=Z_4)  # -> Geometry, Transform

crv_2 = Curve(split_3.ListA)
crv_3 = Curve(split_3.ListB)
srf_3 = Surface(split_2.ListA)
srf_4 = Surface(move_5.Geometry)

bbx = BrepBrep(BrepA=graft(crv_2), BrepB=srf_4)  # -> Curves, Points
number_slider_3 = Slider(2, range=0..10)
pln = Plane(yz)
cluster = Cluster(C=bbx.Curves, A_2=crv_2, F=number_slider_3, P=pln, G=Toggle(False), A=slot_width)
crv_4 = Curve(cluster)

bbx_2 = BrepBrep(BrepA=graft(crv_3), BrepB=srf_3)  # -> Curves, Points
cluster_2 = Cluster(C=bbx_2.Curves, A_2=crv_3, F=number_slider_3, P=xz, G=Toggle(True), A=slot_width)
crv_5 = Curve(cluster_2)

deplane = DeconstructPlane(Plane=merge_4)  # -> Origin, XAxis, YAxis, ZAxis
neg = Negative(Value=plate_width)
multiplication_3 = Multiplication(A=neg, B=Slider(0.5, range=0..1))
amp = Amplitude(Vector=graft(deplane.ZAxis), Amplitude=multiplication_3)
amp_2 = Amplitude(Vector=graft(deplane.ZAxis), Amplitude=plate_width)

series = Series(Start=1, Step=1, Count=lng_2)
series_2 = Series(Start=1, Step=1, Count=lng)
concat = Concatenate(FragmentA="X", FragmentB=series)
concat_2 = Concatenate(FragmentA="Y", FragmentB=series_2)
merge_5 = Merge(Data1=concat, Data2=concat_2)  # -> graft(Result)

merge_6 = Merge(Data1=flatten(crv_4), Data2=flatten(crv_5))

pt_2 = Point(Point(6.216533602, -172.5460848, 0))
pln_2 = Plane(merge_4)
crv_6 = Curve(merge_6)

orient = Orient(Geometry=crv_6, Source=pln_2, Target=pt_2)  # -> Geometry, Transform
bbox = BoundingBox(Content=orient.Geometry, Plane=PlaneXY(0, 0, 0))  # -> Box, Box_2
area_3 = Area(Geometry=bbox.Box)  # -> Area, Centroid
drec_2 = DeconstuctRectangle(Rectangle=bbox.Box)  # -> BasePlane, XInterval, YInterval

dedomain = DeconstructDomain(Domain=drec_2.YInterval)  # -> Start, End
subtraction = Subtraction(A=dedomain.End, B=dedomain.Start)
merge_7 = Merge(Data1=flatten(Slider(0, range=0..100)), Data2=flatten(subtraction))
addition = Addition(A=graft(subtraction), B=graft(merge_7))
multiplication_4 = Multiplication(A=addition, B=Slider(0.5, range=0..1))
flatten = FlattenTree(Tree=multiplication_4, Path="{0}")
ma = MassAddition(Input=flatten)  # -> Result, PartialResults
neg_2 = Negative(Value=ma.PartialResults)

Y_2 = UnitY(Factor=neg_2)
move_6 = Move(Geometry=pt_2, Motion=Y_2)  # -> Geometry, Transform
orient_2 = Orient(Geometry=orient.Geometry, Source=area_3.Centroid, Target=move_6.Geometry)  # -> Geometry, Transform
crv_7 = Curve(orient_2.Geometry)

edges_2 = BrepEdges(Brep=crv_7)  # -> Naked, Interior, NonManifold
item = ListItem(List=edges_2.Naked, Index=0, Wrap=True)
midpt_2 = CurveMiddle(Curve=item)

move_7 = Move(Geometry=extr, Motion=amp)  # -> Geometry, Transform
extr_3 = Extrude(Base=move_7.Geometry, Direction=amp_2)

preview = CustomPreview(Geometry=patch, Material=ColourSwatch(SwatchColor=RGB(101, 80, 255)))

as_text = AnnotationTextSettings(TextHeight=Slider(3, range=0..10), HorizontalAlignment=Slider(2, range=0..10))  # -> TextSettings, Font, TextHeight, TextGap, MaskFrame, MaskColour, MaskMargins, ViewOriented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
text_entity = TextEntity(Plane=midpt_2, Text=merge_5, TextSettings=as_text.TextSettings)  # -> TextEntity, Plane, Text
merge_8 = Merge(Data1=graft(crv_7), Data2=text_entity.TextEntity)
group = Group(Objects=merge_8)

preview_2 = CustomPreview(Geometry=extr_3, Material=ColourSwatch(SwatchColor=RGB(75, 201, 16)))

# ==== cluster Cluster
C = ClusterInput()
end = EndPoints(Curve=C)  # -> Start, End
merge = Merge(Data1=end.Start, Data2=end.End)
pdecon = Deconstruct(Point=merge)  # -> XComponent, YComponent, ZComponent
F = ClusterInput()
sort = SortList(Keys=pdecon.ZComponent, ValuesA=merge)  # -> Keys, ValuesA
G = ClusterInput()
pt = Point(reverse(sort.ValuesA))
Z = UnitZ(Factor=F)
pt_2 = Point(sort.ValuesA)
neg = Negative(Value=Z)
filter = StreamFilter(Gate=G, Stream0=pt_2, Stream1=pt)
item = ListItem(List=filter, Index=0, Wrap=True)  # -> Item, Item1
filter_2 = StreamFilter(Gate=G, Stream0=Z, Stream1=neg)
A = ClusterInput()
P = ClusterInput()
move = Move(Geometry=item.Item1, Motion=filter_2)  # -> Geometry, Transform
multiplication = Multiplication(A=A, B=Slider(0.5, range=0..1))
deplane = DeconstructPlane(Plane=P)  # -> Origin, XAxis, YAxis, ZAxis
neg_2 = Negative(Value=multiplication)
merge_2 = Merge(Data1=multiplication, Data2=neg_2)
amp = Amplitude(Vector=graft(deplane.XAxis), Amplitude=merge_2)
move_2 = Move(Geometry=move.Geometry, Motion=amp)  # -> Geometry, Transform
item_2 = ListItem(List=move_2.Geometry, Index=0, Wrap=True)  # -> Item, Item1
rec_3pt = Rectangle3Pt(PointA=item_2.Item, PointB=item_2.Item1, PointC=item.Item)  # -> Rectangle, Length
pshift = ShiftPaths(Data=rec_3pt.Rectangle, Offset=-1)  # -> simplify(Data)
A_2 = ClusterInput()
rdiff = RegionDifference(CurvesA=A_2, CurvesB=pshift)
R = ClusterOutput(rdiff)
